# Grasshopper definition Barkbeetle - for headstock testing.gh (Grasshopper 1.0.7)
# Copyright: Creative commons BY-SA
# Copyright: Creative Commons BY-SA
# Copyright: none

# ---- group: Tricks
use_inside_cutting = ValueList({"No": 0, "Yes": 1}, selected="No")
# Developed by Jens Dyvik and Siemen Cuypers
# 
# License: Creative Commons Attribution ShareAllike (cc-by-sa)
make_finish_pass = ValueList({"No": 0, "Yes": 1}, selected="No")
make_dogbones = ValueList({"No": 0, "Yes": 1}, selected="No")

# ---- group: Milling bit
number_of_flutes = ValueList({"1", "2", "3", "4"}, selected="1")
bit_diameter = ValueList({"1mm": 1, "2mm": 2, "3mm": 3, "3.175mm": 3.175, "4mm": 4, "6mm": 6, "8mm": 8, "10mm": 10, "12mm": 12}, selected="6mm")
bit_type = ValueList({"Up-cut": 0, "Down-cut": 1, "Compression": 4, "Ball nose": 2, "V-bit": 3}, selected="Up-cut")

# ---- group: Material
material_thickness = Slider(20, range=0..100)
# Main settings
material = ValueList({"Foam / wax": 0, "Wood": 1, "Hard wood": 2, "Plastic": 3, "Aluminium": 4, "Bronze": 5, "Soft steel": 6, "Hard steel": 7}, selected="Wood")

# ---- group: Depths
engrave_depth = Slider(0, range=0..40)
pocket_depth = Slider(8, range=0..40)
drill_depth = Slider(12.6, range=0..40)
cut_depth = Slider(12.5, range=0..40)

# ----
include_start_code = BooleanToggle(True)

# ---- group: Override
# Values above 1 makes passes deeper. good for strong and stiff machines
# 
# Values bellow 1 makes passes shallower, so more passes are reuired to cut through. Good for weak machines
# Adjusts how fast the machine moves during cuts (it is best to adjust pass depth, and leave feedrates to default).
pass_depth_factor = Slider(0.3, range=0.2..4)
feed_rate_factor = Slider(1.2, range=0.2..2)

# ---- group: Check if ball nose is current bit
bit_type_id = Panel(bit_type)
ball_nose_id = Panel("2")
equals = Equality(FirstNumber=bit_type_id, SecondNumber=ball_nose_id)  # -> Equality, Inequality
ball_nose_is_current_bit = Panel(equals.Equality)

# ---- group: Make fastest directoin when ballnose milling
prioritize_fastest_direction = BooleanToggle(False)
prioritize_fastest_direction_2 = BooleanToggle(True)
filter = StreamFilter(Gate=ball_nose_is_current_bit, Stream0=prioritize_fastest_direction, Stream1=prioritize_fastest_direction_2)

# ---- group: Make vertical milling direction when end mill cutting
make_horizontal_finsihing = BooleanToggle(False)
make_horizontal_finishing = BooleanToggle(True)
filter_2 = StreamFilter(Gate=ball_nose_is_current_bit, Stream0=make_horizontal_finsihing, Stream1=make_horizontal_finishing)

# ----
engrave_depth_from_easy_interface = Panel(engrave_depth)
drill_depth_from_easy_interface = Panel(drill_depth)
cut_depth_from_easy_interface = Panel(cut_depth)
pocket_depth_from_easy_interface = Panel(pocket_depth)
# POST PROCESSOR SETTINGS
custom_start_g_code = Panel("""$H					;run GRBL homing cycle
G92 X-24.5 Y-2.5 Z0    ;set the difference between homing location and where we want X and X home postion to be
G0 X-24.5 Z-85		;quickly jog to a good postion to start probing. X is important, Z negative is just to save some time
G38.2 F200 Z-300	;start probing downwards
G92 Z0				;make probe surface Z zero
G0 Z1				;move up 1 mm
G38.2 F50 Z-100		;probe again with extra slow speed for maximum precision
G92 Z0				;make probe surface Z zero again
G0 Z16.2				;move to the height of the bed
G92 Z0				;make bed height Z zero""")
make_dogbones_from_easy_interface = Panel(make_dogbones)
use_inside_cutting_from_easy_interface = Panel(use_inside_cutting)

# ---- group: Check if we should use climb milling (metals and plastic)
material_type_from_easy_interface = Panel(material)
larger = LargerThan(FirstNumber=material_type_from_easy_interface, SecondNumber="2")  # -> LargerThan, OrEqualTo

# ----
custom_start_g_code_2 = CustomStartGCode(custom_start_code=custom_start_g_code, material_thicness=material_thickness)

use_ballnose_for_3d_finishing = BooleanToggle(False)
use_auto_settings = BooleanToggle(True)
filter_3 = StreamFilter(Gate=use_auto_settings, Stream0=use_ballnose_for_3d_finishing, Stream1=ball_nose_is_current_bit)
use_ballnose_for_3d_milling = Panel(filter_3)

number_slider = Slider(0.5, range=0..1)

use_ballnose_for_3d_roughing = BooleanToggle(False)
use_auto_settings_2 = BooleanToggle(True)
filter_4 = StreamFilter(Gate=use_auto_settings_2, Stream0=use_ballnose_for_3d_roughing, Stream1=ball_nose_is_current_bit)
use_ballnose_for_3d_roughing_2 = Panel(filter_4)

make_horizontal_finishing_2 = BooleanToggle(False)
use_auto_settings_3 = BooleanToggle(True)
filter_5 = StreamFilter(Gate=use_auto_settings_3, Stream0=make_horizontal_finishing_2, Stream1=filter_2)
make_horizontal_finishing_3 = Panel(filter_5)

prioritize_fastest_direction_3 = BooleanToggle(False)
use_auto_settings_4 = BooleanToggle(False)
filter_6 = StreamFilter(Gate=use_auto_settings_4, Stream0=prioritize_fastest_direction_3, Stream1=filter)
prioritize_fastest_direction_4 = Panel(filter_6)

dogbone_corner_angle_threshold = Slider(121, range=0..1000)
dogbone_corner_angle_threshold_2 = Panel(dogbone_corner_angle_threshold)

deviation_tolerance = Slider(0.01, range=0.01..0.1)

use_climb_direction = BooleanToggle(False)
use_auto_settings_5 = BooleanToggle(True)
filter_7 = StreamFilter(Gate=use_auto_settings_5, Stream0=use_climb_direction, Stream1=larger.LargerThan)
use_climb_direction_2 = Panel(filter_7)

roughing_material_leftover = Slider(0.5, range=0..1)
roughing_material_leftover_2 = Panel(roughing_material_leftover)

use_trochoidal_peck_entry = BooleanToggle(False)

roughing_stepover = Slider(0.6, range=0.05..0.9)
roughing_stepover_2 = Panel(roughing_stepover)

# ----
# Advanced 2D settings:
pocket_raster_direction_along_y = BooleanToggle(False)
raster_direction_along_y = Panel(pocket_raster_direction_along_y)

finishing_stepover = Slider(0.06, range=0.05..0.9)
finishing_stepover_2 = Panel(finishing_stepover)

cutout_tolerance = Slider(0, range=-0.5..0.5)
cutout_tolerance_2 = Panel(cutout_tolerance)

use_high_speed_maching = ValueList({"No": 0, "Trochoidal": 1, "Plunge": 2}, selected="No")

pocket_stepover = Slider(0.8, range=0..1)
pocket_stepover_2 = Panel(pocket_stepover)

make_safety_pass_from_cutout = BooleanToggle(False)
make_safety_pass_from_cutout_2 = Panel(make_safety_pass_from_cutout)

make_horizontal_roughing = BooleanToggle(True)
make_horizontal_roughing_2 = Panel(make_horizontal_roughing)

prioritize_fastest_direction_5 = BooleanToggle(False)
prioritize_fastest_direction_6 = Panel(prioritize_fastest_direction_5)

include_surface_edges = BooleanToggle(True)
include_surface_edges_2 = Panel(include_surface_edges)

include_surface_edges_3 = BooleanToggle(False)
include_surface_edges_4 = Panel(include_surface_edges_3)

generate_roughing = BooleanToggle(False)
# Roughing:
generate_3d_roughing = Panel(generate_roughing)

# ---- group: Startpoint & Sorting
# 3D SETTINGS
startpoint_cutout = ValueList({"Original CurveSeam": 0, "Bottom Left": 1, "Top Left": 2, "Bottom Right": 3, "Top Right": 4}, selected="Bottom Left")
autosort_cutout = ValueList({"Off": 0, "Shortest Distance": 1, "Left to Right": 2, "Right to Left": 3, "Bottom to Top": 4, "Top to Bottom": 5}, selected="Shortest Distance")
autosort_drill = BooleanToggle(True)

# ----
generate_finishing = BooleanToggle(True)
generate_3d_finishing = Panel(generate_finishing)

generate_cutout = BooleanToggle(False)
# AUTOMILL:
generate_cutout_2 = Panel(generate_cutout)

# ----
# fix - slice objects true triggers camera to be set to 1:1 location
generate_pockets = BooleanToggle(True)
generate_pockets_2 = Panel(generate_pockets)

z_zero_is_at_bottom_of_stock = BooleanToggle(True)

# ---- group: CNC mill input geometery
pipeline = GeometryPipeline(
    GroupByLayer=False,
    GroupByType=False,
    IncludeHidden=True,
    IncludeLocked=True,
    LayerFilter="CNC engrave",
    NameFilter="*",
    SublayerFiltering=False,
    TypeFilter=4)
cnc_pocket_curves = Curve()
cnc_cutout_curves = Curve()
breps_for_3d_mill = Brep()
pipeline_2 = GeometryPipeline(
    GroupByLayer=False,
    GroupByType=False,
    IncludeHidden=True,
    IncludeLocked=True,
    LayerFilter="CNC 3D",
    NameFilter="*",
    SublayerFiltering=False,
    TypeFilter=32)
pipeline_3 = GeometryPipeline(
    GroupByLayer=False,
    GroupByType=False,
    IncludeHidden=True,
    IncludeLocked=True,
    LayerFilter="CNC 3D",
    NameFilter="*",
    SublayerFiltering=False,
    TypeFilter=1073741848)
pipeline_4 = GeometryPipeline(
    GroupByLayer=False,
    GroupByType=False,
    IncludeHidden=True,
    IncludeLocked=True,
    LayerFilter="CNC drill",
    NameFilter="*",
    SublayerFiltering=False,
    TypeFilter=4)
pipeline_5 = GeometryPipeline(
    GroupByLayer=False,
    GroupByType=False,
    IncludeHidden=True,
    IncludeLocked=True,
    LayerFilter="CNC pocket",
    NameFilter="*",
    SublayerFiltering=False,
    TypeFilter=4)
pipeline_6 = GeometryPipeline(
    GroupByLayer=False,
    GroupByType=False,
    IncludeHidden=True,
    IncludeLocked=True,
    LayerFilter="CNC cut",
    NameFilter="*",
    SublayerFiltering=False,
    TypeFilter=4)
tab_breps = Brep(<brep referenced from the Rhino model>)
meshes_for_3d_mill = Mesh()
pipeline_7 = GeometryPipeline(
    GroupByLayer=False,
    GroupByType=False,
    IncludeHidden=True,
    IncludeLocked=True,
    LayerFilter="CNC tabs",
    NameFilter="*",
    SublayerFiltering=False,
    TypeFilter=1073741848)
# Developed by Jens Dyvik / Fellesverkstedet
# 
# License: Creative Commons Attribution ShareAllike (cc-by-sa)
# GEOMETRY INPUT
# Add rhino geometry in the corresponding layers, or right click  to set geometry
cnc_drill_curves = Curve()
cnc_engrave_curves = Curve(<curve referenced from the Rhino model>)

# ----
# Finishing:
skip_collision_detection = BooleanToggle(True)
finsih_pass_offset_ratio_bit_diamter = Panel("0.03")
trochoidal_toolpath_width_factor = Panel("2.01")
use_peck_entry = Panel(use_trochoidal_peck_entry)
tolerance = Panel("0.01")
overshoot_margin_mm = Panel("0.5")
overshoot_margin_mm_2 = Panel("0.05")
tolerance_2 = Panel("0.01")
automill = Automill(breps_to_mill=[pipeline_3, breps_for_3d_mill])  # -> pocket_curves_5, pocket_depths_4, cutout_curves_3, cutout_depths_2, _3d_mill_surfaces_2, collision_detect_mesh_2
filter_8 = StreamFilter(Gate=generate_cutout_2, Stream1=automill.cutout_depths_2)
filter_9 = StreamFilter(Gate=generate_cutout_2, Stream1=automill.cutout_curves_3)

item = ListItem(List=automill.pocket_curves_5, Index=0, Wrap=True)
null = NullItem(Item=item)  # -> NullFlags, InvalidFlags, Description
filter_10 = StreamFilter(Gate=null.NullFlags, Stream0=automill.pocket_curves_5, Stream1=[pipeline_5, cnc_pocket_curves])

pocket_depths_from_automill = Number(automill.pocket_depths_4)
item_2 = ListItem(List=pocket_depths_from_automill, Index=0, Wrap=True)
null_2 = NullItem(Item=item_2)  # -> NullFlags, InvalidFlags, Description
filter_11 = StreamFilter(Gate=null_2.NullFlags, Stream0=pocket_depths_from_automill, Stream1=pocket_depth_from_easy_interface)

# ---- group: Make machine wireframe preview
neg = Negative(Value=material_thickness)
machine_preview_curves = Curve()
Z = UnitZ(Factor=neg)
move = Move(Geometry=flatten(machine_preview_curves), Motion=Z)  # -> Geometry, Transform
preview = CustomPreview(Geometry=move.Geometry, Shader=ColourSwatch(SwatchColor=RGB(125, 125, 125)))

# ----
# 2D SETTINGS
milling_bit_diameter = Slider(6.9, range=0..10)
use_auto_settings_6 = BooleanToggle(True)

pass_depth = Slider(11, range=0.4..20)
use_auto_settings_7 = BooleanToggle(True)

plunge_rate = Slider(20, range=6..80)
use_auto_settings_8 = BooleanToggle(True)

feed_rate = Slider(6, range=6..200)
use_auto_settings_9 = BooleanToggle(True)

ramp_angle = Slider(0.8, range=0.2..101)
use_auto_settings_10 = BooleanToggle(True)

connect_toolpaths_levels = BooleanToggle(True)
use_auto_settings_11 = BooleanToggle(True)

connect_toolpaths_levels_2 = BooleanToggle(True)
use_auto_settings_12 = BooleanToggle(True)

use_auto_settings_13 = BooleanToggle(False)
ramp_plunges = BooleanToggle(False)

# ---- group: ShopBot PostProcessor settings
make_shopbot_code_not_g_code = BooleanToggle(True)
custom_start_g_code_3 = Panel(custom_start_g_code_2)
custom_start_sbp_code = Panel("C6")
custom_end_g_code = Panel("M5")
custom_end_sbp_code = Panel("""END
Canceljob:	'define the name of the sub routine
	MSGBOX (Please specificy the correct material thickness in you CAM program and try again,16,Shame on you)	'define the message box of shame
END	'end the job""")
use_trochoidal_milling = Panel(use_high_speed_maching)
safe_z_height = Panel("10")
jog_rate_xy_mm_s = Panel("120")
jog_rate_z_mm_s = Panel("60")
worka_area_size_x = Panel("2440")
worka_area_size_y = Panel("1220")
end_of_job_go_to_x_position = Panel("600")
end_of_job_go_to_y_position = Panel("600")
deviation_tolerance_2 = Panel(deviation_tolerance)
spindle_speed = Panel("18000")
job_name = Panel("Bark beetle stream")
toolpath_streaming_folder = FilePath("C:\Users\Jens\Dropbox (Personal)\jens (1)\BarkBeetle stream - Jenses laptop\")
include_end_code = BooleanToggle(True)
use_spindle = BooleanToggle(True)
stream_contents = BooleanToggle(True)

# ----
settings_generator = FeedRateLibraryExperimemtal(
    material_id=material,
    bit_diameter=bit_diameter,
    bit_type_id=bit_type,
    number_of_flutes=number_of_flutes,
    spindle_rpm=spindle_speed,
    use_high_speed_maching=use_high_speed_maching,
    toolpath_width_factor=trochoidal_toolpath_width_factor,
    pass_depth_factor=pass_depth_factor,
    feed_rate_factor=feed_rate_factor)  # -> feed_rate_4, plunge_rate_4, pass_depth_4, ramp_plunges_4, ramp_angle_4, trochoidal_stepover_2, toolpath_width_2, actual_bit_diameter_3
bit_diameter_from_easy_interface = Panel(settings_generator.toolpath_width_2)
feed_rate_from_easy_interface = Panel(settings_generator.feed_rate_4)
plunge_rate_from_easy_interface = Panel(settings_generator.plunge_rate_4)
pass_depth_from_easy_interface = Panel(settings_generator.pass_depth_4)
ramp_plunges_from_easy_interface = Panel(settings_generator.ramp_plunges_4)
ramp_angle_from_easy_interface = Panel(settings_generator.ramp_angle_4)

filter_12 = StreamFilter(Gate=use_auto_settings_13, Stream0=ramp_plunges, Stream1=ramp_plunges_from_easy_interface)
ramp_plunges_2 = Panel(filter_12)

ramp_plunges_3 = Panel(ramp_plunges_2)
ramp_plunges_4 = Panel(ramp_plunges_2)
not = GateNot(A=ramp_plunges_3)
not_2 = GateNot(A=ramp_plunges_4)

filter_13 = StreamFilter(Gate=use_auto_settings_10, Stream0=ramp_angle, Stream1=ramp_angle_from_easy_interface)
ramp_angle_2 = Panel(filter_13)

filter_14 = StreamFilter(Gate=use_auto_settings_11, Stream0=connect_toolpaths_levels, Stream1=not)
connect_toolpaths_levels_3 = Panel(filter_14)

filter_15 = StreamFilter(Gate=use_auto_settings_12, Stream0=connect_toolpaths_levels_2, Stream1=not_2)
connect_toolpaths_levels_4 = Panel(filter_15)

filter_16 = StreamFilter(Gate=use_auto_settings_7, Stream0=pass_depth, Stream1=pass_depth_from_easy_interface)
pass_depth_2 = Panel(filter_16)

filter_17 = StreamFilter(Gate=use_auto_settings_9, Stream0=number_slider, Stream1=feed_rate_from_easy_interface)
feed_rate_mm_s = Panel(filter_17)

filter_18 = StreamFilter(Gate=use_auto_settings_8, Stream0=number_slider, Stream1=plunge_rate_from_easy_interface)
plunge_rate_mm_s = Panel(filter_18)

filter_19 = StreamFilter(Gate=use_auto_settings_6, Stream0=milling_bit_diameter, Stream1=bit_diameter_from_easy_interface)
# Main
milling_bit_diameter_2 = Panel(filter_19)

# ---- group: ShopBot PostProcessor settings (continued)
trochoidal_stepover = Panel(settings_generator.trochoidal_stepover_2)
actual_milling_bit_diamter = Panel(settings_generator.actual_bit_diameter_3)

# ----
filter_20 = StreamFilter(Gate=make_shopbot_code_not_g_code, Stream0=custom_start_g_code_3, Stream1=custom_start_sbp_code)
filter_21 = StreamFilter(Gate=make_shopbot_code_not_g_code, Stream0=custom_end_g_code, Stream1=custom_end_sbp_code)

# ---- group: Adjust safe Z height according to Z zero position
addition = Addition(SafeZHeight=safe_z_height, MaterialThickness=material_thickness)
filter_22 = StreamFilter(ZZeroIsAtBottomOfStock=z_zero_is_at_bottom_of_stock, Stream0=safe_z_height, Stream1=addition)
safe_z_height_witch_z_zero_at_material_b = Panel(filter_22)  # "Safe Z height witch Z zero at material bottom"

# ----
custom_start_sbp_code_2 = CustomStartSBPCode(material_thicness=material_thickness, safe_z_height=safe_z_height_witch_z_zero_at_material_b)
filter_23 = StreamFilter(Gate=include_start_code, Stream1=filter_20)
filter_24 = StreamFilter(Gate=include_end_code, Stream1=filter_21)
horizontal_3d_mill_from_mesh_ex = Horizontal3DMillFromMeshExperimental(
    meshes_for_3d_mill=[pipeline_2, meshes_for_3d_mill],
    milling_bit_diameter=milling_bit_diameter_2,
    roughing_stepover=roughing_stepover_2,
    finishing_stepover=finishing_stepover_2,
    pass_depth_roughing=pass_depth_2,
    roughing_material_leftover=roughing_material_leftover_2,
    generate_3d_roughing=generate_3d_roughing,
    generate_3d_finishing=generate_3d_finishing)  # -> rouging_toolpaths_5, finishing_toolpaths_6, cutout_curves_4, cutout_depths_3
filter_25 = StreamFilter(Gate=generate_cutout_2, Stream1=horizontal_3d_mill_from_mesh_ex.cutout_curves_4)
filter_26 = StreamFilter(Gate=generate_cutout_2, Stream1=horizontal_3d_mill_from_mesh_ex.cutout_depths_3)

# ---- group: Make finishing from automill
finishing_stepover_3 = Panel(finishing_stepover_2)
generate_3d_finishing_2 = Panel(generate_3d_finishing)
filter_27 = StreamFilter(Gate=generate_3d_finishing_2, Stream1=automill.collision_detect_mesh_2)
filter_28 = StreamFilter(Gate=generate_3d_finishing_2, Stream1=automill._3d_mill_surfaces_2)
surface_3d_mill = Surface3DMill(
    surfaces_for_3d_mill=filter_28,
    collision_mesh=filter_27,
    milling_bit_diameter=milling_bit_diameter_2,
    stepover=finishing_stepover_3,
    overshoot_margin_mm=overshoot_margin_mm_2,
    make_horizontal_toolpaths=make_horizontal_finishing_3,
    prioritize_fastest_milling_direction=prioritize_fastest_direction_4,
    include_surface_edges=include_surface_edges_4,
    use_ballnose_for_3d_milling=use_ballnose_for_3d_milling,
    connect_toolpaths_levels=connect_toolpaths_levels_3,
    tolerance=tolerance_2,
    skip_collision_detection=skip_collision_detection)
surface_3d_finishing_toolpaths = Curve(surface_3d_mill)

# ---- group: Make roughing from automill
generate_3d_roughing_2 = Panel(generate_3d_roughing)
roughing_material_leftover_3 = Panel(roughing_material_leftover_2)
roughing_stepover_3 = Panel(roughing_stepover_2)
multiplication = Multiplication(A=roughing_material_leftover_3, B="2")
filter_29 = StreamFilter(Gate=generate_3d_roughing_2, Stream1=filter_9)
filter_30 = StreamFilter(Gate=generate_3d_roughing_2, Stream1=automill.collision_detect_mesh_2)
filter_31 = StreamFilter(Gate=generate_3d_roughing_2, Stream1=automill._3d_mill_surfaces_2)
addition_2 = Addition(A=milling_bit_diameter_2, B=multiplication)
addition_3 = Addition(A=overshoot_margin_mm, B=roughing_material_leftover_3)
surface_3d_mill_2 = Surface3DMill(
    surfaces_for_3d_mill=filter_31,
    collision_mesh=filter_30,
    milling_bit_diameter=addition_2,
    stepover=roughing_stepover_2,
    overshoot_margin_mm=addition_3,
    make_horizontal_toolpaths=make_horizontal_roughing_2,
    prioritize_fastest_milling_direction=prioritize_fastest_direction_6,
    include_surface_edges=include_surface_edges_2,
    use_ballnose_for_3d_milling=use_ballnose_for_3d_roughing_2,
    connect_toolpaths_levels=connect_toolpaths_levels_4,
    tolerance=tolerance,
    skip_collision_detection=skip_collision_detection)
roughing_material_leftover_4 = Number(roughing_material_leftover_2)
_3d_roughing_toolpaths = Curve(surface_3d_mill_2)
pass_depth_3 = Number(pass_depth_2)
make_pass_depths = MakePassDepths(
    toolpaths=_3d_roughing_toolpaths,
    pass_depth=pass_depth_3,
    roughing_material_leftover=roughing_material_leftover_4,
    outline_curves=filter_29,
    milling_bit_diameter=milling_bit_diameter_2,
    make_safety_pass_from_cutout=make_safety_pass_from_cutout_2)
surface_3d_roughing_toolpaths = Curve(make_pass_depths)

# ----
autosort_cutout_2 = AutoSortCutout(int=autosort_cutout, crv=[pipeline, cnc_engrave_curves])
cnc_line_engrave_curves = Curve(reparameterize(flatten(autosort_cutout_2)))
engrave = Engrave(engrave_curves=cnc_line_engrave_curves, cut_depth=engrave_depth_from_easy_interface, pass_depth=pass_depth_2)

surface_3d_roughing_toolpaths_2 = Curve(surface_3d_roughing_toolpaths)
rouging_toolpaths_3d_mesh = Curve(horizontal_3d_mill_from_mesh_ex.rouging_toolpaths_5)
surface_3d_finishing_toolpaths_2 = Curve(surface_3d_finishing_toolpaths)
finishing_toolpaths_3d_mesh = Curve(horizontal_3d_mill_from_mesh_ex.finishing_toolpaths_6)
merge = Merge(Data1=flatten(surface_3d_roughing_toolpaths_2), Data2=flatten(rouging_toolpaths_3d_mesh))
merge_2 = Merge(Data1=flatten(surface_3d_finishing_toolpaths_2), Data2=flatten(finishing_toolpaths_3d_mesh))
filter_32 = StreamFilter(Gate=make_shopbot_code_not_g_code, Stream0="NC", Stream1="sbp")

# ---- group: Make work area, stock and Z level preview
worka_area_size_y_2 = Panel(worka_area_size_y)
worka_area_size_x_2 = Panel(worka_area_size_x)
Z_2 = UnitZ(MaterialThickness=material_thickness)
dom = ConstructDomain(DomainStart="0", DomainEnd=worka_area_size_x_2)
dom_2 = ConstructDomain(DomainStart="0", DomainEnd=worka_area_size_y_2)
neg_2 = Negative(MaterialThickness=material_thickness)
rectangle = Rectangle(Plane=PlaneXY(0, 0, 0), XSize=dom, YSize=dom_2, Radius=0)  # -> Rectangle, Length
rev = Reverse(Vector=Z_2)
filter_33 = StreamFilter(ZZeroIsAtBottomOfStock=z_zero_is_at_bottom_of_stock, Stream0=0, Stream1=material_thickness)
machine_work_area = Curve(rectangle.Rectangle)
filter_34 = StreamFilter(ZZeroIsAtBottomOfStock=z_zero_is_at_bottom_of_stock, Stream0=neg_2, Stream1=0)
move_2 = Move(Geometry=machine_work_area, Motion=rev)  # -> Geometry, Transform
cp = ControlPoints(Curve=move_2.Geometry)  # -> Points, Weights, Knots
cp_2 = ControlPoints(Curve=machine_work_area)  # -> Points, Weights, Knots
ln = Line(StartPoint=cp_2.Points, EndPoint=cp.Points)
join = TextJoin(Text=[".Z", filter_34])
join_2 = TextJoin(Text=[".Z", filter_33])
item_3 = ListItem(List=cp_2.Points, Index=0, Wrap=True)
item_4 = ListItem(List=cp.Points, Index=0, Wrap=True)
swatch = ColourSwatch(SwatchColor=RGB(161, 247, 255))
xz = XZPlane(Origin=item_4)
xz_2 = XZPlane(Origin=item_3)
tag = TextTag3D(Location=xz_2, Text=join_2, Size=3, Colour=swatch, Justification=7)
tag_2 = TextTag3D(Location=xz, Text=join, Size=3, Colour=swatch, Justification=7)
preview_2 = CustomPreview(Geometry=machine_work_area, Shader=swatch)
preview_3 = CustomPreview(Geometry=[ln, move_2.Geometry], Shader=ColourSwatch(SwatchColor=RGB(141, 217, 224)))

# ----
finsih_pass_offset_ratio_bit_diamter_2 = Panel(finsih_pass_offset_ratio_bit_diamter)
milling_bit_diameter_3 = Panel(milling_bit_diameter_2)
make_finsih_pass = Panel(make_finish_pass)
cutout_curves_from_3d_mesh = Curve(flatten(filter_25))
cutout_curves_from_automill = Curve(flatten(filter_9))
cutout_depths_from_automill = Number(filter_8)
cutout_depths_from_3d_mesh = Number(filter_26)
merge_3 = Merge(Data1=flatten(cutout_curves_from_automill), Data2=flatten(cutout_curves_from_3d_mesh))
multiplication_2 = Multiplication(A=milling_bit_diameter_3, B=finsih_pass_offset_ratio_bit_diamter_2)
merge_4 = Merge(Data1=flatten(cutout_depths_from_automill), Data2=flatten(cutout_depths_from_3d_mesh))
addition_4 = Addition(A=milling_bit_diameter_3, B=multiplication_2)
filter_35 = StreamFilter(Gate=make_finsih_pass, Stream0=milling_bit_diameter_3, Stream1=addition_4)
cut_depths_from_automill_and_3d_mesh = Number(merge_4)
tab_breps_2 = Brep(flatten([pipeline_7, tab_breps]))
use_inside_cutting_from_easy_interface_2 = Panel(use_inside_cutting)
make_dogbones_2 = Panel(make_dogbones_from_easy_interface)
corner_angle_threshold = Panel(dogbone_corner_angle_threshold_2)
milling_bit_diameter_4 = Panel(milling_bit_diameter_3)
filter_36 = StreamFilter(Gate=use_inside_cutting_from_easy_interface_2, Stream0=Toggle(False), Stream1=Toggle(True))
milling_bit_diameter_before_finish = Panel(filter_35)

item_5 = ListItem(List=merge_3, Index=0, Wrap=True)
null_3 = NullItem(Item=item_5)  # -> NullFlags, InvalidFlags, Description
filter_37 = StreamFilter(Gate=null_3.NullFlags, Stream0=merge_3, Stream1=[pipeline_6, cnc_cutout_curves])

cut_depths_from_automill_and_3d_mesh_2 = Number(cut_depths_from_automill_and_3d_mesh)
item_6 = ListItem(List=cut_depths_from_automill_and_3d_mesh_2, Index=0, Wrap=True)
null_4 = NullItem(Item=item_6)  # -> NullFlags, InvalidFlags, Description
filter_38 = StreamFilter(Gate=null_4.NullFlags, Stream0=cut_depths_from_automill_and_3d_mesh_2, Stream1=cut_depth_from_easy_interface)

cnc_milling_postprocessor = CNCMillingPostProcessor(
    toolpath_curves=merge_2,
    tab_breps=tab_breps_2,
    feed_rate=feed_rate_mm_s,
    plunge_rate=plunge_rate_mm_s,
    jog_rate=jog_rate_xy_mm_s,
    jog_rate_z=jog_rate_z_mm_s,
    safe_z_height=safe_z_height_witch_z_zero_at_material_b,
    use_spindle=use_spindle,
    spindle_speed=spindle_speed,
    ramp_plunges=ramp_plunges_2,
    ramp_angle=ramp_angle_2,
    start_code=filter_23,
    end_code=filter_24,
    make_shopbot_code_not_g_code=make_shopbot_code_not_g_code,
    end_of_job_go_to_x=end_of_job_go_to_x_position,
    end_of_job_go_to_y=end_of_job_go_to_y_position,
    deviation_tolerance=deviation_tolerance_2,
    use_high_speed_machining=use_trochoidal_milling,
    milling_bit_diameter=actual_milling_bit_diamter,
    toolpath_width_factor=trochoidal_toolpath_width_factor,
    stepover=trochoidal_stepover,
    use_peck_entry=use_peck_entry,
    z_zero_is_at_bottom_of_stock=z_zero_is_at_bottom_of_stock,
    material_thickness=material_thickness,
    job_name=job_name)  # -> g_code_stream, g_code_for_tab_cleanup, toolpath_preview_curves_2, tab_cleanup_preview_curves_2, cut_transition_preview_lines_2, cut_entry_preview_lines_2, cut_exit_preview_lines_2
cnc_milling_postprocessor_2 = CNCMillingPostProcessor_2(
    toolpath_curves=merge,
    tab_breps=tab_breps_2,
    feed_rate=feed_rate_mm_s,
    plunge_rate=plunge_rate_mm_s,
    jog_rate=jog_rate_xy_mm_s,
    jog_rate_z=jog_rate_z_mm_s,
    safe_z_height=safe_z_height_witch_z_zero_at_material_b,
    use_spindle=use_spindle,
    spindle_speed=spindle_speed,
    ramp_plunges=ramp_plunges_2,
    ramp_angle=ramp_angle_2,
    start_code=filter_23,
    end_code=filter_24,
    make_shopbot_code_not_g_code=make_shopbot_code_not_g_code,
    end_of_job_go_to_x=end_of_job_go_to_x_position,
    end_of_job_go_to_y=end_of_job_go_to_y_position,
    deviation_tolerance=deviation_tolerance_2,
    use_high_speed_machining=use_trochoidal_milling,
    milling_bit_diameter=actual_milling_bit_diamter,
    toolpath_width_factor=trochoidal_toolpath_width_factor,
    stepover=trochoidal_stepover,
    use_peck_entry=use_peck_entry,
    z_zero_is_at_bottom_of_stock=z_zero_is_at_bottom_of_stock,
    material_thickness=material_thickness,
    job_name=job_name)  # -> g_code_stream, g_code_for_tab_cleanup, toolpath_preview_curves_2, tab_cleanup_preview_curves_2, cut_transition_preview_lines_2, cut_entry_preview_lines_2, cut_exit_preview_lines_2
cnc_milling_postprocessor_3 = CNCMillingPostProcessor_2(
    toolpath_curves=engrave,
    tab_breps=tab_breps_2,
    feed_rate=feed_rate_mm_s,
    plunge_rate=plunge_rate_mm_s,
    jog_rate=jog_rate_xy_mm_s,
    jog_rate_z=jog_rate_z_mm_s,
    safe_z_height=safe_z_height_witch_z_zero_at_material_b,
    use_spindle=use_spindle,
    spindle_speed=spindle_speed,
    ramp_plunges=ramp_plunges_2,
    ramp_angle=ramp_angle_2,
    start_code=filter_23,
    end_code=filter_24,
    make_shopbot_code_not_g_code=make_shopbot_code_not_g_code,
    end_of_job_go_to_x=end_of_job_go_to_x_position,
    end_of_job_go_to_y=end_of_job_go_to_y_position,
    deviation_tolerance=deviation_tolerance_2,
    use_high_speed_machining=use_trochoidal_milling,
    milling_bit_diameter=actual_milling_bit_diamter,
    toolpath_width_factor=trochoidal_toolpath_width_factor,
    stepover=trochoidal_stepover,
    use_peck_entry=use_peck_entry,
    z_zero_is_at_bottom_of_stock=z_zero_is_at_bottom_of_stock,
    material_thickness=material_thickness,
    job_name=job_name)  # -> g_code_stream, g_code_for_tab_cleanup, toolpath_preview_curves_2, tab_cleanup_preview_curves_2, cut_transition_preview_lines_2, cut_entry_preview_lines_2, cut_exit_preview_lines_2

# ---- group: Engrave G-code
stream_and_save_as_code = Panel(cnc_milling_postprocessor_3.g_code_stream)

# ---- group: 3D roughing G-code
stream_and_save_as_code_2 = Panel(cnc_milling_postprocessor_2.g_code_stream)

# ---- group: 3D finishing G-code
stream_and_save_as_code_3 = Panel(cnc_milling_postprocessor.g_code_stream)

# ----
stream_code = FileCreator(
    name="3 Engrave - Bark beetle",
    ext=filter_32,
    lines=stream_and_save_as_code,
    write=stream_contents,
    path=toolpath_streaming_folder)  # inputs lines: list, write: Boolean
#   port name: Desired file name.
# ---------- stream_code: Python ----------
#Tweaked by Siemen Cuypers / 2019

ghenv.Component.Name = "File Creator"

import rhinoscriptsyntax as rs
import Grasshopper as gh

# Set varible to desired folder path
def Export(ext):
    
    dir = path
    txt = name + "." + ext
    
    if dir:
        file=str(dir)+ '\\' + txt
    filePath = open(file, "w") # Open the file
    for line in lines: # Iterate through lines
        filePath.write(line + "\n") # Write separate lines
    filePath.close() # Close the file

if write:
    if path:
        Export(ext)
    else:
        msg = "Set directory path for streaming"
        ghenv.Component.AddRuntimeMessage(gh.Kernel.GH_RuntimeMessageLevel.Warning, msg)
else:
    msg = "Set 'write' to True for streaming"
    ghenv.Component.AddRuntimeMessage(gh.Kernel.GH_RuntimeMessageLevel.Warning, msg)
# ---------- end stream_code ----------
stream_code_2 = FileCreator(
    name="7 3D Finishing - Bark beetle",
    ext=filter_32,
    lines=stream_and_save_as_code_3,
    write=stream_contents,
    path=toolpath_streaming_folder)  # inputs lines: list, write: Boolean; same code as stream_code
stream_code_3 = FileCreator(
    name="6 3D Roughing - Bark beetle",
    ext=filter_32,
    lines=stream_and_save_as_code_2,
    write=stream_contents,
    path=toolpath_streaming_folder)  # inputs lines: list, write: Boolean; same code as stream_code

milling_bit_diameter_5 = Panel(milling_bit_diameter_2)
make_finsih_pass_2 = Panel(make_finish_pass)
finsih_pass_offset_ratio_bit_diamter_3 = Panel(finsih_pass_offset_ratio_bit_diamter)
multiplication_3 = Multiplication(A=milling_bit_diameter_5, B=finsih_pass_offset_ratio_bit_diamter_3)
addition_5 = Addition(A=milling_bit_diameter_5, B=multiplication_3)
cnc_pocket_curves_2 = Curve(reparameterize(flatten(filter_10)))
filter_39 = StreamFilter(Gate=make_finsih_pass_2, Stream0=milling_bit_diameter_5, Stream1=addition_5)
milling_bit_diameter_before_finish_2 = Panel(filter_39)

# ---- group: Add dogbones to pockets
make_dogbones_3 = Panel(make_dogbones_from_easy_interface)
corner_angle_threshold_2 = Panel(dogbone_corner_angle_threshold_2)
gate = StreamGate(Stream=cnc_pocket_curves_2, Gate=make_dogbones_3)  # -> Target0, Target1
dogbone_maker = DogboneMaker(
    curves_to_dogbone=gate.Target1,
    milling_bit_diameter=milling_bit_diameter_5,
    corner_angle_threshold=corner_angle_threshold_2,
    flip_cornes_boolean=Toggle(True))
filter_40 = StreamFilter(Gate=make_dogbones_3, Stream0=gate.Target0, Stream1=dogbone_maker)

# ----
pocket = Pocket(
    curves_for_raster_pocket=filter_40,
    cut_depth_pocket=filter_11,
    pass_depth=pass_depth_2,
    tool_diameter=milling_bit_diameter_before_finish_2,
    stepover_0_1=pocket_stepover_2,
    raster_along_y_0_1=raster_direction_along_y)

gate_2 = StreamGate(Stream=filter_40, Gate=make_finsih_pass_2)  # -> Target0, Target1
cutout = CutoutOrProfile(
    curves_for_cutout=gate_2.Target1,
    cut_depth=filter_11,
    pass_depth=filter_11,
    tool_diameter=milling_bit_diameter_5,
    cutout_tolerance=cutout_tolerance_2,
    use_climb_direction=use_climb_direction_2,
    use_inside_cutting=Toggle(True))
merge_5 = Merge(Data1=pocket, Data2=cutout)
clean = CleanTree(RemoveNulls=True, RemoveInvalid=True, RemoveEmpty=False, Tree=merge_5)

cnc_milling_postprocessor_4 = CNCMillingPostProcessor_2(
    toolpath_curves=clean,
    tab_breps=tab_breps_2,
    feed_rate=feed_rate_mm_s,
    plunge_rate=plunge_rate_mm_s,
    jog_rate=jog_rate_xy_mm_s,
    jog_rate_z=jog_rate_z_mm_s,
    safe_z_height=safe_z_height_witch_z_zero_at_material_b,
    use_spindle=use_spindle,
    spindle_speed=spindle_speed,
    ramp_plunges=ramp_plunges_2,
    ramp_angle=ramp_angle_2,
    start_code=filter_23,
    end_code=filter_24,
    make_shopbot_code_not_g_code=make_shopbot_code_not_g_code,
    end_of_job_go_to_x=end_of_job_go_to_x_position,
    end_of_job_go_to_y=end_of_job_go_to_y_position,
    deviation_tolerance=deviation_tolerance_2,
    use_high_speed_machining=use_trochoidal_milling,
    milling_bit_diameter=actual_milling_bit_diamter,
    toolpath_width_factor=trochoidal_toolpath_width_factor,
    stepover=trochoidal_stepover,
    use_peck_entry=use_peck_entry,
    z_zero_is_at_bottom_of_stock=z_zero_is_at_bottom_of_stock,
    material_thickness=material_thickness,
    job_name=job_name)  # -> g_code_stream, g_code_for_tab_cleanup, toolpath_preview_curves_2, tab_cleanup_preview_curves_2, cut_transition_preview_lines_2, cut_entry_preview_lines_2, cut_exit_preview_lines_2

# ---- group: Pocket G-code
stream_and_save_as_code_4 = Panel(cnc_milling_postprocessor_4.g_code_stream)

# ----
stream_code_4 = FileCreator(
    name="2 Pocket - Bark beetle",
    ext=filter_32,
    lines=stream_and_save_as_code_4,
    write=stream_contents,
    path=toolpath_streaming_folder)  # inputs lines: list, write: Boolean; same code as stream_code

cnc_cutout_curves_2 = Curve(reparameterize(flatten(filter_37)))

movestartpoint = MoveStartPoint(crv=cnc_cutout_curves_2, int=startpoint_cutout)
cnc_cutout_curves_3 = Curve(reparameterize(flatten(movestartpoint)))

gate_3 = StreamGate(Stream=cnc_cutout_curves_3, Gate=make_dogbones_2)  # -> Target0, Target1
dogbone_maker_2 = DogboneMaker(
    curves_to_dogbone=gate_3.Target1,
    milling_bit_diameter=milling_bit_diameter_4,
    corner_angle_threshold=corner_angle_threshold,
    flip_cornes_boolean=filter_36)
filter_41 = StreamFilter(Gate=make_dogbones_2, Stream0=gate_3.Target0, Stream1=dogbone_maker_2)
autosort_cutout_3 = AutoSortCutout(int=autosort_cutout, crv=filter_41)
gate_4 = StreamGate(Stream=autosort_cutout_3, Gate=make_finsih_pass)  # -> Target0, Target1
cutout_2 = CutoutOrProfile(
    curves_for_cutout=autosort_cutout_3,
    cut_depth=filter_38,
    pass_depth=pass_depth_2,
    tool_diameter=milling_bit_diameter_before_finish,
    cutout_tolerance=cutout_tolerance_2,
    use_climb_direction=use_climb_direction_2,
    use_inside_cutting=use_inside_cutting_from_easy_interface)
cutout_3 = CutoutOrProfile(
    curves_for_cutout=gate_4.Target1,
    cut_depth=filter_38,
    pass_depth=filter_38,
    tool_diameter=milling_bit_diameter_4,
    cutout_tolerance=cutout_tolerance_2,
    use_climb_direction=use_climb_direction_2,
    use_inside_cutting=use_inside_cutting_from_easy_interface)
merge_6 = Merge(Data1=cutout_2, Data2=cutout_3)
clean_2 = CleanTree(RemoveNulls=True, RemoveInvalid=True, RemoveEmpty=False, Tree=merge_6)

cnc_milling_postprocessor_5 = CNCMillingPostProcessor_2(
    toolpath_curves=clean_2,
    tab_breps=tab_breps_2,
    feed_rate=feed_rate_mm_s,
    plunge_rate=plunge_rate_mm_s,
    jog_rate=jog_rate_xy_mm_s,
    jog_rate_z=jog_rate_z_mm_s,
    safe_z_height=safe_z_height_witch_z_zero_at_material_b,
    use_spindle=use_spindle,
    spindle_speed=spindle_speed,
    ramp_plunges=ramp_plunges_2,
    ramp_angle=ramp_angle_2,
    start_code=filter_23,
    end_code=filter_24,
    make_shopbot_code_not_g_code=make_shopbot_code_not_g_code,
    end_of_job_go_to_x=end_of_job_go_to_x_position,
    end_of_job_go_to_y=end_of_job_go_to_y_position,
    deviation_tolerance=deviation_tolerance_2,
    use_high_speed_machining=use_trochoidal_milling,
    milling_bit_diameter=actual_milling_bit_diamter,
    toolpath_width_factor=trochoidal_toolpath_width_factor,
    stepover=trochoidal_stepover,
    use_peck_entry=use_peck_entry,
    z_zero_is_at_bottom_of_stock=z_zero_is_at_bottom_of_stock,
    material_thickness=material_thickness,
    job_name=job_name)  # -> g_code_stream, g_code_for_tab_cleanup, toolpath_preview_curves_2, tab_cleanup_preview_curves_2, cut_transition_preview_lines_2, cut_entry_preview_lines_2, cut_exit_preview_lines_2

# ---- group: Cut G-code
stream_and_save_as_code_5 = Panel(cnc_milling_postprocessor_5.g_code_stream)

# ---- group: Tab cleanup G-code
stream_and_save_as_code_6 = Panel(cnc_milling_postprocessor_5.g_code_for_tab_cleanup)

# ----
stream_code_5 = FileCreator(
    name="5 Tab cleanup - Bark beetle",
    ext=filter_32,
    lines=stream_and_save_as_code_6,
    write=stream_contents,
    path=toolpath_streaming_folder)  # inputs lines: list, write: Boolean; same code as stream_code
stream_code_6 = FileCreator(
    name="4 Cut - Bark beetle",
    ext=filter_32,
    lines=stream_and_save_as_code_5,
    write=stream_contents,
    path=toolpath_streaming_folder)  # inputs lines: list, write: Boolean; same code as stream_code
tab_cleanup_preview_lines = Curve(cnc_milling_postprocessor_5.tab_cleanup_preview_curves_2)

# ----
# Toolpath generation:
cnc_drill_curves_2 = Curve(reparameterize(flatten([pipeline_4, cnc_drill_curves])))

cull = CullPattern(List=cnc_drill_curves_2, CullPattern=autosort_drill)
autosort_curves = AutosortCurves(curves=cull)
filter_42 = StreamFilter(Gate=autosort_drill, Stream0=cnc_drill_curves_2, Stream1=autosort_curves)

drill = Drill(drill_curves=filter_42, I=drill_depth_from_easy_interface, I_2=milling_bit_diameter_2)  # -> drill_toolpaths_3, drill_preview_geometry_3

# ----
# Post processing, set output directory here:
cnc_milling_postprocessor_6 = CNCMillingPostProcessor(
    toolpath_curves=drill.drill_toolpaths_3,
    tab_breps=tab_breps_2,
    feed_rate=feed_rate_mm_s,
    plunge_rate=plunge_rate_mm_s,
    jog_rate=jog_rate_xy_mm_s,
    jog_rate_z=jog_rate_z_mm_s,
    safe_z_height=safe_z_height_witch_z_zero_at_material_b,
    use_spindle=use_spindle,
    spindle_speed=spindle_speed,
    ramp_plunges=ramp_plunges_2,
    ramp_angle=ramp_angle_2,
    start_code=filter_23,
    end_code=filter_24,
    make_shopbot_code_not_g_code=make_shopbot_code_not_g_code,
    end_of_job_go_to_x=end_of_job_go_to_x_position,
    end_of_job_go_to_y=end_of_job_go_to_y_position,
    deviation_tolerance=deviation_tolerance_2,
    use_high_speed_machining=0,
    milling_bit_diameter=milling_bit_diameter_2,
    toolpath_width_factor=2.3,
    stepover=0.1,
    use_peck_entry=False,
    z_zero_is_at_bottom_of_stock=z_zero_is_at_bottom_of_stock,
    material_thickness=material_thickness,
    job_name=job_name)  # -> g_code_stream, g_code_for_tab_cleanup, toolpath_preview_curves_2, tab_cleanup_preview_curves_2, cut_transition_preview_lines_2, cut_entry_preview_lines_2, cut_exit_preview_lines_2

# ---- group: Drill G-code
stream_and_save_as_code_7 = Panel(cnc_milling_postprocessor_6.g_code_stream)

# ----
stream_code_7 = FileCreator(
    name="1 Drill - Bark beetle",
    ext=filter_32,
    lines=stream_and_save_as_code_7,
    write=stream_contents,
    path=toolpath_streaming_folder)  # inputs lines: list, write: Boolean; same code as stream_code

# ---- group: Toolpath preview
color_of_toolpaths = ColourSwatch(SwatchColor=RGB(0, 255, 238))
color_of_toolpaths_when_inside_cutting_i = ColourSwatch(SwatchColor=RGB(255, 61, 155))  # "Color of toolpaths when inside cutting is on"
use_inside_cutting_2 = Panel(use_inside_cutting_from_easy_interface)
pocket_toolpaths = Curve(cnc_milling_postprocessor_4.toolpath_preview_curves_2)
engrave_toolpaths = Curve(cnc_milling_postprocessor_3.toolpath_preview_curves_2)
cut_toolpaths = Curve(cnc_milling_postprocessor_5.toolpath_preview_curves_2)
_3d_rough_toolpaths = Curve(cnc_milling_postprocessor_2.toolpath_preview_curves_2)
_3d_finish_toolpaths = Curve(cnc_milling_postprocessor.toolpath_preview_curves_2)
cut_transition_preview_lines = Curve([cnc_milling_postprocessor_6.cut_transition_preview_lines_2, cnc_milling_postprocessor_5.cut_transition_preview_lines_2, cnc_milling_postprocessor_2.cut_transition_preview_lines_2, cnc_milling_postprocessor.cut_transition_preview_lines_2, cnc_milling_postprocessor_4.cut_transition_preview_lines_2, cnc_milling_postprocessor_3.cut_transition_preview_lines_2])
cut_entry_preview_lines = Curve([cnc_milling_postprocessor_6.cut_entry_preview_lines_2, cnc_milling_postprocessor_5.cut_entry_preview_lines_2, cnc_milling_postprocessor_2.cut_entry_preview_lines_2, cnc_milling_postprocessor.cut_entry_preview_lines_2, cnc_milling_postprocessor_4.cut_entry_preview_lines_2, cnc_milling_postprocessor_3.cut_entry_preview_lines_2])
cut_exit_preview_lines = Curve([cnc_milling_postprocessor_6.cut_exit_preview_lines_2, cnc_milling_postprocessor_5.cut_exit_preview_lines_2, cnc_milling_postprocessor_2.cut_exit_preview_lines_2, cnc_milling_postprocessor.cut_exit_preview_lines_2, cnc_milling_postprocessor_4.cut_entry_preview_lines_2, cnc_milling_postprocessor_3.cut_exit_preview_lines_2])
jog_transitions = ColourSwatch(SwatchColor=RGB(71, 61, 38))
drill_preview_geometry = Curve(drill.drill_preview_geometry_3)
tab_cleanup = ColourSwatch(SwatchColor=RGB(74, 74, 74))
hold_down = ColourSwatch(SwatchColor=RGB(255, 191, 0))
cut_entries = ColourSwatch(SwatchColor=RGB(145, 193, 194))
filter_43 = StreamFilter(Gate=use_inside_cutting_2, Stream0=color_of_toolpaths, Stream1=color_of_toolpaths_when_inside_cutting_i)
cut_exits = ColourSwatch(SwatchColor=RGB(61, 88, 89))
filter_44 = StreamFilter(Gate=use_inside_cutting_2, Stream0=color_of_toolpaths, Stream1=color_of_toolpaths_when_inside_cutting_i)
filter_45 = StreamFilter(Gate=use_inside_cutting_2, Stream0=color_of_toolpaths, Stream1=color_of_toolpaths_when_inside_cutting_i)
filter_46 = StreamFilter(Gate=use_inside_cutting_2, Stream0=color_of_toolpaths, Stream1=color_of_toolpaths_when_inside_cutting_i)
filter_47 = StreamFilter(Gate=use_inside_cutting_2, Stream0=color_of_toolpaths, Stream1=color_of_toolpaths_when_inside_cutting_i)
preview_4 = CustomPreview(Geometry=_3d_finish_toolpaths, Shader=filter_43)
preview_5 = CustomPreview(Geometry=cut_transition_preview_lines, Shader=jog_transitions)
preview_6 = CustomPreview(Geometry=cut_entry_preview_lines, Shader=cut_entries)
preview_7 = CustomPreview(Geometry=cut_exit_preview_lines, Shader=cut_exits)
preview_8 = CustomPreview(Geometry=drill_preview_geometry, Shader=hold_down)
preview_9 = CustomPreview(Geometry=engrave_toolpaths, Shader=filter_44)
preview_10 = CustomPreview(Geometry=tab_cleanup_preview_lines, Shader=tab_cleanup)
preview_11 = CustomPreview(Geometry=pocket_toolpaths, Shader=filter_45)
preview_12 = CustomPreview(Geometry=cut_toolpaths, Shader=filter_46)
preview_13 = CustomPreview(Geometry=_3d_rough_toolpaths, Shader=filter_47)

# ---- group: Create start point and direction arrows
# Preview generation:
start_arrow_length = Panel("2")
start_arrow_pixel_width = Panel("3")
eval = EvaluateLength(Curve=_3d_finish_toolpaths, Length=0, Normalized=True)  # -> Point, Tangent, Parameter
eval_2 = EvaluateLength(Curve=tab_cleanup_preview_lines, Length=0, Normalized=True)  # -> Point, Tangent, Parameter
eval_3 = EvaluateLength(Curve=engrave_toolpaths, Length=0, Normalized=True)  # -> Point, Tangent, Parameter
eval_4 = EvaluateLength(Curve=_3d_rough_toolpaths, Length=0, Normalized=True)  # -> Point, Tangent, Parameter
eval_5 = EvaluateLength(Curve=cut_toolpaths, Length=0, Normalized=True)  # -> Point, Tangent, Parameter
eval_6 = EvaluateLength(Curve=pocket_toolpaths, Length=0, Normalized=True)  # -> Point, Tangent, Parameter
amp = Amplitude(Vector=eval.Tangent, Amplitude=start_arrow_length)
amp_2 = Amplitude(Vector=eval_2.Tangent, Amplitude=start_arrow_length)
amp_3 = Amplitude(Vector=eval_3.Tangent, Amplitude=start_arrow_length)
amp_4 = Amplitude(Vector=eval_4.Tangent, Amplitude=start_arrow_length)
amp_5 = Amplitude(Vector=eval_5.Tangent, Amplitude=start_arrow_length)
amp_6 = Amplitude(Vector=eval_6.Tangent, Amplitude=start_arrow_length)
vdisex = VectorDisplayEx(Point=eval.Point, Vector=amp, Colour=filter_43, Width=start_arrow_pixel_width)
vdisex_2 = VectorDisplayEx(Point=eval_2.Point, Vector=amp_2, Colour=tab_cleanup, Width=start_arrow_pixel_width)
vdisex_3 = VectorDisplayEx(Point=eval_3.Point, Vector=amp_3, Colour=filter_44, Width=start_arrow_pixel_width)
vdisex_4 = VectorDisplayEx(Point=eval_4.Point, Vector=amp_4, Colour=filter_47, Width=start_arrow_pixel_width)
vdisex_5 = VectorDisplayEx(Point=eval_5.Point, Vector=amp_5, Colour=filter_46, Width=start_arrow_pixel_width)
vdisex_6 = VectorDisplayEx(Point=eval_6.Point, Vector=amp_6, Colour=filter_45, Width=start_arrow_pixel_width)

# ----
all_toolpath_preview_curves = Curve(flatten([cnc_milling_postprocessor_6.toolpath_preview_curves_2, cnc_milling_postprocessor_5.toolpath_preview_curves_2, cnc_milling_postprocessor_2.toolpath_preview_curves_2, cnc_milling_postprocessor.toolpath_preview_curves_2, cnc_milling_postprocessor_4.toolpath_preview_curves_2, cnc_milling_postprocessor_3.toolpath_preview_curves_2]))

# ---- group: find deepest Z for summary info
find_deepest_z = FindDeepestZ(toolpaths=all_toolpath_preview_curves)
deepest_z = Panel(find_deepest_z)

# ---- group: Create warning message if a job is too deep
deepest_alowed_cut_into_bed_before_warni = Panel("-1")  # "Deepest alowed cut into bed before warning (should be a negative value)"
warning_message_if_cut_is_too_deep = Panel("JOB WILL CUT INTO MACHINE BED!")
addition_6 = Addition(MaterialThickness=material_thickness, B=deepest_z)
smaller = SmallerThan(FirstNumber=addition_6, SecondNumber=deepest_alowed_cut_into_bed_before_warni)  # -> SmallerThan, OrEqualTo
filter_48 = StreamFilter(Gate=smaller.SmallerThan, Stream1=warning_message_if_cut_is_too_deep)
division = Division(A=worka_area_size_x, B=25)
xy = XYPlane(Origin=Point(0, 0, 0))
tag_3 = TextTag3D(Location=xy, Text=filter_48, Size=division, Colour=RGB(255, 48, 128), Justification=1)

# ----
estimate_time = EstimateTime(
    C_2=all_toolpath_preview_curves,
    feed_rate=feed_rate_mm_s,
    C=cut_transition_preview_lines,
    C_3=[cut_entry_preview_lines, cut_exit_preview_lines],
    feed_rate_2=feed_rate_mm_s)
compile_settings = CompileSettings(
    estimated_job_time_in_seconds=estimate_time,
    feed_rate=feed_rate_mm_s,
    plunge_rate=plunge_rate_mm_s,
    spindle_rpm=spindle_speed,
    pass_depth=pass_depth_2,
    ramp_plunges=ramp_plunges_2,
    ramp_angle=ramp_angle_2,
    deepest_z=find_deepest_z)  # -> complete_settings, crucial_settings

# ---- group: Current settings
panel = Panel(compile_settings.complete_settings)

# ----
bool = Boolean(smaller.SmallerThan)
python = GhPythonScript(x=bool, y=warning_message_if_cut_is_too_deep)  # -> out, a
# ---------- python: Python ----------
__author__ = "Siemen"
__version__ = "2020.07.17"

import rhinoscriptsyntax as rs

if x:
    rs.MessageBox(y,0,"WARNING")
# ---------- end python ----------

# ==== cluster Drill: Creates a drilling toolpath from the center of the input geometry, usually circles. Handy for making pre milling hold down holes. Pro-tip: Make your input circle diameter the diameter of your screw head + 2x the diameter of your milling bit. Then you know how close you can place your screw holes o your cutting geometry. If your screw hole circle and cutting geometry overlap, you are in trouble.
I = ClusterInput()
I_2 = ClusterInput()
default_tool_diameter = Panel("6")
default_drill_depth = Panel("10")
null = NullItem(Item=I_2)  # -> NullFlags, InvalidFlags, Description
null_2 = NullItem(Item=I)  # -> NullFlags, InvalidFlags, Description
drill_curves = ClusterInput()
filter = StreamFilter(Gate=null.NullFlags, Stream0=I_2, Stream1=default_tool_diameter)
filter_2 = StreamFilter(Gate=null_2.NullFlags, Stream0=I, Stream1=default_drill_depth)

# ---- group: Creat hold down drill lines
drill_curves_2 = Curve(drill_curves)
drill_depth = Number(filter_2)
area = Area(Geometry=drill_curves_2)  # -> Area, Centroid
drill_depth_2 = Panel(drill_depth)
pdecon = Deconstruct(Point=area.Centroid)  # -> XComponent, YComponent, ZComponent
pt = ConstructPoint(XCoordinate=pdecon.XComponent, YCoordinate=pdecon.YComponent, ZCoordinate=0)
neg = Negative(Value=drill_depth_2)
Z = UnitZ(Factor=neg)
move = Move(Geometry=pt, Motion=Z)  # -> Geometry, Transform
ln = Line(StartPoint=pt, EndPoint=move.Geometry)

# ----
tool_diameter_for_preview = Number(filter)

# ---- group: Create hold down preview circles
drill_toolpaths = Curve(ln)
tool_diameter = Panel(tool_diameter_for_preview)
end = EndPoints(Curve=drill_toolpaths)  # -> Start, End
multiplication = Multiplication(A=tool_diameter, B="0.5")
pt_2 = Point(end.Start)
neg_2 = Negative(Value=multiplication)
neg_3 = Negative(Value=multiplication)
X = UnitX(Factor=multiplication)
X_2 = UnitX(Factor=neg_3)
Y = UnitY(Factor=neg_2)
Y_2 = UnitY(Factor=multiplication)
move_2 = Move(Geometry=pt_2, Motion=Y)  # -> Geometry, Transform
xy = XYPlane(Origin=pt_2)
move_3 = Move(Geometry=pt_2, Motion=X_2)  # -> Geometry, Transform
move_4 = Move(Geometry=pt_2, Motion=Y_2)  # -> Geometry, Transform
move_5 = Move(Geometry=pt_2, Motion=X)  # -> Geometry, Transform
cir = Circle(Plane=xy, Radius=multiplication)
ln_2 = Line(StartPoint=move_4.Geometry, EndPoint=move_2.Geometry)
ln_3 = Line(StartPoint=move_5.Geometry, EndPoint=move_3.Geometry)
drill_preview_geometry = Curve([ln_3, ln_2, cir])

# ----
drill_preview_geometry_2 = Curve(drill_preview_geometry)
drill_toolpaths_2 = Curve(ln)
drill_preview_geometry_3 = ClusterOutput(drill_preview_geometry_2)
drill_toolpaths_3 = ClusterOutput(drill_toolpaths_2)

# ==== cluster Engrave: Creates toolpaths with pass depths from 2D and 3D curves. Handy for making your own freestyle toolpaths. Be careful about start depths of your curves. Pass depth and cut depth assumes your input curve starts at surface level (Z0).
engrave_curves = ClusterInput()
pass_depth = ClusterInput()
cut_depth = ClusterInput()
engrave_curves_2 = Curve(engrave_curves)
pass_depth_2 = Number(pass_depth)
cut_depth_2 = Number(cut_depth)
pass_depth_3 = Panel(pass_depth_2)
cut_depth_line_engrave = Panel(cut_depth_2)
division = Division(A=cut_depth_line_engrave, B=pass_depth_3)
round = Round(Number=division)  # -> Nearest, Floor, Ceiling
division_2 = Division(A=cut_depth_line_engrave, B=round.Ceiling)
actual_pass_depth = Panel(division_2)
series = Series(Start=actual_pass_depth, Step=actual_pass_depth, Count=round.Ceiling)
neg = Negative(Value=series)
null = NullItem(Item=division_2)  # -> NullFlags, InvalidFlags, Description
filter = StreamFilter(Gate=null.NullFlags, Stream0=neg, Stream1="0")
Z = UnitZ(Factor=filter)
move = Move(Geometry=graft(engrave_curves_2), Motion=Z)  # -> Geometry, Transform
flatten = FlattenTree(Tree=move.Geometry, Path="{0}")
clean = CleanTree(RemoveNulls=True, RemoveInvalid=True, RemoveEmpty=False, Tree=flatten)
engrave_toolpaths = Curve(clean)
engrave_toolpaths_2 = ClusterOutput(engrave_toolpaths)

# ==== cluster DogboneMaker: Automatically adds dogbones to toolpath curves. Dogbones are used for making sharp internal cornes. This overcomes to challenge of making a sharp corner with a round spinning milling bit
corner_angle_threshold = ClusterInput()
milling_bit_diameter = ClusterInput()
flip_cornes_boolean = ClusterInput()
curves_to_dogbone = ClusterInput()
flip_cornes_boolean_2 = Integer(flip_cornes_boolean)
radius_margin = Panel("0.11")

milling_bit_diameter_2 = Number(milling_bit_diameter)
multiplication = Multiplication(A=milling_bit_diameter_2, B="0.5")
addition = Addition(A=multiplication, B=radius_margin)
dogbone_radius = Panel(addition)

corner_angle_threshold_2 = Number(corner_angle_threshold)
dom = ConstructDomain(DomainStart="1", DomainEnd="179")
smaller = SmallerThan(FirstNumber=corner_angle_threshold_2, SecondNumber="1")  # -> SmallerThan, OrEqualTo
filter = StreamFilter(Gate=smaller.SmallerThan, Stream0=corner_angle_threshold_2, Stream1="1")
larger = LargerThan(FirstNumber=filter, SecondNumber="179")  # -> LargerThan, OrEqualTo
filter_2 = StreamFilter(Gate=larger.LargerThan, Stream0=corner_angle_threshold_2, Stream1="179")
subtraction = Subtraction(A="360", B=filter_2)
division = Division(A=subtraction, B="360")
dogbone_minium_angle = Panel(division)

curves_to_dogbone_2 = Curve(curves_to_dogbone)
flatten = FlattenTree(Tree=curves_to_dogbone_2, Path="{0}")

# ---- group: Merge overlapping curves //removed to alow neighbouring pockets
mcx = MultipleCurves(Curves=flatten)  # -> Points, IndexA, IndexB, ParamA, ParamB; disabled
dcon = DeleteConsecutive(Set=[mcx.IndexA, mcx.IndexB], Wrap=False)  # -> Set, Count
item = ListItem(List=flatten, Index=dcon.Set, Wrap=True)
cull_i = CullIndex(List=flatten, Indices=dcon.Set, Wrap=True)
runion = RegionUnion(Curves=item)
merged_overlapping_curves = Curve([runion, cull_i])

# ---- group: Detect curves inside curves
aligned_curves = Curve(flatten)
graft = GraftTree(Tree=aligned_curves, IncludeEmptyLists=True, IncludeNullItems=True)
end = EndPoints(Curve=aligned_curves)  # -> Start, End
incurve = PointInCurve(Point=end.Start, Curve=graft)  # -> Relationship, Point
multiplication_2 = Multiplication(A=incurve.Relationship, B="0.5")
round = Round(Number=multiplication_2)  # -> Nearest, Floor, Ceiling
int = Integer(round.Floor)
flip = FlipMatrix(Data=int)
ma = MassAddition(Input=flip)  # -> Result, PartialResults
pshift = ShiftPaths(Data=ma.Result, Offset=-1)
dispatch = Dispatch(List=aligned_curves, DispatchPattern=pshift)  # -> ListA, ListB
curves_outside = Curve(dispatch.ListB)
curves_inside = Curve(dispatch.ListA)

# ----
xy = XYPlane(Origin=Point(0, 0, 0))
cir = Circle(Plane=xy, Radius="0.01")
dogbone_minium_angle_2 = Panel(dogbone_minium_angle)
len = Length(Curve=cir)
multiplication_3 = Multiplication(A=len, B=dogbone_minium_angle_2)

xy_2 = XYPlane(Origin=Point(0, 0, 0))
cir_2 = Circle(Plane=xy_2, Radius="0.01")
dogbone_minium_angle_3 = Panel(dogbone_minium_angle)
len_2 = Length(Curve=cir_2)
multiplication_4 = Multiplication(A=len_2, B=dogbone_minium_angle_3)

flip_cornes_boolean_3 = Panel(flip_cornes_boolean_2)
flip_cornes_boolean_4 = Panel(flip_cornes_boolean_2)
curves_to_dogbone_3 = Curve(flatten)
lng = ListLength(List=curves_to_dogbone_3)

curves_for_dogbone = Curve(curves_inside)
cp = ControlPoints(Curve=curves_for_dogbone)  # -> Points, Weights, Knots

disc = Discontinuity(Curve=curves_for_dogbone, Level=1)  # -> Points, Parameters

curves_for_dogbone_2 = Curve(curves_outside)
cp_2 = ControlPoints(Curve=curves_for_dogbone_2)  # -> Points, Weights, Knots

disc_2 = Discontinuity(Curve=curves_for_dogbone_2, Level=1)  # -> Points, Parameters

xy_3 = XYPlane(Origin=disc.Points)
cir_3 = Circle(Plane=xy_3, Radius="0.01")
trim = TrimWithRegion(Curve=cir_3, Region=graft(curves_for_dogbone), Plane=xy_3)  # -> Inside, Outside

filter_3 = StreamFilter(Gate=flip_cornes_boolean_4, Stream0=trim.Outside, Stream1=trim.Inside)

pshift_2 = ShiftPaths(Data=filter_3, Offset=-1)
len_3 = Length(Curve=pshift_2)

xy_4 = XYPlane(Origin=disc_2.Points)
cir_4 = Circle(Plane=xy_4, Radius="0.01")
trim_2 = TrimWithRegion(Curve=cir_4, Region=graft(curves_for_dogbone_2), Plane=xy_4)  # -> Inside, Outside

filter_4 = StreamFilter(Gate=flip_cornes_boolean_3, Stream0=trim_2.Inside, Stream1=trim_2.Outside)

pshift_3 = ShiftPaths(Data=filter_4, Offset=-1)
len_4 = Length(Curve=pshift_3)

larger_2 = LargerThan(FirstNumber=len_3, SecondNumber=multiplication_3)  # -> LargerThan, OrEqualTo
dogbone_radius_2 = Panel(dogbone_radius)
dispatch_2 = Dispatch(List=disc.Points, DispatchPattern=larger_2.LargerThan)  # -> ListA, ListB
dispatch_3 = Dispatch(List=pshift_2, DispatchPattern=larger_2.LargerThan)  # -> ListA, ListB
eval = EvaluateLength(Curve=dispatch_3.ListA, Length="0.5", Normalized=True)  # -> Point, Tangent, Parameter
pt = Point(dispatch_2.ListA)
pln = Plane(dispatch_2.ListA)
pt_2 = Point(eval.Point)
vec2pt = Vector2Pt(PointA=pt_2, PointB=pt, Unitize=False)  # -> Vector, Length

amp = Amplitude(Vector=vec2pt.Vector, Amplitude=dogbone_radius_2)

move = Move(Geometry=pln, Motion=amp)  # -> Geometry, Transform
cir_5 = Circle(Plane=move.Geometry, Radius=dogbone_radius_2)

lng_2 = ListLength(List=cir_5)
larger_3 = LargerThan(FirstNumber=lng_2, SecondNumber="0.01")  # -> LargerThan, OrEqualTo
pshift_4 = ShiftPaths(Data=larger_3.LargerThan, Offset=-1)
ma_2 = MassAddition(Input=pshift_4)  # -> Result, PartialResults
dispatch_4 = Dispatch(List=curves_for_dogbone, DispatchPattern=pshift_4)  # -> ListA, ListB
crv = Curve(dispatch_4.ListB)
smaller_2 = SmallerThan(FirstNumber=ma_2.Result, SecondNumber="0.5")  # -> SmallerThan, OrEqualTo
clean = CleanTree(RemoveNulls=True, RemoveInvalid=True, RemoveEmpty=False, Tree=crv)

crv_2 = Curve(curves_for_dogbone)
graft_2 = GraftTree(Tree=crv_2, IncludeEmptyLists=True, IncludeNullItems=True)
runion_2 = RegionUnion(Curves=[cir_5, graft_2])
pshift_5 = ShiftPaths(Data=runion_2, Offset=-1)
pshift_6 = ShiftPaths(Data=pshift_5, Offset=-1)

filter_5 = StreamFilter(Gate=smaller_2.SmallerThan, Stream0=pshift_6)
merge = Merge(Data1=filter_5, Data2=clean)
dogboned_inside_curves = Curve(merge)

larger_4 = LargerThan(FirstNumber=len_4, SecondNumber=multiplication_4)  # -> LargerThan, OrEqualTo
dogbone_radius_3 = Panel(dogbone_radius)
dispatch_5 = Dispatch(List=disc_2.Points, DispatchPattern=larger_4.LargerThan)  # -> ListA, ListB
dispatch_6 = Dispatch(List=pshift_3, DispatchPattern=larger_4.LargerThan)  # -> ListA, ListB
eval_2 = EvaluateLength(Curve=dispatch_6.ListA, Length="0.5", Normalized=True)  # -> Point, Tangent, Parameter
pln_2 = Plane(dispatch_5.ListA)
pt_3 = Point(dispatch_5.ListA)
pt_4 = Point(eval_2.Point)
vec2pt_2 = Vector2Pt(PointA=pt_4, PointB=pt_3, Unitize=False)  # -> Vector, Length

amp_2 = Amplitude(Vector=vec2pt_2.Vector, Amplitude=dogbone_radius_3)

move_2 = Move(Geometry=pln_2, Motion=amp_2)  # -> Geometry, Transform
cir_6 = Circle(Plane=move_2.Geometry, Radius=dogbone_radius_3)

crv_3 = Curve(curves_for_dogbone_2)
flip_cornes_boolean_5 = Panel(flip_cornes_boolean_2)
graft_3 = GraftTree(Tree=crv_3, IncludeEmptyLists=True, IncludeNullItems=True)
gate = StreamGate(Stream=[graft_3, cir_6], Gate=flip_cornes_boolean_5)  # -> Target0, Target1
gate_2 = StreamGate(Stream=graft_3, Gate=flip_cornes_boolean_5)  # -> Target0, Target1
gate_3 = StreamGate(Stream=cir_6, Gate=flip_cornes_boolean_5)  # -> Target0, Target1
runion_3 = RegionUnion(Curves=gate.Target1)
rdiff = RegionDifference(CurvesA=gate_2.Target0, CurvesB=gate_3.Target0)
filter_6 = StreamFilter(Gate=flip_cornes_boolean_5, Stream0=rdiff, Stream1=runion_3)
pshift_7 = ShiftPaths(Data=filter_6, Offset=-1)
pshift_8 = ShiftPaths(Data=pshift_7, Offset=-1)

lng_3 = ListLength(List=cir_6)
larger_5 = LargerThan(FirstNumber=lng_3, SecondNumber="0.01")  # -> LargerThan, OrEqualTo
pshift_9 = ShiftPaths(Data=larger_5.LargerThan, Offset=-1)
ma_3 = MassAddition(Input=pshift_9)  # -> Result, PartialResults
dispatch_7 = Dispatch(List=curves_for_dogbone_2, DispatchPattern=pshift_9)  # -> ListA, ListB
crv_4 = Curve(dispatch_7.ListB)
smaller_3 = SmallerThan(FirstNumber=ma_3.Result, SecondNumber="0.5")  # -> SmallerThan, OrEqualTo
clean_2 = CleanTree(RemoveNulls=True, RemoveInvalid=True, RemoveEmpty=False, Tree=crv_4)

filter_7 = StreamFilter(Gate=smaller_3.SmallerThan, Stream0=pshift_8)
merge_2 = Merge(Data1=filter_7, Data2=clean_2)
dogboned_outside_curves = Curve(merge_2)
merge_3 = Merge(Data1=dogboned_inside_curves, Data2=dogboned_outside_curves)
flatten_2 = FlattenTree(Tree=merge_3, Path="{0}")
end_2 = EndPoints(Curve=flatten_2)  # -> Start, End
dup = DuplicateData(Data=graft(flatten_2), Number=lng, Order=True)
flip_2 = FlipMatrix(Data=dup)
crv_cp = CurveClosestPoint(Point=end_2.Start, Curve=graft(curves_to_dogbone_3))  # -> Point, Parameter, Distance
pshift_10 = ShiftPaths(Data=flip_2, Offset=-1)
sort = SortList(Keys=crv_cp.Distance, ValuesA=pshift_10)  # -> Keys, ValuesA
item_2 = ListItem(List=sort.ValuesA, Index=0, Wrap=True)
flatten_3 = FlattenTree(Tree=item_2, Path="{0}")
dogboned_curves = Curve(flatten_3)
dogboned_curves_2 = ClusterOutput(dogboned_curves)

# ==== cluster Automill: Dissects a Brep and outputs curves, surfaces and cut depths for 2D and 3D milling. Can make it lightning fast to set up a combo 2D and 3D milling jobs. No need to set up different pocket and cut depths or isolate 2D geometry from 3D.
breps_to_mill = ClusterInput()
extra_cut_depth = Panel("0.6")
breps_to_mill_2 = Brep(breps_to_mill)
clean = CleanTree(RemoveNulls=True, RemoveInvalid=True, RemoveEmpty=False, Tree=breps_to_mill_2)

# ---- group: Detect surfaces for robo fab finishing pass
number_slider = Slider(5, range=0..10)
surfaces_from_brep = Surface()
identifier_surfaces = Surface(<surface referenced from the Rhino model>)
sdivide = DivideSurface(Surface=identifier_surfaces, UCount=number_slider, VCount=number_slider)  # -> Points, Normals, Parameters
graft = GraftTree(Tree=surfaces_from_brep, IncludeEmptyLists=True, IncludeNullItems=True)
srf_cp = SurfaceClosestPoint(Point=sdivide.Points, Surface=graft)  # -> Point, UVPoint, Distance
avr = Average(Input=srf_cp.Distance)
simplify = SimplifyTree(Tree=avr, Front=False)
equals = Equality(FirstNumber=simplify, SecondNumber="0")  # -> Equality, Inequality
dispatch = Dispatch(List=graft, DispatchPattern=equals.Equality)  # -> ListA, ListB
identified_surfaces = Surface(dispatch.ListA)

# ----
bbox = BoundingBox(Content=clean, Plane=PlaneXY(0, 0, 0))  # -> Box, Box_2
debrep = DeconstructBrep(Brep=bbox.Box)  # -> Faces, Edges, Vertices
item = ListItem(List=debrep.Edges, Index="8", Wrap=True)
pshift = ShiftPaths(Data=item, Offset=-1)
end = EndPoints(Curve=pshift)  # -> Start, End
len = Length(Curve=pshift)
pt = Point(end.End)
pdecon = Deconstruct(Point=pt)  # -> XComponent, YComponent, ZComponent
object_heights = Panel(len)
lovest_points = Panel(pdecon.ZComponent)

tolerance = Panel("0.01")
bit_diameter = Panel("3")
neg = Negative(Value=bit_diameter)
Z = UnitZ(Factor="0.01")
breps_to_mill_3 = Brep(clean)
neg_2 = Negative(Value=Z)
bit_diameter_2 = Panel("3")
neg_3 = Negative(Value=bit_diameter_2)

debrep_2 = DeconstructBrep(Brep=clean)  # -> Faces, Edges, Vertices
planar = IsPlanar(Surface=debrep_2.Faces, Interior=True)  # -> Planar, Plane
dispatch_2 = Dispatch(List=debrep_2.Faces, DispatchPattern=planar.Planar)  # -> ListA, ListB
dispatch_3 = Dispatch(List=planar.Plane, DispatchPattern=planar.Planar)  # -> ListA, ListB
curving_surfaces = Surface(dispatch_2.ListB)
planar_surfaces = Surface(dispatch_2.ListA)
Z_2 = UnitZ(Factor=1)
align = AlignPlane(Plane=dispatch_3.ListA, Direction=Z_2)  # -> Plane, Angle
deplane = DeconstructPlane(Plane=align.Plane)  # -> Origin, XAxis, YAxis, ZAxis
angle = Angle(VectorA=deplane.XAxis, VectorB=Z_2)  # -> Angle, Reflex
larger = LargerThan(FirstNumber=angle.Angle, SecondNumber="0.01")  # -> LargerThan, OrEqualTo
pi = Pi(Factor=1)
dispatch_4 = Dispatch(List=planar_surfaces, DispatchPattern=larger.LargerThan)  # -> ListA, ListB
multiplication = Multiplication(A="0.5", B=pi)
dispatch_5 = Dispatch(List=angle.Angle, DispatchPattern=larger.LargerThan)  # -> ListA, ListB
non_vertical_surfaces = Surface(dispatch_4.ListA)

multiplication_2 = Multiplication(A=multiplication, B="10000")
multiplication_3 = Multiplication(A=dispatch_5.ListA, B="10000")
int = Integer(multiplication_3)
int_2 = Integer(multiplication_2)

equals_2 = Equality(FirstNumber=int, SecondNumber=int_2)  # -> Equality, Inequality

dispatch_6 = Dispatch(List=non_vertical_surfaces, DispatchPattern=equals_2.Equality)  # -> ListA, ListB

horizontal_surfaces = Surface(dispatch_6.ListA)
breps_to_mill_4 = Brep(clean)
graft_2 = GraftTree(Tree=breps_to_mill_4, IncludeEmptyLists=True, IncludeNullItems=True)
area = Area(Geometry=horizontal_surfaces)  # -> Area, Centroid
mesh = MeshBrep(
    Brep=graft_2,
    Settings={GridMaxCount=0, GridMinCount=16, JaggedSeams=False, MaxEdgeLength=0, MinEdgeLength=0.0001, MinTolerance=0, Refine=True, RefineAngle=0, RelativeTolerance=0.65, SimplePlanes=True, Tolerance=0})
srf_cp_2 = SurfaceClosestPoint(Point=area.Centroid, Surface=horizontal_surfaces)  # -> Point, UVPoint, Distance
vec2pt = Vector2Pt(PointA=area.Centroid, PointB=srf_cp_2.Point, Unitize=False)  # -> Vector, Length
addition = Addition(A=srf_cp_2.Distance, B="0.1")
amp = Amplitude(Vector=vec2pt.Vector, Amplitude=addition)
move = Move(Geometry=area.Centroid, Motion=amp)  # -> Geometry, Transform
meshcp = MeshClosestPoint(Point=move.Geometry, Mesh=mesh)  # -> Point, Index, Parameter
meval = MeshEval(Mesh=mesh, Parameter=meshcp.Parameter)  # -> Point, Normal, Colour
Z_3 = UnitZ(Factor=1)
angle_2 = Angle(VectorA=meval.Normal, VectorB=Z_3)  # -> Angle, Reflex
larger_2 = LargerThan(FirstNumber=angle_2.Angle, SecondNumber=multiplication)  # -> LargerThan, OrEqualTo
dispatch_7 = Dispatch(List=horizontal_surfaces, DispatchPattern=larger_2.LargerThan)  # -> ListA, ListB
upward_pointing_surfaces = Surface(dispatch_7.ListB)

downward_pointing_surfaces = Surface(dispatch_7.ListA)

upward_pointing_surfaces_2 = Surface(upward_pointing_surfaces)
planar_2 = IsPlanar(Surface=upward_pointing_surfaces_2, Interior=True)  # -> Planar, Plane
deplane_2 = DeconstructPlane(Plane=planar_2.Plane)  # -> Origin, XAxis, YAxis, ZAxis
pdecon_2 = Deconstruct(Point=deplane_2.Origin)  # -> XComponent, YComponent, ZComponent
multiplication_4 = Multiplication(A=pdecon_2.ZComponent, B="100")
int_3 = Integer(multiplication_4)
equals_3 = Equality(FirstNumber=int_3, SecondNumber="0")  # -> Equality, Inequality
dispatch_8 = Dispatch(List=upward_pointing_surfaces_2, DispatchPattern=equals_3.Equality)  # -> ListA, ListB
lower_surfaces = Surface(dispatch_8.ListB)

tolerance_2 = Panel(tolerance)
lovest_points_2 = Panel(lovest_points)
breps_to_mill_5 = Brep(clean)
non_vertical_surfaces_2 = Surface(non_vertical_surfaces)
custom_mesh_settings = SettingsCustom(
    StitchSeams=True,
    SimplePlanes=False,
    Refine=True,
    MinCount=16,
    MaxCount=400,
    AspectRatio=20,
    MaxDistance=tolerance_2,
    MaxAngle=20,
    MinEdge=0,
    MaxEdge=0)
smooth = SettingsQuality()
mesh_2 = MeshBrep(Brep=breps_to_mill_5, Settings=smooth)
mesh_3 = MeshBrep(Brep=breps_to_mill_5, Settings=custom_mesh_settings)
meshes_from_breps = Mesh(mesh_2)
xy = XYPlane(Origin=Point(0, 0, 0))
meshes_from_breps_2 = Mesh(mesh_3)
xy_2 = XYPlane(Origin=Point(0, 0, 0))
abs = Absolute(Value=lovest_points_2)
mshadow = MeshShadow(Mesh=meshes_from_breps, Light=Vector(0, 0, -1), Plane=xy)
mshadow_2 = MeshShadow(Mesh=meshes_from_breps_2, Light=Vector(0, 0, -1), Plane=xy_2)
join = JoinCurves(Curves=mshadow, Preserve=False)
join_2 = JoinCurves(Curves=mshadow_2, Preserve=False)
area_2 = Area(Geometry=join)  # -> Area, Centroid
area_3 = Area(Geometry=join_2)  # -> Area, Centroid
smaller = SmallerThan(FirstNumber=area_3.Area, SecondNumber=area_2.Area)  # -> SmallerThan, OrEqualTo
p_n_c = PickNChoose(Pattern=smaller.SmallerThan, Stream0=join_2, Stream1=join)
simplify_2 = SimplifyTree(Tree=p_n_c, Front=False)
master_shadow_curve = Curve(simplify_2)

master_shadow_curve_2 = Curve(master_shadow_curve)
flatten = FlattenTree(Tree=master_shadow_curve_2, Path="{0}")
null = NullItem(Item=flatten)  # -> NullFlags, InvalidFlags, Description
filter = StreamFilter(Gate=null.NullFlags, Stream0=master_shadow_curve_2, Stream1=mshadow)
master_shadow_curve_3 = Curve(filter)

ma = MassAddition(Input=area_2.Area)  # -> Result, PartialResults
ma_2 = MassAddition(Input=area_3.Area)  # -> Result, PartialResults
smaller_2 = SmallerThan(FirstNumber=ma_2.Result, SecondNumber=ma.Result)  # -> SmallerThan, OrEqualTo
simplify_3 = SimplifyTree(Tree=smaller_2.SmallerThan, Front=False)
weave = Weave(Pattern=simplify_3, Stream0=graft(meshes_from_breps_2), Stream1=graft(meshes_from_breps), NullGaps=False)
flatten_2 = FlattenTree(Tree=weave, Path="{0}")
mjoin = MeshJoin(Meshes=flatten_2)
joined_mesh_mesh_from_breps = Mesh(mjoin)

curving_surfaces_2 = Surface(curving_surfaces)
slanted_surfaces = Surface(dispatch_6.ListB)
merge = Merge(Data1=flatten(slanted_surfaces), Data2=flatten(curving_surfaces_2))
_3d_mill_surfaces = Surface(reparameterize(merge))
collision_detect_mesh = Mesh(joined_mesh_mesh_from_breps)
collision_detect_mesh_2 = ClusterOutput(collision_detect_mesh)
_3d_mill_surfaces_2 = ClusterOutput(_3d_mill_surfaces)

lower_surfaces_2 = Surface(dispatch_8.ListB)
edges = BrepEdges(Brep=lower_surfaces_2)  # -> Naked, Interior, NonManifold
join_3 = JoinCurves(Curves=edges.Naked, Preserve=False)
pshift_2 = ShiftPaths(Data=join_3, Offset=-1)
pshift_3 = ShiftPaths(Data=pshift_2, Offset=-1)
clean_2 = CleanTree(RemoveNulls=True, RemoveInvalid=True, RemoveEmpty=Toggle(True), Tree=pshift_3)
pocket_curves = Curve(clean_2)
xy_3 = XYPlane(Origin=Point(0, 0, 0))

pocket_curves_2 = Curve(pocket_curves)  # disabled
offset = Offset(Curve=pocket_curves_2, Distance=neg, Plane=PlaneXY(0, 0, 0), Corners=1)
pshift_4 = ShiftPaths(Data=offset, Offset=-1)
boundary = BoundarySurfaces(Edges=pshift_4)
move_2 = Move(Geometry=boundary, Motion=Z)  # -> Geometry, Transform
trim = TrimSolid(Shape=move_2.Geometry, Cutters=breps_to_mill_3)
srf = Surface(trim)
move_3 = Move(Geometry=srf, Motion=neg_2)  # -> Geometry, Transform
pocket_surfaces = Surface(move_3.Geometry)
pocket_surfaces_2 = Surface(pocket_surfaces)
sdivide_2 = DivideSurface(Surface=pocket_surfaces_2, UCount=10, VCount=10)  # -> Points, Normals, Parameters
extended_pocket_curves = Curve(reparameterize(pocket_curves))
pline = PolyLine(Vertices=sdivide_2.Points, Closed=False)
wires = BrepWireframe(Brep=pocket_surfaces_2, Density=-1)
join_4 = JoinCurves(Curves=wires, Preserve=False)
offset_2 = Offset(Curve=join_4, Distance=bit_diameter_2, Plane=PlaneXY(0, 0, 0), Corners=1)

graft_3 = GraftTree(Tree=abs, IncludeEmptyLists=True, IncludeNullItems=True)
lng = ListLength(List=master_shadow_curve_3)
pshift_5 = ShiftPaths(Data=lng, Offset=-1)
pshift_6 = ShiftPaths(Data=pshift_5, Offset=-1)
redpline = Reduce(Polyline=master_shadow_curve_3, Tolerance=tolerance_2)  # -> Polyline, Reduction
extra_cut_depth_2 = Panel(extra_cut_depth)
flatten_3 = FlattenTree(Tree=redpline.Polyline, Path="{0}")
cutout_curves = Curve(flatten_3)

simplify_4 = SimplifyTree(Tree=graft_3, Front=False)

dup = DuplicateData(Data=simplify_4, Number=lng, Order=True)
cut_depths = Panel(dup)
addition_2 = Addition(A=cut_depths, B=extra_cut_depth_2)
flatten_4 = FlattenTree(Tree=addition_2, Path="{0}")
item_2 = ListItem(List=cut_depths, Index=0, Wrap=True)
cut_depths_with_margin = Panel(flatten_4)
null_2 = NullItem(Item=item_2)  # -> NullFlags, InvalidFlags, Description
filter_2 = StreamFilter(Gate=null_2.NullFlags, Stream0=cut_depths_with_margin, Stream1=cut_depths)

cutout_curves_2 = Curve(cutout_curves)
cutout_depths = Number(filter_2)
cutout_depths_2 = ClusterOutput(cutout_depths)
cutout_curves_3 = ClusterOutput(cutout_curves_2)

end_2 = EndPoints(Curve=extended_pocket_curves)  # -> Start, End
pdecon_3 = Deconstruct(Point=end_2.Start)  # -> XComponent, YComponent, ZComponent
abs_2 = Absolute(Value=pdecon_3.ZComponent)
project = Project(Geometry=extended_pocket_curves, Plane=xy_3)  # -> Geometry, Transform
flatten_5 = FlattenTree(Tree=project.Geometry, Path="{0}")
clean_3 = CleanTree(RemoveNulls=True, RemoveInvalid=True, RemoveEmpty=False, Tree=flatten_5)
pocket_curves_3 = Curve(clean_3)

clean_4 = CleanTree(RemoveNulls=True, RemoveInvalid=True, RemoveEmpty=False, Tree=abs_2)

pocket_depths = Panel(clean_4)

flatten_6 = FlattenTree(Tree=pocket_depths, Path="{0}")
pocket_depths_2 = Panel(flatten_6)
pocket_curves_4 = Curve(pocket_curves_3)
pocket_depths_3 = Number(pocket_depths_2)
pocket_curves_5 = ClusterOutput(pocket_curves_4)
pocket_depths_4 = ClusterOutput(pocket_depths_3)

# ==== cluster Surface3DMill: Extracts iso-curves from a surface to create evenly spaced toolpaths. A great companion with the automill function. Note: Collision detection makes long calculation time for big objects.
prioritize_fastest_milling_direction = ClusterInput()
surfaces_for_3d_mill = ClusterInput()
collision_mesh = ClusterInput()
milling_bit_diameter = ClusterInput()
stepover = ClusterInput()
overshoot_margin_mm = ClusterInput()
make_horizontal_toolpaths = ClusterInput()
include_surface_edges = ClusterInput()
use_ballnose_for_3d_milling = ClusterInput()
connect_toolpaths_levels = ClusterInput()
tolerance = ClusterInput()
skip_collision_detection = ClusterInput()
prioritize_fastest_milling_direction_2 = Boolean(prioritize_fastest_milling_direction)
skip_collision_detection_2 = Boolean(skip_collision_detection)
overshoot_margin_mm_2 = Number(overshoot_margin_mm)
make_horizontal_toolpaths_2 = Boolean(make_horizontal_toolpaths)
use_ballnose_for_3d_milling_2 = Boolean(use_ballnose_for_3d_milling)
connect_toolpaths_levels_2 = Boolean(connect_toolpaths_levels)
include_surface_edges_2 = Boolean(include_surface_edges)
milling_bit_diameter_2 = Number(milling_bit_diameter)
stepover_2 = Number(stepover)
tolerance_2 = Number(tolerance)
surfaces_for_3d_mill_2 = Surface(surfaces_for_3d_mill)
collision_mesh_2 = Mesh(collision_mesh)
prioritize_fastest_milling_direction_3 = Panel(prioritize_fastest_milling_direction_2)
make_horizontal_toolpaths_3 = Panel(make_horizontal_toolpaths_2)
connect_toolpaths_levels_3 = Panel(connect_toolpaths_levels_2)
include_surface_edges_3 = Panel(include_surface_edges_2)
use_ballnose_for_3d_milling_3 = Panel(use_ballnose_for_3d_milling_2)
skip_collision_detection_3 = Panel(skip_collision_detection_2)
tolerance_3 = Panel(tolerance_2)
overshoot_margin_mm_3 = Panel(overshoot_margin_mm_2)
millling_bit_diameter = Panel(milling_bit_diameter_2)
stepover_3 = Panel(stepover_2)
connect_toolpath_tolerance_factor = Panel("4")
number_of_iso_curve_samples = Panel("20")
flatten = FlattenTree(Tree=collision_mesh_2, Path="{0}")
mjoin = MeshJoin(Meshes=flatten)
multiplication = Multiplication(A=millling_bit_diameter, B=stepover_3)
stepover_distance = Panel(multiplication)
multiplication_2 = Multiplication(A=millling_bit_diameter, B="0.5")
millling_bit_radius = Panel(multiplication_2)
srf = Surface(surfaces_for_3d_mill_2)
stepover_distance_2 = Panel(stepover_distance)
stepover_distance_3 = Panel(stepover_distance)
prioritize_fastest_milling_direction_4 = Panel(prioritize_fastest_milling_direction_3)
use_ballnose_for_3d_milling_4 = Panel(use_ballnose_for_3d_milling_3)
use_ballnose_for_3d_milling_5 = Panel(use_ballnose_for_3d_milling_3)
panel = Panel("1")  # disabled

# ---- group: Rebuild planar surfaces to help make horizontal milling diractions
flatten_2 = FlattenTree(Tree=surfaces_for_3d_mill_2, Path="{0}")  # disabled
planar = IsPlanar(Surface=flatten_2, Interior=True)  # -> Planar, Plane
dispatch = Dispatch(List=flatten_2, DispatchPattern=planar.Planar)  # -> ListA, ListB
edges = BrepEdges(Brep=dispatch.ListA)  # -> Naked, Interior, NonManifold
boundary = BoundarySurfaces(Edges=edges.Naked)
pshift = ShiftPaths(Data=boundary, Offset=-1)
srf_2 = Surface(flatten_2)
weave = Weave(Pattern=planar.Planar, Stream0=dispatch.ListB, Stream1=srf_2, NullGaps=False)

# ----
srf_3 = Surface(pshift)
area = Area(Geometry=srf_3)  # -> Area, Centroid
srf_cp = SurfaceClosestPoint(Point=area.Centroid, Surface=srf_3)  # -> Point, UVPoint, Distance
evalsrf = EvaluateSurface(Surface=srf_3, Point=srf_cp.UVPoint)  # -> Point, Normal, Frame
amp = Amplitude(Vector=evalsrf.Normal, Amplitude=Slider(1, range=0..1))
move = Move(Geometry=evalsrf.Point, Motion=amp)  # -> Geometry, Transform
pdecon = Deconstruct(Point=evalsrf.Point)  # -> XComponent, YComponent, ZComponent
pdecon_2 = Deconstruct(Point=move.Geometry)  # -> XComponent, YComponent, ZComponent
smaller = SmallerThan(FirstNumber=pdecon_2.ZComponent, SecondNumber=pdecon.ZComponent)  # -> SmallerThan, OrEqualTo
dispatch_2 = Dispatch(List=srf_3, DispatchPattern=smaller.SmallerThan)  # -> ListA, ListB
flip = Flip(Surface=dispatch_2.ListA)  # -> Surface, Result
weave_2 = Weave(Pattern=smaller.SmallerThan, Stream0=dispatch_2.ListB, Stream1=flip.Surface, NullGaps=False)

# ---- group: Rebuild planar surfaces to help make horizontal milling diractions (continued)
srf_4 = Surface(weave_2)

# ---- group: Surface isocurve extraction
surfaces_for_3d_mill_3 = Surface(reparameterize(srf))
number_of_iso_curve_samples_2 = Panel(number_of_iso_curve_samples)
collision_mesh_3 = Mesh(mjoin)
make_horizontal_isocurves = Panel(make_horizontal_toolpaths_3)
include_surface_edges_boolean = Panel(include_surface_edges_3)
untrim = Untrim(Surface=surfaces_for_3d_mill_3)
surfaces_for_isocurve_extraction = Surface(untrim)
panel_2 = Panel(number_of_iso_curve_samples_2)
subtraction = Subtraction(A="1", B="0.01")
subtraction_2 = Subtraction(A=subtraction, B="0.01")
subtraction_3 = Subtraction(A=panel_2, B="1")
division = Division(A=subtraction_2, B=subtraction_3)
series = Series(Start="0.01", Step=division, Count=panel_2)
pt = ConstructPoint(XCoordinate=series, YCoordinate=series, ZCoordinate=0)
iso = IsoCurve(Surface=surfaces_for_isocurve_extraction, UVPoint=graft(pt))  # -> UIsocurve, VIsocurve
pshift_2 = ShiftPaths(Data=iso.VIsocurve, Offset=-1)
pshift_3 = ShiftPaths(Data=iso.UIsocurve, Offset=-1)
flip_2 = FlipMatrix(Data=pshift_2)
flip_3 = FlipMatrix(Data=pshift_3)
bbox = BoundingBox(Content=flip_3, Plane=PlaneXY(0, 0, 0))  # -> Box, Box_2
bbox_2 = BoundingBox(Content=flip_2, Plane=PlaneXY(0, 0, 0))  # -> Box, Box_2
debox = DeconstructBox(Box=bbox.Box)  # -> Plane, X, Y, Z
debox_2 = DeconstructBox(Box=bbox_2.Box)  # -> Plane, X, Y, Z
dedomain = DeconstructDomain(Domain=debox.Z)  # -> Start, End
dedomain_2 = DeconstructDomain(Domain=debox_2.Z)  # -> Start, End
pt_2 = ConstructPoint(XCoordinate=0, YCoordinate=0, ZCoordinate=dedomain.End)
pt_3 = ConstructPoint(XCoordinate=0, YCoordinate=0, ZCoordinate=dedomain.Start)
pt_4 = ConstructPoint(XCoordinate=0, YCoordinate=0, ZCoordinate=dedomain_2.End)
pt_5 = ConstructPoint(XCoordinate=0, YCoordinate=0, ZCoordinate=dedomain_2.Start)
ln = Line(StartPoint=pt_3, EndPoint=pt_2)
ln_2 = Line(StartPoint=pt_5, EndPoint=pt_4)
len = Length(Curve=ln)
len_2 = Length(Curve=ln_2)
avr = Average(Input=len)
avr_2 = Average(Input=len_2)
larger = LargerThan(FirstNumber=avr, SecondNumber=avr_2)  # -> LargerThan, OrEqualTo
make_horizontal_isocurves_boolean = Boolean(make_horizontal_isocurves)
stepover_distance_4 = Panel(stepover_distance)  # disabled
panel_3 = Panel("1")  # disabled
panel_4 = Panel("1")  # disabled
surfaces_for_3d_mill_4 = Surface(reparameterize(surfaces_for_3d_mill_3))
edges_2 = BrepEdges(Brep=surfaces_for_3d_mill_4)  # -> Naked, Interior, NonManifold
crv = Curve([edges_2.Naked, edges_2.Interior])
include_surface_edges_boolean_2 = Panel(include_surface_edges_boolean)

# ----
bbox_3 = BoundingBox(Content=collision_mesh_3, Plane=PlaneXY(0, 0, 0))  # -> Box, Box_2
debrep = DeconstructBrep(Brep=bbox_3.Box)  # -> Faces, Edges, Vertices
item = ListItem(List=debrep.Edges, Index="8", Wrap=True)
pshift_4 = ShiftPaths(Data=item, Offset=-1)
len_3 = Length(Curve=pshift_4)
object_height = Panel(len_3)

u_or_v_boolean = Boolean(larger.LargerThan)
suirify = Suirify(crv)

# ---- group: Surface isocurve extraction (continued)
not = GateNot(A=u_or_v_boolean)
filter = StreamFilter(Gate=make_horizontal_isocurves_boolean, Stream0=u_or_v_boolean, Stream1=not)
u_or_v_slice_booleans = Panel(filter)
weave_3 = Weave(Pattern=u_or_v_slice_booleans, Stream0=flip_3, Stream1=flip_2, NullGaps=False)
simplify = SimplifyTree(Tree=weave_3, Front=False)
crv_2 = Curve(simplify)
len_4 = Length(Curve=crv_2)  # disabled
u_or_v_slice_booleans_2 = Panel(u_or_v_slice_booleans)
simplify_2 = SimplifyTree(Tree=u_or_v_slice_booleans_2, Front=False)

avr_3 = Average(Input=len_4)  # disabled
division_2 = Division(A=len_4, B=avr_3)  # disabled
sort = SortList(Keys=division_2)  # -> Keys, ValuesA; disabled
rev = ReverseList(List=sort.Keys)  # disabled
item_2 = ListItem(List=rev, Index=0, Wrap=True)  # disabled
division_3 = Division(A=division_2, B=item_2)  # disabled
graph = GraphMapper(division_3, x0=0, x1=1, y0=0, y1=1, container_name="Bezier", cpx=[0, 0, 0, 1], cpy=[0, 1, 1, 1])  # disabled
multiplication_3 = Multiplication(A=graph, B=item_2)  # disabled
multiplication_4 = Multiplication(A=avr_3, B=multiplication_3)  # disabled
avr_4 = Average(Input=multiplication_4)  # disabled

# ---- group: New take on geting better iso curve distribution
stepover_distance_5 = Panel(stepover_distance)
sampled_isocurves = Curve(simplify)
surfaces_for_3d_mill_5 = Surface(reparameterize(surfaces_for_3d_mill_3))
len_5 = Length(Curve=sampled_isocurves)
sort_2 = SortList(Keys=len_5, ValuesA=sampled_isocurves)  # -> Keys, ValuesA
rev_2 = ReverseList(List=sort_2.ValuesA)
item_3 = ListItem(List=rev_2, Index=0, Wrap=True)
divlength = DivideLength(Curve=item_3, Length=stepover_distance_5)  # -> Points, Tangents, Parameters
graft = GraftTree(Tree=surfaces_for_3d_mill_5, IncludeEmptyLists=True, IncludeNullItems=True)
suirify_2 = Suirify(graft)
suirify_3 = Suirify(divlength.Points)
srf_cp_2 = SurfaceClosestPoint(Point=suirify_3, Surface=suirify_2)  # -> Point, UVPoint, Distance
iso_2 = IsoCurve(Surface=suirify_2, UVPoint=srf_cp_2.UVPoint)  # -> UIsocurve, VIsocurve

# ----
not_2 = GateNot(A=filter)
u_or_v_slice_booleans_3 = Panel(not_2)
weave_4 = Weave(Pattern=u_or_v_slice_booleans_3, Stream0=flip_3, Stream1=flip_2, NullGaps=False)
simplify_3 = SimplifyTree(Tree=weave_4, Front=False)
crv_3 = Curve(simplify_3)
len_6 = Length(Curve=crv_3)  # disabled
stepover_distance_6 = Panel(stepover_distance)  # disabled
panel_5 = Panel("1")  # disabled
panel_6 = Panel("1")  # disabled
surfaces_for_3d_mill_6 = Surface(reparameterize(surfaces_for_3d_mill_3))
u_or_v_slice_booleans_4 = Panel(u_or_v_slice_booleans_3)
edges_3 = BrepEdges(Brep=surfaces_for_3d_mill_6)  # -> Naked, Interior, NonManifold
crv_4 = Curve([edges_3.Naked, edges_3.Interior])
simplify_4 = SimplifyTree(Tree=u_or_v_slice_booleans_4, Front=False)
include_surface_edges_boolean_3 = Panel(include_surface_edges_boolean)

avr_5 = Average(Input=len_6)  # disabled
division_4 = Division(A=len_6, B=avr_5)  # disabled
sort_3 = SortList(Keys=division_4)  # -> Keys, ValuesA; disabled
rev_3 = ReverseList(List=sort_3.Keys)  # disabled
item_4 = ListItem(List=rev_3, Index=0, Wrap=True)  # disabled
division_5 = Division(A=division_4, B=item_4)  # disabled
graph_2 = GraphMapper(division_5, x0=0, x1=1, y0=0, y1=1, container_name="Bezier", cpx=[0, 0, 0, 1], cpy=[0, 1, 1, 1])  # disabled
multiplication_5 = Multiplication(A=graph_2, B=item_4)  # disabled
multiplication_6 = Multiplication(A=avr_5, B=multiplication_5)  # disabled
avr_6 = Average(Input=multiplication_6)  # disabled

# ---- group: New take on geting better iso curve distribution
stepover_distance_7 = Panel(stepover_distance)
sampled_isocurves_2 = Curve(crv_3)
surfaces_for_3d_mill_7 = Surface(reparameterize(surfaces_for_3d_mill_3))
len_7 = Length(Curve=sampled_isocurves_2)
sort_4 = SortList(Keys=len_7, ValuesA=sampled_isocurves_2)  # -> Keys, ValuesA
rev_4 = ReverseList(List=sort_4.ValuesA)
item_5 = ListItem(List=rev_4, Index=0, Wrap=True)
divlength_2 = DivideLength(Curve=item_5, Length=stepover_distance_7)  # -> Points, Tangents, Parameters
graft_2 = GraftTree(Tree=surfaces_for_3d_mill_7, IncludeEmptyLists=True, IncludeNullItems=True)
suirify_4 = Suirify(graft_2)
suirify_5 = Suirify(divlength_2.Points)
srf_cp_3 = SurfaceClosestPoint(Point=suirify_5, Surface=suirify_4)  # -> Point, UVPoint, Distance
iso_3 = IsoCurve(Surface=suirify_4, UVPoint=srf_cp_3.UVPoint)  # -> UIsocurve, VIsocurve

# ----
suirify_6 = Suirify(crv_4)

base_lenghts_for_stepover_distance = Panel(avr_6)  # disabled
division_6 = Division(A=base_lenghts_for_stepover_distance, B=stepover_distance_6)  # disabled
round = Round(Number=division_6)  # -> Nearest, Floor, Ceiling; disabled
number_of_iscourves = Panel(round.Ceiling)  # disabled
panel_7 = Panel(number_of_iscourves)  # disabled
subtraction_4 = Subtraction(A=panel_7, B=panel_5)  # disabled
division_7 = Division(A=panel_6, B=subtraction_4)  # disabled
series_2 = Series(Start=0, Step=division_7, Count=panel_7)  # disabled
pt_6 = ConstructPoint(XCoordinate=series_2, YCoordinate=series_2, ZCoordinate=0)  # disabled
pshift_5 = ShiftPaths(Data=pt_6, Offset=-1)  # disabled
iso_4 = IsoCurve(Surface=graft(surfaces_for_3d_mill_6), UVPoint=pshift_5)  # -> UIsocurve, VIsocurve; disabled
pshift_6 = ShiftPaths(Data=iso_3.VIsocurve, Offset=-1)
pshift_7 = ShiftPaths(Data=iso_3.UIsocurve, Offset=-1)
weave_5 = Weave(Pattern=simplify_4, Stream0=pshift_6, Stream1=pshift_7, NullGaps=False)

suirify_7 = Suirify(weave_5)

merge = Merge(Data1=suirify_6, Data2=suirify_7)
filter_2 = StreamFilter(Gate=include_surface_edges_boolean_3, Stream0=suirify_7, Stream1=merge)
opposite_toolpaths_from_isocurves = Curve(filter_2)

# ---- group: Surface isocurve extraction (continued)
base_lenghts_for_stepover_distance_2 = Panel(avr_4)  # disabled
division_8 = Division(A=base_lenghts_for_stepover_distance_2, B=stepover_distance_4)  # disabled
round_2 = Round(Number=division_8)  # -> Nearest, Floor, Ceiling; disabled
number_of_iscourves_2 = Panel(round_2.Ceiling)  # disabled
panel_8 = Panel(number_of_iscourves_2)  # disabled
subtraction_5 = Subtraction(A=panel_8, B=panel_3)  # disabled
division_9 = Division(A=panel_4, B=subtraction_5)  # disabled
series_3 = Series(Start=0, Step=division_9, Count=panel_8)  # disabled
pt_7 = ConstructPoint(XCoordinate=series_3, YCoordinate=series_3, ZCoordinate=0)  # disabled
pshift_8 = ShiftPaths(Data=pt_7, Offset=-1)  # disabled
iso_5 = IsoCurve(Surface=graft(surfaces_for_3d_mill_4), UVPoint=pshift_8)  # -> UIsocurve, VIsocurve; disabled
pshift_9 = ShiftPaths(Data=iso_2.UIsocurve, Offset=-1)
pshift_10 = ShiftPaths(Data=iso_2.VIsocurve, Offset=-1)
weave_6 = Weave(Pattern=simplify_2, Stream0=pshift_10, Stream1=pshift_9, NullGaps=False)

# ----
suirify_8 = Suirify(weave_6)

# ---- group: Surface isocurve extraction (continued)
merge_2 = Merge(Data1=suirify, Data2=suirify_8)
filter_3 = StreamFilter(Gate=include_surface_edges_boolean_2, Stream0=suirify_8, Stream1=merge_2)
toolpaths_from_isocurves = Curve(filter_3)

# ----
toolpaths_from_isocurves_2 = Curve(toolpaths_from_isocurves)

# ---- group: Dicover fastest milling direction
opposite_toolpaths_from_isocurves_2 = Curve(reparameterize(opposite_toolpaths_from_isocurves))
toolpaths_from_isocurves_3 = Curve(reparameterize(filter_3))
len_8 = Length(Curve=toolpaths_from_isocurves_3)
len_9 = Length(Curve=opposite_toolpaths_from_isocurves_2)
ma = MassAddition(Input=len_8)  # -> Result, PartialResults
ma_2 = MassAddition(Input=len_9)  # -> Result, PartialResults
group = Group(Objects=opposite_toolpaths_from_isocurves_2)
group_2 = Group(Objects=toolpaths_from_isocurves_3)

# ----
lng = ListLength(List=toolpaths_from_isocurves_3)
lng_2 = ListLength(List=opposite_toolpaths_from_isocurves_2)
multiplication_7 = Multiplication(A=lng, B=stepover_distance_2)
multiplication_8 = Multiplication(A=lng_2, B=stepover_distance_3)
addition = Addition(A=ma_2.Result, B=multiplication_8)
addition_2 = Addition(A=ma.Result, B=multiplication_7)
lng_3 = ListLength(List=toolpaths_from_isocurves_3)
lng_4 = ListLength(List=opposite_toolpaths_from_isocurves_2)
larger_2 = LargerThan(FirstNumber=addition_2, SecondNumber=addition)  # -> LargerThan, OrEqualTo
larger_3 = LargerThan(FirstNumber=lng_3, SecondNumber=lng_4)  # -> LargerThan, OrEqualTo

# ---- group: Dicover fastest milling direction (continued)
p_n_c = PickNChoose(Pattern=larger_3.LargerThan, Stream0=group_2, Stream1=group)
ungroup = Ungroup(Group=p_n_c)
simplify_5 = SimplifyTree(Tree=ungroup, Front=False)
shortest_toolpaths_from_isocurves = Curve(simplify_5)

# ----
shortest_toolpaths_from_isocurves_2 = Curve(shortest_toolpaths_from_isocurves)
filter_4 = StreamFilter(
    Gate=prioritize_fastest_milling_direction_4,
    Stream0=toolpaths_from_isocurves_2,
    Stream1=shortest_toolpaths_from_isocurves_2)

# ---- group: Remove undercut points
surfaces_for_3d_mill_8 = Surface(reparameterize(surfaces_for_3d_mill_3))
toolpaths_from_isocurves_4 = Curve(filter_4)
tolerance_4 = Panel(tolerance_3)
topoly = CurveToPolyline(Curve=toolpaths_from_isocurves_4, ToleranceDistance=tolerance_4, ToleranceAngle=0)  # -> Polyline, Segments
surfaces_for_3d_mill_9 = Surface(reparameterize(surfaces_for_3d_mill_8))
cp = ControlPoints(Curve=topoly.Polyline)  # -> Points, Weights, Knots
pshift_11 = ShiftPaths(Data=cp.Points, Offset=-1)
srf_cp_4 = SurfaceClosestPoint(Point=pshift_11, Surface=graft(surfaces_for_3d_mill_9))  # -> Point, UVPoint, Distance
evalsrf_2 = EvaluateSurface(Surface=graft(surfaces_for_3d_mill_9), Point=srf_cp_4.UVPoint)  # -> Point, Normal, Frame
unflatten = UnflattenTree(Tree=evalsrf_2.Point, Guide=cp.Points)
unflatten_2 = UnflattenTree(Tree=evalsrf_2.Normal, Guide=cp.Points)
amp_2 = Amplitude(Vector=unflatten_2, Amplitude="1")
move_2 = Move(Geometry=unflatten, Motion=amp_2)  # -> Geometry, Transform
pt_8 = Point(unflatten)
neg = Negative(Value="0.0001")
Z = UnitZ(Factor=neg)
move_3 = Move(Geometry=move_2.Geometry, Motion=Z)  # -> Geometry, Transform
pt_9 = Point(unflatten)
pdecon_3 = Deconstruct(Point=move_3.Geometry)  # -> XComponent, YComponent, ZComponent
pdecon_4 = Deconstruct(Point=pt_8)  # -> XComponent, YComponent, ZComponent
smaller_2 = SmallerThan(FirstNumber=pdecon_3.ZComponent, SecondNumber=pdecon_4.ZComponent)  # -> SmallerThan, OrEqualTo
dispatch_3 = Dispatch(List=pt_9, DispatchPattern=smaller_2.OrEqualTo)  # -> ListA, ListB
dispatch_4 = Dispatch(List=amp_2, DispatchPattern=smaller_2.OrEqualTo)  # -> ListA, ListB
undercut_free_points = Point(dispatch_3.ListB)
point_normals = Vector(dispatch_4.ListB)

# ----
undercut_free_points_2 = Point(dispatch_3.ListB)
point_normals_2 = Vector(dispatch_4.ListB)
undercut_free_points_3 = Point(undercut_free_points_2)
point_normals_3 = Vector(point_normals_2)
gate = StreamGate(Stream=point_normals_3, Gate=use_ballnose_for_3d_milling_4)  # -> Target0, Target1
gate_2 = StreamGate(Stream=undercut_free_points_3, Gate=use_ballnose_for_3d_milling_4)  # -> Target0, Target1

# ---- group: Offset compenstate with end mill radius
millling_bit_radius_2 = Panel(millling_bit_radius)
undercut_free_points_4 = Point(gate_2.Target0)
point_normals_4 = Vector(gate.Target0)
move_4 = Move(Geometry=undercut_free_points_4, Motion=point_normals_4)  # -> Geometry, Transform
xy = XYPlane(Origin=Point(0, 0, 0))
project = Project(Geometry=move_4.Geometry, Plane=xy)  # -> Geometry, Transform
project_2 = Project(Geometry=undercut_free_points_4, Plane=xy)  # -> Geometry, Transform
ln_3 = Line(StartPoint=project_2.Geometry, EndPoint=project.Geometry)
len_10 = Length(Curve=ln_3)
vec2pt = Vector2Pt(PointA=project_2.Geometry, PointB=project.Geometry, Unitize=False)  # -> Vector, Length
smaller_3 = SmallerThan(FirstNumber=len_10, SecondNumber="0.001")  # -> SmallerThan, OrEqualTo
millling_bit_radius_3 = Panel(millling_bit_radius_2)
dispatch_5 = Dispatch(List=undercut_free_points_4, DispatchPattern=smaller_3.SmallerThan)  # -> ListA, ListB
dispatch_6 = Dispatch(List=vec2pt.Vector, DispatchPattern=smaller_3.SmallerThan)  # -> ListA, ListB
top_points = Point(dispatch_5.ListA)
side_points = Point(dispatch_5.ListB)
amp_3 = Amplitude(Vector=dispatch_6.ListB, Amplitude=millling_bit_radius_3)
move_5 = Move(Geometry=side_points, Motion=amp_3)  # -> Geometry, Transform
end_mill_compensated_points = Point(move_5.Geometry)

# ----
end_mill_compensated_points_2 = Point(end_mill_compensated_points)

# ---- group: Offset compensate with ball nose radius
millling_bit_radius_4 = Panel(millling_bit_radius)
undercut_free_points_5 = Point(gate_2.Target1)
point_normals_5 = Vector(gate.Target1)
amp_4 = Amplitude(Vector=point_normals_5, Amplitude=millling_bit_radius_4)
move_6 = Move(Geometry=undercut_free_points_5, Motion=amp_4)  # -> Geometry, Transform
neg_2 = Negative(Value=millling_bit_radius_4)
Z_2 = UnitZ(Factor=neg_2)

# ----
move_7 = Move(Geometry=move_6.Geometry, Motion=Z_2)  # -> Geometry, Transform

# ---- group: Offset compensate with ball nose radius (continued)
ball_nose_compensated_points = Point(move_7.Geometry)

# ----
ball_nose_compensated_points_2 = Point(ball_nose_compensated_points)
filter_5 = StreamFilter(Gate=use_ballnose_for_3d_milling_5, Stream0=end_mill_compensated_points_2, Stream1=ball_nose_compensated_points_2)

# ---- group: Overshoot extend toolpaths
# Bug:
# Polyline sometimes intersects with object
toolpath_points_for_overshoot = Point(filter_5)
overshoot_margin = Panel(overshoot_margin_mm_3)
pline = PolyLine(Vertices=toolpath_points_for_overshoot, Closed=False)
ext = ExtendCurve(Curve=pline, Type=0, Start=overshoot_margin, End=overshoot_margin)
simplify_6 = SimplifyTree(Tree=ext, Front=False)
extended_toolpaths = Curve(simplify_6)

# ---- group: Check toolpaths for air miling (necessary in case of allowing toolpath points from the 90deg side on a surface)
toolpaths_to_check_for_air_milling = Curve(extended_toolpaths)
planar_2 = Planar(Curve=toolpaths_to_check_for_air_milling)  # -> Planar, Plane, Deviation
deplane = DeconstructPlane(Plane=planar_2.Plane)  # -> Origin, XAxis, YAxis, ZAxis
Z_3 = UnitZ(Factor=1)
pdecon_5 = Deconstruct(Point=deplane.Origin)  # -> XComponent, YComponent, ZComponent
angle = Angle(VectorA=deplane.ZAxis, VectorB=Z_3)  # -> Angle, Reflex
multiplication_9 = Multiplication(A=pdecon_5.ZComponent, B="1000")
round_3 = Round(Number=multiplication_9)  # -> Nearest, Floor, Ceiling
equals = Equality(FirstNumber=angle.Angle, SecondNumber="0.0")  # -> Equality, Inequality
equals_2 = Equality(FirstNumber=round_3.Nearest, SecondNumber="0.0")  # -> Equality, Inequality
and = GateAnd(A=equals_2.Equality, B=equals.Equality)
dispatch_7 = Dispatch(List=toolpaths_to_check_for_air_milling, DispatchPattern=and)  # -> ListA, ListB
toolpaths_checked_for_air_milling = Curve(dispatch_7.ListB)

# ---- group: Filter whether to collsion check or not (collision checking is takes a long time)
skip_collision_detection_4 = Panel(skip_collision_detection_3)
gate_3 = StreamGate(Stream=toolpaths_checked_for_air_milling, Gate=skip_collision_detection_4)  # -> Target0, Target1

# ---- group: Collision correct toolpaths
millling_bit_radius_5 = Panel(millling_bit_radius)
use_ballnose_for_3d_milling_6 = Panel(use_ballnose_for_3d_milling_3)
collsion_mesh_tolerance_factor = Panel("0.5")
object_height_2 = Panel(object_height)
toolpath_subdivide_factor = Panel("0.2")
tolerance_5 = Panel(tolerance_3)
make_horizontal_isocurves_boolean_2 = Boolean(make_horizontal_isocurves)
meshes_from_breps = Mesh(collision_mesh_3)
toolpaths = Curve(gate_3.Target0)
mjoin_2 = MeshJoin(Meshes=flatten(meshes_from_breps))
division_10 = Division(A=tolerance_5, B="1")
sort_5 = SortList(Keys=object_height_2)  # -> Keys, ValuesA
geometry_collision_detect_mesh = Mesh(mjoin_2)
xy_2 = XYPlane(Origin=Point(0, 0, 0))
rev_5 = ReverseList(List=sort_5.Keys)
multiplication_10 = Multiplication(A=millling_bit_radius_5, B=collsion_mesh_tolerance_factor)
item_6 = ListItem(List=rev_5, Index=0, Wrap=True)
panel_9 = Panel("0.01")
Z_4 = UnitZ(Factor=item_6)
multiplication_11 = Multiplication(A=tolerance_5, B="6")
custom_mesh_settings = SettingsCustom(
    StitchSeams=True,
    SimplePlanes=False,
    Refine=True,
    MinCount=16,
    MaxCount=400,
    AspectRatio=20,
    MaxDistance=0,
    MaxAngle=20,
    MinEdge=multiplication_10,
    MaxEdge=0)
Z_5 = UnitZ(Factor=multiplication_11)
xy_3 = XYPlane(Origin=Point(0, 0, 0))
move_8 = Move(Geometry=toolpaths, Motion=Z_5)  # -> Geometry, Transform
multiplication_12 = Multiplication(A=millling_bit_radius_5, B=toolpath_subdivide_factor)
use_ballnose_for_3d_milling_7 = Panel(use_ballnose_for_3d_milling_6)
geometry_collision_detect_mesh_2 = Mesh(geometry_collision_detect_mesh)
xy_4 = XYPlane(Origin=Point(0, 0, 0))
neg_3 = Negative(Value=multiplication_11)
Z_6 = UnitZ(Factor=neg_3)
tolerance_6 = Panel(tolerance_5)

# ----
multiplication_13 = Multiplication(A=tolerance_5, B="10")
subtraction_6 = Subtraction(A=millling_bit_radius_5, B=multiplication_13)
len_11 = Length(Curve=move_8.Geometry)  # disabled
division_11 = Division(A=len_11, B=multiplication_12)  # disabled
round_4 = Round(Number=division_11)  # -> Nearest, Floor, Ceiling; disabled
addition_3 = Addition(A=round_4.Ceiling, B=panel)  # disabled
division_12 = Division(A=len_11, B=round_4.Ceiling)  # disabled
series_4 = Series(Start=0, Step=division_12, Count=addition_3)  # disabled

# ---- group: Attempt to do better sample point division
divlength_3 = DivideLength(Curve=move_8.Geometry, Length=multiplication_12)  # -> Points, Tangents, Parameters
end = EndPoints(Curve=move_8.Geometry)  # -> Start, End
suirify_9 = Suirify(end.End)
suirify_10 = Suirify(divlength_3.Points)
merge_3 = Merge(Data1=suirify_10, Data2=suirify_9)

# ----
eval = EvaluateLength(Curve=move_8.Geometry, Length=series_4, Normalized=False)  # -> Point, Tangent, Parameter; disabled
toolpath_points_for_collsion_detect = Point(merge_3)
make_horizontal_isocurves_boolean_3 = Boolean(make_horizontal_isocurves_boolean_2)
make_horizontal_isocurves_boolean_4 = Boolean(make_horizontal_isocurves_boolean_2)

# ---- group: Collision correct toolpaths (continued)
cir = Circle(Plane=xy_2, Radius=subtraction_6)
extr = Extrude(Base=cir, Direction=Z_4)
cap = CapHoles(Brep=extr)
sph = Sphere(Base=xy_3, Radius=subtraction_6)
sunion = SolidUnion(Breps=flatten([sph, cap]))
Z_7 = UnitZ(Factor=subtraction_6)
move_9 = Move(Geometry=sunion, Motion=Z_7)  # -> Geometry, Transform
filter_6 = StreamFilter(Gate=use_ballnose_for_3d_milling_7, Stream0=extr, Stream1=move_9.Geometry)
mesh = MeshBrep(Brep=filter_6, Settings=custom_mesh_settings)
bit_collison_detection_mesh = Mesh(mesh)
xy_5 = XYPlane(Origin=toolpath_points_for_collsion_detect)
orient = Orient(Geometry=bit_collison_detection_mesh, Source=xy_4, Target=xy_5)  # -> Geometry, Transform
colom = CollisionOneMany(Collider=orient.Geometry, Obstacles=geometry_collision_detect_mesh_2)  # -> Collision, Index
dispatch_8 = Dispatch(List=toolpath_points_for_collsion_detect, DispatchPattern=colom.Collision)  # -> ListA, ListB
move_10 = Move(Geometry=dispatch_8.ListB, Motion=Z_6)  # -> Geometry, Transform

# ---- group: Detect breaks from collsion and create disconnected polylines
toolpath_points_for_collsion_detect_2 = Point(toolpath_points_for_collsion_detect)
collsion_results = Boolean(colom.Collision)
lng_5 = ListLength(List=toolpath_points_for_collsion_detect_2)
series_5 = Series(Start=0, Step=1, Count=lng_5)
pt_10 = ConstructPoint(XCoordinate=series_5, YCoordinate=0, ZCoordinate=0)
dispatch_9 = Dispatch(List=toolpath_points_for_collsion_detect_2, DispatchPattern=collsion_results)  # -> ListA, ListB
X = UnitX(Factor="0.5")
dispatch_10 = Dispatch(List=pt_10, DispatchPattern=collsion_results)  # -> ListA, ListB
Y = UnitY(Factor="0.5")
pline_2 = PolyLine(Vertices=dispatch_9.ListB, Closed=False)
pt_11 = Point(dispatch_9.ListA)
pline_3 = PolyLine(Vertices=dispatch_10.ListB, Closed=False)
move_11 = Move(Geometry=dispatch_10.ListA, Motion=X)  # -> Geometry, Transform
explode = Explode(Curve=pline_2, Recursive=True)  # -> Segments, Vertices
explode_2 = Explode(Curve=pline_3, Recursive=True)  # -> Segments, Vertices
neg_4 = Negative(Value=Y)
move_12 = Move(Geometry=move_11.Geometry, Motion=Y)  # -> Geometry, Transform
move_13 = Move(Geometry=move_11.Geometry, Motion=neg_4)  # -> Geometry, Transform
ln_4 = Line(StartPoint=move_12.Geometry, EndPoint=move_13.Geometry)
colom_2 = CollisionOneMany(Collider=explode_2.Segments, Obstacles=ln_4)  # -> Collision, Index
dispatch_11 = Dispatch(List=explode.Segments, DispatchPattern=colom_2.Collision)  # -> ListA, ListB
crv_5 = Curve(dispatch_11.ListB)
join = JoinCurves(Curves=crv_5, Preserve=Toggle(True))
collsion_free_toolpaths = Curve(join)

# ----
gate_4 = StreamGate(Stream=move_10.Geometry, Gate=make_horizontal_isocurves_boolean_3)  # -> Target0, Target1
collsion_free_toolpaths_2 = Curve(collsion_free_toolpaths)
pline_4 = PolyLine(Vertices=gate_4.Target1, Closed=False)
move_14 = Move(Geometry=collsion_free_toolpaths_2, Motion=Z_6)  # -> Geometry, Transform

# ---- group: Collision correct toolpaths (continued)
pline_5 = PolyLine(Vertices=gate_4.Target0, Closed=False)
redpline = Reduce(Polyline=move_14.Geometry, Tolerance=tolerance_6)  # -> Polyline, Reduction
collision_corrected_toolpaths = Curve(redpline.Polyline)

# ----
filter_7 = StreamFilter(Gate=make_horizontal_isocurves_boolean_4, Stream0=pline_5, Stream1=pline_4)

# ---- group: Pick non colllsion checked toolpaths if chosen
skip_collision_detection_5 = Panel(skip_collision_detection_3)
filter_8 = StreamFilter(Gate=skip_collision_detection_5, Stream0=collision_corrected_toolpaths, Stream1=gate_3.Target1)

# ---- group: Filter if toolpaths are to be woven
connect_toolpaths_levels_booloean = Boolean(connect_toolpaths_levels_3)
gate_5 = StreamGate(Stream=filter_8, Gate=connect_toolpaths_levels_booloean)  # -> Target0, Target1

# ---- group: Weave toolpaths
toolpaths_to_weave = Curve(gate_5.Target1)
simplify_7 = SimplifyTree(Tree=toolpaths_to_weave, Front=False)
pshift_12 = ShiftPaths(Data=simplify_7, Offset=-1)
flatten_3 = FlattenTree(Tree=simplify_7, Path="{0}")
flatten_4 = FlattenTree(Tree=pshift_12, Path="{0}")
lng_6 = ListLength(List=srf)
item_7 = ListItem(List=flatten_4, Index=0, Wrap=True)
null = NullItem(Item=item_7)  # -> NullFlags, InvalidFlags, Description
smaller_4 = SmallerThan(FirstNumber=lng_6, SecondNumber="2")  # -> SmallerThan, OrEqualTo
filter_9 = StreamFilter(Gate=null.NullFlags, Stream0=pshift_12, Stream1=flatten_3)
filter_10 = StreamFilter(Gate=smaller_4.SmallerThan, Stream0=filter_9, Stream1=flatten_3)
dispatch_12 = Dispatch(List=filter_10, DispatchPattern=[True, False])  # -> ListA, ListB
flip_4 = FlipCurve(Curve=dispatch_12.ListB)  # -> Curve, Flag
weave_7 = Weave(Pattern=[0, 1], Stream0=dispatch_12.ListA, Stream1=flip_4.Curve, NullGaps=False)
simplify_8 = SimplifyTree(Tree=weave_7, Front=False)
woven_toolpaths = Curve(simplify_8)

# ----
connect_toolpaths_levels_booloean_2 = Boolean(connect_toolpaths_levels_booloean)
non_woven_toolpaths = Curve(gate_5.Target0)

# ---- group: Create connection lines
stepover_distance_8 = Panel(stepover_distance)
toolpaths_to_connect = Curve(woven_toolpaths)
connect_toolpath_tolerance_factor_2 = Panel(connect_toolpath_tolerance_factor)
end_2 = EndPoints(Curve=toolpaths_to_connect)  # -> Start, End
shift = ShiftList(List=end_2.Start, Shift="1", Wrap=True)
multiplication_14 = Multiplication(A=stepover_distance_8, B=connect_toolpath_tolerance_factor_2)
ln_5 = Line(StartPoint=end_2.End, EndPoint=shift)
len_12 = Length(Curve=ln_5)
larger_4 = LargerThan(FirstNumber=len_12, SecondNumber=multiplication_14)  # -> LargerThan, OrEqualTo
lng_7 = ListLength(List=toolpaths_to_connect)
series_6 = Series(Start=0, Step=1, Count=lng_7)
dispatch_13 = Dispatch(List=series_6, DispatchPattern=larger_4.LargerThan)  # -> ListA, ListB
replace = ReplaceItems(List=ln_5, Indices=dispatch_13.ListA, Wrap=False)

# ---- group: Collision detect connection lines
connection_lines_to_collision_check = Curve(replace)
geometry_collision_detect_mesh_3 = Mesh(geometry_collision_detect_mesh)
bit_collison_detection_mesh_2 = Mesh(mesh)
eval_2 = EvaluateLength(Curve=connection_lines_to_collision_check, Length="0.5", Normalized=True)  # -> Point, Tangent, Parameter
xy_6 = XYPlane(Origin=eval_2.Point)
xy_7 = XYPlane(Origin=Point(0, 0, 0))
lng_8 = ListLength(List=toolpaths_to_connect)
orient_2 = Orient(Geometry=bit_collison_detection_mesh_2, Source=xy_7, Target=xy_6)  # -> Geometry, Transform
series_7 = Series(Start=0, Step=1, Count=lng_8)
colom_3 = CollisionOneMany(Collider=orient_2.Geometry, Obstacles=geometry_collision_detect_mesh_3)  # -> Collision, Index
dispatch_14 = Dispatch(List=series_7, DispatchPattern=colom_3.Collision)  # -> ListA, ListB
replace_2 = ReplaceItems(List=replace, Indices=dispatch_14.ListA, Wrap=False)

# ---- group: Create connection lines (continued)
weave_8 = Weave(Pattern=[0, 1], Stream0=toolpaths_to_connect, Stream1=replace_2, NullGaps=False)
clean = CleanTree(RemoveNulls=True, RemoveInvalid=True, RemoveEmpty=False, Tree=weave_8)
simplify_9 = SimplifyTree(Tree=clean, Front=False)
connected_toolpaths = Curve(simplify_9)

# ----
connected_toolpaths_2 = Curve(connected_toolpaths)
filter_11 = StreamFilter(Gate=connect_toolpaths_levels_booloean_2, Stream0=non_woven_toolpaths, Stream1=connected_toolpaths_2)
clean_2 = CleanTree(RemoveNulls=True, RemoveInvalid=True, RemoveEmpty=True, Tree=filter_11)

# ---- group: Try make sure that the toolpath starts as high as possible
toolaptahs = Curve(clean_2)
end_3 = EndPoints(Curve=toolaptahs)  # -> Start, End
pdecon_6 = Deconstruct(Point=end_3.Start)  # -> XComponent, YComponent, ZComponent
rev_6 = ReverseList(List=pdecon_6.ZComponent)
item_8 = ListItem(List=pdecon_6.ZComponent, Index=0, Wrap=True)
item_9 = ListItem(List=rev_6, Index=0, Wrap=True)
group_3 = Group(Objects=toolaptahs)
smaller_5 = SmallerThan(FirstNumber=item_8, SecondNumber=item_9)  # -> SmallerThan, OrEqualTo
dispatch_15 = Dispatch(List=group_3, DispatchPattern=smaller_5.SmallerThan)  # -> ListA, ListB
clean_3 = CleanTree(RemoveNulls=True, RemoveInvalid=True, RemoveEmpty=False, Tree=dispatch_15.ListA)
clean_4 = CleanTree(RemoveNulls=True, RemoveInvalid=True, RemoveEmpty=False, Tree=dispatch_15.ListB)
ungroup_2 = Ungroup(Group=dispatch_15.ListA)
flip_5 = FlipCurve(Curve=ungroup_2)  # -> Curve, Flag
rev_7 = ReverseList(List=flip_5.Curve)
group_4 = Group(Objects=rev_7)
suirify_11 = Suirify(group_4)
weave_9 = Weave(Pattern=smaller_5.SmallerThan, Stream0=dispatch_15.ListB, Stream1=suirify_11, NullGaps=False)
ungroup_3 = Ungroup(Group=weave_9)

# ---- group: Hack to fix error when there is only one surface
lng_9 = ListLength(List=flatten(group_3))  # disabled
panel_10 = Panel("2")  # disabled
smaller_6 = SmallerThan(FirstNumber=lng_9, SecondNumber=panel_10)  # -> SmallerThan, OrEqualTo; disabled
filter_12 = StreamFilter(Gate=smaller_6.SmallerThan, Stream0=ungroup_3, Stream1=rev_7)  # disabled

# ----
flatten_5 = FlattenTree(Tree=ungroup_3, Path="{0}")
clean_5 = CleanTree(RemoveNulls=True, RemoveInvalid=True, RemoveEmpty=True, Tree=flatten_5)
surface_3d_mill_toolpaths = Curve(clean_5)
surface_3d_mill_toolpaths_2 = ClusterOutput(surface_3d_mill_toolpaths)

# ---- group: Create second round fo connection lines
panel_11 = Panel("""1
1
0
0""")  # disabled
toolaptaths_for_additional_weaving = Curve(connected_toolpaths)  # disabled
dispatch_16 = Dispatch(List=toolaptaths_for_additional_weaving, DispatchPattern=panel_11)  # -> ListA, ListB; disabled
stepover_distance_9 = Panel(stepover_distance)  # disabled
connect_toolpath_tolerance_factor_3 = Panel(connect_toolpath_tolerance_factor)  # disabled
flip_6 = FlipCurve(Curve=dispatch_16.ListB)  # -> Curve, Flag; disabled
weave_10 = Weave(Pattern=panel_11, Stream0=flip_6.Curve, Stream1=dispatch_16.ListA, NullGaps=False)  # disabled
toolpaths_to_connect_2 = Curve(weave_10)  # disabled
end_4 = EndPoints(Curve=weave_10)  # -> Start, End; disabled
cp_2 = ClosestPoint(Point=end_4.Start, Cloud=end_4.End)  # -> ClosestPoint, CPIndex, Distance; disabled
ln_6 = Line(StartPoint=end_4.Start, EndPoint=cp_2.ClosestPoint)  # disabled
line = Line(ln_6)  # disabled
ln_7 = Line(StartPoint=end_4.Start, EndPoint=end_4.End)  # disabled
panel_12 = Panel("0.5")  # disabled
panel_13 = Panel("0.5")  # disabled
multiplication_15 = Multiplication(A=stepover_distance_9, B=connect_toolpath_tolerance_factor_3)  # disabled
len_13 = Length(Curve=line)  # disabled
eval_3 = EvaluateLength(Curve=ln_7, Length=panel_12, Normalized=True)  # -> Point, Tangent, Parameter; disabled
eval_4 = EvaluateLength(Curve=line, Length=panel_13, Normalized=True)  # -> Point, Tangent, Parameter; disabled
larger_5 = LargerThan(FirstNumber=len_13, SecondNumber=multiplication_15)  # -> LargerThan, OrEqualTo; disabled
lng_10 = ListLength(List=toolpaths_to_connect_2)  # disabled
cp_3 = ClosestPoint(Point=eval_3.Point, Cloud=eval_4.Point)  # -> ClosestPoint, CPIndex, Distance; disabled
panel_14 = Panel("0.01")  # disabled
series_8 = Series(Start=0, Step=1, Count=lng_10)  # disabled
smaller_7 = SmallerThan(FirstNumber=cp_3.Distance, SecondNumber=panel_14)  # -> SmallerThan, OrEqualTo; disabled
dispatch_17 = Dispatch(List=series_8, DispatchPattern=smaller_7.SmallerThan)  # -> ListA, ListB; disabled
dispatch_18 = Dispatch(List=series_8, DispatchPattern=larger_5.LargerThan)  # -> ListA, ListB; disabled
replace_3 = ReplaceItems(List=line, Indices=dispatch_17.ListA, Wrap=False)  # disabled
replace_4 = ReplaceItems(List=replace_3, Indices=dispatch_18.ListA, Wrap=False)  # disabled

# ---- group: Collision detect connection lines
connection_lines_to_collision_check_2 = Curve(replace_4)  # disabled
geometry_collision_detect_mesh_4 = Mesh(geometry_collision_detect_mesh)  # disabled
bit_collison_detection_mesh_3 = Mesh(mesh)  # disabled
panel_15 = Panel("0.5")  # disabled
eval_5 = EvaluateLength(Curve=connection_lines_to_collision_check_2, Length=panel_15, Normalized=True)  # -> Point, Tangent, Parameter; disabled
xy_8 = XYPlane(Origin=eval_5.Point)  # disabled
xy_9 = XYPlane(Origin=Point(0, 0, 0))  # disabled
lng_11 = ListLength(List=toolpaths_to_connect_2)  # disabled
orient_3 = Orient(Geometry=bit_collison_detection_mesh_3, Source=xy_9, Target=xy_8)  # -> Geometry, Transform; disabled
series_9 = Series(Start=0, Step=1, Count=lng_11)  # disabled
colom_4 = CollisionOneMany(Collider=orient_3.Geometry, Obstacles=geometry_collision_detect_mesh_4)  # -> Collision, Index; disabled
dispatch_19 = Dispatch(List=series_9, DispatchPattern=colom_4.Collision)  # -> ListA, ListB; disabled
replace_5 = ReplaceItems(List=replace_4, Indices=dispatch_19.ListA, Wrap=False)  # disabled

# ---- group: Create second round fo connection lines (continued)
weave_11 = Weave(Pattern=[0, 1], Stream0=toolpaths_to_connect_2, Stream1=replace_5, NullGaps=False)  # disabled
clean_6 = CleanTree(RemoveNulls=True, RemoveInvalid=True, RemoveEmpty=False, Tree=weave_11)  # disabled
simplify_10 = SimplifyTree(Tree=clean_6, Front=False)  # disabled
connected_toolpaths_3 = Curve(simplify_10)  # disabled

# ----
second_round_conected_toolpaths = Curve(connected_toolpaths_3)  # disabled

# ==== cluster MakePassDepths: Creates pass depths from 2D and 3D toolpath curves. Handy for creating 3D roughing operations from Surface 3D mill or freestyle 3D curves. Enables the milling machine can dig its way down to the surface of a 3D objects, layer by layer (pass depth) This makes enables a 3D finish operations to have very little material left to clear, making high speeds and smooth result possible.
make_safety_pass_from_cutout = ClusterInput()
roughing_material_leftover = ClusterInput()
milling_bit_diameter = ClusterInput()
outline_curves = ClusterInput()
pass_depth = ClusterInput()
toolpaths = ClusterInput()
toolpaths_2 = Curve(toolpaths)
pass_depth_2 = Number(pass_depth)
outline_curves_2 = Curve(outline_curves)
milling_bit_diameter_2 = Number(milling_bit_diameter)
roughing_material_leftover_2 = Number(roughing_material_leftover)
make_safety_pass_from_cutout_2 = Boolean(make_safety_pass_from_cutout)
pass_depth_3 = Panel(pass_depth_2)
roughing_material_leftover_3 = Panel(roughing_material_leftover_2)
flatten = FlattenTree(Tree=toolpaths_2, Path="{0}")

# ---- group: Find deepest toolapth coordinate
_3d_roughing_toolpaths = Curve(flatten)
bbox = BoundingBox(Content=_3d_roughing_toolpaths, Plane=PlaneXY(0, 0, 0), UnionBox=True)  # -> Box, Box_2
debrep = DeconstructBrep(Brep=bbox.Box)  # -> Faces, Edges, Vertices
item = ListItem(List=debrep.Vertices, Index=0, Wrap=True)
pdecon = Deconstruct(Point=item)  # -> XComponent, YComponent, ZComponent
pt = ConstructPoint(XCoordinate=pdecon.XComponent, YCoordinate=pdecon.YComponent, ZCoordinate=0)
ln = Line(StartPoint=item, EndPoint=pt)
len = Length(Curve=ln)
flatten_2 = FlattenTree(Tree=len, Path="{0}")
deepest_toolapth_coordinate = Panel(flatten_2)

# ---- group: Make safety cleanup pass
multiplication = Multiplication(A=roughing_material_leftover_3, B="2")
deepest_toolapth_coordinate_2 = Panel(deepest_toolapth_coordinate)
filter = StreamFilter(Gate=make_safety_pass_from_cutout_2, Stream1=outline_curves_2)
addition = Addition(A=milling_bit_diameter_2, B=multiplication)
cutout = Cutout(
    curves_for_cutout=filter,
    cut_depth=deepest_toolapth_coordinate_2,
    pass_depth=pass_depth_3,
    tool_diameter=addition,
    cutout_tolerance=roughing_material_leftover_3,
    use_climb_direction=Toggle(False),
    use_inside_cutting=Toggle(False))
safety_cleanup_pass = Curve(cutout)

# ---- group: Find roughing depths
deepest_toolapth_coordinate_3 = Panel(deepest_toolapth_coordinate)
pass_depth_4 = Panel(pass_depth_3)
division = Division(A=deepest_toolapth_coordinate_3, B=pass_depth_4)
round = Round(Number=division)  # -> Nearest, Floor, Ceiling
division_2 = Division(A=deepest_toolapth_coordinate_3, B=round.Ceiling)
roughing_material_leftover_4 = Panel(roughing_material_leftover_3)
roughing_pass_depth = Panel(division_2)
number_of_roughing_passes = Panel(round.Ceiling)
addition_2 = Addition(A=roughing_material_leftover_4, B=roughing_pass_depth)
subtraction = Subtraction(A=number_of_roughing_passes, B="1")
series = Series(Start=addition_2, Step=roughing_pass_depth, Count=subtraction)
rough_depths = Number(series)

# ----
roughing_material_leftover_5 = Panel(roughing_material_leftover_3)
_3d_roughing_toolpaths_2 = Curve(flatten)
Z = UnitZ(Factor=roughing_material_leftover_5)
move = Move(Geometry=_3d_roughing_toolpaths_2, Motion=Z)  # -> Geometry, Transform
final_roughing_pass = Curve(move.Geometry)

# ---- group: Sort lower pass
final_roughing_pass_2 = Curve(final_roughing_pass)  # disabled
end = EndPoints(Curve=final_roughing_pass_2)  # -> Start, End
merge = Merge(Data1=end.Start, Data2=end.End)
xy = XYPlane(Origin=Point(0, 0, 0))
hull = ConvexHull(Points=merge, Plane=xy)  # -> Hull, HullZ, Indices
outline_curves_3 = Curve(hull.HullZ)
end_2 = EndPoints(Curve=final_roughing_pass_2)  # -> Start, End
simplify = SimplifyTree(Tree=outline_curves_3, Front=False)
alongcrv = SortAlongCurve(Points=end_2.End, Curve=simplify)  # -> Points, Indices
item_2 = ListItem(List=final_roughing_pass_2, Index=alongcrv.Indices, Wrap=True)
flatten_3 = FlattenTree(Tree=item_2, Path="{0}")
sorted_final_roughing_pass = Curve(flatten_3)

# ----
final_roughing_pass_3 = Curve(final_roughing_pass)
safety_cleanup_pass_2 = Curve(safety_cleanup_pass)
safety_cleanup_pass_3 = Curve(safety_cleanup_pass)
final_roughing_pass_4 = Curve(sorted_final_roughing_pass)

# ---- group: Z position and trim upper toolpaths
deepest_toolapth_coordinate_4 = Panel(deepest_toolapth_coordinate)
_3d_roughing_toolpaths_3 = Curve(flatten)
rough_depths_2 = Number(rough_depths)
rev = ReverseList(List=rough_depths_2)
bbox_2 = BoundingBox(Content=_3d_roughing_toolpaths_3, Plane=PlaneXY(0, 0, 0), UnionBox=True)  # -> Box, Box_2
Z_2 = UnitZ(Factor=rev)
debrep_2 = DeconstructBrep(Brep=bbox_2.Box)  # -> Faces, Edges, Vertices
item_3 = ListItem(List=debrep_2.Faces, Index="5", Wrap=True)
edges = BrepEdges(Brep=item_3)  # -> Naked, Interior, NonManifold
xy_2 = XYPlane(Origin=Point(0, 0, 0))
join = JoinCurves(Curves=edges.Naked, Preserve=False)
project = Project(Geometry=join, Plane=xy_2)  # -> Geometry, Transform
deepest_toolapth_coordinate_5 = Panel(deepest_toolapth_coordinate_4)
offset = Offset(Curve=project.Geometry, Distance="1", Plane=xy_2, Corners=1)
addition_3 = Addition(A=deepest_toolapth_coordinate_5, B="1")
neg = Negative(Value=addition_3)
Z_3 = UnitZ(Factor=neg)
extr = Extrude(Base=offset, Direction=Z_3)
cap = CapHoles(Brep=extr)

# ----
group = Group(Objects=_3d_roughing_toolpaths_3)

# ---- group: Z position and trim upper toolpaths (continued)
move_2 = Move(Geometry=group, Motion=Z_2)  # -> Geometry, Transform

# ----
ungroup = Ungroup(Group=move_2.Geometry)

# ---- group: Z position and trim upper toolpaths (continued)
trim = TrimWithBrep(Curve=ungroup, Brep=cap)  # -> Inside, Outside
z_positioned_and_trimed_toolpaths = Curve(trim.Inside)

# ---- group: Sort upper pass
toolpaths_for_connection = Curve(z_positioned_and_trimed_toolpaths)  # disabled
end_3 = EndPoints(Curve=toolpaths_for_connection)  # -> Start, End
pass_depth_5 = Panel(pass_depth_3)
cp = ClosestPoint(Point=end_3.Start, Cloud=end_3.End)  # -> ClosestPoint, CPIndex, Distance
ln_2 = Line(StartPoint=end_3.Start, EndPoint=cp.ClosestPoint)
multiplication_2 = Multiplication(A=pass_depth_5, B="0.5")
len_2 = Length(Curve=ln_2)
larger = LargerThan(FirstNumber=len_2, SecondNumber=multiplication_2)  # -> LargerThan, OrEqualTo
merge_2 = Merge(Data1=end_3.Start, Data2=end_3.End)
xy_3 = XYPlane(Origin=Point(0, 0, 0))
dispatch = Dispatch(List=ln_2, DispatchPattern=larger.LargerThan)  # -> ListA, ListB
pshift = ShiftPaths(Data=merge_2, Offset=-1)
join_2 = JoinCurves(Curves=[dispatch.ListB, toolpaths_for_connection], Preserve=False)
hull_2 = ConvexHull(Points=pshift, Plane=xy_3)  # -> Hull, HullZ, Indices
simplify_2 = SimplifyTree(Tree=toolpaths_for_connection, Front=False)
outline_curves_4 = Curve(hull_2.HullZ)
pshift_2 = ShiftPaths(Data=simplify_2, Offset=-1)
simplify_3 = SimplifyTree(Tree=outline_curves_4, Front=False)
end_4 = EndPoints(Curve=pshift_2)  # -> Start, End
alongcrv_2 = SortAlongCurve(Points=end_4.End, Curve=simplify_3)  # -> Points, Indices
item_4 = ListItem(List=pshift_2, Index=alongcrv_2.Indices, Wrap=True)
flatten_4 = FlattenTree(Tree=item_4, Path="{0}")
sorted_upper_roughing_passes = Curve(flatten_4)

# ----
cp_2 = ClosestPoint(Point=end_3.Start, Cloud=end_3.End)  # -> ClosestPoint, CPIndex, Distance
flatten_5 = FlattenTree(Tree=z_positioned_and_trimed_toolpaths, Path="{0}")
z_positioned_and_trimed_toolpaths_2 = Curve(flatten(flatten_5))
upper_roughing_passes = Curve(sorted_upper_roughing_passes)
merge_3 = Merge(Data1=z_positioned_and_trimed_toolpaths_2, Data2=final_roughing_pass_3, Data3=safety_cleanup_pass_2)
merge_4 = Merge(Data1=upper_roughing_passes, Data2=final_roughing_pass_4, Data3=safety_cleanup_pass_3)
lng = ListLength(List=merge_4)
multiplication_3 = Multiplication(A=lng, B=Slider(0.775, range=0..1))
toolpaths_with_pass_depth = Curve(merge_3)
item_5 = ListItem(List=merge_4, Index=multiplication_3, Wrap=True)
toolpaths_with_pass_depth_2 = ClusterOutput(toolpaths_with_pass_depth)

# ==== cluster FindDeepestZ: Finds the deepest Z coordinate in your toolapths. Handy for safety checks!
toolpaths = ClusterInput()
toolpaths_2 = Geometry(toolpaths)
bbox = BoundingBox(Content=flatten(toolpaths_2), Plane=PlaneXY(0, 0, 0), UnionBox=True)  # -> Box, Box_2
box_corners = BoxCorners(Box=bbox.Box)  # -> CornerA, CornerB, CornerC, CornerD, CornerE, CornerF, CornerG, CornerH
pt = Point(box_corners.CornerA)
pdecon = Deconstruct(Point=pt)  # -> XComponent, YComponent, ZComponent
deepest_z = Number(pdecon.ZComponent)
deepest_z_2 = ClusterOutput(deepest_z)

# ==== cluster FeedRateLibraryExperimemtal: Outputs CNC milling settings based on material type, bit diameter, bit type. Current values based on ShopBot alpha, single flute end mills and18000 rpm spindle speed
use_high_speed_maching = ClusterInput()
toolpath_width_factor = ClusterInput()
pass_depth_factor = ClusterInput()
# Adjust feed rate defaults here:
# (chip load)
feed_rate_factor = ClusterInput()
number_of_flutes = ClusterInput()
spindle_rpm = ClusterInput()
bit_diameter = ClusterInput()
material_id = ClusterInput()
bit_type_id = ClusterInput()
bit_diameter_2 = Number(bit_diameter)
spindle_rpm_2 = Number(spindle_rpm)
material_id_2 = Integer(material_id)
bit_type_id_2 = Number(bit_type_id)
use_high_speed_maching_2 = Integer(use_high_speed_maching)
feed_rate_factor_2 = Number(feed_rate_factor)
number_of_flutes_2 = Integer(number_of_flutes)
toolpath_width_factor_2 = Number(toolpath_width_factor)
pass_depth_factor_2 = Number(pass_depth_factor)
material_type_id = Panel(material_id_2)
bit_type_id_3 = Panel(bit_type_id_2)
bit_diameter_3 = Panel(bit_diameter_2)
larger = LargerThan(FirstNumber=bit_type_id_3, SecondNumber="0")  # -> LargerThan, OrEqualTo
equals = Equality(FirstNumber=bit_type_id_3, SecondNumber="4")  # -> Equality, Inequality
bool = Boolean(larger.LargerThan)
and = GateAnd(A=bool, B=equals.Inequality)
bit_type_is_not_an_up_cut_or_compression = Panel(and)

# ---- group: ShopBot alpha pass depths
# Adjust pass depth defaults here:
pass_depths_6mm_upcut_single_flute = Panel("""19.8
15
10
8
2.5
1.2
0.9
0.6""")

# ---- group: Calculate feedrate
# Material ID ref: Foam / wax        = 0
# Soft wood         = 1
# Hard wood         = 2
# Plastic           = 3
# Aluminium / brass = 4
# Bronze            = 5
# Soft steel        = 6
# Stainless steel   = 7
chip_loads_for_6mm_bit = Panel("""0.25
0.165
0.115
0.0725
0.04
0.035
0.032
0.025""")
bit_diameter_chip_loads_are_based_on = Panel("6")
number_of_flutes_3 = Panel(number_of_flutes_2)
plunge_rate_reduction_factor_down_cut_or = Panel("0.5")  # "Plunge rate reduction factor down-cut or other"
spindle_rpm_3 = Panel(spindle_rpm_2)
plunge_rate_reduction_factor_up_cut = Panel("0.7")
bit_diameter_4 = Panel(bit_diameter_3)
multiplication_factor = Panel("0.45")
multiplication = Multiplication(A=spindle_rpm_3, B=number_of_flutes_3)
multiplication_2 = Multiplication(A=multiplication, B=chip_loads_for_6mm_bit)
division = Division(A=multiplication_2, B="60")
int = Integer(division)
feedrates_based_on_default_bit_biamter = Panel(int)

# ----
# Material ID ref: Foam / wax        = 0
# Soft wood         = 1
# Hard wood         = 2
# Plastic           = 3
# Aluminium / brass = 4
# Bronze            = 5
# Soft steel        = 6
# Stainless steel   = 7
# Adjust ramp angles here:
material_ramp_angles = Panel("""45
30
25
18
12
9
6
4""")
# Adjust high speed machining defaults here:
# Material ID ref: Foam / wax        = 0
# Soft wood         = 1
# Hard wood         = 2
# Plastic           = 3
# Aluminium / brass = 4
# Bronze            = 5
# Soft steel        = 6
# Stainless steel   = 7
plunge_rough_stepover_for_different_mate = Panel("""0.4
0.4
0.4
0.4
0.25
0.22
0.18
0.12""")  # "Plunge rough stepover for different materials"
use_high_speed_maching_3 = Panel(use_high_speed_maching_2)

# ---- group: Make a Feedrate multiplier based on current bit diamter
subtraction = Subtraction(A="1", B=multiplication_factor)
multiplication_3 = Multiplication(A=bit_diameter_4, B=multiplication_factor)
multiplication_4 = Multiplication(A=bit_diameter_chip_loads_are_based_on, B=subtraction)
addition = Addition(A=multiplication_4, B=multiplication_3)
division_2 = Division(A=addition, B=bit_diameter_chip_loads_are_based_on)
feedrate_multiplier_based_on_bit_diamter = Panel(division_2)

# ----
multiplication_5 = Multiplication(A=feedrates_based_on_default_bit_biamter, B=feedrate_multiplier_based_on_bit_diamter)
feedrates_adjusted_to_current_bit_diamte = Panel(multiplication_5)  # "Feedrates adjusted to current bit diamter"

# ---- group: Make feed rate domain
int_2 = Integer()
int_3 = Integer()
dom = ConstructDomain(DomainStart=int_3, DomainEnd=int_2)
feed_rates_domains = Panel(dom)
material_type = Panel(material_type_id)
flatten = FlattenTree(Path="{0}")
item = ListItem(List=feed_rates_domains, Index=material_type, Wrap=True)
feed_rate_domain = Panel(item)

# ---- group: Select feedrate
material_type_2 = Panel(material_type_id)
item_2 = ListItem(List=feedrates_adjusted_to_current_bit_diamte, Index=material_type_2, Wrap=True)
feed_rate = Panel(item_2)

# ---- group: Calculate plunge rate
plunge_rate_reduction_factor_up_cut_2 = Panel(plunge_rate_reduction_factor_down_cut_or)
bit_type_is_not_an_up_cut = Panel(bit_type_is_not_an_up_cut_or_compression)
plunge_rate_reduction_factor_up_cut_3 = Panel(plunge_rate_reduction_factor_up_cut)
filter = StreamFilter(
    Gate=bit_type_is_not_an_up_cut,
    Stream0=plunge_rate_reduction_factor_up_cut_3,
    Stream1=plunge_rate_reduction_factor_up_cut_2)
multiplication_6 = Multiplication(A=feed_rate, B=filter)
int_4 = Integer(multiplication_6)
num = Number(int_4)
plunge_rate = Panel(num)

# ----
use_high_speed_maching_4 = Panel(use_high_speed_maching_2)
use_high_speed_maching_5 = Panel(use_high_speed_maching_2)
use_high_speed_maching_6 = Panel(use_high_speed_maching_2)
use_high_speed_maching_7 = Panel(use_high_speed_maching_2)
use_high_speed_maching_8 = Panel(use_high_speed_maching_2)
actual_bit_diameter = Panel(bit_diameter_3)
actual_bit_diameter_2 = Number(actual_bit_diameter)
actual_bit_diameter_3 = ClusterOutput(actual_bit_diameter_2)

# ---- group: Calculate pass depth
# Material ID ref: Foam / wax        = 0
# Soft wood         = 1
# Hard wood         = 2
# Plastic           = 3
# Aluminium / brass = 4
# Bronze            = 5
# Soft steel        = 6
# Stainless steel   = 7
pass_depths_6mm_upcut_single_flute_2 = Panel("""19.8
10
6
4
1.8
1.2
0.9
0.6""")
v_bit_reduction_factor = Panel("0.5")
v_bit_identifier = Panel("3")
bit_diameter_chip_loads_are_based_on_2 = Panel("6")
downcut_or_ball_nose_depth_reduction_fac = Panel("0.6")  # "Downcut or ball nose depth reduction factor"
bit_type_id_4 = Panel(bit_type_id_3)
bit_type_is_not_an_up_cut_2 = Panel(bit_type_is_not_an_up_cut_or_compression)
number_of_flutes_4 = Panel(number_of_flutes_2)
multiplication_factor_flutes = Panel("0.33")
bit_diameter_5 = Panel(bit_diameter_3)
multiplication_factor_diamter = Panel("1.05")
subtraction_2 = Subtraction(A="1", B=multiplication_factor_diamter)
multiplication_7 = Multiplication(A=bit_diameter_5, B=multiplication_factor_diamter)
multiplication_8 = Multiplication(A=bit_diameter_chip_loads_are_based_on_2, B=subtraction_2)
addition_2 = Addition(A=multiplication_8, B=multiplication_7)
division_3 = Division(A=addition_2, B=bit_diameter_chip_loads_are_based_on_2)
pass_depth_multiplier_based_on_bit_diamt = Panel(division_3)  # "Pass depth multiplier based on bit diamter"
multiplication_9 = Multiplication(A=pass_depths_6mm_upcut_single_flute_2, B=pass_depth_multiplier_based_on_bit_diamt)
pass_depths_adjusted_to_current_bit_diam = Panel(multiplication_9)  # "Pass depths adjusted to current bit diamter"
number_of_flutes_5 = Panel(number_of_flutes_4)
multiplication_factor_flutes_2 = Panel(multiplication_factor_flutes)
division_4 = Division(A=pass_depths_adjusted_to_current_bit_diam, B=number_of_flutes_5)
multiplication_10 = Multiplication(A=division_4, B=multiplication_factor_flutes_2)
addition_3 = Addition(A=division_4, B=multiplication_10)
panel = Panel("10")
bit_type_simple = Panel(bit_type_is_not_an_up_cut_2)
material_type_3 = Panel(material_type_id)
bit_type_id_5 = Panel(bit_type_id_4)
v_bit_reduction_factor_2 = Panel(v_bit_reduction_factor)
v_bit_identifier_2 = Panel(v_bit_identifier)
v_bit_reduction_factor_3 = Panel(v_bit_reduction_factor_2)
equals_2 = Equality(FirstNumber=bit_type_id_5, SecondNumber=v_bit_identifier_2)  # -> Equality, Inequality

# ----
larger_2 = LargerThan(FirstNumber=number_of_flutes_5, SecondNumber="1")  # -> LargerThan, OrEqualTo
filter_2 = StreamFilter(Gate=larger_2.LargerThan, Stream0=pass_depths_adjusted_to_current_bit_diam, Stream1=addition_3)
downcut_or_ball_nose_depth_reduction_fac_2 = Panel(downcut_or_ball_nose_depth_reduction_fac)  # "Downcut or ball nose depth reduction factor"

# ---- group: Make high speed milling speeds
# Material ID ref: Foam / wax        = 0
# Soft wood         = 1
# Hard wood         = 2
# Plastic           = 3
# Aluminium / brass = 4
# Bronze            = 5
# Soft steel        = 6
# Stainless steel   = 7
stepover_for_different_materials = Panel("""0.9
0.9
0.9
0.8
0.2
0.15
0.1
0.09""")
material_type_id_2 = Panel(material_type_id)
# Material ID ref: Foam / wax        = 0
# Soft wood         = 1
# Hard wood         = 2
# Plastic           = 3
# Aluminium / brass = 4
# Bronze            = 5
# Soft steel        = 6
# Stainless steel   = 7
high_speed_chip_loads_for_different_mate = Panel("""0.5
0.3
0.2
0.2
0.08
0.07
0.04
0.03""")  # "High speed chip loads for different materials"
# Material ID ref: Foam / wax        = 0
# Soft wood         = 1
# Hard wood         = 2
# Plastic           = 3
# Aluminium / brass = 4
# Bronze            = 5
# Soft steel        = 6
# Stainless steel   = 7
ramp_angle_for_different_materials = Panel("""45
20
10
3
1.2
0.9
0.8
0.6""")
plunge_rough_feed_and_plunge_rate_reduct = Panel("0.7")  # "Plunge rough feed and plunge rate reduction factor"
high_speed_pass_depth_to_bit_diameter_ra = Panel("2.5")  # "High speed pass depth to bit diameter ratio"
item_3 = ListItem(List=ramp_angle_for_different_materials, Index=material_type_id_2, Wrap=True)
item_4 = ListItem(List=high_speed_chip_loads_for_different_mate, Index=material_type_id_2, Wrap=True)
ramp_angle_high_speed_helix = Panel(item_3)
high_speed_chip_load = Panel(item_4)
bit_diameter_from_easy_interface = Panel(bit_diameter_3)
arc_diamter_factor = Panel(toolpath_width_factor_2)
bit_diameter_6 = Panel(bit_diameter_3)
multiplication_11 = Multiplication(A=high_speed_pass_depth_to_bit_diameter_ra, B=bit_diameter_6)
multiplication_12 = Multiplication(A=bit_diameter_from_easy_interface, B=arc_diamter_factor)
high_speed_virtual_bit_diamter = Panel(multiplication_12)
high_speed_pass_depth = Panel(multiplication_11)

# ----
filter_3 = StreamFilter(
    Gate=use_high_speed_maching_3,
    Stream1=stepover_for_different_materials,
    Stream2=plunge_rough_stepover_for_different_mate)

# ---- group: Make high speed milling speeds (continued)
item_5 = ListItem(List=filter_3, Index=material_type_id_2, Wrap=True)
current_high_speed_stepover = Panel(item_5)
feedrate_calculator_for_arcs = FeedrateCalculatorForArcs(
    spindle_rpm=spindle_rpm_2,
    milling_bit_diameter=bit_diameter_3,
    arc_diameter_factor=toolpath_width_factor_2,
    number_of_flutes=number_of_flutes_2,
    chip_load=high_speed_chip_load,
    max_stepover=current_high_speed_stepover,
    ramp_feed_reduction_factor=0.5)  # -> arc_compensated_feedrate_3, ramp_feedrate_2, feedback_3
multiplication_13 = Multiplication(A=feedrate_calculator_for_arcs.arc_compensated_feedrate_3, B=plunge_rough_feed_and_plunge_rate_reduct)
plungr_rough_rate = Panel(multiplication_13)

# ----
high_speed_virtual_bit_diamter_2 = Panel(high_speed_virtual_bit_diamter)
ramp_angle_high_speed_helix_2 = Panel(ramp_angle_high_speed_helix)
plunge_rough_rate = Panel(plungr_rough_rate)
plunge_rough_rate_2 = Panel(plungr_rough_rate)
high_speed_feedrate = Panel(feedrate_calculator_for_arcs.arc_compensated_feedrate_3)
high_speed_pass_depth_2 = Panel(high_speed_pass_depth)
filter_4 = StreamFilter(
    Gate=use_high_speed_maching_8,
    Stream0=actual_bit_diameter,
    Stream1=high_speed_virtual_bit_diamter_2,
    Stream2=actual_bit_diameter)
trochoidal_stepover = Number(current_high_speed_stepover)
toolpath_width = Number(filter_4)
trochoidal_stepover_2 = ClusterOutput(trochoidal_stepover)
toolpath_width_2 = ClusterOutput(toolpath_width)

# ---- group: Calculate pass depth (continued)
pass_depths_adjusted_to_current_flute_co = Panel(filter_2)  # "Pass depths adjusted to current flute count"
multiplication_14 = Multiplication(A=pass_depths_adjusted_to_current_flute_co, B=panel)

# ----
int_5 = Integer(multiplication_14)
division_5 = Division(A=int_5, B=panel)
current_pass_depths = Panel(division_5)
multiplication_15 = Multiplication(A=current_pass_depths, B=downcut_or_ball_nose_depth_reduction_fac_2)

# ---- group: Calculate pass depth (continued)
filter_5 = StreamFilter(Gate=bit_type_simple, Stream0=current_pass_depths, Stream1=multiplication_15)
item_6 = ListItem(List=filter_5, Index=material_type_3, Wrap=True)
multiplication_16 = Multiplication(A=item_6, B="10")
int_6 = Integer(multiplication_16)
division_6 = Division(A=int_6, B="10")
multiplication_17 = Multiplication(A=division_6, B=v_bit_reduction_factor_3)
filter_6 = StreamFilter(Gate=equals_2.Equality, Stream0=division_6, Stream1=multiplication_17)
pass_depth = Panel(filter_6)

# ---- group: Map ramp and ramp angles
material_type_4 = Panel(material_type_id)
bit_type_is_not_an_up_cut_3 = Panel(bit_type_is_not_an_up_cut_or_compression)
material_ramp_angles_2 = Panel(material_ramp_angles)
material_type_5 = Panel(material_type_id)
larger_3 = LargerThan(FirstNumber=material_type_4, SecondNumber="2")  # -> LargerThan, OrEqualTo
bool_2 = Boolean(bit_type_is_not_an_up_cut_3)
larger_4 = LargerThan(FirstNumber=material_type_5, SecondNumber="2")  # -> LargerThan, OrEqualTo
item_7 = ListItem(List=material_ramp_angles_2, Index=material_type_5, Wrap=True)
ramp_because_of_special_bit_in_material = Panel(larger_3.LargerThan)
ramp_because_of_bit_type = Panel(bool_2)
ramp_because_of_material = Panel(larger_4.LargerThan)
and_2 = GateAnd(A=ramp_because_of_bit_type, B=ramp_because_of_special_bit_in_material)
or = GateOr(A=ramp_because_of_material, B=and_2)
ramp_angle = Panel(item_7)

# ----
or_2 = GateOr(A=equals.Equality, B=or)

# ---- group: Map ramp and ramp angles (continued)
ramp_plunges = Panel(or_2)

# ----
ramp_plunges_2 = Panel(ramp_plunges)
ramp_angle_2 = Panel(ramp_angle)
filter_7 = StreamFilter(
    Gate=use_high_speed_maching_7,
    Stream0=ramp_angle_2,
    Stream1=ramp_angle_high_speed_helix_2,
    Stream2=ramp_angle_high_speed_helix_2)
ramp_plunges_3 = Boolean(ramp_plunges_2)
ramp_angle_3 = Integer(filter_7)
ramp_plunges_4 = ClusterOutput(ramp_plunges_3)
ramp_angle_4 = ClusterOutput(ramp_angle_3)

# ---- group: Feed rate and pass depth adjustment
feed_rate_2 = Panel(feed_rate)
plunge_rate_2 = Panel(plunge_rate)
pass_depth_2 = Panel(pass_depth)
pass_depth_factor_3 = Number(pass_depth_factor_2)
feed_rate_factor_3 = Number(feed_rate_factor_2)
multiplication_18 = Multiplication(A=pass_depth_2, B=pass_depth_factor_3)
multiplication_19 = Multiplication(A=plunge_rate_2, B=feed_rate_factor_3)
multiplication_20 = Multiplication(A=feed_rate_2, B=feed_rate_factor_3)
int_7 = Integer(multiplication_19)
num_2 = Number(multiplication_18)
ajusted_pass_depth = Panel(num_2)
adjusted_plunge_rateod_plunge_rate = Panel(int_7)

# ----
int_8 = Integer(multiplication_20)

# ---- group: Feed rate and pass depth adjustment (continued)
adjusted_feedrate = Panel(int_8)

# ----
classic_feed_rate = Panel(adjusted_feedrate)
classic_pass_depth = Panel(ajusted_pass_depth)
classic_plunge_rate = Panel(adjusted_plunge_rateod_plunge_rate)
filter_8 = StreamFilter(Gate=use_high_speed_maching_4, Stream0=classic_feed_rate, Stream1=high_speed_feedrate, Stream2=plunge_rough_rate)
filter_9 = StreamFilter(Gate=use_high_speed_maching_5, Stream0=classic_plunge_rate, Stream1=classic_plunge_rate, Stream2=plunge_rough_rate_2)
filter_10 = StreamFilter(
    Gate=use_high_speed_maching_6,
    Stream0=classic_pass_depth,
    Stream1=high_speed_pass_depth_2,
    Stream2=high_speed_pass_depth_2)
plunge_rate_3 = Number(filter_9)
pass_depth_3 = Number(filter_10)
feed_rate_3 = Integer(filter_8)
feed_rate_4 = ClusterOutput(feed_rate_3)
plunge_rate_4 = ClusterOutput(plunge_rate_3)
pass_depth_4 = ClusterOutput(pass_depth_3)

# ==== cluster Horizontal3DMillFromMeshExperimental: Makes horizontal roughing, finishing and cutouts from mesh. Attempts to distribute slicing levels optimally based on surface angles. Not 100% reliable, always check your toolpaths in 3D view before running.
use_end_mill_for_cutout = BooleanToggle(True)
slice_at_full_depth = BooleanToggle(True)
cutout_tolerance = Slider(0, range=-0.5..0.5)
cutout_to_full_material_depth = BooleanToggle(False)
make_flea_jump_transitions = BooleanToggle(False)
connect_toolpaths_levels = BooleanToggle(True)
generate_cutout = BooleanToggle(True)
curve_sample_slice_reduction = Panel("2")
generate_cutout_2 = Panel(generate_cutout)
cutout_tolerance_2 = Panel(cutout_tolerance)
cutout_to_full_material_depth_2 = Panel(cutout_to_full_material_depth)
material_thickness = Panel("19")
extra_cut_depth = Panel("0.6")
reduction_tolerance = Panel("0.02")
top_layer_pocket_threshold = Panel("5")
inital_sample_slice_spacing = Panel("1")
sample_top_value_percentage = Panel("0.25")
top_slice_thickness = Panel("0.01")
# Make max depth value
# Make use cutout for last roughing pass boolean
# Fix roughing selection pattern
connect_toolpath_tolerance_factor = Panel("2")
slice_at_full_depth_2 = Panel(slice_at_full_depth)
vertical_angle_cutoff = Panel("89")
make_flea_jump_transitions_2 = Integer(make_flea_jump_transitions)
connect_toolpaths_levels_2 = Integer(connect_toolpaths_levels)
max_angle_limit = Panel("1")
lowes_slice_leftover_thickness = Panel("0.01")
roughing_material_leftover = ClusterInput()
generate_3d_roughing = ClusterInput()
generate_3d_finishing = ClusterInput()
pass_depth_roughing = ClusterInput()
milling_bit_diameter = ClusterInput()
roughing_stepover = ClusterInput()
meshes_for_3d_mill = ClusterInput()
finishing_stepover = ClusterInput()
roughing_material_leftover_2 = Number(roughing_material_leftover)
generate_3d_roughing_2 = Boolean(generate_3d_roughing)
generate_3d_finishing_2 = Boolean(generate_3d_finishing)
pass_depth_roughing_2 = Number(pass_depth_roughing)
milling_bit_diameter_2 = Number(milling_bit_diameter)
roughing_stepover_2 = Number(roughing_stepover)
meshes_for_3d_mill_2 = Mesh(meshes_for_3d_mill)
finishing_stepover_2 = Number(finishing_stepover)
breps_for_3d_mill = Brep()  # disabled
number_slider = Slider(2, range=0..10)
multiplication = Multiplication(A=milling_bit_diameter_2, B=finishing_stepover_2)
multiplication_2 = Multiplication(A=milling_bit_diameter_2, B=roughing_stepover_2)
multiplication_3 = Multiplication(A=milling_bit_diameter_2, B="0.5")
custom_mesh_settings = SettingsCustom(
    StitchSeams=True,
    SimplePlanes=False,
    Refine=True,
    MinCount=16,
    MaxCount=400,
    AspectRatio=20,
    MaxDistance=0,
    MaxAngle=20,
    MinEdge=number_slider,
    MaxEdge=number_slider)
smooth = SettingsQuality()
jagged = SettingsSpeed()
stepover_distance_roughing = Panel(multiplication_2)
milling_bit_radius = Panel(multiplication_3)
stepover_distance = Panel(multiplication)
mesh = MeshBrep(Brep=breps_for_3d_mill, Settings=custom_mesh_settings)
# Horizontal slice from bottom.
# Start with tool dimater spacing.
# Evalute max angle of surface between slices.
# Generate additional slices based on inclination
# make guide graph with points position from average inclination of slices
# (average of top 25%)
# 
# cull sampling points colliding with mesh
# 
# rebuild graph with even distance for slice density positions
# 
# pocket last top 0.1mm slice if needed
filter = StreamFilter(Gate=use_end_mill_for_cutout, Stream0=milling_bit_radius)
merge = Merge(Data1=flatten(mesh), Data2=flatten(meshes_for_3d_mill_2))
addition = Addition(A=filter, B=extra_cut_depth)
flatten = FlattenTree(Tree=merge, Path="{0}")
meshes_for_3d_milling = Mesh(flatten)
mjoin = MeshJoin(Meshes=meshes_for_3d_milling)
joined_meshes_for_3d_milling = Mesh(mjoin)
bbox = BoundingBox(Content=meshes_for_3d_milling, Plane=PlaneXY(0, 0, 0), UnionBox=False)  # -> Box, Box_2
debrep = DeconstructBrep(Brep=bbox.Box)  # -> Faces, Edges, Vertices
bbox_2 = BoundingBox(Content=meshes_for_3d_milling, Plane=PlaneXY(0, 0, 0), UnionBox=False)  # -> Box, Box_2
meshes_without_offset = Mesh(meshes_for_3d_milling)
item = ListItem(List=debrep.Vertices, Index="0", Wrap=True)
item_2 = ListItem(List=debrep.Vertices, Index="4", Wrap=True)
debrep_2 = DeconstructBrep(Brep=bbox_2.Box)  # -> Faces, Edges, Vertices
xy = XYPlane(Origin=item_2)
bbox_3 = BoundingBox(Content=meshes_without_offset, Plane=PlaneXY(0, 0, 0), UnionBox=False)  # -> Box, Box_2
item_3 = ListItem(List=debrep_2.Vertices, Index="0", Wrap=True)
item_4 = ListItem(List=debrep_2.Vertices, Index="4", Wrap=True)
pshift = ShiftPaths(Data=xy, Offset=-1)
debrep_3 = DeconstructBrep(Brep=bbox_3.Box)  # -> Faces, Edges, Vertices
dist = Distance(PointA=item_4, PointB=item_3)
mshadow = MeshShadow(Mesh=meshes_for_3d_milling, Light=Vector(0, 0, -1), Plane=pshift)
item_5 = ListItem(List=debrep_3.Vertices, Index="4", Wrap=True)
model_height = Panel(dist)
top_slice_sample_thickness = Panel("0.01")
lng = ListLength(List=mshadow)
simplify = SimplifyTree(Tree=item_5, Front=False)
Z = UnitZ(Factor=1)
cp = ControlPoints(Curve=mshadow)  # -> Points, Weights, Knots
sort = SortList(Keys=flatten(lng))  # -> Keys, ValuesA
pdecon = Deconstruct(Point=simplify)  # -> XComponent, YComponent, ZComponent
rev = Reverse(Vector=Z)
simplify_2 = SimplifyTree(Tree=model_height, Front=False)
item_6 = ListItem(List=sort.Keys, Index=0, Wrap=True)
milling_bit_diameter_3 = Panel(milling_bit_diameter_2)
top_layer_pocket_threshold_2 = Panel(top_layer_pocket_threshold)
subtraction = Subtraction(A=pdecon.ZComponent, B=top_slice_sample_thickness)
cutout_to_full_material_depth_3 = Panel(cutout_to_full_material_depth_2)
meshray = MeshRay(Mesh=joined_meshes_for_3d_milling, Point=cp.Points, Direction=rev)  # -> Point, Hit
model_height_2 = Panel(simplify_2)
material_thickness_2 = Panel(material_thickness)
not = GateNot(A=item_6)
pt = ConstructPoint(XCoordinate=pdecon.XComponent, YCoordinate=pdecon.YComponent, ZCoordinate=subtraction)
pline = PolyLine(Vertices=meshray.Point, Closed=False)
failed_mesh_shadow_boolean = Panel(not)
# make grid?
slice_at_full_depth_boolean = Panel(slice_at_full_depth_2)
xy_2 = XYPlane(Origin=pt)
pshift_2 = ShiftPaths(Data=pline, Offset=-1)
multiplication_4 = Multiplication(A=milling_bit_diameter_3, B=top_layer_pocket_threshold_2)
filter_2 = StreamFilter(Gate=cutout_to_full_material_depth_3, Stream0=model_height_2, Stream1=material_thickness_2)
sec = MeshPlane(Mesh=graft(meshes_without_offset), Plane=xy_2)
bbox_4 = BoundingBox(Content=pshift_2, Plane=PlaneXY(0, 0, 0), UnionBox=True)  # -> Box, Box_2
top_layer_pocket_threshold_area = Panel(multiplication_4)
top_slice_location_point = Point(item_2)
or = GateOr(A=slice_at_full_depth_boolean, B=failed_mesh_shadow_boolean)
join = JoinCurves(Curves=sec, Preserve=False)
debrep_4 = DeconstructBrep(Brep=bbox_4.Box)  # -> Faces, Edges, Vertices
cutout_depth = Panel(filter_2)
top_slice_thickness_2 = Panel(top_slice_thickness)
item_7 = ListItem(List=join, Index=0, Wrap=True)
panel = Panel(or)
top_layer_slice = Curve(sec)
item_8 = ListItem(List=debrep_4.Vertices, Index=0, Wrap=True)
lng_2 = ListLength(List=join)
area = Area(Geometry=item_7)  # -> Area, Centroid
filter_3 = StreamFilter(Gate=panel, Stream0=item_8, Stream1=item)
larger = LargerThan(FirstNumber=lng_2, SecondNumber="1")  # -> LargerThan, OrEqualTo
simplify_3 = SimplifyTree(Tree=top_slice_location_point, Front=False)
stepover_distance_2 = Panel(stepover_distance)
larger_2 = LargerThan(FirstNumber=area.Area, SecondNumber=top_layer_pocket_threshold_area)  # -> LargerThan, OrEqualTo
lowes_slice_leftover_thickness_2 = Panel(lowes_slice_leftover_thickness)
simplify_4 = SimplifyTree(Tree=filter_3, Front=False)
pdecon_2 = Deconstruct(Point=simplify_3)  # -> XComponent, YComponent, ZComponent
pdecon_3 = Deconstruct(Point=simplify_4)  # -> XComponent, YComponent, ZComponent
xor = GateXor(A=larger.LargerThan, B=larger_2.LargerThan)
subtraction_2 = Subtraction(A=pdecon_2.ZComponent, B=top_slice_thickness_2)
addition_2 = Addition(A=pdecon_3.ZComponent, B=lowes_slice_leftover_thickness_2)
pt_2 = ConstructPoint(XCoordinate=pdecon_2.XComponent, YCoordinate=pdecon_2.YComponent, ZCoordinate=subtraction_2)
skip_top_slices_boolean = Integer(xor)
pt_3 = ConstructPoint(XCoordinate=pdecon_2.XComponent, YCoordinate=pdecon_2.YComponent, ZCoordinate=addition_2)
skip_top_slices_boolean_2 = Integer(skip_top_slices_boolean)
stepover_distance_3 = Panel(stepover_distance)
simplify_5 = SimplifyTree(Tree=skip_top_slices_boolean_2, Front=False)
multiplication_5 = Multiplication(A=stepover_distance_3, B="0.33")
pdecon_4 = Deconstruct(Point=pt_2)  # -> XComponent, YComponent, ZComponent
multiplication_6 = Multiplication(A=simplify_5, B=multiplication_5)
subtraction_3 = Subtraction(A=pdecon_4.ZComponent, B=multiplication_6)
pt_4 = ConstructPoint(XCoordinate=pdecon_4.XComponent, YCoordinate=pdecon_4.YComponent, ZCoordinate=subtraction_3)
upper_boundary_point = Point(pt_4)
lower_boundary_point = Point(pt_3)
inital_sample_slice_spacing_2 = Panel(inital_sample_slice_spacing)
ln = Line(StartPoint=upper_boundary_point, EndPoint=lower_boundary_point)
master_graph_line = Line(ln)
divide_curve_even_lenght = DivideCurveEvenLenght(crv=master_graph_line, B=inital_sample_slice_spacing_2)
meshes_for_3d_milling_2 = Mesh(meshes_for_3d_milling)
master_graph_points = Point(divide_curve_even_lenght)
xy_3 = XYPlane(Origin=master_graph_points)
multiplication_7 = Multiplication(A=inital_sample_slice_spacing_2, B=curve_sample_slice_reduction)
graft = GraftTree(Tree=meshes_for_3d_milling_2, IncludeEmptyLists=True, IncludeNullItems=True)
pshift_3 = ShiftPaths(Data=xy_3, Offset=-1)
inital_sample_slice_spacing_3 = Panel(multiplication_7)
sec_2 = MeshPlane(Mesh=graft, Plane=pshift_3)
divlength = DivideLength(Curve=sec_2, Length=inital_sample_slice_spacing_3)  # -> Points, Tangents, Parameters
Z_2 = UnitZ(Factor="0.1")
move = Move(Geometry=divlength.Points, Motion=Z_2)  # -> Geometry, Transform
pshift_4 = ShiftPaths(Data=move.Geometry, Offset=-1)
Z_3 = UnitZ(Factor=1)
mjoin_2 = MeshJoin(Meshes=meshes_for_3d_milling_2)
simplify_6 = SimplifyTree(Tree=pshift_4, Front=False)
meshray_2 = MeshRay(Mesh=mjoin_2, Point=simplify_6, Direction=Z_3)  # -> Point, Hit
dispatch = Dispatch(List=simplify_6, DispatchPattern=meshray_2.Hit)  # -> ListA, ListB
pt_5 = Point(dispatch.ListB)
clean = CleanTree(RemoveNulls=True, RemoveInvalid=True, RemoveEmpty=True, Tree=pt_5)
meshcp = MeshClosestPoint(Point=clean, Mesh=mjoin_2)  # -> Point, Index, Parameter
meval = MeshEval(Mesh=mjoin_2, Parameter=meshcp.Parameter)  # -> Point, Normal, Colour
vdis = VectorDisplay(Anchor=clean, Vector=meval.Normal)
Z_4 = UnitZ(Factor=1)
angle = Angle(VectorA=meval.Normal, VectorB=Z_4)  # -> Angle, Reflex
deg = Degrees(Radians=angle.Angle)
lng_3 = ListLength(List=deg)
sort_2 = SortList(Keys=deg)  # -> Keys, ValuesA
panel_2 = Panel(sort_2.Keys)
multiplication_8 = Multiplication(A=lng_3, B=sample_top_value_percentage)
round = Round(Number=multiplication_8)  # -> Nearest, Floor, Ceiling
split = SplitList(List=sort_2.Keys, Index=round.Ceiling)  # -> ListA, ListB
panel_3 = Panel(split.ListA)
avr = Average(Input=split.ListA)
panel_4 = Panel(avr)
lng_4 = ListLength(List=meshes_for_3d_milling)
pshift_5 = ShiftPaths(Data=avr, Offset=-1)
larger_3 = LargerThan(FirstNumber=lng_4, SecondNumber="1")  # -> LargerThan, OrEqualTo
pshift_6 = ShiftPaths(Data=pshift_5, Offset=-1)
pshift_7 = ShiftPaths(Data=avr, Offset=1)
max_angle_limit_2 = Panel(max_angle_limit)
filter_4 = StreamFilter(Gate=larger_3.LargerThan, Stream0=pshift_7, Stream1=pshift_6)
smaller = SmallerThan(FirstNumber=filter_4, SecondNumber=max_angle_limit_2)  # -> SmallerThan, OrEqualTo
dispatch_2 = Dispatch(List=filter_4, DispatchPattern=smaller.SmallerThan)  # -> ListA, ListB
lng_5 = ListLength(List=dispatch_2.ListA)
dup = DuplicateData(Data=max_angle_limit_2, Number=lng_5, Order=True)
master_graph_points_2 = Point(master_graph_points)
master_graph_line_2 = Line(master_graph_line)
pshift_8 = ShiftPaths(Data=dup, Offset=-1)
weave = Weave(Pattern=smaller.SmallerThan, Stream0=dispatch_2.ListB, Stream1=pshift_8, NullGaps=False)
average_surface_angle = Panel(weave)
lng_6 = ListLength(List=master_graph_points_2)
len = Length(Curve=master_graph_line_2)
subtraction_4 = Subtraction(A=lng_6, B="1")
division = Division(A=len, B=subtraction_4)
division_2 = Division(A=division, B="2")
neg = Negative(Value=division_2)
Z_5 = UnitZ(Factor=neg)
Z_6 = UnitZ(Factor=division_2)
move_2 = Move(Geometry=master_graph_points_2, Motion=Z_6)  # -> Geometry, Transform
move_3 = Move(Geometry=master_graph_points_2, Motion=Z_5)  # -> Geometry, Transform
xy_4 = XYPlane(Origin=master_graph_points_2)
subtraction_5 = Subtraction(A="90", B=average_surface_angle)
xz = XZPlane(Origin=master_graph_points_2)
neg_2 = Negative(Value=division_2)
ln_2 = Line(StartPoint=move_2.Geometry, EndPoint=move_3.Geometry)
neg_3 = Negative(Value=subtraction_5)
Z_7 = UnitZ(Factor=neg_2)
Z_8 = UnitZ(Factor=division_2)
move_4 = Move(Geometry=xy_4, Motion=Z_8)  # -> Geometry, Transform
move_5 = Move(Geometry=xy_4, Motion=Z_7)  # -> Geometry, Transform
rotate = Rotate(Geometry=ln_2, Angle=degrees(neg_3), Plane=xz)  # -> Geometry, Transform
plx = LinePlane(Line=rotate.Geometry, Plane=move_4.Geometry)  # -> Point, ParamL, ParamP
plx_2 = LinePlane(Line=rotate.Geometry, Plane=move_5.Geometry)  # -> Point, ParamL, ParamP
xy_5 = XYPlane(Origin=Point(0, 0, 0))
ln_3 = Line(StartPoint=plx.Point, EndPoint=plx_2.Point)
project = Project(Geometry=ln_3, Plane=xy_5)  # -> Geometry, Transform
bbox_5 = BoundingBox(Content=ln_3, Plane=PlaneXY(0, 0, 0))  # -> Box, Box_2; disabled
len_2 = Length(Curve=project.Geometry)
dim = Dimensions(Surface=bbox_5.Box)  # -> UDimension, VDimension; disabled
line_width = Number(len_2)
ma = MassAddition(Input=line_width)  # -> Result, PartialResults
division_3 = Division(A=line_width, B="2")
neg_4 = Negative(Value=ma.PartialResults)
X = UnitX(Factor=division_3)
X_2 = UnitX(Factor=neg_4)
move_6 = Move(Geometry=ln_3, Motion=X)  # -> Geometry, Transform
move_7 = Move(Geometry=move_6.Geometry, Motion=X_2)  # -> Geometry, Transform
milling_bit_radius_2 = Panel(multiplication_3)
curvepoint = PointOnCurve(move_7.Geometry, parameter=0.5)
intcrv = Interpolate(Vertices=curvepoint, Degree=3, Periodic=False, KnotStyle=1)  # -> Curve, Length, Domain
neg_5 = Negative(Value=milling_bit_radius_2)
xz_2 = XZPlane(Origin=Point(0, 0, 0))
offset = Offset(Curve=intcrv.Curve, Distance=milling_bit_radius_2, Plane=xz_2, Corners=1)
crv = Curve(intcrv.Curve)
end = EndPoints(Curve=master_graph_line_2)  # -> Start, End
end_2 = EndPoints(Curve=crv)  # -> Start, End
vec2pt = Vector2Pt(PointA=end_2.End, PointB=end.End, Unitize=False)  # -> Vector, Length
move_8 = Move(Geometry=crv, Motion=vec2pt.Vector)  # -> Geometry, Transform
stepover = Panel(stepover_distance)
simplify_7 = SimplifyTree(Tree=crv, Front=False)
divide_curve_even_lenght_2 = DivideCurveEvenLenght(crv=simplify_7, B=stepover)
pshift_9 = ShiftPaths(Data=divide_curve_even_lenght_2, Offset=-1)
pt_6 = Point(end.End)
pdecon_5 = Deconstruct(Point=pshift_9)  # -> XComponent, YComponent, ZComponent
pdecon_6 = Deconstruct(Point=pt_6)  # -> XComponent, YComponent, ZComponent
pt_7 = ConstructPoint(XCoordinate=pdecon_6.XComponent, YCoordinate=pdecon_5.YComponent, ZCoordinate=pdecon_5.ZComponent)
stepover_distance_4 = Panel(stepover_distance)
milling_bit_radius_3 = Panel(multiplication_3)
top_slice_location_point_2 = Point(item_2)
pt_8 = Point(pt_7)
skip_top_slices_boolean_3 = Integer(skip_top_slices_boolean)
top_layer_slice_2 = Curve(top_layer_slice)
subtraction_6 = Subtraction(A=milling_bit_radius_3, B=stepover_distance_4)
pdecon_7 = Deconstruct(Point=top_slice_location_point_2)  # -> XComponent, YComponent, ZComponent
pdecon_8 = Deconstruct(Point=pt_8)  # -> XComponent, YComponent, ZComponent
addition_3 = Addition(A=pdecon_7.ZComponent, B=subtraction_6)
item_9 = ListItem(List=pdecon_8.ZComponent, Index=0, Wrap=True)
crv_2 = Curve(top_layer_slice_2)
p_n_c = PickNChoose(Pattern=skip_top_slices_boolean_3, Stream1=crv_2)
p_n_c_2 = PickNChoose(Pattern=skip_top_slices_boolean_3, Stream0=item_9, Stream1=addition_3)
Z_9 = UnitZ(Factor=top_slice_sample_thickness)
pshift_10 = ShiftPaths(Data=p_n_c_2, Offset=-1)
move_9 = Move(Geometry=p_n_c, Motion=Z_9)  # -> Geometry, Transform
larger_4 = LargerThan(FirstNumber=pdecon_8.ZComponent, SecondNumber=pshift_10)  # -> LargerThan, OrEqualTo
top_slice_section_for_pocket = Curve(move_9.Geometry)
dispatch_3 = Dispatch(List=pt_8, DispatchPattern=larger_4.LargerThan)  # -> ListA, ListB
pt_9 = Point(dispatch_3.ListB)
meshes_for_3d_milling_3 = Mesh(graft(meshes_for_3d_milling))
meshes_for_3d_milling_4 = Mesh(joined_meshes_for_3d_milling)
milling_bit_radius_4 = Panel(multiplication_3)
initial_sample_lenght = Panel("0.2")
samples_per_circle = Panel("24")
xy_6 = XYPlane(Origin=pt_9)
reduction_tolerance_2 = Panel(reduction_tolerance)
sec_3 = MeshPlane(Mesh=meshes_for_3d_milling_3, Plane=xy_6)
join_2 = JoinCurves(Curves=sec_3, Preserve=False)
clean_2 = CleanTree(RemoveNulls=True, RemoveInvalid=True, RemoveEmpty=True, Tree=join_2)
simplify_8 = SimplifyTree(Tree=clean_2, Front=False)
redpline = Reduce(Polyline=simplify_8, Tolerance=reduction_tolerance_2)  # -> Polyline, Reduction
cp_2 = ControlPoints(Curve=redpline.Polyline)  # -> Points, Weights, Knots
crv_3 = Curve(redpline.Polyline)
xy_7 = XYPlane(Origin=cp_2.Points)
cir = Circle(Plane=xy_7, Radius=initial_sample_lenght)
ccx = CurveCurve(CurveA=cir, CurveB=graft(crv_3))  # -> Points, ParamsA, ParamsB
ccx_2 = CurveCurve(CurveA=crv_3, CurveB=cir)  # -> Points, ParamsA, ParamsB; disabled
pshift_11 = ShiftPaths(Data=ccx.Points, Offset=-1)
crv_4 = Curve(crv_3)
alongcrv = SortAlongCurve(Points=pshift_11, Curve=graft(crv_4))  # -> Points, Indices
pshift_12 = ShiftPaths(Data=alongcrv.Points, Offset=-1)
meshes_for_3d_milling_5 = Mesh(meshes_for_3d_milling_4)
sample_points_for_offset = Point(pshift_12)
milling_bit_radius_5 = Panel(milling_bit_radius_4)
sample_points_for_offset_2 = Point(sample_points_for_offset)
meshcp_2 = MeshClosestPoint(Point=sample_points_for_offset_2, Mesh=meshes_for_3d_milling_5)  # -> Point, Index, Parameter
meval_2 = MeshEval(Mesh=meshes_for_3d_milling_5, Parameter=meshcp_2.Parameter)  # -> Point, Normal, Colour
amp = Amplitude(Vector=meval_2.Normal, Amplitude=milling_bit_radius_5)
move_10 = Move(Geometry=meshcp_2.Point, Motion=amp)  # -> Geometry, Transform
pt_10 = Point(move_10.Geometry)
Z_10 = UnitZ(Factor="0.1")
meshcp_3 = MeshClosestPoint(Point=pt_10, Mesh=meshes_for_3d_milling_5)  # -> Point, Index, Parameter
vec2pt_2 = Vector2Pt(PointA=meshcp_3.Point, PointB=pt_10, Unitize=False)  # -> Vector, Length
mjoin_3 = MeshJoin(Meshes=meshes_for_3d_milling_2)
amp_2 = Amplitude(Vector=vec2pt_2.Vector, Amplitude=milling_bit_radius_5)
Z_11 = UnitZ(Factor=1)
move_11 = Move(Geometry=meshcp_3.Point, Motion=amp_2)  # -> Geometry, Transform
neg_6 = Negative(Value="0.1")
Z_12 = UnitZ(Factor=neg_6)
reduction_tolerance_3 = Panel(reduction_tolerance_2)
crv_5 = Curve(crv_3)
joined_meshes = Mesh(joined_meshes_for_3d_milling)
neg_7 = Negative(Value="0.01")
Z_13 = UnitZ(Factor=neg_7)
cullpt = CullDuplicates(Points=move_11.Geometry, Tolerance=reduction_tolerance_3, CullMode=3)  # -> Points, Indices, Valence
alongcrv_2 = SortAlongCurve(Points=cullpt.Points, Curve=graft(crv_5))  # -> Points, Indices
pline_2 = PolyLine(Vertices=cullpt.Points, Closed=True)
vertical_angle_cutoff_2 = Panel(vertical_angle_cutoff)
pline_3 = PolyLine(Vertices=alongcrv_2.Points, Closed=True)
Z_14 = UnitZ(Factor=1)
redpline_2 = Reduce(Polyline=pline_3, Tolerance=reduction_tolerance_3)  # -> Polyline, Reduction
corner_sample_angle_threshold = Slider(9, range=0..100)
simplify_9 = SimplifyTree(Tree=redpline_2.Polyline, Front=False)
crv_6 = Curve(simplify_9)
cp_3 = ControlPoints(Curve=crv_6)  # -> Points, Weights, Knots
Z_15 = UnitZ(Factor=1)
simplify_10 = SimplifyTree(Tree=cp_3.Points, Front=False)
panel_5 = Panel(corner_sample_angle_threshold)
cullpt_2 = CullDuplicates(Points=simplify_10, Tolerance=reduction_tolerance_3, CullMode=3)  # -> Points, Indices, Valence
pt_11 = Point(cullpt_2.Points)
crv_cp = CurveClosestPoint(Point=pt_11, Curve=crv_6)  # -> Point, Parameter, Distance
eval = EvaluateCurve(Curve=crv_6, Parameter=crv_cp.Parameter)  # -> Point, Tangent, Angle
xy_8 = XYPlane(Origin=Point(0, 0, 0))
rad = Radians(Degrees=panel_5)
samples_per_circle_2 = Panel(samples_per_circle)
pt_12 = Point(cullpt_2.Points)
cir_2 = Circle(Plane=xy_8, Radius=milling_bit_radius_5)
larger_5 = LargerThan(FirstNumber=eval.Angle, SecondNumber=rad)  # -> LargerThan, OrEqualTo
len_3 = Length(Curve=cir_2)
p_n_c_3 = PickNChoose(Pattern=larger_5.LargerThan, Stream1=pt_11)
pt_13 = Point(p_n_c_3)
cps = ClosestPoints(Point=pt_13, Cloud=pt_13, Count="2")  # -> ClosestPoint, CPIndex, Distance
item_10 = ListItem(List=cps.Distance, Index="1", Wrap=True)
division_4 = Division(A=len_3, B=samples_per_circle_2)
pshift_13 = ShiftPaths(Data=item_10, Offset=-1)
multiplication_9 = Multiplication(A=pshift_13, B="0.49")
division_5 = Division(A=multiplication_9, B=division_4)
milling_bit_radius_6 = Panel(multiplication_3)
round_2 = Round(Number=division_5)  # -> Nearest, Floor, Ceiling
joined_meshes_2 = Mesh(joined_meshes_for_3d_milling)
pt_14 = Point(p_n_c_3)
pt_15 = Point(cullpt_2.Points)
division_6 = Division(A=multiplication_9, B=round_2.Ceiling)
xy_9 = XYPlane(Origin=pt_14)
series = Series(Start=division_6, Step=division_6, Count=round_2.Ceiling)
graft_2 = GraftTree(Tree=xy_9, IncludeEmptyLists=True, IncludeNullItems=True)
sph = Sphere(Base=graft_2, Radius=series)
pshift_14 = ShiftPaths(Data=sph, Offset=-1)
bcx = BrepCurve(Brep=pshift_14, Curve=crv_6)  # -> Curves, Points
series_2 = Series(Start=0, Step=Slider(45, range=0..100), Count=Slider(8, range=0..10))
pshift_15 = ShiftPaths(Data=bcx.Points, Offset=-1)
merge_2 = Merge(Data1=cullpt_2.Points, Data2=pshift_15)
rad_2 = Radians(Degrees=series_2)
reduction_tolerance_4 = Panel(reduction_tolerance_2)
alongcrv_3 = SortAlongCurve(Points=merge_2, Curve=graft(crv_6))  # -> Points, Indices
Z_16 = UnitZ(Factor=1)
pline_4 = PolyLine(Vertices=alongcrv_3.Points, Closed=True)
smoothpline = SmoothPolyline(Polyline=pline_4, Strength="1", Times="2")
redpline_3 = Reduce(Polyline=smoothpline, Tolerance=reduction_tolerance_4)  # -> Polyline, Reduction; disabled
cp_4 = ControlPoints(Curve=smoothpline)  # -> Points, Weights, Knots
pshift_16 = ShiftPaths(Data=cp_4.Points, Offset=-1)
meshcp_4 = MeshClosestPoint(Point=pshift_16, Mesh=meshes_for_3d_milling_5)  # -> Point, Index, Parameter
mesh_2 = Mesh(meshes_for_3d_milling)
vec2pt_3 = Vector2Pt(PointA=meshcp_4.Point, PointB=pshift_16, Unitize=False)  # -> Vector, Length
bbox_6 = BoundingBox(Content=mesh_2, Plane=PlaneXY(0, 0, 0), UnionBox=False)  # -> Box, Box_2
amp_3 = Amplitude(Vector=vec2pt_3.Vector, Amplitude=milling_bit_radius_5)
xy_10 = XYPlane(Origin=Point(0, 0, 0))
simplify_11 = SimplifyTree(Tree=top_layer_slice_2, Front=False)
move_12 = Move(Geometry=meshcp_4.Point, Motion=amp_3)  # -> Geometry, Transform
debrep_5 = DeconstructBrep(Brep=bbox_6.Box)  # -> Faces, Edges, Vertices
project_2 = Project(Geometry=simplify_11, Plane=xy_10)  # -> Geometry, Transform
item_11 = ListItem(List=debrep_5.Vertices, Index="4", Wrap=True)
pline_5 = PolyLine(Vertices=move_12.Geometry, Closed=True)
crv_7 = Curve(pline_5)
xy_11 = XYPlane(Origin=item_11)
pshift_17 = ShiftPaths(Data=xy_11, Offset=-1)
area_cull = Panel("10")
milling_bit_radius_7 = Panel(milling_bit_radius)
mshadow_2 = MeshShadow(Mesh=mesh_2, Light=Vector(0, 0, -1), Plane=pshift_17)
joined_meshes_3 = Mesh(joined_meshes_for_3d_milling)
joined_meshes_for_3d_milling_2 = Mesh(joined_meshes_for_3d_milling)
# do mesh inclusion test?
toolpath_for_mesh_inclusion_test = Curve(pline_5)
area_2 = Area(Geometry=mshadow_2)  # -> Area, Centroid
multiplication_10 = Multiplication(A=milling_bit_radius_7, B=area_cull)
cp_5 = ControlPoints(Curve=toolpath_for_mesh_inclusion_test)  # -> Points, Weights, Knots
smaller_2 = SmallerThan(FirstNumber=area_2.Area, SecondNumber=multiplication_10)  # -> SmallerThan, OrEqualTo
# fix: select failed shadow and tringulate for speed
dispatch_4 = Dispatch(List=mshadow_2, DispatchPattern=smaller_2.SmallerThan)  # -> ListA, ListB
minc = MeshInclusion(Mesh=joined_meshes_for_3d_milling_2, Point=cp_5.Points, Strict=False)
dispatch_5 = Dispatch(List=cp_5.Points, DispatchPattern=minc)  # -> ListA, ListB
pt_16 = Point(dispatch_5.ListB)
pline_6 = PolyLine(Vertices=pt_16, Closed=False)
collsion_corrected_toolpaths = Curve(pline_6)
collsion_corrected_toolpaths_2 = Curve(collsion_corrected_toolpaths)
explode = Explode(Curve=collsion_corrected_toolpaths_2, Recursive=True)  # -> Segments, Vertices
cp_6 = ControlPoints(Curve=explode.Segments)  # -> Points, Weights, Knots
# Fix undercut based on points on surface
simplify_12 = SimplifyTree(Tree=cp_6.Points, Front=False)
move_13 = Move(Geometry=simplify_12, Motion=Z_10)  # -> Geometry, Transform
simplify_13 = SimplifyTree(Tree=move_13.Geometry, Front=False)
meshray_3 = MeshRay(Mesh=mjoin_3, Point=simplify_13, Direction=Z_11)  # -> Point, Hit
dispatch_6 = Dispatch(List=simplify_13, DispatchPattern=meshray_3.Hit)  # -> ListA, ListB
move_14 = Move(Geometry=dispatch_6.ListB, Motion=Z_12)  # -> Geometry, Transform
pt_17 = Point(move_14.Geometry)
meshcp_5 = MeshClosestPoint(Point=pt_17, Mesh=joined_meshes)  # -> Point, Index, Parameter
move_15 = Move(Geometry=meshcp_5.Point, Motion=Z_13)  # -> Geometry, Transform
meshcp_6 = MeshClosestPoint(Point=move_15.Geometry, Mesh=joined_meshes)  # -> Point, Index, Parameter
meval_3 = MeshEval(Mesh=joined_meshes, Parameter=meshcp_6.Parameter)  # -> Point, Normal, Colour
angle_2 = Angle(VectorA=meval_3.Normal, VectorB=Z_14)  # -> Angle, Reflex
deg_2 = Degrees(Radians=angle_2.Angle)
larger_6 = LargerThan(FirstNumber=deg_2, SecondNumber=vertical_angle_cutoff_2)  # -> LargerThan, OrEqualTo
vec2pt_4 = Vector2Pt(PointA=meshcp_6.Point, PointB=pt_17, Unitize=False)  # -> Vector, Length
dispatch_7 = Dispatch(List=pt_17, DispatchPattern=larger_6.LargerThan)  # -> ListA, ListB
dispatch_8 = Dispatch(List=vec2pt_4.Vector, DispatchPattern=larger_6.LargerThan)  # -> ListA, ListB
angle_3 = Angle(VectorA=dispatch_8.ListB, VectorB=Z_15)  # -> Angle, Reflex
deg_3 = Degrees(Radians=angle_3.Angle)
larger_7 = LargerThan(FirstNumber=deg_3, SecondNumber="90")  # -> LargerThan, OrEqualTo
dispatch_9 = Dispatch(List=dispatch_7.ListB, DispatchPattern=larger_7.LargerThan)  # -> ListA, ListB
pt_18 = Point(dispatch_9.ListB)
pt_19 = Point(pt_18)
meshcp_7 = MeshClosestPoint(Point=pt_19, Mesh=joined_meshes_2)  # -> Point, Index, Parameter
pdecon_9 = Deconstruct(Point=pt_19)  # -> XComponent, YComponent, ZComponent
pdecon_10 = Deconstruct(Point=meshcp_7.Point)  # -> XComponent, YComponent, ZComponent
pt_20 = ConstructPoint(XCoordinate=pdecon_10.XComponent, YCoordinate=pdecon_10.YComponent, ZCoordinate=pdecon_9.ZComponent)
vec2pt_5 = Vector2Pt(PointA=pt_19, PointB=pt_20, Unitize=False)  # -> Vector, Length
amp_4 = Amplitude(Vector=vec2pt_5.Vector, Amplitude=milling_bit_radius_6)
move_16 = Move(Geometry=pt_19, Motion=amp_4)  # -> Geometry, Transform
xy_12 = XYPlane(Origin=pt_19)
rotate_2 = Rotate(Geometry=move_16.Geometry, Angle=rad_2, Plane=xy_12)  # -> Geometry, Transform
meshray_4 = MeshRay(Mesh=joined_meshes_2, Point=rotate_2.Geometry, Direction=Z_16)  # -> Point, Hit
sort_3 = SortList(Keys=meshray_4.Hit)  # -> Keys, ValuesA
rev_2 = ReverseList(List=sort_3.Keys)
item_12 = ListItem(List=rev_2, Index=0, Wrap=True)
dispatch_10 = Dispatch(List=pt_19, DispatchPattern=item_12)  # -> ListA, ListB
pt_21 = Point(dispatch_10.ListB)
pt_22 = Point(pt_21)
pline_7 = PolyLine(Vertices=pt_22, Closed=False)
clean_3 = CleanTree(RemoveNulls=True, RemoveInvalid=True, RemoveEmpty=True, Tree=pline_7)
crv_8 = Curve(clean_3)
explode_2 = Explode(Curve=crv_8, Recursive=True)  # -> Segments, Vertices
project_3 = Project(Geometry=explode_2.Segments, Plane=xy_10)  # -> Geometry, Transform
colom = CollisionOneMany(Collider=explode_2.Segments, Obstacles=flatten(joined_meshes_3))  # -> Collision, Index
colom_2 = CollisionOneMany(Collider=project_3.Geometry, Obstacles=flatten(project_2.Geometry))  # -> Collision, Index
or_2 = GateOr(A=colom.Collision, B=colom_2.Collision)
dispatch_11 = Dispatch(List=explode_2.Segments, DispatchPattern=or_2)  # -> ListA, ListB
crv_9 = Curve(dispatch_11.ListB)
explode_3 = Explode(Curve=crv_9, Recursive=True)  # -> Segments, Vertices; disabled
simplify_14 = SimplifyTree(Tree=explode_3.Segments, Front=False)
curvepoint_2 = PointOnCurve(simplify_14, parameter=0.5)
project_4 = Project(Geometry=curvepoint_2, Plane=xy_10)  # -> Geometry, Transform; disabled
# Fix: make slices from donut shape work
panel_6 = Panel("0.6")
oultine_curve_for_cutout = Curve(dispatch_4.ListB)
incurves = PointInCurves(Point=project_4.Geometry, Curves=flatten(project_2.Geometry))  # -> Relationship, Index, Point
tool_diameter = Panel(milling_bit_diameter_2)
multiplication_11 = Multiplication(A=incurves.Relationship, B=panel_6)
simplify_15 = SimplifyTree(Tree=oultine_curve_for_cutout, Front=False)
int = Integer(multiplication_11)
dispatch_12 = Dispatch(List=simplify_14, DispatchPattern=int)  # -> ListA, ListB
tool_diameter_2 = Panel(tool_diameter)
xy_13 = XYPlane(Origin=Point(0, 0, 0))
curves_for_cutout = Curve(simplify_15)
collison_free_polylines = Curve(crv_9)
operation_plane = Plane(xy_13)
multiplication_12 = Multiplication(A=tool_diameter_2, B="0.5")
cls = Closed(Curve=curves_for_cutout)  # -> Closed, Periodic
explode_4 = Explode(Curve=collison_free_polylines, Recursive=True)  # -> Segments, Vertices
number_of_checking_points_per_segment = Panel("4")
tool_radius = Panel(multiplication_12)
cutout_tolerance_3 = Panel(cutout_tolerance_2)
dispatch_13 = Dispatch(List=curves_for_cutout, DispatchPattern=cls.Closed)  # -> ListA, ListB
simplify_16 = SimplifyTree(Tree=explode_4.Segments, Front=False)
addition_4 = Addition(A=tool_radius, B=cutout_tolerance_3)
divide = DivideCurve(Curve=simplify_16, Count=number_of_checking_points_per_segment, Kinks=False)  # -> Points, Tangents, Parameters
mesh_3 = Mesh(mjoin_3)
compensated_tool_radius = Panel(addition_4)
cull_i = CullIndex(List=divide.Points, Indices="0", Wrap=True)
rev_3 = ReverseList(List=cull_i)
curves_for_merging_overlap = Curve(dispatch_13.ListA)
cull_i_2 = CullIndex(List=rev_3, Indices="0", Wrap=True)
simplify_17 = SimplifyTree(Tree=cull_i_2, Front=False)
mcx = MultipleCurves(Curves=curves_for_merging_overlap)  # -> Points, IndexA, IndexB, ParamA, ParamB
pt_23 = Point(simplify_17)
dcon = DeleteConsecutive(Set=[mcx.IndexA, mcx.IndexB], Wrap=False)  # -> Set, Count
meshcp_8 = MeshClosestPoint(Point=pt_23, Mesh=mesh_3)  # -> Point, Index, Parameter
milling_bit_radius_8 = Panel(milling_bit_radius)
dist_2 = Distance(PointA=pt_23, PointB=meshcp_8.Point)
item_13 = ListItem(List=curves_for_merging_overlap, Index=dcon.Set, Wrap=True)
subtraction_7 = Subtraction(A=dist_2, B=milling_bit_radius_8)
abs = Absolute(Value=subtraction_7)
cull_i_3 = CullIndex(List=curves_for_merging_overlap, Indices=dcon.Set, Wrap=True)
runion = RegionUnion(Curves=item_13, Plane=operation_plane)
ratio_for_cull = Panel("0.5")
ratio_for_cull_2 = Panel("1")
sort_4 = SortList(Keys=abs)  # -> Keys, ValuesA
rev_4 = ReverseList(List=sort_4.Keys)
merged_overlapping_curves = Curve([runion, cull_i_3])
multiplication_13 = Multiplication(A=milling_bit_radius_8, B=ratio_for_cull)
item_14 = ListItem(List=rev_4, Index=0, Wrap=True)
larger_8 = LargerThan(FirstNumber=item_14, SecondNumber=multiplication_13)  # -> LargerThan, OrEqualTo
threshold_for_rebuild = Panel("0.1")
dispatch_14 = Dispatch(List=item_14, DispatchPattern=larger_8.LargerThan)  # -> ListA, ListB
dispatch_15 = Dispatch(List=simplify_16, DispatchPattern=larger_8.LargerThan)  # -> ListA, ListB
# For higher sampling number fix bridge curves beeing pulled under overhangs
larger_9 = LargerThan(FirstNumber=dispatch_14.ListB, SecondNumber=threshold_for_rebuild)  # -> LargerThan, OrEqualTo
crv_10 = Curve(dispatch_15.ListB)
curves_for_aligned_direction = Curve(merged_overlapping_curves)
dispatch_16 = Dispatch(List=crv_10, DispatchPattern=larger_9.LargerThan)  # -> ListA, ListB
# fix bad corner cull and angle check. use obr test triangle
panel_7 = Panel("2")
multiplication_14 = Multiplication(A=number_of_checking_points_per_segment, B=panel_7)
divide_2 = DivideCurve(Curve=dispatch_16.ListA, Count="1", Kinks=False)  # -> Points, Tangents, Parameters
graft_3 = GraftTree(Tree=curves_for_aligned_direction, IncludeEmptyLists=True, IncludeNullItems=True)
pline_8 = PolyLine(Vertices=divide_2.Points, Closed=False)
clean_4 = CleanTree(RemoveNulls=True, RemoveInvalid=True, RemoveEmpty=False, Tree=pline_8)
offset_2 = Offset(Curve=graft_3, Distance="0.01", Plane=PlaneXY(0, 0, 0), Corners=2)
pshift_18 = ShiftPaths(Data=clean_4, Offset=-1)
end_3 = EndPoints(Curve=offset_2)  # -> Start, End
pshift_19 = ShiftPaths(Data=end_3.Start, Offset=-1)
curvepoint_3 = PointOnCurve(pshift_18, parameter=0.496)
Z_17 = UnitZ(Factor="0.1")
incurve = PointInCurve(Point=pshift_19, Curve=graft_3)  # -> Relationship, Point
move_17 = Move(Geometry=curvepoint_3, Motion=Z_17)  # -> Geometry, Transform
mjoin_4 = MeshJoin(Meshes=meshes_for_3d_milling_2)
multiplication_15 = Multiplication(A=incurve.Relationship, B="0.5")
simplify_18 = SimplifyTree(Tree=move_17.Geometry, Front=False)
round_3 = Round(Number=multiplication_15)  # -> Nearest, Floor, Ceiling
Z_18 = UnitZ(Factor=1)
meshray_5 = MeshRay(Mesh=mjoin_4, Point=simplify_18, Direction=Z_18)  # -> Point, Hit
crv_11 = Curve(graft_3)
int_2 = Integer(round_3.Nearest)
flip = FlipCurve(Curve=crv_11)  # -> Curve, Flag
dispatch_17 = Dispatch(List=pshift_18, DispatchPattern=meshray_5.Hit)  # -> ListA, ListB
weave_2 = Weave(Pattern=int_2, Stream0=flip.Curve, Stream1=crv_11, NullGaps=False)
lng_7 = ListLength(List=dispatch_17.ListA)
crv_12 = Curve(dispatch_17.ListB)
pshift_20 = ShiftPaths(Data=weave_2, Offset=-1)
dup_2 = DuplicateData(Data="0", Number=lng_7, Order=True)
use_inside_cutting = Panel("0")
pshift_21 = ShiftPaths(Data=dup_2, Offset=-1)
flip_2 = FlipCurve(Curve=pshift_20)  # -> Curve, Flag
weave_3 = Weave(Pattern=[0, 1], Stream0=crv_12, Stream1=pshift_21, NullGaps=False)
weave_4 = Weave(Pattern=larger_9.LargerThan, Stream0=dispatch_16.ListB, Stream1=weave_3, NullGaps=False)
filter_5 = StreamFilter(Gate=use_inside_cutting, Stream0=pshift_20, Stream1=flip_2.Curve)
crv_13 = Curve(weave_4)
aligned_curves = Curve(filter_5)
clean_5 = CleanTree(RemoveNulls=True, RemoveInvalid=True, RemoveEmpty=False, Tree=crv_13)
crv_14 = Curve(clean_5)
simplify_19 = SimplifyTree(Tree=aligned_curves, Front=False)
pshift_22 = ShiftPaths(Data=crv_14, Offset="-2")
null = NullItem(Item=pshift_22)  # -> NullFlags, InvalidFlags, Description
aligned_curves_2 = Curve(simplify_19)
flatten_2 = FlattenTree(Tree=crv_14, Path="{0}")
item_15 = ListItem(List=flatten(null.InvalidFlags), Index=0, Wrap=True)
end_4 = EndPoints(Curve=aligned_curves_2)  # -> Start, End
graft_4 = GraftTree(Tree=aligned_curves_2, IncludeEmptyLists=True, IncludeNullItems=True)
filter_6 = StreamFilter(Gate=item_15, Stream0=pshift_22, Stream1=flatten_2)
flatten_3 = FlattenTree(Tree=end_4.Start, Path="{0}")
join_3 = JoinCurves(Curves=filter_6, Preserve=False)
incurve_2 = PointInCurve(Point=flatten_3, Curve=graft_4)  # -> Relationship, Point
cp_7 = ControlPoints(Curve=join_3)  # -> Points, Weights, Knots
pdecon_11 = Deconstruct(Point=cp_7.Points)  # -> XComponent, YComponent, ZComponent
multiplication_16 = Multiplication(A=incurve_2.Relationship, B="0.5")
nblur = BlurNumbers(
    Numbers=pdecon_11.ZComponent,
    Strength=Slider(1, range=0..1),
    Iterations=Slider(10, range=0..10),
    Lock=Toggle(True),
    Wrap=False)
generate_roughing = Panel(generate_3d_roughing_2)
milling_bit_radius_9 = Panel(milling_bit_radius)
mesh_4 = Mesh(joined_meshes_for_3d_milling)
points_to_offset_with_tool_radius = Point(cp_7.Points)
avr_2 = Average(Input=pdecon_11.ZComponent)
round_4 = Round(Number=multiplication_16)  # -> Nearest, Floor, Ceiling
int_3 = Integer(round_4.Floor)
pt_24 = ConstructPoint(XCoordinate=pdecon_11.XComponent, YCoordinate=pdecon_11.YComponent, ZCoordinate=nblur)
sort_5 = SortList(Keys=int_3)  # -> Keys, ValuesA
pline_9 = PolyLine(Vertices=pt_24, Closed=False)
meshcp_9 = MeshClosestPoint(Point=points_to_offset_with_tool_radius, Mesh=mesh_4)  # -> Point, Index, Parameter
rev_5 = ReverseList(List=sort_5.Keys)
dist_3 = Distance(PointA=points_to_offset_with_tool_radius, PointB=meshcp_9.Point)
smoothpline_2 = SmoothPolyline(Polyline=pline_9, Strength=1, Times=Slider(5, range=0..10))
item_16 = ListItem(List=rev_5, Index=0, Wrap=True)
redpline_4 = Reduce(Polyline=smoothpline_2, Tolerance="0.02")  # -> Polyline, Reduction
vec2pt_6 = Vector2Pt(PointA=meshcp_9.Point, PointB=points_to_offset_with_tool_radius, Unitize=False)  # -> Vector, Length
subtraction_8 = Subtraction(A=milling_bit_radius_9, B=dist_3)
pshift_23 = ShiftPaths(Data=item_16, Offset=-1)
cp_8 = ControlPoints(Curve=redpline_4.Polyline)  # -> Points, Weights, Knots
pt_25 = Point(cp_8.Points)
lng_8 = ListLength(List=pshift_23)
smaller_3 = SmallerThan(FirstNumber=lng_8, SecondNumber="2")  # -> SmallerThan, OrEqualTo
amp_5 = Amplitude(Vector=vec2pt_6.Vector, Amplitude=subtraction_8)
dispatch_18 = Dispatch(List=pshift_23, DispatchPattern=smaller_3.SmallerThan)  # -> ListA, ListB
move_18 = Move(Geometry=points_to_offset_with_tool_radius, Motion=amp_5)  # -> Geometry, Transform
not_2 = GateNot(A=dispatch_18.ListA)
points_at_tool_radius_distance_from_mesh = Point(move_18.Geometry)
weave_5 = Weave(Pattern=[0, 1], Stream0=dispatch_18.ListB, Stream1=not_2, NullGaps=False)
dispatch_19 = Dispatch(List=aligned_curves_2, DispatchPattern=weave_5)  # -> ListA, ListB
curves_outside = Curve(dispatch_19.ListA)
curves_inside = Curve(dispatch_19.ListB)
simplify_20 = SimplifyTree(Tree=points_at_tool_radius_distance_from_mesh, Front=False)
mjoin_5 = MeshJoin(Meshes=meshes_for_3d_milling_2)
Z_19 = UnitZ(Factor=1)
meshray_6 = MeshRay(Mesh=mjoin_5, Point=simplify_20, Direction=Z_19)  # -> Point, Hit
curves_for_offset_outwards = Curve(curves_outside)
dispatch_20 = Dispatch(List=simplify_20, DispatchPattern=meshray_6.Hit)  # -> ListA, ListB
curves_for_offset_inwards = Curve(curves_inside)
operation_plane_2 = Plane(operation_plane)
pt_26 = Point(dispatch_20.ListB)
neg_8 = Negative(Value=compensated_tool_radius)
redpline_5 = Reduce(Polyline=curves_for_offset_outwards, Tolerance="0.02")  # -> Polyline, Reduction
redpline_6 = Reduce(Polyline=curves_for_offset_inwards, Tolerance="0.02")  # -> Polyline, Reduction
finish_stepover = Panel(finishing_stepover_2)
roughing_stepover_3 = Panel(roughing_stepover_2)
milling_bit_radius_10 = Panel(milling_bit_radius)
reduction_tolerance_5 = Panel(reduction_tolerance)
offset_3 = Offset(Curve=redpline_5.Polyline, Distance=neg_8, Plane=operation_plane_2, Corners=2)
offset_4 = Offset(Curve=redpline_6.Polyline, Distance=compensated_tool_radius, Plane=operation_plane_2, Corners=2)
pline_10 = PolyLine(Vertices=pt_26, Closed=False)
cls_2 = Closed(Curve=offset_3)  # -> Closed, Periodic
cls_3 = Closed(Curve=offset_4)  # -> Closed, Periodic
redpline_7 = Reduce(Polyline=pline_10, Tolerance=reduction_tolerance_5)  # -> Polyline, Reduction
division_7 = Division(A=roughing_stepover_3, B=finish_stepover)
multiplication_17 = Multiplication(A=milling_bit_radius_10, B="1")
round_5 = Round(Number=division_7)  # -> Nearest, Floor, Ceiling
len_4 = Length(Curve=redpline_7.Polyline)
# Use cutout as last roughing pass?
# Fix: cull logic. not always true. make possible use all finsih for roughing
toggle = BooleanToggle(True)
smaller_4 = SmallerThan(FirstNumber=len_4, SecondNumber=multiplication_17)  # -> SmallerThan, OrEqualTo
smaller_5 = SmallerThan(FirstNumber=round_5.Floor, SecondNumber="2")  # -> SmallerThan, OrEqualTo
dup_3 = DuplicateData(Data=Toggle(False), Number=round_5.Floor, Order=True)
safe_offset_curve = SafeOffsetCurve(offset_amount=compensated_tool_radius, curves_to_offset=redpline_5.Polyline)  # -> error_corrected_curves_outside_2, error_corrected_curves_inside_2
safe_offset_curve_2 = SafeOffsetCurve(offset_amount=compensated_tool_radius, curves_to_offset=redpline_6.Polyline)  # -> error_corrected_curves_outside_2, error_corrected_curves_inside_2
dispatch_21 = Dispatch(List=redpline_7.Polyline, DispatchPattern=smaller_4.SmallerThan)  # -> ListA, ListB
crv_15 = Curve(dispatch_21.ListB)
filter_7 = StreamFilter(Gate=generate_roughing, Stream1=crv_15)
len_5 = Length(Curve=flatten(dispatch_21.ListB))
simplify_21 = SimplifyTree(Tree=filter_7, Front=False)
ma_2 = MassAddition(Input=len_5)  # -> Result, PartialResults
panel_8 = Panel(ma_2.Result)
pshift_24 = ShiftPaths(Data=simplify_21, Offset=-1)
null_2 = NullItem(Item=pshift_24)  # -> NullFlags, InvalidFlags, Description
flatten_4 = FlattenTree(Tree=null_2.NullFlags, Path="{0}")
item_17 = ListItem(List=flatten_4, Index=0, Wrap=True)
filter_8 = StreamFilter(Gate=item_17, Stream0=pshift_24, Stream1=simplify_21)
pshift_25 = ShiftPaths(Data=filter_8, Offset=-1)
null_3 = NullItem(Item=pshift_25)  # -> NullFlags, InvalidFlags, Description
flatten_5 = FlattenTree(Tree=null_3.NullFlags, Path="{0}")
item_18 = ListItem(List=flatten_5, Index=0, Wrap=True)
filter_9 = StreamFilter(Gate=item_18, Stream0=pshift_25, Stream1=filter_8)
flatten_6 = FlattenTree(Tree=filter_9, Path="{0}")
pshift_26 = ShiftPaths(Data=filter_9, Offset=-1)
null_4 = NullItem(Item=pshift_26)  # -> NullFlags, InvalidFlags, Description
flatten_7 = FlattenTree(Tree=null_4.NullFlags, Path="{0}")
item_19 = ListItem(List=flatten_7, Index=0, Wrap=True)
filter_10 = StreamFilter(Gate=item_19, Stream0=pshift_26, Stream1=flatten_6)
rev_6 = ReverseList(List=filter_10)
# Fix: pick correct bottom lines when opn toolpaths in bottom
divide_3 = DivideCurve(Curve=rev_6, Count=10, Kinks=False)  # -> Points, Tangents, Parameters; disabled
pdecon_12 = Deconstruct(Point=divide_3.Points)  # -> XComponent, YComponent, ZComponent
avr_3 = Average(Input=pdecon_12.ZComponent)
merge_3 = Merge(Data1=flatten(toggle), Data2=flatten(dup_3))
generate_finishing = Panel(generate_3d_finishing_2)
pshift_27 = ShiftPaths(Data=avr_3, Offset=-1)
cull = CullPattern(List=rev_6, CullPattern=merge_3)
panel_9 = Panel(pshift_27)
filter_11 = StreamFilter(Gate=smaller_5.SmallerThan, Stream0=cull, Stream1=rev_6)
flip_3 = FlipCurve(Curve=safe_offset_curve.error_corrected_curves_outside_2)  # -> Curve, Flag
p_n_c_4 = PickNChoose(Pattern=cls_3.Closed, Stream0=safe_offset_curve_2.error_corrected_curves_inside_2, Stream1=offset_4)
p_n_c_5 = PickNChoose(Pattern=cls_2.Closed, Stream0=flip_3.Curve, Stream1=offset_3)
clean_6 = CleanTree(RemoveNulls=True, RemoveInvalid=True, RemoveEmpty=True, Tree=filter_11)
flip_4 = FlipCurve(Curve=p_n_c_4)  # -> Curve, Flag
rev_7 = ReverseList(List=clean_6)
outside_cutout_curves = Curve(p_n_c_5)
inside_cutout_curves = Curve(flip_4.Curve)
neg_9 = Negative(Value=milling_bit_radius_10)
filter_12 = StreamFilter(Gate=generate_finishing, Stream1=dispatch_21.ListB)
Z_20 = UnitZ(Factor=neg_9)
crv_16 = Curve(rev_7)
outside_cutout_curves_2 = Curve(outside_cutout_curves)
inside_cutout_curves_2 = Curve(inside_cutout_curves)
move_19 = Move(Geometry=filter_12, Motion=Z_20)  # -> Geometry, Transform
cp_9 = ControlPoints(Curve=crv_16)  # -> Points, Weights, Knots
clean_7 = CleanTree(RemoveNulls=True, RemoveInvalid=True, RemoveEmpty=False, Tree=move_19.Geometry)
points_to_offset_with_tool_radius_2 = Point(cp_9.Points)
mesh_5 = Mesh(joined_meshes_for_3d_milling)
milling_bit_radius_11 = Panel(milling_bit_radius)
roughing_material_leftover_3 = Panel(roughing_material_leftover_2)
inside_outline_curves = Curve(inside_cutout_curves_2)
simplify_22 = SimplifyTree(Tree=clean_7, Front=False)
lng_9 = ListLength(List=meshes_for_3d_milling)
addition_5 = Addition(A=milling_bit_radius_11, B=roughing_material_leftover_3)
end_5 = EndPoints(Curve=inside_outline_curves)  # -> Start, End
smaller_6 = SmallerThan(FirstNumber=lng_9, SecondNumber="2")  # -> SmallerThan, OrEqualTo
flatten_8 = FlattenTree(Tree=simplify_22, Path="{0}")
pshift_28 = ShiftPaths(Data=simplify_22, Offset="-1")
pshift_29 = ShiftPaths(Data=simplify_22, Offset="-2")
meshcp_10 = MeshClosestPoint(Point=points_to_offset_with_tool_radius_2, Mesh=mesh_5)  # -> Point, Index, Parameter
incurves_2 = PointInCurves(Point=end_5.Start, Curves=outside_cutout_curves_2)  # -> Relationship, Index, Point
dist_4 = Distance(PointA=points_to_offset_with_tool_radius_2, PointB=meshcp_10.Point)
item_20 = ListItem(List=flatten(pshift_29), Index=0, Wrap=True)
addition_6 = Addition(A=incurves_2.Index, B="1")
vec2pt_7 = Vector2Pt(PointA=meshcp_10.Point, PointB=points_to_offset_with_tool_radius_2, Unitize=False)  # -> Vector, Length
null_5 = NullItem(Item=item_20)  # -> NullFlags, InvalidFlags, Description
merge_4 = Merge(Data1=outside_cutout_curves, Data2=inside_cutout_curves)  # disabled
subtraction_9 = Subtraction(A=addition_5, B=dist_4)
ins = InsertItems(List=outside_cutout_curves_2, Item=inside_outline_curves, Indices=incurves_2.Index, Wrap=True)
filter_13 = StreamFilter(Gate=null_5.NullFlags, Stream0=pshift_29, Stream1=pshift_28)
filter_14 = StreamFilter(Gate=smaller_6.SmallerThan, Stream0=filter_13, Stream1=flatten_8)
finishing_toolpaths = Curve(filter_14)
cls_4 = Closed(Curve=finishing_toolpaths)  # -> Closed, Periodic
sorted_inside_and_outside_curves = Curve(ins)
amp_6 = Amplitude(Vector=vec2pt_7.Vector, Amplitude=subtraction_9)
dispatch_22 = Dispatch(List=finishing_toolpaths, DispatchPattern=cls_4.Closed)  # -> ListA, ListB
move_20 = Move(Geometry=points_to_offset_with_tool_radius_2, Motion=amp_6)  # -> Geometry, Transform
xz_3 = XZPlane(Origin=Point(0, 0, 0))
end_6 = EndPoints(Curve=dispatch_22.ListB)  # -> Start, End
use_climb_direction = Panel("0")
rotate_3 = Rotate(Geometry=end_6.Start, Angle=1.570796327, Plane=xz_3)  # -> Geometry, Transform
points_at_tool_radius_distance_from_mesh_2 = Point(move_20.Geometry)
flip_5 = FlipCurve(Curve=sorted_inside_and_outside_curves)  # -> Curve, Flag
flatten_9 = FlattenTree(Tree=rotate_3.Geometry, Path="{0}")
filter_15 = StreamFilter(Gate=use_climb_direction, Stream0=flip_5.Curve, Stream1=sorted_inside_and_outside_curves)
item_21 = ListItem(List=flatten_9, Index=0, Wrap=True)
sort_pt = SortPoints(Points=rotate_3.Geometry)  # -> Points, Indices
null_6 = NullItem(Item=item_21)  # -> NullFlags, InvalidFlags, Description
pline_11 = PolyLine(Vertices=points_at_tool_radius_distance_from_mesh_2, Closed=False)
sorted_inside_and_outside_curves_2 = Curve(filter_15)
item_22 = ListItem(List=dispatch_22.ListB, Index=sort_pt.Indices, Wrap=True)
milling_bit_radius_12 = Panel(milling_bit_radius)
generate_cutout_3 = Panel(generate_cutout_2)
rev_8 = ReverseList(List=pt_9)
rev_9 = ReverseList(List=item_22)
milling_bit_radius_13 = Panel(milling_bit_radius)
item_23 = ListItem(List=rev_8, Index=0, Wrap=True)
extra_cut_depth_2 = Panel(addition)
dispatch_23 = Dispatch(List=item_22, DispatchPattern=[True, False])  # -> ListA, ListB
cutout_depth_2 = Panel(cutout_depth)
neg_10 = Negative(Value=milling_bit_radius_12)
generate_roughing_2 = Panel(generate_3d_roughing_2)
filter_16 = StreamFilter(Gate=generate_cutout_3, Stream1=sorted_inside_and_outside_curves_2)
devec = DeconstructVector(Vector=item_23)  # -> XComponent, YComponent, ZComponent
flip_6 = FlipCurve(Curve=dispatch_23.ListB)  # -> Curve, Flag
pshift_30 = ShiftPaths(Data=pline_11, Offset=-1)
Z_21 = UnitZ(Factor=neg_10)
weave_6 = Weave(Pattern=[0, 1], Stream0=dispatch_23.ListA, Stream1=flip_6.Curve, NullGaps=False)
cls_5 = Closed(Curve=outside_cutout_curves)  # -> Closed, Periodic
subtraction_10 = Subtraction(A=devec.ZComponent, B=milling_bit_radius_13)
move_21 = Move(Geometry=pshift_30, Motion=Z_21)  # -> Geometry, Transform
xz_4 = XZPlane(Origin=Point(0, 0, 0))
filter_17 = StreamFilter(Gate=generate_roughing_2, Stream1=sorted_inside_and_outside_curves_2)
abs_2 = Absolute(Value=subtraction_10)
weave_7 = Weave(Pattern=cls_4.Closed, Stream0=weave_6, Stream1=dispatch_22.ListA, NullGaps=False)
pass_depth = Panel(pass_depth_roughing_2)
cull_2 = CullPattern(List=cutout_depth_2, CullPattern=cls_5.Closed)
x_tremez = Extremes(Curve=move_21.Geometry, Plane=xz_4)  # -> Highest, Lowest
filter_18 = StreamFilter(Gate=null_6.NullFlags, Stream0=weave_7, Stream1=finishing_toolpaths)
simplify_23 = SimplifyTree(Tree=filter_16, Front=False)
clean_8 = CleanTree(RemoveNulls=True, RemoveInvalid=True, RemoveEmpty=True, Tree=cull_2)
extra_cut_depth_3 = Panel(addition)
roughing_material_leftover_4 = Panel(roughing_material_leftover_2)
cutout_depth_3 = Panel(abs_2)
simplify_24 = SimplifyTree(Tree=filter_17, Front=False)
devec_2 = DeconstructVector(Vector=x_tremez.Lowest)  # -> XComponent, YComponent, ZComponent
flatten_10 = FlattenTree(Tree=filter_18, Path="{0}")
clean_9 = CleanTree(RemoveNulls=True, RemoveInvalid=True, RemoveEmpty=False, Tree=simplify_23)
simplify_25 = SimplifyTree(Tree=clean_8, Front=False)
clean_10 = CleanTree(RemoveNulls=True, RemoveInvalid=True, RemoveEmpty=False, Tree=flatten_10)
clean_11 = CleanTree(RemoveNulls=True, RemoveInvalid=True, RemoveEmpty=False, Tree=simplify_24)
# Fix roughing to be at full depth, not pass depth distance from surface
division_8 = Division(A=devec_2.ZComponent, B=pass_depth)
cls_6 = Closed(Curve=outside_cutout_curves)  # -> Closed, Periodic
round_6 = Round(Number=division_8)  # -> Nearest, Floor, Ceiling
addition_7 = Addition(A=simplify_25, B=extra_cut_depth_2)
offset_5 = Offset(Curve=clean_11, Distance=roughing_material_leftover_4, Plane=PlaneXY(0, 0, 0), Corners=1)
sorted_inside_and_outside_curves_3 = Curve(clean_9)
cull_3 = CullPattern(List=cutout_depth_3, CullPattern=cls_6.Closed)
neg_11 = Negative(Value=round_6.Floor)
finishing_toolpaths_2 = Curve(clean_10)
stepover_distance_5 = Panel(stepover_distance)
connect_toolpaths_levels_3 = Integer(connect_toolpaths_levels_2)
connect_toolpath_tolerance_factor_2 = Panel(connect_toolpath_tolerance_factor)
make_flea_jump_transitions_3 = Integer(make_flea_jump_transitions_2)
cut_depth_cutout = Panel(addition_7)
pass_depth_cutout = Panel(pass_depth_roughing_2)
clean_12 = CleanTree(RemoveNulls=True, RemoveInvalid=True, RemoveEmpty=True, Tree=cull_3)
unflatten = UnflattenTree(Tree=offset_5, Guide=clean_11)
smaller_7 = SmallerThan(FirstNumber=neg_11, SecondNumber="2")  # -> SmallerThan, OrEqualTo
simplify_26 = SimplifyTree(Tree=clean_12, Front=False)
dispatch_24 = Dispatch(List=neg_11, DispatchPattern=smaller_7.SmallerThan)  # -> ListA, ListB
division_9 = Division(A=cut_depth_cutout, B=pass_depth_cutout)
graft_5 = GraftTree(Tree=sorted_inside_and_outside_curves_3, IncludeEmptyLists=True, IncludeNullItems=True)
crv_17 = Curve(move_21.Geometry)
subtraction_11 = Subtraction(A=dispatch_24.ListB, B="1")
panel_10 = Panel("0")
round_7 = Round(Number=division_9)  # -> Nearest, Floor, Ceiling
addition_8 = Addition(A=simplify_26, B=extra_cut_depth_3)
dispatch_25 = Dispatch(List=crv_17, DispatchPattern=smaller_7.SmallerThan)  # -> ListA, ListB
sorted_inside_and_outside_curves_4 = Curve(unflatten)
series_3 = Series(Start=pass_depth, Step=pass_depth, Count=subtraction_11)
multiplication_18 = Multiplication(A=stepover_distance_5, B=connect_toolpath_tolerance_factor_2)
end_7 = EndPoints(Curve=finishing_toolpaths_2)  # -> Start, End
division_10 = Division(A=cut_depth_cutout, B=round_7.Ceiling)
crv_18 = Curve(dispatch_25.ListB)
pass_depth_2 = Panel(pass_depth_roughing_2)
cut_depth_cutout_2 = Panel(addition_8)
clean_13 = CleanTree(RemoveNulls=True, RemoveInvalid=True, RemoveEmpty=True, Tree=series_3)
actual_pass_depth = Panel(division_10)
lng_10 = ListLength(List=sorted_inside_and_outside_curves_3)
Z_22 = UnitZ(Factor=clean_13)
shift = ShiftList(List=end_7.Start, Shift="1", Wrap=True)
division_11 = Division(A=cut_depth_cutout_2, B=pass_depth_2)
move_22 = Move(Geometry=graft(crv_18), Motion=Z_22)  # -> Geometry, Transform
dup_4 = DuplicateData(Data=cut_depth_cutout, Number=lng_10, Order=True)
ln_4 = Line(StartPoint=end_7.End, EndPoint=shift)
flatten_11 = FlattenTree(Tree=sorted_inside_and_outside_curves_3, Path="{0}")
round_8 = Round(Number=division_11)  # -> Nearest, Floor, Ceiling
series_4 = Series(Start=actual_pass_depth, Step=actual_pass_depth, Count=round_7.Ceiling)
flatten_12 = FlattenTree(Tree=dup_4, Path="{0}")
rev_10 = ReverseList(List=move_22.Geometry)
neg_12 = Negative(Value=series_4)
division_12 = Division(A=cut_depth_cutout_2, B=round_8.Ceiling)
cut_depths_for_cutout = Panel(flatten_12)
flatten_13 = FlattenTree(Tree=rev_10, Path="{0}")
len_6 = Length(Curve=ln_4)
Z_23 = UnitZ(Factor=neg_12)
crv_19 = Curve(flatten_13)
actual_pass_depth_2 = Panel(division_12)
subtraction_12 = Subtraction(A=round_8.Ceiling, B="1")
larger_10 = LargerThan(FirstNumber=len_6, SecondNumber=multiplication_18)  # -> LargerThan, OrEqualTo
lng_11 = ListLength(List=finishing_toolpaths_2)
move_23 = Move(Geometry=graft_5, Motion=Z_23)  # -> Geometry, Transform; disabled
cls_7 = Closed(Curve=crv_19)  # -> Closed, Periodic
cutout_depths = Number(cut_depths_for_cutout)
cutout_curves = Curve(flatten_11)
dispatch_26 = Dispatch(List=crv_19, DispatchPattern=cls_7.Closed)  # -> ListA, ListB
series_5 = Series(Start=0, Step=1, Count=lng_11)
flatten_14 = FlattenTree(Tree=move_23.Geometry, Path="{0}")
series_6 = Series(Start=actual_pass_depth_2, Step=actual_pass_depth_2, Count=round_8.Ceiling)
dispatch_27 = Dispatch(List=dispatch_26.ListB, DispatchPattern=[True, False])  # -> ListA, ListB
neg_13 = Negative(Value=series_6)
dispatch_28 = Dispatch(List=series_5, DispatchPattern=larger_10.LargerThan)  # -> ListA, ListB
cutout_curves_2 = Curve(flatten_14)
flip_7 = FlipCurve(Curve=dispatch_27.ListB)  # -> Curve, Flag
Z_24 = UnitZ(Factor=neg_13)
stepover_distance_6 = Panel(stepover_distance_5)
replace = ReplaceItems(List=ln_4, Indices=dispatch_28.ListA, Wrap=False)
weave_8 = Weave(Pattern=[0, 1], Stream0=dispatch_27.ListA, Stream1=flip_7.Curve, NullGaps=False)
move_24 = Move(Geometry=sorted_inside_and_outside_curves_4, Motion=Z_24)  # -> Geometry, Transform
end_8 = EndPoints(Curve=graft(replace))  # -> Start, End
weave_9 = Weave(Pattern=cls_7.Closed, Stream0=weave_8, Stream1=dispatch_26.ListA, NullGaps=False)
flatten_15 = FlattenTree(Tree=move_24.Geometry, Path="{0}")
Z_25 = UnitZ(Factor=stepover_distance_6)
rouging_toolpaths = Curve(weave_9)
move_25 = Move(Geometry=end_8.Start, Motion=Z_25)  # -> Geometry, Transform
move_26 = Move(Geometry=end_8.End, Motion=Z_25)  # -> Geometry, Transform
item_24 = ListItem(List=weave_9, Index=Slider(0, range=0..100), Wrap=False)
final_roughing_passes = Curve(flatten_15)
nurbs = NurbsCurve(Vertices=[end_8.Start, move_26.Geometry, move_25.Geometry, end_8.End], Degree=3, Periodic=False)  # -> Curve, Length, Domain
pshift_31 = ShiftPaths(Data=nurbs.Curve, Offset=-1)
filter_19 = StreamFilter(Gate=make_flea_jump_transitions_3, Stream0=replace, Stream1=pshift_31)
flatten_16 = FlattenTree(Tree=simplify_22, Path="{0}")
weave_10 = Weave(Pattern=[0, 1], Stream0=finishing_toolpaths_2, Stream1=filter_19, NullGaps=False)
final_roughing_passes_2 = Curve(final_roughing_passes)
rouging_toolpaths_2 = Curve(rouging_toolpaths)
clean_14 = CleanTree(RemoveNulls=True, RemoveInvalid=True, RemoveEmpty=False, Tree=flatten_16)
clean_15 = CleanTree(RemoveNulls=True, RemoveInvalid=True, RemoveEmpty=False, Tree=weave_10)
merge_5 = Merge(Data1=rouging_toolpaths_2, Data2=final_roughing_passes_2)
connected_finishing_toolpaths = Curve(clean_15)
finishing_toolpaths_3 = Curve(clean_14)
rouging_toolpaths_3 = Curve(merge_5)
filter_20 = StreamFilter(Gate=connect_toolpaths_levels_3, Stream0=finishing_toolpaths_3, Stream1=connected_finishing_toolpaths)
finishing_toolpaths_4 = Curve(filter_20)
len_7 = Length(Curve=flatten(finishing_toolpaths_4))  # disabled
ma_3 = MassAddition(Input=len_7)  # -> Result, PartialResults
division_13 = Division(A=ma_3.Result, B=Slider(30, range=0..100))
division_14 = Division(A=division_13, B=Slider(60, range=0..100))
panel_11 = Panel(division_14)
finishing_toolpaths_5 = Curve(finishing_toolpaths_4)
rouging_toolpaths_4 = Curve(rouging_toolpaths_3)
cutout_curves_3 = Curve(cutout_curves)
cutout_depths_2 = Number(cutout_depths)
cutout_curves_4 = ClusterOutput(cutout_curves_3)
cutout_depths_3 = ClusterOutput(cutout_depths_2)
rouging_toolpaths_5 = ClusterOutput(rouging_toolpaths_4)
finishing_toolpaths_6 = ClusterOutput(finishing_toolpaths_5)

# ==== cluster CompileSettings: Compiles an overview of current milling settings. Nice for quickly checking your settings, or the output from the feedrate calculator, before running a job.
estimated_job_time_in_seconds = ClusterInput()
plunge_rate = ClusterInput()
spindle_rpm = ClusterInput()
deepest_z = ClusterInput()
ramp_angle = ClusterInput()
ramp_plunges = ClusterInput()
feed_rate = ClusterInput()
pass_depth = ClusterInput()
estimated_job_time_in_seconds_2 = Number(estimated_job_time_in_seconds)
plunge_rate_2 = Number(plunge_rate)
ramp_plunges_2 = Boolean(ramp_plunges)
pass_depth_2 = Number(pass_depth)
feed_rate_2 = Number(feed_rate)
spindle_rpm_2 = Number(spindle_rpm)
ramp_angle_2 = Integer(ramp_angle)
deepest_z_2 = Number(deepest_z)
int = Integer(plunge_rate_2)
int_2 = Integer(feed_rate_2)
int_3 = Integer(spindle_rpm_2)
spindle_rpm_3 = Panel(int_3)
join = TextJoin(Text=["Spindle RPM: ", spindle_rpm_3])

# ---- group: Format for settings display
int_4 = Integer(estimated_job_time_in_seconds_2)
feed_rate_3 = Panel(int_2)
plunge_rate_3 = Panel(int)
panel = Panel("Estimated job time: ")
panel_2 = Panel(" sec")
pass_depth_3 = Panel(pass_depth_2)
ramp_plunges_3 = Panel(ramp_plunges_2)
ramp_angle_3 = Panel(ramp_angle_2)
deepest_point = Panel(deepest_z_2)
panel_3 = Panel(" min and ")
join_2 = TextJoin(Text=["Feed rate: ", feed_rate_3])
join_3 = TextJoin(Text=["Plunge rate: ", plunge_rate_3])
join_4 = TextJoin(Text=["Pass depth: ", pass_depth_3])
join_5 = TextJoin(Text=["Ramp plunges: ", ramp_plunges_3])
join_6 = TextJoin(Text=["Ramp angle:", ramp_angle_3])
join_7 = TextJoin(Text=["Deepest Z: ", deepest_point])
merge = Merge(Data1=join_2, Data2=" ", Data3=join_3, Data4=" ", Data5=join_4, Data6=" ", Data7=join_7, Data8=" ")

# ----
division = Division(A=int_4, B="60")
expression = Expression(x=division, Expression="Floor(x)")
multiplication = Multiplication(A=expression, B="60")
subtraction = Subtraction(A=int_4, B=multiplication)
merge_2 = Merge(Data1=panel, Data2=expression, Data3=panel_3, Data4=subtraction, Data5=panel_2)

# ---- group: Format for settings display (continued)
join_8 = TextJoin(Text=merge_2)
merge_3 = Merge(
    Data1=join_8,
    Data2=" ",
    Data3=join_2,
    Data4=" ",
    Data5=join_3,
    Data6=" ",
    Data7=join,
    Data8=" ",
    Data9=join_4,
    Data10=" ",
    Data11=join_5,
    Data12=" ",
    Data13=join_6,
    Data14=" ",
    Data15=join_7)

# ----
crucial_settings = ClusterOutput(merge)
complete_settings = ClusterOutput(merge_3)

# ==== cluster CNCMillingPostProcessor: Converts toolpath curves into coordinates that a CNC machine can read. Use tab boxes for making safe cutouts, and ramps for smooth entry into hard materials.
make_shopbot_code_not_g_code = ClusterInput()
z_zero_is_at_bottom_of_stock = ClusterInput()  # Is Z zero postion at bottom or top of staock
use_high_speed_machining = ClusterInput()  # 0=off 1=Trochoidal 2=Plunge roughing
toolpath_width_factor = ClusterInput()
milling_bit_diameter = ClusterInput()
deviation_tolerance = ClusterInput()
end_of_job_go_to_x = ClusterInput()
end_of_job_go_to_y = ClusterInput()
material_thickness = ClusterInput()  # Used to create correct Z height for toolpaths when Z zero is at stock bottom
toolpath_curves = ClusterInput()
use_peck_entry = ClusterInput()
ramp_plunges = ClusterInput()
spindle_speed = ClusterInput()
safe_z_height = ClusterInput()
ramp_angle = ClusterInput()
use_spindle = ClusterInput()
plunge_rate = ClusterInput()
start_code = ClusterInput()  # Add a suitable start code for your machine here
tab_breps = ClusterInput()
jog_rate_z = ClusterInput()
job_name = ClusterInput()
feed_rate = ClusterInput()
end_code = ClusterInput()  # Add a suitable end code for your machine here
stepover = ClusterInput()
jog_rate = ClusterInput()

# ---- group: Additional settings
spindle_startup_time_g_code = Panel("5")
max_peck_depth_factor_plunge_roughing = Panel("0.4")
number_of_decimal_places = Panel("3")

# ----
toolpath_curves_2 = Curve(toolpath_curves)
tab_breps_2 = Brep(tab_breps)
feed_rate_2 = Number(feed_rate)
plunge_rate_2 = Number(plunge_rate)
jog_rate_2 = Number(jog_rate)
jog_rate_z_2 = Number(jog_rate_z)
safe_z_height_2 = Number(safe_z_height)
use_spindle_2 = Integer(use_spindle)
spindle_speed_2 = Number(spindle_speed)
ramp_plunges_2 = Integer(ramp_plunges)
ramp_angle_2 = Number(ramp_angle)
start_code_2 = Text(start_code)
end_code_2 = Text(end_code)
make_shopbot_code_not_g_code_2 = Boolean(make_shopbot_code_not_g_code)
end_of_job_go_to_x_2 = Number(end_of_job_go_to_x)
end_of_job_go_to_y_2 = Number(end_of_job_go_to_y)
deviation_tolerance_2 = Number(deviation_tolerance)
use_high_speed_machining_2 = Integer(use_high_speed_machining)
milling_bit_diameter_2 = Number(milling_bit_diameter)
toolpath_width_factor_2 = Number(toolpath_width_factor)
stepover_2 = Number(stepover)
use_peck_entry_2 = Boolean(use_peck_entry)
z_zero_is_at_bottom_of_stock_2 = Boolean(z_zero_is_at_bottom_of_stock)
material_thickness_2 = Number(material_thickness)
job_name_2 = Text(job_name)

flatten = FlattenTree(Tree=tab_breps_2, Path="{0}")
flatten_2 = FlattenTree(Tree=toolpath_curves_2, Path="{0}")

# ---- group: Convert speeds from mm per seond to mm per minute for g-code
seconds_in_a_minute = Panel("60")
multiplication = Multiplication(A=feed_rate_2, B=seconds_in_a_minute)
multiplication_2 = Multiplication(A=plunge_rate_2, B=seconds_in_a_minute)
multiplication_3 = Multiplication(A=jog_rate_2, B=seconds_in_a_minute)
multiplication_4 = Multiplication(A=jog_rate_z_2, B=seconds_in_a_minute)
feed_rate_in_mm_m = Number(multiplication)
plunge_rate_in_mm_m = Number(multiplication_2)
jog_rate_x_y_in_mm_m = Number(multiplication_3)
jog_rate_z_in_mm_m = Number(multiplication_4)

# ---- group: Make G-Code spindle start
spindle_speed_3 = Number(spindle_speed_2)
use_spindle_3 = Integer(use_spindle_2)
spindle_startup_time_g_code_2 = Panel(spindle_startup_time_g_code)
int = Integer(spindle_speed_3)
merge = Merge(Data1="M3 S", Data2=int, Data3=" ; start spindle and set spindle speed")
merge_2 = Merge(Data1="G4 P", Data2=spindle_startup_time_g_code_2, Data3=" ;wait a few seconds for the spindle to start")
join = TextJoin(Text=merge)
join_2 = TextJoin(Text=merge_2)
merge_3 = Merge(Data1=flatten(join), Data2=flatten(join_2))
filter = StreamFilter(Gate=use_spindle_3, Stream1=merge_3)
g_code_spindle_start = Panel(filter)

# ---- group: Find virtual bit diamter for trochoidal milling
multiplication_5 = Multiplication(A=milling_bit_diameter_2, B=toolpath_width_factor_2)
trochoidal_milling_bit_diameter = Number(multiplication_5)

# ---- group: Add prefix to shopbot job name
join_3 = TextJoin(Text=flatten(["'", job_name_2]))

# ----
clean = CleanTree(RemoveNulls=True, RemoveInvalid=True, RemoveEmpty=False, Tree=flatten_2)

# ---- group: Route toolpaths according to machining type
use_trochoidal_milling = Panel(use_high_speed_machining_2)
gate = StreamGate(Stream=clean, Gate=use_trochoidal_milling)  # -> Target0, Target1, Target2

# ---- group: Convert to polylines to extract toolpath coordinates
topoly = CurveToPolyline(Curve=gate.Target0, ToleranceDistance=deviation_tolerance_2, ToleranceAngle=0)  # -> Polyline, Segments
polyline_toolpaths = Curve(topoly.Polyline)

# ---- group: Adds tabs to toolpaths
tab_toolpaths = TabToolpaths(polyline_toolpaths=gate.Target1, tab_breps=flatten, milling_bit_diamter=trochoidal_milling_bit_diameter)  # -> tabbed_toolpaths_3, tab_cleanup_toolpaths_4

# ---- group: Eliminate unecessary jog Z
connect_overlapping_toolpaths = ConnectOverlappingToolpaths(polyline_toolpaths=polyline_toolpaths)

# ---- group: Adds tabs to toolpaths
tab_toolpaths_2 = TabToolpaths(polyline_toolpaths=gate.Target2, tab_breps=flatten, milling_bit_diamter=milling_bit_diameter_2)  # -> tabbed_toolpaths_3, tab_cleanup_toolpaths_4

# ----
ramp_plunges_3 = Integer(ramp_plunges_2)

# ---- group: Avoid trochoidal milling to use computer calculations
gate_2 = StreamGate(Stream=milling_bit_diameter_2, Gate=use_high_speed_machining_2)  # -> Target0, Target1
gate_3 = StreamGate(Stream=toolpath_width_factor_2, Gate=use_high_speed_machining_2)  # -> Target0, Target1
gate_4 = StreamGate(Stream=ramp_angle_2, Gate=use_high_speed_machining_2)  # -> Target0, Target1
gate_5 = StreamGate(Stream=use_peck_entry_2, Gate=use_high_speed_machining_2)  # -> Target0, Target1
gate_6 = StreamGate(Stream=max_peck_depth_factor_plunge_roughing, Gate=use_high_speed_machining_2)  # -> Target0, Target1

gate_7 = StreamGate(Stream=milling_bit_diameter_2, Gate=use_high_speed_machining_2)  # -> Target0, Target1
gate_8 = StreamGate(Stream=toolpath_width_factor_2, Gate=use_high_speed_machining_2)  # -> Target0, Target1
gate_9 = StreamGate(Stream=ramp_angle_2, Gate=use_high_speed_machining_2)  # -> Target0, Target1
gate_10 = StreamGate(Stream=use_peck_entry_2, Gate=use_high_speed_machining_2)  # -> Target0, Target1
gate_11 = StreamGate(Stream=max_peck_depth_factor_plunge_roughing, Gate=use_high_speed_machining_2)  # -> Target0, Target1

# ----
filter_2 = StreamFilter(Gate=ramp_plunges_3, Stream0=connect_overlapping_toolpaths, Stream1=polyline_toolpaths)
trochoidal_high_speed_milling = TrochoidalHighSpeedMilling(
    toolpath_curves=tab_toolpaths.tabbed_toolpaths_3,
    milling_bit_diameter=gate_2.Target1,
    toolpath_width_factor=gate_3.Target1,
    stepover=stepover_2,
    ramp_angle=gate_4.Target1,
    jog_z_lift_factor=0.1,
    use_climb_milling=True,
    straight_arc_extensions=True,
    use_peck_entry=gate_5.Target1,
    max_peck_depth_factor=gate_6.Target1)
trochoidal_high_speed_milling_2 = TrochoidalHighSpeedMilling(
    toolpath_curves=tab_toolpaths.tab_cleanup_toolpaths_4,
    milling_bit_diameter=gate_7.Target1,
    toolpath_width_factor=gate_8.Target1,
    stepover=stepover_2,
    ramp_angle=gate_9.Target1,
    jog_z_lift_factor=0.1,
    use_climb_milling=True,
    straight_arc_extensions=True,
    use_peck_entry=gate_10.Target1,
    max_peck_depth_factor=gate_11.Target1)
plunge_roughing = PlungeRoughing(toolpath_curves=tab_toolpaths_2.tabbed_toolpaths_3, milling_bit_diameter=milling_bit_diameter_2, stepover=stepover_2)
plunge_roughing_2 = PlungeRoughing(
    toolpath_curves=tab_toolpaths_2.tab_cleanup_toolpaths_4,
    milling_bit_diameter=milling_bit_diameter_2,
    stepover=stepover_2)
plunge_rough_lines = Curve(plunge_roughing)
plunge_rough_lines_2 = Curve(plunge_roughing_2)

# ---- group: Convert to polylines to extract toolpath coordinates
topoly_2 = CurveToPolyline(Curve=trochoidal_high_speed_milling_2, ToleranceDistance=deviation_tolerance_2, ToleranceAngle=0)  # -> Polyline, Segments
join_4 = JoinCurves(Curves=topoly_2.Polyline, Preserve=False)

topoly_3 = CurveToPolyline(Curve=trochoidal_high_speed_milling, ToleranceDistance=deviation_tolerance_2, ToleranceAngle=0)  # -> Polyline, Segments
join_5 = JoinCurves(Curves=topoly_3.Polyline, Preserve=False)

# ----
trochoidal_polyline_toolpaths = Curve(join_5)
trochoidal_polyline_toolpaths_from_insid = Curve(join_4)  # "Trochoidal polyline toolpaths from inside tab boundary boxes"
use_high_speed_machining_3 = Panel(use_high_speed_machining_2)
use_high_speed_machining_4 = Panel(use_high_speed_machining_2)
number_of_decimal_places_2 = Panel(number_of_decimal_places)
number_of_decimal_places_3 = Panel(number_of_decimal_places)
num = Number(number_of_decimal_places_3)
num_2 = Number(number_of_decimal_places_3)
num_3 = Number(number_of_decimal_places_3)
num_4 = Number(number_of_decimal_places_2)
num_5 = Number(number_of_decimal_places_2)
num_6 = Number(number_of_decimal_places_2)

# ---- group: Prepare correct safe Z height
subtraction = Subtraction(ActualSafeZHeight=safe_z_height_2, MaterialThickness=material_thickness_2)
filter_3 = StreamFilter(ZZeroIsAtBottomOfStock=z_zero_is_at_bottom_of_stock_2, Stream0=safe_z_height_2, Stream1=subtraction)

# ---- group: Name
# ShopBot code tab cleanup processing
panel = Panel(join_3)

# ---- group: Turn off spindle
filter_4 = StreamFilter(Gate=use_spindle_2, Stream1="SO,1,0")

# ---- group: Set spindle speed
spindle_speed_4 = Number(spindle_speed_2)
int_2 = Integer(spindle_speed_4)
join_6 = TextJoin(Text=["TR,", int_2, ",1"])

# ---- group: Name
# ShopBot code toolpath processing
panel_2 = Panel(join_3)

# ---- group: Set spindle speed
spindle_speed_5 = Number(spindle_speed_2)
int_3 = Integer(spindle_speed_5)
join_7 = TextJoin(Text=["TR,", int_3, ",1"])

# ---- group: Turn off spindle
filter_5 = StreamFilter(Gate=use_spindle_2, Stream1="SO,1,0")

# ---- group: Start spindle
panel_3 = Panel("PAUSE 1")
filter_6 = StreamFilter(Gate=use_spindle_2, Stream1="SO,1,1")

panel_4 = Panel("PAUSE 1")
filter_7 = StreamFilter(Gate=use_spindle_2, Stream1="SO,1,1")

# ---- group: Set Feed rate (X Y speed) and plunge rate (Z speed)
feed_rate_3 = Number(feed_rate_2)
plunge_rate_3 = Number(plunge_rate_2)
plunge_rate_4 = Number(plunge_rate_3)
feed_rate_4 = Number(feed_rate_3)
text = Text("MS,")
text_2 = Text(",")
join_8 = TextJoin(Text=flatten([text, feed_rate_4, text_2, plunge_rate_4]))

feed_rate_5 = Number(feed_rate_2)
plunge_rate_5 = Number(plunge_rate_2)
plunge_rate_6 = Number(plunge_rate_5)
feed_rate_6 = Number(feed_rate_5)
text_3 = Text("MS,")
text_4 = Text(",")
join_9 = TextJoin(Text=flatten([text_3, feed_rate_6, text_4, plunge_rate_6]))

# ----
filter_8 = StreamFilter(Gate=use_spindle_2, Stream1=join_6)
filter_9 = StreamFilter(Gate=use_spindle_2, Stream1=join_7)
text_5 = Text("J2,")
text_6 = Text("J2,")
text_7 = Text(",")
text_8 = Text(",")
join_10 = TextJoin(Text=[text_5, end_of_job_go_to_x_2, text_8, end_of_job_go_to_y_2])
join_11 = TextJoin(Text=[text_6, end_of_job_go_to_x_2, text_7, end_of_job_go_to_y_2])
g_code_spindle_start_2 = Panel(g_code_spindle_start)
g_code_spindle_start_3 = Panel(g_code_spindle_start)
start_code_3 = Text(start_code_2)
start_code_4 = Text(start_code_2)
end_code_3 = Text(end_code_2)
end_code_4 = Text(end_code_2)
endcode = Panel(end_code_3)
endcode_2 = Panel(end_code_4)
endcode_3 = Panel("""G4  S3
M280 S-90 P0 F3000 R""")
# Endcode - Ultimaker original , extruder upgrade + heatbed: ;End GCode
# M104 S0                     ;extruder heater off
# M140 S0                     ;heated bed heater off (if you have it)
# G91                                    ;relative positioning
# G1 E-1 F300                            ;retract the filament a bit before lifting the nozzle, to release some of the pressure
# G1 Z+0.5 E-5 X-20 Y-20 F9000 ;move Z up a bit and retract filament even more
# G28 X0 Y0                              ;move X/Y to min endstops, so the head is out of the way
# M84                         ;steppers off
# G90                         ;absolute positioning
# Endcode - Printrbot Simple: M104 S0                     ;extruder heater off
# M140 S0                     ;heated bed heater off (if you have it)
# 
# G91                                    ;relative positioning
# G1 E-1 F300                            ;retract the filament a bit before lifting the nozzle, to release some of the pressure
# G1 Z+0.5 E-5 X-20 Y-20 F9000 ;move Z up a bit and retract filament even more
# G28 X0 Y0                              ;move X/Y to min endstops, so the head is out of the way
# 
# M84                         ;steppers off
# G90                         ;absolute positioning
endcode_fabtotum = Panel("""G4 S2; Dwell
M5; SPINDLE OFF""")
start_code_5 = Text(start_code_2)
start_code_6 = Text(start_code_2)
end_code_5 = Text(end_code_2)
end_code_6 = Text(end_code_2)

# ---- group: Checks if there are tabs and skips tab toolpaths if there are no tab breps
lng = ListLength(List=flatten)
null = NullItem(Item=lng)  # -> NullFlags, InvalidFlags, Description
cull = CullPattern(List=milling_bit_diameter_2, CullPattern=invert(null.NullFlags))
gate_12 = StreamGate(Stream=filter_2, Gate=null.NullFlags)  # -> Target0, Target1

# ---- group: Adds tabs to toolpaths
tab_toolpaths_3 = TabToolpaths(polyline_toolpaths=gate_12.Target0, tab_breps=flatten, milling_bit_diamter=cull)  # -> tabbed_toolpaths_3, tab_cleanup_toolpaths_4

# ---- group: Checks if there are tabs and skips tab toolpaths if there are no tab breps (continued)
filter_10 = StreamFilter(Gate=null.NullFlags, Stream0=tab_toolpaths_3.tabbed_toolpaths_3, Stream1=gate_12.Target1)

# ---- group: Add ramps to cleanup toolpaths
tab_cleanup_toolpaths = Curve(tab_toolpaths_3.tab_cleanup_toolpaths_4)
ramp_plunges_4 = Integer(ramp_plunges_2)
ramp_toolpath_plunges = RampToolpathPlunges(toolpaths_to_ramp=tab_cleanup_toolpaths, ramp_angle=ramp_angle_2)
filter_11 = StreamFilter(Gate=ramp_plunges_4, Stream0=tab_cleanup_toolpaths, Stream1=ramp_toolpath_plunges)

# ---- group: Try to reduce uneccessy Z movement
connect_overlapping_toolpaths_2 = ConnectOverlappingToolpaths(polyline_toolpaths=filter_11)

# ----
panel_5 = Panel(connect_overlapping_toolpaths_2)
filter_12 = StreamFilter(
    Gate=use_high_speed_machining_3,
    Stream0=connect_overlapping_toolpaths_2,
    Stream1=trochoidal_polyline_toolpaths_from_insid,
    Stream2=plunge_rough_lines_2)

# ---- group: Move toolpaths up with material thcikness distance in case of Z zero at bottom of stock
Z = UnitZ(MaterialThickness=material_thickness_2)
move = Move(TabCleanupToolpaths=filter_12, Motion=Z)  # -> Geometry, Transform
filter_13 = StreamFilter(ZZeroIsAtBottomOfStock=z_zero_is_at_bottom_of_stock_2, Stream0=filter_12, Stream1=move.Geometry)

# ---- group: Extract toolpath points from toopath polylines
cp = ControlPoints(Curve=filter_13)  # -> Points, Weights, Knots

# ---- group: Send tab cleanup toolpath points to g-code or ShopBot code postprocessor
toolpath_points_for_tab_cleanup_job = Point(cp.Points)
make_shopbot_code_not_g_code_3 = Boolean(make_shopbot_code_not_g_code_2)
gate_13 = StreamGate(Stream=toolpath_points_for_tab_cleanup_job, Gate=make_shopbot_code_not_g_code_3)  # -> Target0, Target1

# ---- group: Format milling positions with axis names and feedrates
toolpath_points = Point(gate_13.Target0)
lng_2 = ListLength(List=toolpath_points)
number_of_decimal_places_4 = Panel(number_of_decimal_places)
feed_rate_7 = Number(feed_rate_in_mm_m)
plunge_rate_7 = Number(plunge_rate_in_mm_m)
dup = DuplicateData(Data=flatten(" X"), Number=flatten(lng_2), Order=True)
dup_2 = DuplicateData(Data=flatten("F"), Number=flatten(lng_2), Order=True)
dup_3 = DuplicateData(Data=graft(feed_rate_7), Number=graft(lng_2), Order=True)
pdecon = Deconstruct(Point=toolpath_points)  # -> XComponent, YComponent, ZComponent
lng_3 = ListLength(List=toolpath_points)
replace = ReplaceItems(List=dup_3, Item=plunge_rate_7, Indices="0", Wrap=False)
flatten_3 = FlattenTree(Tree=dup_2, Path="{0}")
flatten_4 = FlattenTree(Tree=dup, Path="{0}")
flatten_5 = FlattenTree(Tree=replace, Path="{0}")
num_7 = Number(pdecon.XComponent)
num_8 = Number(number_of_decimal_places_4)
num_9 = Number(pdecon.YComponent)
num_10 = Number(number_of_decimal_places_4)
num_11 = Number(pdecon.ZComponent)
num_12 = Number(number_of_decimal_places_4)
graft = GraftTree(Tree=flatten_3, IncludeEmptyLists=True, IncludeNullItems=True)
expression = Expression(x=num_7, y=num_8, Expression="Round(x,y)")
expression_2 = Expression(x=num_9, y=num_10, Expression="Round(x,y)")
expression_3 = Expression(x=num_11, y=num_12, Expression="Round(x,y)")
graft_2 = GraftTree(Tree=flatten_5, IncludeEmptyLists=True, IncludeNullItems=True)
graft_3 = GraftTree(Tree=flatten_4, IncludeEmptyLists=True, IncludeNullItems=True)
panel_6 = Panel(expression)
panel_7 = Panel(expression_2)
panel_8 = Panel(expression_3)
join_12 = TextJoin(Text=[graft, graft_2, graft_3])
dup_4 = DuplicateData(Data=" Z", Number=lng_3, Order=True)
dup_5 = DuplicateData(Data=" Y", Number=lng_3, Order=True)
dup_6 = DuplicateData(Data="G1 ", Number=lng_3, Order=True)
simplify = SimplifyTree(Tree=flatten(join_12), Front=False)
simplify_2 = SimplifyTree(Tree=flatten(dup_6), Front=False)
simplify_3 = SimplifyTree(Tree=flatten(panel_6), Front=False)
simplify_4 = SimplifyTree(Tree=flatten(dup_5), Front=False)
simplify_5 = SimplifyTree(Tree=flatten(panel_7), Front=False)
simplify_6 = SimplifyTree(Tree=flatten(dup_4), Front=False)
simplify_7 = SimplifyTree(Tree=flatten(panel_8), Front=False)
graft_4 = GraftTree(Tree=simplify_2, IncludeEmptyLists=True, IncludeNullItems=True)
graft_5 = GraftTree(Tree=simplify_3, IncludeEmptyLists=True, IncludeNullItems=True)
graft_6 = GraftTree(Tree=simplify_4, IncludeEmptyLists=True, IncludeNullItems=True)
graft_7 = GraftTree(Tree=simplify_5, IncludeEmptyLists=True, IncludeNullItems=True)
graft_8 = GraftTree(Tree=simplify_6, IncludeEmptyLists=True, IncludeNullItems=True)
graft_9 = GraftTree(Tree=simplify_7, IncludeEmptyLists=True, IncludeNullItems=True)
graft_10 = GraftTree(Tree=simplify, IncludeEmptyLists=True, IncludeNullItems=True)
join_13 = TextJoin(Text=[graft_4, graft_10, graft_5, graft_6, graft_7, graft_8, graft_9])
flatten_6 = FlattenTree(Tree=join_13, Path="{0}")
panel_9 = Panel(flatten_6)

# ----
toolpath_points_2 = Point(gate_13.Target1)
pdecon_2 = Deconstruct(Point=toolpath_points_2)  # -> XComponent, YComponent, ZComponent
lng_4 = ListLength(List=toolpath_points_2)
num_13 = Number(pdecon_2.XComponent)
num_14 = Number(pdecon_2.YComponent)
num_15 = Number(pdecon_2.ZComponent)

# ---- group: Format jog XY postions
custom_home_y = Number(end_of_job_go_to_y_2)
jog_rate_x_y = Number(jog_rate_x_y_in_mm_m)
item = ListItem(List=expression, Index=0, Wrap=True)
custom_home_x = Number(end_of_job_go_to_x_2)
item_2 = ListItem(List=expression_2, Index=0, Wrap=True)
int_4 = Integer(jog_rate_x_y)
lng_5 = ListLength(List=flatten(item))
safe_z_height_3 = Number(safe_z_height_2)
lng_6 = ListLength(List=flatten(item))
join_14 = TextJoin(Text=["F", int_4, " X"])
dup_7 = DuplicateData(Data="G1 ", Number=lng_5, Order=True)
dup_8 = DuplicateData(Data=" Y", Number=lng_5, Order=True)
dup_9 = DuplicateData(Data=" Z", Number=lng_5, Order=True)
dup_10 = DuplicateData(Data=safe_z_height_3, Number=lng_5, Order=True)
dup_11 = DuplicateData(Data=join_14, Number=lng_6, Order=True)
simplify_8 = SimplifyTree(Tree=flatten(dup_7), Front=False)
simplify_9 = SimplifyTree(Tree=flatten(item), Front=False)
simplify_10 = SimplifyTree(Tree=flatten(dup_8), Front=False)
simplify_11 = SimplifyTree(Tree=flatten(item_2), Front=False)
simplify_12 = SimplifyTree(Tree=flatten(dup_9), Front=False)
simplify_13 = SimplifyTree(Tree=flatten(dup_10), Front=False)
simplify_14 = SimplifyTree(Tree=flatten(dup_11), Front=False)
graft_11 = GraftTree(Tree=simplify_8, IncludeEmptyLists=True, IncludeNullItems=True)
graft_12 = GraftTree(Tree=simplify_14, IncludeEmptyLists=True, IncludeNullItems=True)
graft_13 = GraftTree(Tree=simplify_9, IncludeEmptyLists=True, IncludeNullItems=True)
graft_14 = GraftTree(Tree=simplify_10, IncludeEmptyLists=True, IncludeNullItems=True)
graft_15 = GraftTree(Tree=simplify_11, IncludeEmptyLists=True, IncludeNullItems=True)
graft_16 = GraftTree(Tree=simplify_12, IncludeEmptyLists=True, IncludeNullItems=True)
graft_17 = GraftTree(Tree=simplify_13, IncludeEmptyLists=True, IncludeNullItems=True)
join_15 = TextJoin(Text=[graft_11, graft_12, graft_13, graft_14, graft_15])
jog_rate_x_y_2 = Integer(jog_rate_x_y)
flatten_7 = FlattenTree(Tree=join_15, Path="{0}")
join_16 = TextJoin(Text=["F", jog_rate_x_y_2])
home_x = Number(custom_home_x)
home_y = Number(custom_home_y)
join_17 = TextJoin(Text=["G1 ", join_16, " X", home_x, " Y", home_y])
merge_4 = Merge(Data1=flatten(flatten_7), Data2=flatten(join_17))
jog_x_y_positions = Panel(merge_4)

# ----
expression_4 = Expression(x=num_13, y=num, Expression="Round(x,y)")
expression_5 = Expression(x=num_14, y=num_2, Expression="Round(x,y)")
expression_6 = Expression(x=num_15, y=num_3, Expression="Round(x,y)")
flatten_8 = FlattenTree(Tree=lng_4, Path="{0}")
merge_5 = Merge(Data1=Slider(0, range=0..100), Data2=flatten_8)
panel_10 = Panel(expression_4)
panel_11 = Panel(expression_5)
panel_12 = Panel(expression_6)

# ---- group: Jog to startpoints
item_3 = ListItem(List=expression_4, Index=0, Wrap=True)
item_4 = ListItem(List=expression_5, Index=0, Wrap=True)
lng_7 = ListLength(List=flatten(item_3))
text_9 = Text(",")
text_10 = Text("J2,")
dup_12 = DuplicateData(Data=text_10, Number=lng_7, Order=True)
dup_13 = DuplicateData(Data=text_9, Number=lng_7, Order=True)
simplify_15 = SimplifyTree(Tree=flatten(dup_12), Front=False)
simplify_16 = SimplifyTree(Tree=flatten(item_3), Front=False)
simplify_17 = SimplifyTree(Tree=flatten(dup_13), Front=False)
simplify_18 = SimplifyTree(Tree=flatten(item_4), Front=False)
graft_18 = GraftTree(Tree=simplify_15, IncludeEmptyLists=True, IncludeNullItems=True)
graft_19 = GraftTree(Tree=simplify_16, IncludeEmptyLists=True, IncludeNullItems=True)
graft_20 = GraftTree(Tree=simplify_17, IncludeEmptyLists=True, IncludeNullItems=True)
graft_21 = GraftTree(Tree=simplify_18, IncludeEmptyLists=True, IncludeNullItems=True)
join_18 = TextJoin(Text=[graft_18, graft_19, graft_20, graft_21])
flatten_9 = FlattenTree(Tree=join_18, Path="{0}")
merge_6 = Merge(Data1=flatten_9, Data2=join_10)

# ---- group: Jog to safe Z
safe_z_height_4 = Number(flatten(safe_z_height_2))
text_11 = Text("JZ,")
graft_22 = GraftTree(Tree=safe_z_height_4, IncludeEmptyLists=True, IncludeNullItems=True)
graft_23 = GraftTree(Tree=text_11, IncludeEmptyLists=True, IncludeNullItems=True)
lng_8 = ListLength(List=flatten(merge_5))
join_19 = TextJoin(Text=[graft_23, graft_22])
dup_14 = DuplicateData(Data=join_19, Number=lng_8, Order=True)

# ---- group: Toolpath coordinates
text_12 = Text("M3,")
text_13 = Text(",")
text_14 = Text(",")
dup_15 = DuplicateData(Data=text_14, Number=lng_4, Order=True)
dup_16 = DuplicateData(Data=text_13, Number=lng_4, Order=True)
dup_17 = DuplicateData(Data=text_12, Number=lng_4, Order=True)
simplify_19 = SimplifyTree(Tree=flatten(dup_17), Front=False)
simplify_20 = SimplifyTree(Tree=flatten(panel_10), Front=False)
simplify_21 = SimplifyTree(Tree=flatten(dup_16), Front=False)
simplify_22 = SimplifyTree(Tree=flatten(panel_11), Front=False)
simplify_23 = SimplifyTree(Tree=flatten(dup_15), Front=False)
simplify_24 = SimplifyTree(Tree=flatten(panel_12), Front=False)
graft_24 = GraftTree(Tree=simplify_19, IncludeEmptyLists=True, IncludeNullItems=True)
graft_25 = GraftTree(Tree=simplify_20, IncludeEmptyLists=True, IncludeNullItems=True)
graft_26 = GraftTree(Tree=simplify_21, IncludeEmptyLists=True, IncludeNullItems=True)
graft_27 = GraftTree(Tree=simplify_22, IncludeEmptyLists=True, IncludeNullItems=True)
graft_28 = GraftTree(Tree=simplify_23, IncludeEmptyLists=True, IncludeNullItems=True)
graft_29 = GraftTree(Tree=simplify_24, IncludeEmptyLists=True, IncludeNullItems=True)
join_20 = TextJoin(Text=[graft_24, graft_25, graft_26, graft_27, graft_28, graft_29])
flatten_10 = FlattenTree(Tree=join_20, Path="{0}")

# ---- group: Format jog Z postions
# G-Code tab cleanup processing
jog_rate_z_3 = Number(jog_rate_z_in_mm_m)
int_5 = Integer(jog_rate_z_3)
join_21 = TextJoin(Text=["F", int_5])
safe_z_height_5 = Number(safe_z_height_2)
join_22 = TextJoin(Text=["G1 ", join_21, " Z", safe_z_height_5])
lng_9 = ListLength(List=merge_4)
dup_18 = DuplicateData(Data=join_22, Number=lng_9, Order=True)
flatten_11 = FlattenTree(Tree=dup_18, Path="{0}")
jog_z_positions = Panel(flatten_11)

# ---- group: Insert JZ commands
ma = MassAddition(Input=merge_5)  # -> Result, PartialResults
ins = InsertItems(List=flatten_10, Item=dup_14, Indices=ma.PartialResults, Wrap=True)

# ---- group: Insert jog to safe Z
ma_2 = MassAddition(Input=flatten(lng_3))  # -> Result, PartialResults
merge_7 = Merge(Data1=Slider(0, range=0..100), Data2=ma_2.PartialResults)
ins_2 = InsertItems(List=flatten(panel_9), Item=flatten(jog_z_positions), Indices=flatten(merge_7), Wrap=True)

# ---- group: Insert J2 commands
lng_10 = ListLength(List=merge_6)
dup_19 = DuplicateData(Data=Slider(1, range=0..1), Number=lng_10, Order=True)
addition = Addition(A=dup_19, B=merge_5)
ma_3 = MassAddition(Input=addition)  # -> Result, PartialResults
ins_3 = InsertItems(List=ins, Item=merge_6, Indices=ma_3.PartialResults, Wrap=True)

# ----
panel_13 = Panel(join_22)

# ---- group: Insert jog X Y positions
lng_11 = ListLength(List=merge_7)
series = Series(Start=1, Step=1, Count=lng_11)
addition_2 = Addition(A=merge_7, B=series)
ins_4 = InsertItems(List=flatten(ins_2), Item=flatten(jog_x_y_positions), Indices=flatten(addition_2), Wrap=True)

# ----
flatten_12 = FlattenTree(Tree=ins_3, Path="{0}")
merge_8 = Merge(Data1=start_code_4, Data2=panel_13, Data3=g_code_spindle_start_3)
startcode = Panel(merge_8)
merge_9 = Merge(
    Data1=start_code_5,
    Data2=panel,
    Data3=filter_8,
    Data4=filter_6,
    Data5=panel_3,
    Data6=join_8,
    Data7=flatten_12,
    Data8=filter_4,
    Data9=end_code_5)
merge_10 = Merge(Data1=flatten(startcode), Data2=flatten(ins_4), Data3=flatten(endcode_2))
tab_cleanup_toolpath_shopbot_code = Panel(merge_9)
tab_cleanup_toolpath_g_code = Panel(merge_10)
tab_cleanup_toolpath_shopbot_code_2 = Panel(tab_cleanup_toolpath_shopbot_code)
tab_cleanup_toolpath_g_code_2 = Panel(tab_cleanup_toolpath_g_code)
filter_14 = StreamFilter(Gate=make_shopbot_code_not_g_code_2, Stream0=tab_cleanup_toolpath_g_code_2, Stream1=tab_cleanup_toolpath_shopbot_code_2)
g_code_for_tab_cleanup = ClusterOutput(filter_14)  # Connect a panel to stream the code to a folder on your computer

# ---- group: Checks if ramp plunges = true
ramp_plunges_5 = Integer(ramp_plunges_2)
gate_14 = StreamGate(Stream=filter_10, Gate=ramp_plunges_5)  # -> Target0, Target1

# ---- group: Add ramps to toolpaths
ramp_toolpath_plunges_2 = RampToolpathPlunges(toolpaths_to_ramp=gate_14.Target1, ramp_angle=ramp_angle_2)

# ---- group: Try to reduce uneccessy Z movement
connect_overlapping_toolpaths_3 = ConnectOverlappingToolpaths(polyline_toolpaths=ramp_toolpath_plunges_2)

# ---- group: Checks if ramp plunges = true (continued)
filter_15 = StreamFilter(Gate=flatten(ramp_plunges_5), Stream0=flatten(gate_14.Target0), Stream1=flatten(connect_overlapping_toolpaths_3))

# ----
filter_16 = StreamFilter(Gate=use_high_speed_machining_4, Stream0=filter_15, Stream1=trochoidal_polyline_toolpaths, Stream2=plunge_rough_lines)

# ---- group: Move toolpaths up with material thcikness distance in case of Z zero at bottom of stock
Z_2 = UnitZ(MaterialThickness=material_thickness_2)
move_2 = Move(Toolpaths=filter_16, Motion=Z_2)  # -> Geometry, Transform
filter_17 = StreamFilter(ZZeroIsAtBottomOfStock=z_zero_is_at_bottom_of_stock_2, Stream0=filter_16, Stream1=move_2.Geometry)

# ---- group: Extract toolpath points from toopath polylines
cp_2 = ControlPoints(Curve=filter_17)  # -> Points, Weights, Knots

# ---- group: Send main toolpath points to g-code or ShopBot code postprocessor
make_shopbot_code_not_g_code_4 = Boolean(make_shopbot_code_not_g_code_2)
toolpath_points_3 = Point(cp_2.Points)
gate_15 = StreamGate(Stream=toolpath_points_3, Gate=make_shopbot_code_not_g_code_4)  # -> Target0, Target1

# ----
toolpath_points_4 = Point(gate_15.Target1)
pdecon_3 = Deconstruct(Point=toolpath_points_4)  # -> XComponent, YComponent, ZComponent
lng_12 = ListLength(List=toolpath_points_4)
num_16 = Number(pdecon_3.YComponent)
num_17 = Number(pdecon_3.XComponent)
num_18 = Number(pdecon_3.ZComponent)
expression_7 = Expression(x=num_16, y=num_5, Expression="Round(x,y)")
expression_8 = Expression(x=num_17, y=num_4, Expression="Round(x,y)")
expression_9 = Expression(x=num_18, y=num_6, Expression="Round(x,y)")

# ---- group: Prepare correct height of toolpaths for preview
Z_3 = UnitZ(MaterialThickness=material_thickness_2)
rev = Reverse(Vector=Z_3)
move_3 = Move(ToolpathPoints=toolpath_points_3, Motion=rev)  # -> Geometry, Transform
filter_18 = StreamFilter(ZZeroIsAtBottomOfStock=z_zero_is_at_bottom_of_stock_2, Stream0=toolpath_points_3, Stream1=move_3.Geometry)

# ----
flatten_13 = FlattenTree(Tree=lng_12, Path="{0}")
merge_11 = Merge(Data1=Slider(0, range=0..100), Data2=flatten_13)
panel_14 = Panel(expression_8)
panel_15 = Panel(expression_7)
panel_16 = Panel(expression_9)

# ---- group: Jog to startpoints
item_5 = ListItem(List=expression_8, Index=0, Wrap=True)
item_6 = ListItem(List=expression_7, Index=0, Wrap=True)
lng_13 = ListLength(List=flatten(item_5))
text_15 = Text(",")
text_16 = Text("J2,")
dup_20 = DuplicateData(Data=text_16, Number=lng_13, Order=True)
dup_21 = DuplicateData(Data=text_15, Number=lng_13, Order=True)
simplify_25 = SimplifyTree(Tree=flatten(dup_20), Front=False)
simplify_26 = SimplifyTree(Tree=flatten(item_5), Front=False)
simplify_27 = SimplifyTree(Tree=flatten(dup_21), Front=False)
simplify_28 = SimplifyTree(Tree=flatten(item_6), Front=False)
graft_30 = GraftTree(Tree=simplify_25, IncludeEmptyLists=True, IncludeNullItems=True)
graft_31 = GraftTree(Tree=simplify_26, IncludeEmptyLists=True, IncludeNullItems=True)
graft_32 = GraftTree(Tree=simplify_27, IncludeEmptyLists=True, IncludeNullItems=True)
graft_33 = GraftTree(Tree=simplify_28, IncludeEmptyLists=True, IncludeNullItems=True)
join_23 = TextJoin(Text=[graft_30, graft_31, graft_32, graft_33])
flatten_14 = FlattenTree(Tree=join_23, Path="{0}")
merge_12 = Merge(Data1=flatten_14, Data2=join_11)

# ---- group: Jog to safe Z
safe_z_height_6 = Number(flatten(safe_z_height_2))
text_17 = Text("JZ,")
graft_34 = GraftTree(Tree=safe_z_height_6, IncludeEmptyLists=True, IncludeNullItems=True)
graft_35 = GraftTree(Tree=text_17, IncludeEmptyLists=True, IncludeNullItems=True)
lng_14 = ListLength(List=flatten(merge_11))
join_24 = TextJoin(Text=[graft_35, graft_34])
dup_22 = DuplicateData(Data=join_24, Number=lng_14, Order=True)

# ---- group: Toolpath coordinates
text_18 = Text("M3,")
text_19 = Text(",")
text_20 = Text(",")
dup_23 = DuplicateData(Data=text_20, Number=lng_12, Order=True)
dup_24 = DuplicateData(Data=text_19, Number=lng_12, Order=True)
dup_25 = DuplicateData(Data=text_18, Number=lng_12, Order=True)
simplify_29 = SimplifyTree(Tree=flatten(dup_25), Front=False)
simplify_30 = SimplifyTree(Tree=flatten(panel_14), Front=False)
simplify_31 = SimplifyTree(Tree=flatten(dup_24), Front=False)
simplify_32 = SimplifyTree(Tree=flatten(panel_15), Front=False)
simplify_33 = SimplifyTree(Tree=flatten(dup_23), Front=False)
simplify_34 = SimplifyTree(Tree=flatten(panel_16), Front=False)
graft_36 = GraftTree(Tree=simplify_29, IncludeEmptyLists=True, IncludeNullItems=True)
graft_37 = GraftTree(Tree=simplify_30, IncludeEmptyLists=True, IncludeNullItems=True)
graft_38 = GraftTree(Tree=simplify_31, IncludeEmptyLists=True, IncludeNullItems=True)
graft_39 = GraftTree(Tree=simplify_32, IncludeEmptyLists=True, IncludeNullItems=True)
graft_40 = GraftTree(Tree=simplify_33, IncludeEmptyLists=True, IncludeNullItems=True)
graft_41 = GraftTree(Tree=simplify_34, IncludeEmptyLists=True, IncludeNullItems=True)
join_25 = TextJoin(Text=[graft_36, graft_37, graft_38, graft_39, graft_40, graft_41])
flatten_15 = FlattenTree(Tree=join_25, Path="{0}")

# ---- group: Create jog transtion points
safe_z_height_7 = Number(filter_3)
end_of_job_go_to_y_3 = Number(end_of_job_go_to_y_2)
toolpath_points_5 = Point(filter_18)
end_of_job_go_to_x_3 = Number(end_of_job_go_to_x_2)
flatten_16 = FlattenTree(Tree=toolpath_points_5, Path="{0}")
item_7 = ListItem(List=flatten_16, Index=0, Wrap=True)
rev_2 = ReverseList(List=toolpath_points_5)
null_2 = NullItem(Item=item_7)  # -> NullFlags, InvalidFlags, Description
# Create toolpath preview geometry
item_8 = ListItem(List=toolpath_points_5, Index=0, Wrap=True)
item_9 = ListItem(List=rev_2, Index=0, Wrap=True)
filter_19 = StreamFilter(Gate=null_2.NullFlags, Stream0=end_of_job_go_to_x_3)
filter_20 = StreamFilter(Gate=null_2.NullFlags, Stream0=end_of_job_go_to_y_3)
pdecon_4 = Deconstruct(Point=item_8)  # -> XComponent, YComponent, ZComponent
pdecon_5 = Deconstruct(Point=item_9)  # -> XComponent, YComponent, ZComponent
pt = ConstructPoint(XCoordinate=pdecon_4.XComponent, YCoordinate=pdecon_4.YComponent, ZCoordinate=safe_z_height_7)
pt_2 = ConstructPoint(XCoordinate=filter_19, YCoordinate=filter_20, ZCoordinate=safe_z_height_7)
pt_3 = ConstructPoint(XCoordinate="0", YCoordinate="0", ZCoordinate=safe_z_height_7)
pt_4 = ConstructPoint(XCoordinate=pdecon_5.XComponent, YCoordinate=pdecon_5.YComponent, ZCoordinate=safe_z_height_7)
most_probable_start_position = Point(pt_3)
end_position = Point(pt_2)
safe_z_end_point = Point(pt_4)
safe_z_start_point = Point(pt)

# ---- group: Insert JZ commands
ma_4 = MassAddition(Input=merge_11)  # -> Result, PartialResults
ins_5 = InsertItems(List=flatten_15, Item=dup_22, Indices=ma_4.PartialResults, Wrap=True)

# ---- group: Insert J2 commands
lng_15 = ListLength(List=merge_12)
dup_26 = DuplicateData(Data=Slider(1, range=0..1), Number=lng_15, Order=True)
addition_3 = Addition(A=dup_26, B=merge_11)
ma_5 = MassAddition(Input=addition_3)  # -> Result, PartialResults
ins_6 = InsertItems(List=ins_5, Item=merge_12, Indices=ma_5.PartialResults, Wrap=True)

# ---- group: Create toolpath previews
rev_3 = ReverseList(List=flatten(safe_z_start_point))
ins_7 = InsertItems(List=flatten(rev_3), Item=end_position, Indices="0", Wrap=True)
ins_8 = InsertItems(List=flatten(safe_z_end_point), Item=most_probable_start_position, Indices="0", Wrap=True)
rev_4 = ReverseList(List=flatten(ins_8))
ln = Line(StartPoint=rev_4, EndPoint=ins_7)
ln_2 = Line(StartPoint=safe_z_start_point, EndPoint=item_8)
ln_3 = Line(StartPoint=item_9, EndPoint=safe_z_end_point)
tab_cleanup_preview_curves = Curve(filter_12)
cut_transition_preview_lines = Curve(flatten(ln))
cut_exit_preview_lines = Curve(flatten(ln_3))
cut_entry_preview_lines = Curve(flatten(ln_2))
toolpath_preview_curves = Curve(filter_16)

# ----
flatten_17 = FlattenTree(Tree=ins_6, Path="{0}")
tab_cleanup_preview_curves_2 = ClusterOutput(tab_cleanup_preview_curves)
cut_transition_preview_lines_2 = ClusterOutput(cut_transition_preview_lines)
cut_exit_preview_lines_2 = ClusterOutput(cut_exit_preview_lines)
toolpath_preview_curves_2 = ClusterOutput(toolpath_preview_curves)
cut_entry_preview_lines_2 = ClusterOutput(cut_entry_preview_lines)
merge_13 = Merge(
    Data1=start_code_6,
    Data2=panel_2,
    Data3=filter_9,
    Data4=filter_7,
    Data5=panel_4,
    Data6=join_9,
    Data7=flatten_17,
    Data8=filter_5,
    Data9=end_code_6)
toolpath_shopbot_code = Panel(merge_13)
toolpath_shopbot_code_2 = Panel(toolpath_shopbot_code)

# ---- group: Format milling positions with axis names and feedrates
toolpath_points_6 = Point(gate_15.Target0)
lng_16 = ListLength(List=toolpath_points_6)
plunge_rate_8 = Number(plunge_rate_in_mm_m)
feed_rate_8 = Number(feed_rate_in_mm_m)
panel_17 = Panel(" X")  # disabled
panel_18 = Panel("F")  # disabled
dup_27 = DuplicateData(Data=flatten(panel_17), Number=flatten(lng_16), Order=True)  # disabled
dup_28 = DuplicateData(Data=flatten(panel_18), Number=flatten(lng_16), Order=True)  # disabled
dup_29 = DuplicateData(Data=graft(feed_rate_8), Number=graft(lng_16), Order=True)
number_of_decimal_places_5 = Panel(number_of_decimal_places)
lng_17 = ListLength(List=toolpath_points_6)
replace_2 = ReplaceItems(List=dup_29, Item=plunge_rate_8, Indices="0", Wrap=False)
pdecon_6 = Deconstruct(Point=toolpath_points_6)  # -> XComponent, YComponent, ZComponent
flatten_18 = FlattenTree(Tree=dup_28, Path="{0}")  # disabled
flatten_19 = FlattenTree(Tree=dup_27, Path="{0}")  # disabled
flatten_20 = FlattenTree(Tree=replace_2, Path="{0}")
graft_42 = GraftTree(Tree=flatten_18, IncludeEmptyLists=True, IncludeNullItems=True)  # disabled
graft_43 = GraftTree(Tree=flatten_20, IncludeEmptyLists=True, IncludeNullItems=True)
graft_44 = GraftTree(Tree=flatten_19, IncludeEmptyLists=True, IncludeNullItems=True)  # disabled
num_19 = Number(pdecon_6.XComponent)
num_20 = Number(number_of_decimal_places_5)
num_21 = Number(pdecon_6.YComponent)
num_22 = Number(number_of_decimal_places_5)
num_23 = Number(pdecon_6.ZComponent)
num_24 = Number(number_of_decimal_places_5)
expression_10 = Expression(x=num_19, y=num_20, Expression="Round(x,y)")
expression_11 = Expression(x=num_21, y=num_22, Expression="Round(x,y)")
expression_12 = Expression(x=num_23, y=num_24, Expression="Round(x,y)")
panel_19 = Panel(" Y")  # disabled
panel_20 = Panel(" Z")  # disabled
panel_21 = Panel("G1 ")  # disabled
join_26 = TextJoin(Text=[graft_42, graft_43, graft_44])  # disabled
dup_30 = DuplicateData(Data=panel_20, Number=lng_17, Order=True)  # disabled
dup_31 = DuplicateData(Data=panel_19, Number=lng_17, Order=True)  # disabled
dup_32 = DuplicateData(Data=panel_21, Number=lng_17, Order=True)  # disabled
simplify_35 = SimplifyTree(Tree=flatten(join_26), Front=False)  # disabled
simplify_36 = SimplifyTree(Tree=flatten(dup_32), Front=False)  # disabled
simplify_37 = SimplifyTree(Tree=flatten(expression_10), Front=False)
simplify_38 = SimplifyTree(Tree=flatten(dup_31), Front=False)  # disabled
simplify_39 = SimplifyTree(Tree=flatten(expression_11), Front=False)
simplify_40 = SimplifyTree(Tree=flatten(dup_30), Front=False)  # disabled
simplify_41 = SimplifyTree(Tree=flatten(expression_12), Front=False)
graft_45 = GraftTree(Tree=simplify_36, IncludeEmptyLists=True, IncludeNullItems=True)  # disabled
graft_46 = GraftTree(Tree=simplify_37, IncludeEmptyLists=True, IncludeNullItems=True)
graft_47 = GraftTree(Tree=simplify_38, IncludeEmptyLists=True, IncludeNullItems=True)  # disabled
graft_48 = GraftTree(Tree=simplify_39, IncludeEmptyLists=True, IncludeNullItems=True)
graft_49 = GraftTree(Tree=simplify_40, IncludeEmptyLists=True, IncludeNullItems=True)  # disabled
graft_50 = GraftTree(Tree=simplify_41, IncludeEmptyLists=True, IncludeNullItems=True)
graft_51 = GraftTree(Tree=simplify_35, IncludeEmptyLists=True, IncludeNullItems=True)  # disabled
join_27 = TextJoin(Text=[graft_45, graft_51, graft_46, graft_47, graft_48, graft_49, graft_50])  # disabled
flatten_21 = FlattenTree(Tree=join_27, Path="{0}")  # disabled

# ---- group: Format jog XY postions
jog_rate_x_y_3 = Number(jog_rate_x_y_in_mm_m)
item_10 = ListItem(List=expression_10, Index=0, Wrap=True)
custom_home_x_2 = Number(end_of_job_go_to_x_2)
custom_home_y_2 = Number(end_of_job_go_to_y_2)
item_11 = ListItem(List=expression_11, Index=0, Wrap=True)
int_6 = Integer(jog_rate_x_y_3)
lng_18 = ListLength(List=flatten(item_10))
safe_z_height_8 = Number(safe_z_height_2)
lng_19 = ListLength(List=flatten(item_10))
join_28 = TextJoin(Text=["F", int_6, " X"])
dup_33 = DuplicateData(Data="G1 ", Number=lng_18, Order=True)
dup_34 = DuplicateData(Data=" Y", Number=lng_18, Order=True)
dup_35 = DuplicateData(Data=" Z", Number=lng_18, Order=True)
dup_36 = DuplicateData(Data=safe_z_height_8, Number=lng_18, Order=True)
dup_37 = DuplicateData(Data=join_28, Number=lng_19, Order=True)
simplify_42 = SimplifyTree(Tree=flatten(dup_33), Front=False)
simplify_43 = SimplifyTree(Tree=flatten(item_10), Front=False)
simplify_44 = SimplifyTree(Tree=flatten(dup_34), Front=False)
simplify_45 = SimplifyTree(Tree=flatten(item_11), Front=False)
simplify_46 = SimplifyTree(Tree=flatten(dup_35), Front=False)
simplify_47 = SimplifyTree(Tree=flatten(dup_36), Front=False)
simplify_48 = SimplifyTree(Tree=flatten(dup_37), Front=False)
graft_52 = GraftTree(Tree=simplify_42, IncludeEmptyLists=True, IncludeNullItems=True)
graft_53 = GraftTree(Tree=simplify_48, IncludeEmptyLists=True, IncludeNullItems=True)
graft_54 = GraftTree(Tree=simplify_43, IncludeEmptyLists=True, IncludeNullItems=True)
graft_55 = GraftTree(Tree=simplify_44, IncludeEmptyLists=True, IncludeNullItems=True)
graft_56 = GraftTree(Tree=simplify_45, IncludeEmptyLists=True, IncludeNullItems=True)
graft_57 = GraftTree(Tree=simplify_46, IncludeEmptyLists=True, IncludeNullItems=True)
graft_58 = GraftTree(Tree=simplify_47, IncludeEmptyLists=True, IncludeNullItems=True)
join_29 = TextJoin(Text=[graft_52, graft_53, graft_54, graft_55, graft_56])
jog_rate_x_y_4 = Integer(jog_rate_x_y_3)
flatten_22 = FlattenTree(Tree=join_29, Path="{0}")
join_30 = TextJoin(Text=["F", jog_rate_x_y_4])
home_x_2 = Number(custom_home_x_2)
home_y_2 = Number(custom_home_y_2)
join_31 = TextJoin(Text=["G1 ", join_30, " X", home_x_2, " Y", home_y_2])
merge_14 = Merge(Data1=flatten(flatten_22), Data2=flatten(join_31))
jog_x_y_positions_2 = Panel(merge_14)

# ---- group: Format jog Z postions
# G-Code toolpath processing
jog_rate_z_4 = Number(jog_rate_z_in_mm_m)
int_7 = Integer(jog_rate_z_4)
join_32 = TextJoin(Text=["F", int_7])
safe_z_height_9 = Number(safe_z_height_2)
join_33 = TextJoin(Text=["G1 ", join_32, " Z", safe_z_height_9])
lng_20 = ListLength(List=merge_14)
dup_38 = DuplicateData(Data=join_33, Number=lng_20, Order=True)
flatten_23 = FlattenTree(Tree=dup_38, Path="{0}")
jog_z_positions_2 = Panel(flatten_23)

# ----
format = Format(Format="G1 F{0} X{1} Y{2} Z{3}", Culture=127, Data0=graft_43, Data1=graft_46, Data2=graft_48, Data3=graft_50)
flatten_24 = FlattenTree(Tree=format, Path="{0}")

# ---- group: Format milling positions with axis names and feedrates (continued)
panel_22 = Panel(flatten_24)

# ---- group: Insert jog to safe Z
ma_6 = MassAddition(Input=flatten(lng_17))  # -> Result, PartialResults
merge_15 = Merge(Data1=Slider(0, range=0..100), Data2=ma_6.PartialResults)
ins_9 = InsertItems(List=flatten(panel_22), Item=flatten(jog_z_positions_2), Indices=flatten(merge_15), Wrap=True)

# ----
panel_23 = Panel(join_33)

# ---- group: Insert jog X Y positions
lng_21 = ListLength(List=merge_15)
series_2 = Series(Start=1, Step=1, Count=lng_21)
addition_4 = Addition(A=merge_15, B=series_2)
ins_10 = InsertItems(List=flatten(ins_9), Item=flatten(jog_x_y_positions_2), Indices=flatten(addition_4), Wrap=True)

# ----
merge_16 = Merge(Data1=start_code_3, Data2=panel_23, Data3=g_code_spindle_start_2)
# Startcode - Ultimaker original , extruder upgrade + heatbed: M190 S70.000000
# M109 T0 S220.000000
# T0
# G21        ;metric values
# G90        ;absolute positioning
# M82        ;set extruder to absolute mode
# M107       ;start with the fan off
# G28 X0 Y0  ;move X/Y to min endstops
# G28 Z0     ;move Z to min endstops
# G1 Z15.0 F9000 ;move the platform down 15mm
# G92 E0                  ;zero the extruded length
# G1 F200 E17              ;extrude 17mm of feed stock
# G92 E0                  ;zero the extruded length again
# G1 F9000
# ;Put printing message on LCD screen
# M117 Bark beetle
# Startcode - Printrbot Simple: M190 S30.000000
# M109 S220.000000
# ;Sliced at: Mon 16-03-2015 21:37:50
# ;Basic settings: Layer height: 0.2 Walls: 0.8 Fill: 20
# ;Print time: 3 minutes
# ;Filament used: 0.151m 0.0g
# ;Filament cost: None
# ;M190 S30 ;Uncomment to add your own bed temperature line
# ;M109 S220 ;Uncomment to add your own temperature line
# G21        ;metric values
# G90        ;absolute positioning
# M82        ;set extruder to absolute mode
# M107       ;start with the fan off
# 
# G28 X0 Y0  ;move X/Y to min endstops
# G28 Z0     ;move Z to min endstops
# 
# G1 Z15.0 F9000 ;move the platform down 15mm
# 
# G92 E0                  ;zero the extruded length
# G1 F200 E6              ;extrude 6mm of feed stock
# G92 E0                  ;zero the extruded length again
# G1 F9000
# Startcode - FABtotum: G90        ;absolute positioning
# 
# ;G28	;Home all Axis
# 
# M3 S15000 ;SPINDLE ON - Clockwise , tries to maintain RPM constant min: 6500, max: 15000
# G4 S4; Dwell 4 seconds
# 
# G0 F600 Z-210; move to custom Z 0 position
# G92 Z0; set new zero position
startcode_2 = Panel(merge_16)
merge_17 = Merge(Data1=flatten(startcode_2), Data2=flatten(ins_10), Data3=flatten(endcode))
# Rigth click and choose "Stream destination"
# 
# Give a file name ending with .gcode
# 
# Your toolpath will automatically be updated!
toolpath_g_code = Panel(merge_17)
toolpath_g_code_2 = Panel(toolpath_g_code)
filter_21 = StreamFilter(Gate=make_shopbot_code_not_g_code_2, Stream0=toolpath_g_code_2, Stream1=toolpath_shopbot_code_2)
g_code_stream = ClusterOutput(filter_21)  # Connect a panel to stream the code to a folder on your computer

# ==== cluster CustomStartGCode
material_thicness = ClusterInput()
custom_start_code = ClusterInput()
material_thicness_2 = Number(material_thicness)
start_code_fom_external_file = Panel(custom_start_code)
material_thicness_3 = Panel(material_thicness_2)
merge = Merge(Data1="G0 Z", Data2=material_thicness_3, Data3=" ;jog to material height")
join = TextJoin(Text=merge)
merge_2 = Merge(Data1=flatten(start_code_fom_external_file), Data2=flatten(join), Data3=flatten("G92 Z0 ; make top of material Z zero"))
panel = Panel(merge_2)
start_code = Text(panel)
start_code_2 = ClusterOutput(start_code)

# ==== cluster CNCMillingPostProcessor_2: Converts toolpath curves into coordinates that a CNC machine can read. Use tab boxes for making safe cutouts, and ramps for smooth entry into hard materials.
make_shopbot_code_not_g_code = ClusterInput()
z_zero_is_at_bottom_of_stock = ClusterInput()  # Is Z zero postion at bottom or top of staock
use_high_speed_machining = ClusterInput()  # 0=off 1=Trochoidal 2=Plunge roughing
toolpath_width_factor = ClusterInput()
milling_bit_diameter = ClusterInput()
deviation_tolerance = ClusterInput()
end_of_job_go_to_x = ClusterInput()
end_of_job_go_to_y = ClusterInput()
material_thickness = ClusterInput()  # Used to create correct Z height for toolpaths when Z zero is at stock bottom
toolpath_curves = ClusterInput()
use_peck_entry = ClusterInput()
ramp_plunges = ClusterInput()
spindle_speed = ClusterInput()
safe_z_height = ClusterInput()
ramp_angle = ClusterInput()
use_spindle = ClusterInput()
plunge_rate = ClusterInput()
start_code = ClusterInput()  # Add a suitable start code for your machine here
tab_breps = ClusterInput()
jog_rate_z = ClusterInput()
job_name = ClusterInput()
feed_rate = ClusterInput()
end_code = ClusterInput()  # Add a suitable end code for your machine here
stepover = ClusterInput()
jog_rate = ClusterInput()

# ---- group: Additional settings
spindle_startup_time_g_code = Panel("5")
max_peck_depth_factor_plunge_roughing = Panel("0.4")
number_of_decimal_places = Panel("3")

# ----
toolpath_curves_2 = Curve(toolpath_curves)
tab_breps_2 = Brep(tab_breps)
feed_rate_2 = Number(feed_rate)
plunge_rate_2 = Number(plunge_rate)
jog_rate_2 = Number(jog_rate)
jog_rate_z_2 = Number(jog_rate_z)
safe_z_height_2 = Number(safe_z_height)
use_spindle_2 = Integer(use_spindle)
spindle_speed_2 = Number(spindle_speed)
ramp_plunges_2 = Integer(ramp_plunges)
ramp_angle_2 = Number(ramp_angle)
start_code_2 = Text(start_code)
end_code_2 = Text(end_code)
make_shopbot_code_not_g_code_2 = Boolean(make_shopbot_code_not_g_code)
end_of_job_go_to_x_2 = Number(end_of_job_go_to_x)
end_of_job_go_to_y_2 = Number(end_of_job_go_to_y)
deviation_tolerance_2 = Number(deviation_tolerance)
use_high_speed_machining_2 = Integer(use_high_speed_machining)
milling_bit_diameter_2 = Number(milling_bit_diameter)
toolpath_width_factor_2 = Number(toolpath_width_factor)
stepover_2 = Number(stepover)
use_peck_entry_2 = Boolean(use_peck_entry)
z_zero_is_at_bottom_of_stock_2 = Boolean(z_zero_is_at_bottom_of_stock)
material_thickness_2 = Number(material_thickness)
job_name_2 = Text(job_name)

flatten = FlattenTree(Tree=tab_breps_2, Path="{0}")
flatten_2 = FlattenTree(Tree=toolpath_curves_2, Path="{0}")

# ---- group: Convert speeds from mm per seond to mm per minute for g-code
seconds_in_a_minute = Panel("60")
multiplication = Multiplication(A=feed_rate_2, B=seconds_in_a_minute)
multiplication_2 = Multiplication(A=plunge_rate_2, B=seconds_in_a_minute)
multiplication_3 = Multiplication(A=jog_rate_2, B=seconds_in_a_minute)
multiplication_4 = Multiplication(A=jog_rate_z_2, B=seconds_in_a_minute)
feed_rate_in_mm_m = Number(multiplication)
plunge_rate_in_mm_m = Number(multiplication_2)
jog_rate_x_y_in_mm_m = Number(multiplication_3)
jog_rate_z_in_mm_m = Number(multiplication_4)

# ---- group: Make G-Code spindle start
spindle_speed_3 = Number(spindle_speed_2)
use_spindle_3 = Integer(use_spindle_2)
spindle_startup_time_g_code_2 = Panel(spindle_startup_time_g_code)
int = Integer(spindle_speed_3)
merge = Merge(Data1="M3 S", Data2=int, Data3=" ; start spindle and set spindle speed")
merge_2 = Merge(Data1="G4 P", Data2=spindle_startup_time_g_code_2, Data3=" ;wait a few seconds for the spindle to start")
join = TextJoin(Text=merge)
join_2 = TextJoin(Text=merge_2)
merge_3 = Merge(Data1=flatten(join), Data2=flatten(join_2))
filter = StreamFilter(Gate=use_spindle_3, Stream1=merge_3)
g_code_spindle_start = Panel(filter)

# ---- group: Find virtual bit diamter for trochoidal milling
multiplication_5 = Multiplication(A=milling_bit_diameter_2, B=toolpath_width_factor_2)
trochoidal_milling_bit_diameter = Number(multiplication_5)

# ---- group: Add prefix to shopbot job name
join_3 = TextJoin(Text=flatten(["'", job_name_2]))

# ----
clean = CleanTree(RemoveNulls=True, RemoveInvalid=True, RemoveEmpty=False, Tree=flatten_2)

# ---- group: Route toolpaths according to machining type
use_trochoidal_milling = Panel(use_high_speed_machining_2)
gate = StreamGate(Stream=clean, Gate=use_trochoidal_milling)  # -> Target0, Target1, Target2

# ---- group: Convert to polylines to extract toolpath coordinates
topoly = CurveToPolyline(Curve=gate.Target0, ToleranceDistance=deviation_tolerance_2, ToleranceAngle=0)  # -> Polyline, Segments
polyline_toolpaths = Curve(topoly.Polyline)

# ---- group: Adds tabs to toolpaths
tab_toolpaths = TabToolpaths(polyline_toolpaths=gate.Target1, tab_breps=flatten, milling_bit_diamter=trochoidal_milling_bit_diameter)  # -> tabbed_toolpaths_3, tab_cleanup_toolpaths_4

# ---- group: Eliminate unecessary jog Z
connect_overlapping_toolpaths = ConnectOverlappingToolpaths(polyline_toolpaths=polyline_toolpaths)

# ---- group: Adds tabs to toolpaths
tab_toolpaths_2 = TabToolpaths(polyline_toolpaths=gate.Target2, tab_breps=flatten, milling_bit_diamter=milling_bit_diameter_2)  # -> tabbed_toolpaths_3, tab_cleanup_toolpaths_4

# ----
ramp_plunges_3 = Integer(ramp_plunges_2)

# ---- group: Avoid trochoidal milling to use computer calculations
gate_2 = StreamGate(Stream=milling_bit_diameter_2, Gate=use_high_speed_machining_2)  # -> Target0, Target1
gate_3 = StreamGate(Stream=toolpath_width_factor_2, Gate=use_high_speed_machining_2)  # -> Target0, Target1
gate_4 = StreamGate(Stream=ramp_angle_2, Gate=use_high_speed_machining_2)  # -> Target0, Target1
gate_5 = StreamGate(Stream=use_peck_entry_2, Gate=use_high_speed_machining_2)  # -> Target0, Target1
gate_6 = StreamGate(Stream=max_peck_depth_factor_plunge_roughing, Gate=use_high_speed_machining_2)  # -> Target0, Target1

gate_7 = StreamGate(Stream=milling_bit_diameter_2, Gate=use_high_speed_machining_2)  # -> Target0, Target1
gate_8 = StreamGate(Stream=toolpath_width_factor_2, Gate=use_high_speed_machining_2)  # -> Target0, Target1
gate_9 = StreamGate(Stream=ramp_angle_2, Gate=use_high_speed_machining_2)  # -> Target0, Target1
gate_10 = StreamGate(Stream=use_peck_entry_2, Gate=use_high_speed_machining_2)  # -> Target0, Target1
gate_11 = StreamGate(Stream=max_peck_depth_factor_plunge_roughing, Gate=use_high_speed_machining_2)  # -> Target0, Target1

# ----
filter_2 = StreamFilter(Gate=ramp_plunges_3, Stream0=connect_overlapping_toolpaths, Stream1=polyline_toolpaths)
trochoidal_high_speed_milling = TrochoidalHighSpeedMilling(
    toolpath_curves=tab_toolpaths.tabbed_toolpaths_3,
    milling_bit_diameter=gate_2.Target1,
    toolpath_width_factor=gate_3.Target1,
    stepover=stepover_2,
    ramp_angle=gate_4.Target1,
    jog_z_lift_factor=0.1,
    use_climb_milling=True,
    straight_arc_extensions=True,
    use_peck_entry=gate_5.Target1,
    max_peck_depth_factor=gate_6.Target1)
trochoidal_high_speed_milling_2 = TrochoidalHighSpeedMilling(
    toolpath_curves=tab_toolpaths.tab_cleanup_toolpaths_4,
    milling_bit_diameter=gate_7.Target1,
    toolpath_width_factor=gate_8.Target1,
    stepover=stepover_2,
    ramp_angle=gate_9.Target1,
    jog_z_lift_factor=0.1,
    use_climb_milling=True,
    straight_arc_extensions=True,
    use_peck_entry=gate_10.Target1,
    max_peck_depth_factor=gate_11.Target1)
plunge_roughing = PlungeRoughing(toolpath_curves=tab_toolpaths_2.tabbed_toolpaths_3, milling_bit_diameter=milling_bit_diameter_2, stepover=stepover_2)
plunge_roughing_2 = PlungeRoughing(
    toolpath_curves=tab_toolpaths_2.tab_cleanup_toolpaths_4,
    milling_bit_diameter=milling_bit_diameter_2,
    stepover=stepover_2)
plunge_rough_lines = Curve(plunge_roughing)
plunge_rough_lines_2 = Curve(plunge_roughing_2)

# ---- group: Convert to polylines to extract toolpath coordinates
topoly_2 = CurveToPolyline(Curve=trochoidal_high_speed_milling_2, ToleranceDistance=deviation_tolerance_2, ToleranceAngle=0)  # -> Polyline, Segments
join_4 = JoinCurves(Curves=topoly_2.Polyline, Preserve=False)

topoly_3 = CurveToPolyline(Curve=trochoidal_high_speed_milling, ToleranceDistance=deviation_tolerance_2, ToleranceAngle=0)  # -> Polyline, Segments
join_5 = JoinCurves(Curves=topoly_3.Polyline, Preserve=False)

# ----
trochoidal_polyline_toolpaths = Curve(join_5)
trochoidal_polyline_toolpaths_from_insid = Curve(join_4)  # "Trochoidal polyline toolpaths from inside tab boundary boxes"
use_high_speed_machining_3 = Panel(use_high_speed_machining_2)
use_high_speed_machining_4 = Panel(use_high_speed_machining_2)
number_of_decimal_places_2 = Panel(number_of_decimal_places)
number_of_decimal_places_3 = Panel(number_of_decimal_places)
num = Number(number_of_decimal_places_3)
num_2 = Number(number_of_decimal_places_3)
num_3 = Number(number_of_decimal_places_3)
num_4 = Number(number_of_decimal_places_2)
num_5 = Number(number_of_decimal_places_2)
num_6 = Number(number_of_decimal_places_2)

# ---- group: Prepare correct safe Z height
subtraction = Subtraction(ActualSafeZHeight=safe_z_height_2, MaterialThickness=material_thickness_2)
filter_3 = StreamFilter(ZZeroIsAtBottomOfStock=z_zero_is_at_bottom_of_stock_2, Stream0=safe_z_height_2, Stream1=subtraction)

# ---- group: Name
# ShopBot code tab cleanup processing
panel = Panel(join_3)

# ---- group: Turn off spindle
filter_4 = StreamFilter(Gate=use_spindle_2, Stream1="SO,1,0")

# ---- group: Set spindle speed
spindle_speed_4 = Number(spindle_speed_2)
int_2 = Integer(spindle_speed_4)
join_6 = TextJoin(Text=["TR,", int_2, ",1"])

# ---- group: Name
# ShopBot code toolpath processing
panel_2 = Panel(join_3)

# ---- group: Set spindle speed
spindle_speed_5 = Number(spindle_speed_2)
int_3 = Integer(spindle_speed_5)
join_7 = TextJoin(Text=["TR,", int_3, ",1"])

# ---- group: Turn off spindle
filter_5 = StreamFilter(Gate=use_spindle_2, Stream1="SO,1,0")

# ---- group: Start spindle
panel_3 = Panel("PAUSE 1")
filter_6 = StreamFilter(Gate=use_spindle_2, Stream1="SO,1,1")

panel_4 = Panel("PAUSE 1")
filter_7 = StreamFilter(Gate=use_spindle_2, Stream1="SO,1,1")

# ---- group: Set Feed rate (X Y speed) and plunge rate (Z speed)
feed_rate_3 = Number(feed_rate_2)
plunge_rate_3 = Number(plunge_rate_2)
plunge_rate_4 = Number(plunge_rate_3)
feed_rate_4 = Number(feed_rate_3)
text = Text("MS,")
text_2 = Text(",")
join_8 = TextJoin(Text=flatten([text, feed_rate_4, text_2, plunge_rate_4]))

feed_rate_5 = Number(feed_rate_2)
plunge_rate_5 = Number(plunge_rate_2)
plunge_rate_6 = Number(plunge_rate_5)
feed_rate_6 = Number(feed_rate_5)
text_3 = Text("MS,")
text_4 = Text(",")
join_9 = TextJoin(Text=flatten([text_3, feed_rate_6, text_4, plunge_rate_6]))

# ----
filter_8 = StreamFilter(Gate=use_spindle_2, Stream1=join_6)
filter_9 = StreamFilter(Gate=use_spindle_2, Stream1=join_7)
text_5 = Text("J2,")
text_6 = Text("J2,")
text_7 = Text(",")
text_8 = Text(",")
join_10 = TextJoin(Text=[text_5, end_of_job_go_to_x_2, text_8, end_of_job_go_to_y_2])
join_11 = TextJoin(Text=[text_6, end_of_job_go_to_x_2, text_7, end_of_job_go_to_y_2])
g_code_spindle_start_2 = Panel(g_code_spindle_start)
g_code_spindle_start_3 = Panel(g_code_spindle_start)
start_code_3 = Text(start_code_2)
start_code_4 = Text(start_code_2)
end_code_3 = Text(end_code_2)
end_code_4 = Text(end_code_2)
endcode = Panel(end_code_3)
endcode_2 = Panel(end_code_4)
endcode_3 = Panel("""G4  S3
M280 S-90 P0 F3000 R""")
endcode_fabtotum = Panel("""G4 S2; Dwell
M5; SPINDLE OFF""")
start_code_5 = Text(start_code_2)
start_code_6 = Text(start_code_2)
end_code_5 = Text(end_code_2)
end_code_6 = Text(end_code_2)

# ---- group: Checks if there are tabs and skips tab toolpaths if there are no tab breps
lng = ListLength(List=flatten)
null = NullItem(Item=lng)  # -> NullFlags, InvalidFlags, Description
cull = CullPattern(List=milling_bit_diameter_2, CullPattern=invert(null.NullFlags))
gate_12 = StreamGate(Stream=filter_2, Gate=null.NullFlags)  # -> Target0, Target1

# ---- group: Adds tabs to toolpaths
tab_toolpaths_3 = TabToolpaths(polyline_toolpaths=gate_12.Target0, tab_breps=flatten, milling_bit_diamter=cull)  # -> tabbed_toolpaths_3, tab_cleanup_toolpaths_4

# ---- group: Checks if there are tabs and skips tab toolpaths if there are no tab breps (continued)
filter_10 = StreamFilter(Gate=null.NullFlags, Stream0=tab_toolpaths_3.tabbed_toolpaths_3, Stream1=gate_12.Target1)

# ---- group: Add ramps to cleanup toolpaths
tab_cleanup_toolpaths = Curve(tab_toolpaths_3.tab_cleanup_toolpaths_4)
ramp_plunges_4 = Integer(ramp_plunges_2)
ramp_toolpath_plunges = RampToolpathPlunges(toolpaths_to_ramp=tab_cleanup_toolpaths, ramp_angle=ramp_angle_2)
filter_11 = StreamFilter(Gate=ramp_plunges_4, Stream0=tab_cleanup_toolpaths, Stream1=ramp_toolpath_plunges)

# ---- group: Try to reduce uneccessy Z movement
connect_overlapping_toolpaths_2 = ConnectOverlappingToolpaths(polyline_toolpaths=filter_11)

# ----
panel_5 = Panel(connect_overlapping_toolpaths_2)
filter_12 = StreamFilter(
    Gate=use_high_speed_machining_3,
    Stream0=connect_overlapping_toolpaths_2,
    Stream1=trochoidal_polyline_toolpaths_from_insid,
    Stream2=plunge_rough_lines_2)

# ---- group: Move toolpaths up with material thcikness distance in case of Z zero at bottom of stock
Z = UnitZ(MaterialThickness=material_thickness_2)
move = Move(TabCleanupToolpaths=filter_12, Motion=Z)  # -> Geometry, Transform
filter_13 = StreamFilter(ZZeroIsAtBottomOfStock=z_zero_is_at_bottom_of_stock_2, Stream0=filter_12, Stream1=move.Geometry)

# ---- group: Extract toolpath points from toopath polylines
cp = ControlPoints(Curve=filter_13)  # -> Points, Weights, Knots

# ---- group: Send tab cleanup toolpath points to g-code or ShopBot code postprocessor
toolpath_points_for_tab_cleanup_job = Point(cp.Points)
make_shopbot_code_not_g_code_3 = Boolean(make_shopbot_code_not_g_code_2)
gate_13 = StreamGate(Stream=toolpath_points_for_tab_cleanup_job, Gate=make_shopbot_code_not_g_code_3)  # -> Target0, Target1

# ---- group: Format milling positions with axis names and feedrates
toolpath_points = Point(gate_13.Target0)
lng_2 = ListLength(List=toolpath_points)
number_of_decimal_places_4 = Panel(number_of_decimal_places)
feed_rate_7 = Number(feed_rate_in_mm_m)
plunge_rate_7 = Number(plunge_rate_in_mm_m)
dup = DuplicateData(Data=flatten(" X"), Number=flatten(lng_2), Order=True)
dup_2 = DuplicateData(Data=flatten("F"), Number=flatten(lng_2), Order=True)
dup_3 = DuplicateData(Data=graft(feed_rate_7), Number=graft(lng_2), Order=True)
pdecon = Deconstruct(Point=toolpath_points)  # -> XComponent, YComponent, ZComponent
lng_3 = ListLength(List=toolpath_points)
replace = ReplaceItems(List=dup_3, Item=plunge_rate_7, Indices="0", Wrap=False)
flatten_3 = FlattenTree(Tree=dup_2, Path="{0}")
flatten_4 = FlattenTree(Tree=dup, Path="{0}")
flatten_5 = FlattenTree(Tree=replace, Path="{0}")
num_7 = Number(pdecon.XComponent)
num_8 = Number(number_of_decimal_places_4)
num_9 = Number(pdecon.YComponent)
num_10 = Number(number_of_decimal_places_4)
num_11 = Number(pdecon.ZComponent)
num_12 = Number(number_of_decimal_places_4)
graft = GraftTree(Tree=flatten_3, IncludeEmptyLists=True, IncludeNullItems=True)
expression = Expression(x=num_7, y=num_8, Expression="Round(x,y)")
expression_2 = Expression(x=num_9, y=num_10, Expression="Round(x,y)")
expression_3 = Expression(x=num_11, y=num_12, Expression="Round(x,y)")
graft_2 = GraftTree(Tree=flatten_5, IncludeEmptyLists=True, IncludeNullItems=True)
graft_3 = GraftTree(Tree=flatten_4, IncludeEmptyLists=True, IncludeNullItems=True)
panel_6 = Panel(expression)
panel_7 = Panel(expression_2)
panel_8 = Panel(expression_3)
join_12 = TextJoin(Text=[graft, graft_2, graft_3])
dup_4 = DuplicateData(Data=" Z", Number=lng_3, Order=True)
dup_5 = DuplicateData(Data=" Y", Number=lng_3, Order=True)
dup_6 = DuplicateData(Data="G1 ", Number=lng_3, Order=True)
simplify = SimplifyTree(Tree=flatten(join_12), Front=False)
simplify_2 = SimplifyTree(Tree=flatten(dup_6), Front=False)
simplify_3 = SimplifyTree(Tree=flatten(panel_6), Front=False)
simplify_4 = SimplifyTree(Tree=flatten(dup_5), Front=False)
simplify_5 = SimplifyTree(Tree=flatten(panel_7), Front=False)
simplify_6 = SimplifyTree(Tree=flatten(dup_4), Front=False)
simplify_7 = SimplifyTree(Tree=flatten(panel_8), Front=False)
graft_4 = GraftTree(Tree=simplify_2, IncludeEmptyLists=True, IncludeNullItems=True)
graft_5 = GraftTree(Tree=simplify_3, IncludeEmptyLists=True, IncludeNullItems=True)
graft_6 = GraftTree(Tree=simplify_4, IncludeEmptyLists=True, IncludeNullItems=True)
graft_7 = GraftTree(Tree=simplify_5, IncludeEmptyLists=True, IncludeNullItems=True)
graft_8 = GraftTree(Tree=simplify_6, IncludeEmptyLists=True, IncludeNullItems=True)
graft_9 = GraftTree(Tree=simplify_7, IncludeEmptyLists=True, IncludeNullItems=True)
graft_10 = GraftTree(Tree=simplify, IncludeEmptyLists=True, IncludeNullItems=True)
join_13 = TextJoin(Text=[graft_4, graft_10, graft_5, graft_6, graft_7, graft_8, graft_9])
flatten_6 = FlattenTree(Tree=join_13, Path="{0}")
panel_9 = Panel(flatten_6)

# ----
toolpath_points_2 = Point(gate_13.Target1)
pdecon_2 = Deconstruct(Point=toolpath_points_2)  # -> XComponent, YComponent, ZComponent
lng_4 = ListLength(List=toolpath_points_2)
num_13 = Number(pdecon_2.XComponent)
num_14 = Number(pdecon_2.YComponent)
num_15 = Number(pdecon_2.ZComponent)

# ---- group: Format jog XY postions
custom_home_y = Number(end_of_job_go_to_y_2)
jog_rate_x_y = Number(jog_rate_x_y_in_mm_m)
item = ListItem(List=expression, Index=0, Wrap=True)
custom_home_x = Number(end_of_job_go_to_x_2)
item_2 = ListItem(List=expression_2, Index=0, Wrap=True)
int_4 = Integer(jog_rate_x_y)
lng_5 = ListLength(List=flatten(item))
safe_z_height_3 = Number(safe_z_height_2)
lng_6 = ListLength(List=flatten(item))
join_14 = TextJoin(Text=["F", int_4, " X"])
dup_7 = DuplicateData(Data="G1 ", Number=lng_5, Order=True)
dup_8 = DuplicateData(Data=" Y", Number=lng_5, Order=True)
dup_9 = DuplicateData(Data=" Z", Number=lng_5, Order=True)
dup_10 = DuplicateData(Data=safe_z_height_3, Number=lng_5, Order=True)
dup_11 = DuplicateData(Data=join_14, Number=lng_6, Order=True)
simplify_8 = SimplifyTree(Tree=flatten(dup_7), Front=False)
simplify_9 = SimplifyTree(Tree=flatten(item), Front=False)
simplify_10 = SimplifyTree(Tree=flatten(dup_8), Front=False)
simplify_11 = SimplifyTree(Tree=flatten(item_2), Front=False)
simplify_12 = SimplifyTree(Tree=flatten(dup_9), Front=False)
simplify_13 = SimplifyTree(Tree=flatten(dup_10), Front=False)
simplify_14 = SimplifyTree(Tree=flatten(dup_11), Front=False)
graft_11 = GraftTree(Tree=simplify_8, IncludeEmptyLists=True, IncludeNullItems=True)
graft_12 = GraftTree(Tree=simplify_14, IncludeEmptyLists=True, IncludeNullItems=True)
graft_13 = GraftTree(Tree=simplify_9, IncludeEmptyLists=True, IncludeNullItems=True)
graft_14 = GraftTree(Tree=simplify_10, IncludeEmptyLists=True, IncludeNullItems=True)
graft_15 = GraftTree(Tree=simplify_11, IncludeEmptyLists=True, IncludeNullItems=True)
graft_16 = GraftTree(Tree=simplify_12, IncludeEmptyLists=True, IncludeNullItems=True)
graft_17 = GraftTree(Tree=simplify_13, IncludeEmptyLists=True, IncludeNullItems=True)
join_15 = TextJoin(Text=[graft_11, graft_12, graft_13, graft_14, graft_15])
jog_rate_x_y_2 = Integer(jog_rate_x_y)
flatten_7 = FlattenTree(Tree=join_15, Path="{0}")
join_16 = TextJoin(Text=["F", jog_rate_x_y_2])
home_x = Number(custom_home_x)
home_y = Number(custom_home_y)
join_17 = TextJoin(Text=["G1 ", join_16, " X", home_x, " Y", home_y])
merge_4 = Merge(Data1=flatten(flatten_7), Data2=flatten(join_17))
jog_x_y_positions = Panel(merge_4)

# ----
expression_4 = Expression(x=num_13, y=num, Expression="Round(x,y)")
expression_5 = Expression(x=num_14, y=num_2, Expression="Round(x,y)")
expression_6 = Expression(x=num_15, y=num_3, Expression="Round(x,y)")
flatten_8 = FlattenTree(Tree=lng_4, Path="{0}")
merge_5 = Merge(Data1=Slider(0, range=0..100), Data2=flatten_8)
panel_10 = Panel(expression_4)
panel_11 = Panel(expression_5)
panel_12 = Panel(expression_6)

# ---- group: Jog to startpoints
item_3 = ListItem(List=expression_4, Index=0, Wrap=True)
item_4 = ListItem(List=expression_5, Index=0, Wrap=True)
lng_7 = ListLength(List=flatten(item_3))
text_9 = Text(",")
text_10 = Text("J2,")
dup_12 = DuplicateData(Data=text_10, Number=lng_7, Order=True)
dup_13 = DuplicateData(Data=text_9, Number=lng_7, Order=True)
simplify_15 = SimplifyTree(Tree=flatten(dup_12), Front=False)
simplify_16 = SimplifyTree(Tree=flatten(item_3), Front=False)
simplify_17 = SimplifyTree(Tree=flatten(dup_13), Front=False)
simplify_18 = SimplifyTree(Tree=flatten(item_4), Front=False)
graft_18 = GraftTree(Tree=simplify_15, IncludeEmptyLists=True, IncludeNullItems=True)
graft_19 = GraftTree(Tree=simplify_16, IncludeEmptyLists=True, IncludeNullItems=True)
graft_20 = GraftTree(Tree=simplify_17, IncludeEmptyLists=True, IncludeNullItems=True)
graft_21 = GraftTree(Tree=simplify_18, IncludeEmptyLists=True, IncludeNullItems=True)
join_18 = TextJoin(Text=[graft_18, graft_19, graft_20, graft_21])
flatten_9 = FlattenTree(Tree=join_18, Path="{0}")
merge_6 = Merge(Data1=flatten_9, Data2=join_10)

# ---- group: Jog to safe Z
safe_z_height_4 = Number(flatten(safe_z_height_2))
text_11 = Text("JZ,")
graft_22 = GraftTree(Tree=safe_z_height_4, IncludeEmptyLists=True, IncludeNullItems=True)
graft_23 = GraftTree(Tree=text_11, IncludeEmptyLists=True, IncludeNullItems=True)
lng_8 = ListLength(List=flatten(merge_5))
join_19 = TextJoin(Text=[graft_23, graft_22])
dup_14 = DuplicateData(Data=join_19, Number=lng_8, Order=True)

# ---- group: Toolpath coordinates
text_12 = Text("M3,")
text_13 = Text(",")
text_14 = Text(",")
dup_15 = DuplicateData(Data=text_14, Number=lng_4, Order=True)
dup_16 = DuplicateData(Data=text_13, Number=lng_4, Order=True)
dup_17 = DuplicateData(Data=text_12, Number=lng_4, Order=True)
simplify_19 = SimplifyTree(Tree=flatten(dup_17), Front=False)
simplify_20 = SimplifyTree(Tree=flatten(panel_10), Front=False)
simplify_21 = SimplifyTree(Tree=flatten(dup_16), Front=False)
simplify_22 = SimplifyTree(Tree=flatten(panel_11), Front=False)
simplify_23 = SimplifyTree(Tree=flatten(dup_15), Front=False)
simplify_24 = SimplifyTree(Tree=flatten(panel_12), Front=False)
graft_24 = GraftTree(Tree=simplify_19, IncludeEmptyLists=True, IncludeNullItems=True)
graft_25 = GraftTree(Tree=simplify_20, IncludeEmptyLists=True, IncludeNullItems=True)
graft_26 = GraftTree(Tree=simplify_21, IncludeEmptyLists=True, IncludeNullItems=True)
graft_27 = GraftTree(Tree=simplify_22, IncludeEmptyLists=True, IncludeNullItems=True)
graft_28 = GraftTree(Tree=simplify_23, IncludeEmptyLists=True, IncludeNullItems=True)
graft_29 = GraftTree(Tree=simplify_24, IncludeEmptyLists=True, IncludeNullItems=True)
join_20 = TextJoin(Text=[graft_24, graft_25, graft_26, graft_27, graft_28, graft_29])
flatten_10 = FlattenTree(Tree=join_20, Path="{0}")

# ---- group: Format jog Z postions
# G-Code tab cleanup processing
jog_rate_z_3 = Number(jog_rate_z_in_mm_m)
int_5 = Integer(jog_rate_z_3)
join_21 = TextJoin(Text=["F", int_5])
safe_z_height_5 = Number(safe_z_height_2)
join_22 = TextJoin(Text=["G1 ", join_21, " Z", safe_z_height_5])
lng_9 = ListLength(List=merge_4)
dup_18 = DuplicateData(Data=join_22, Number=lng_9, Order=True)
flatten_11 = FlattenTree(Tree=dup_18, Path="{0}")
jog_z_positions = Panel(flatten_11)

# ---- group: Insert JZ commands
ma = MassAddition(Input=merge_5)  # -> Result, PartialResults
ins = InsertItems(List=flatten_10, Item=dup_14, Indices=ma.PartialResults, Wrap=True)

# ---- group: Insert jog to safe Z
ma_2 = MassAddition(Input=flatten(lng_3))  # -> Result, PartialResults
merge_7 = Merge(Data1=Slider(0, range=0..100), Data2=ma_2.PartialResults)
ins_2 = InsertItems(List=flatten(panel_9), Item=flatten(jog_z_positions), Indices=flatten(merge_7), Wrap=True)

# ---- group: Insert J2 commands
lng_10 = ListLength(List=merge_6)
dup_19 = DuplicateData(Data=Slider(1, range=0..1), Number=lng_10, Order=True)
addition = Addition(A=dup_19, B=merge_5)
ma_3 = MassAddition(Input=addition)  # -> Result, PartialResults
ins_3 = InsertItems(List=ins, Item=merge_6, Indices=ma_3.PartialResults, Wrap=True)

# ----
panel_13 = Panel(join_22)

# ---- group: Insert jog X Y positions
lng_11 = ListLength(List=merge_7)
series = Series(Start=1, Step=1, Count=lng_11)
addition_2 = Addition(A=merge_7, B=series)
ins_4 = InsertItems(List=flatten(ins_2), Item=flatten(jog_x_y_positions), Indices=flatten(addition_2), Wrap=True)

# ----
flatten_12 = FlattenTree(Tree=ins_3, Path="{0}")
merge_8 = Merge(Data1=start_code_4, Data2=panel_13, Data3=g_code_spindle_start_3)
startcode = Panel(merge_8)
merge_9 = Merge(
    Data1=start_code_5,
    Data2=panel,
    Data3=filter_8,
    Data4=filter_6,
    Data5=panel_3,
    Data6=join_8,
    Data7=flatten_12,
    Data8=filter_4,
    Data9=end_code_5)
merge_10 = Merge(Data1=flatten(startcode), Data2=flatten(ins_4), Data3=flatten(endcode_2))
tab_cleanup_toolpath_shopbot_code = Panel(merge_9)
tab_cleanup_toolpath_g_code = Panel(merge_10)
tab_cleanup_toolpath_shopbot_code_2 = Panel(tab_cleanup_toolpath_shopbot_code)
tab_cleanup_toolpath_g_code_2 = Panel(tab_cleanup_toolpath_g_code)
filter_14 = StreamFilter(Gate=make_shopbot_code_not_g_code_2, Stream0=tab_cleanup_toolpath_g_code_2, Stream1=tab_cleanup_toolpath_shopbot_code_2)
g_code_for_tab_cleanup = ClusterOutput(filter_14)  # Connect a panel to stream the code to a folder on your computer

# ---- group: Checks if ramp plunges = true
ramp_plunges_5 = Integer(ramp_plunges_2)
gate_14 = StreamGate(Stream=filter_10, Gate=ramp_plunges_5)  # -> Target0, Target1

# ---- group: Add ramps to toolpaths
ramp_toolpath_plunges_2 = RampToolpathPlunges(toolpaths_to_ramp=gate_14.Target1, ramp_angle=ramp_angle_2)

# ---- group: Try to reduce uneccessy Z movement
connect_overlapping_toolpaths_3 = ConnectOverlappingToolpaths(polyline_toolpaths=ramp_toolpath_plunges_2)

# ---- group: Checks if ramp plunges = true (continued)
filter_15 = StreamFilter(Gate=flatten(ramp_plunges_5), Stream0=flatten(gate_14.Target0), Stream1=flatten(connect_overlapping_toolpaths_3))

# ----
filter_16 = StreamFilter(Gate=use_high_speed_machining_4, Stream0=filter_15, Stream1=trochoidal_polyline_toolpaths, Stream2=plunge_rough_lines)

# ---- group: Move toolpaths up with material thcikness distance in case of Z zero at bottom of stock
Z_2 = UnitZ(MaterialThickness=material_thickness_2)
move_2 = Move(Toolpaths=filter_16, Motion=Z_2)  # -> Geometry, Transform
filter_17 = StreamFilter(ZZeroIsAtBottomOfStock=z_zero_is_at_bottom_of_stock_2, Stream0=filter_16, Stream1=move_2.Geometry)

# ---- group: Extract toolpath points from toopath polylines
cp_2 = ControlPoints(Curve=filter_17)  # -> Points, Weights, Knots

# ---- group: Send main toolpath points to g-code or ShopBot code postprocessor
make_shopbot_code_not_g_code_4 = Boolean(make_shopbot_code_not_g_code_2)
toolpath_points_3 = Point(cp_2.Points)
gate_15 = StreamGate(Stream=toolpath_points_3, Gate=make_shopbot_code_not_g_code_4)  # -> Target0, Target1

# ----
toolpath_points_4 = Point(gate_15.Target1)
pdecon_3 = Deconstruct(Point=toolpath_points_4)  # -> XComponent, YComponent, ZComponent
lng_12 = ListLength(List=toolpath_points_4)
num_16 = Number(pdecon_3.YComponent)
num_17 = Number(pdecon_3.XComponent)
num_18 = Number(pdecon_3.ZComponent)
expression_7 = Expression(x=num_16, y=num_5, Expression="Round(x,y)")
expression_8 = Expression(x=num_17, y=num_4, Expression="Round(x,y)")
expression_9 = Expression(x=num_18, y=num_6, Expression="Round(x,y)")

# ---- group: Prepare correct height of toolpaths for preview
Z_3 = UnitZ(MaterialThickness=material_thickness_2)
rev = Reverse(Vector=Z_3)
move_3 = Move(ToolpathPoints=toolpath_points_3, Motion=rev)  # -> Geometry, Transform
filter_18 = StreamFilter(ZZeroIsAtBottomOfStock=z_zero_is_at_bottom_of_stock_2, Stream0=toolpath_points_3, Stream1=move_3.Geometry)

# ----
flatten_13 = FlattenTree(Tree=lng_12, Path="{0}")
merge_11 = Merge(Data1=Slider(0, range=0..100), Data2=flatten_13)
panel_14 = Panel(expression_8)
panel_15 = Panel(expression_7)
panel_16 = Panel(expression_9)

# ---- group: Jog to startpoints
item_5 = ListItem(List=expression_8, Index=0, Wrap=True)
item_6 = ListItem(List=expression_7, Index=0, Wrap=True)
lng_13 = ListLength(List=flatten(item_5))
text_15 = Text(",")
text_16 = Text("J2,")
dup_20 = DuplicateData(Data=text_16, Number=lng_13, Order=True)
dup_21 = DuplicateData(Data=text_15, Number=lng_13, Order=True)
simplify_25 = SimplifyTree(Tree=flatten(dup_20), Front=False)
simplify_26 = SimplifyTree(Tree=flatten(item_5), Front=False)
simplify_27 = SimplifyTree(Tree=flatten(dup_21), Front=False)
simplify_28 = SimplifyTree(Tree=flatten(item_6), Front=False)
graft_30 = GraftTree(Tree=simplify_25, IncludeEmptyLists=True, IncludeNullItems=True)
graft_31 = GraftTree(Tree=simplify_26, IncludeEmptyLists=True, IncludeNullItems=True)
graft_32 = GraftTree(Tree=simplify_27, IncludeEmptyLists=True, IncludeNullItems=True)
graft_33 = GraftTree(Tree=simplify_28, IncludeEmptyLists=True, IncludeNullItems=True)
join_23 = TextJoin(Text=[graft_30, graft_31, graft_32, graft_33])
flatten_14 = FlattenTree(Tree=join_23, Path="{0}")
merge_12 = Merge(Data1=flatten_14, Data2=join_11)

# ---- group: Jog to safe Z
safe_z_height_6 = Number(flatten(safe_z_height_2))
text_17 = Text("JZ,")
graft_34 = GraftTree(Tree=safe_z_height_6, IncludeEmptyLists=True, IncludeNullItems=True)
graft_35 = GraftTree(Tree=text_17, IncludeEmptyLists=True, IncludeNullItems=True)
lng_14 = ListLength(List=flatten(merge_11))
join_24 = TextJoin(Text=[graft_35, graft_34])
dup_22 = DuplicateData(Data=join_24, Number=lng_14, Order=True)

# ---- group: Toolpath coordinates
text_18 = Text("M3,")
text_19 = Text(",")
text_20 = Text(",")
dup_23 = DuplicateData(Data=text_20, Number=lng_12, Order=True)
dup_24 = DuplicateData(Data=text_19, Number=lng_12, Order=True)
dup_25 = DuplicateData(Data=text_18, Number=lng_12, Order=True)
simplify_29 = SimplifyTree(Tree=flatten(dup_25), Front=False)
simplify_30 = SimplifyTree(Tree=flatten(panel_14), Front=False)
simplify_31 = SimplifyTree(Tree=flatten(dup_24), Front=False)
simplify_32 = SimplifyTree(Tree=flatten(panel_15), Front=False)
simplify_33 = SimplifyTree(Tree=flatten(dup_23), Front=False)
simplify_34 = SimplifyTree(Tree=flatten(panel_16), Front=False)
graft_36 = GraftTree(Tree=simplify_29, IncludeEmptyLists=True, IncludeNullItems=True)
graft_37 = GraftTree(Tree=simplify_30, IncludeEmptyLists=True, IncludeNullItems=True)
graft_38 = GraftTree(Tree=simplify_31, IncludeEmptyLists=True, IncludeNullItems=True)
graft_39 = GraftTree(Tree=simplify_32, IncludeEmptyLists=True, IncludeNullItems=True)
graft_40 = GraftTree(Tree=simplify_33, IncludeEmptyLists=True, IncludeNullItems=True)
graft_41 = GraftTree(Tree=simplify_34, IncludeEmptyLists=True, IncludeNullItems=True)
join_25 = TextJoin(Text=[graft_36, graft_37, graft_38, graft_39, graft_40, graft_41])
flatten_15 = FlattenTree(Tree=join_25, Path="{0}")

# ---- group: Create jog transtion points
safe_z_height_7 = Number(filter_3)
end_of_job_go_to_y_3 = Number(end_of_job_go_to_y_2)
toolpath_points_5 = Point(filter_18)
end_of_job_go_to_x_3 = Number(end_of_job_go_to_x_2)
flatten_16 = FlattenTree(Tree=toolpath_points_5, Path="{0}")
item_7 = ListItem(List=flatten_16, Index=0, Wrap=True)
rev_2 = ReverseList(List=toolpath_points_5)
null_2 = NullItem(Item=item_7)  # -> NullFlags, InvalidFlags, Description
# Create toolpath preview geometry
item_8 = ListItem(List=toolpath_points_5, Index=0, Wrap=True)
item_9 = ListItem(List=rev_2, Index=0, Wrap=True)
filter_19 = StreamFilter(Gate=null_2.NullFlags, Stream0=end_of_job_go_to_x_3)
filter_20 = StreamFilter(Gate=null_2.NullFlags, Stream0=end_of_job_go_to_y_3)
pdecon_4 = Deconstruct(Point=item_8)  # -> XComponent, YComponent, ZComponent
pdecon_5 = Deconstruct(Point=item_9)  # -> XComponent, YComponent, ZComponent
pt = ConstructPoint(XCoordinate=pdecon_4.XComponent, YCoordinate=pdecon_4.YComponent, ZCoordinate=safe_z_height_7)
pt_2 = ConstructPoint(XCoordinate=filter_19, YCoordinate=filter_20, ZCoordinate=safe_z_height_7)
pt_3 = ConstructPoint(XCoordinate="0", YCoordinate="0", ZCoordinate=safe_z_height_7)
pt_4 = ConstructPoint(XCoordinate=pdecon_5.XComponent, YCoordinate=pdecon_5.YComponent, ZCoordinate=safe_z_height_7)
most_probable_start_position = Point(pt_3)
end_position = Point(pt_2)
safe_z_end_point = Point(pt_4)
safe_z_start_point = Point(pt)

# ---- group: Insert JZ commands
ma_4 = MassAddition(Input=merge_11)  # -> Result, PartialResults
ins_5 = InsertItems(List=flatten_15, Item=dup_22, Indices=ma_4.PartialResults, Wrap=True)

# ---- group: Insert J2 commands
lng_15 = ListLength(List=merge_12)
dup_26 = DuplicateData(Data=Slider(1, range=0..1), Number=lng_15, Order=True)
addition_3 = Addition(A=dup_26, B=merge_11)
ma_5 = MassAddition(Input=addition_3)  # -> Result, PartialResults
ins_6 = InsertItems(List=ins_5, Item=merge_12, Indices=ma_5.PartialResults, Wrap=True)

# ---- group: Create toolpath previews
rev_3 = ReverseList(List=flatten(safe_z_start_point))
ins_7 = InsertItems(List=flatten(rev_3), Item=end_position, Indices="0", Wrap=True)
ins_8 = InsertItems(List=flatten(safe_z_end_point), Item=most_probable_start_position, Indices="0", Wrap=True)
rev_4 = ReverseList(List=flatten(ins_8))
ln = Line(StartPoint=rev_4, EndPoint=ins_7)
ln_2 = Line(StartPoint=safe_z_start_point, EndPoint=item_8)
ln_3 = Line(StartPoint=item_9, EndPoint=safe_z_end_point)
tab_cleanup_preview_curves = Curve(filter_12)
cut_transition_preview_lines = Curve(flatten(ln))
cut_exit_preview_lines = Curve(flatten(ln_3))
cut_entry_preview_lines = Curve(flatten(ln_2))
toolpath_preview_curves = Curve(filter_16)

# ----
flatten_17 = FlattenTree(Tree=ins_6, Path="{0}")
tab_cleanup_preview_curves_2 = ClusterOutput(tab_cleanup_preview_curves)
cut_transition_preview_lines_2 = ClusterOutput(cut_transition_preview_lines)
cut_exit_preview_lines_2 = ClusterOutput(cut_exit_preview_lines)
toolpath_preview_curves_2 = ClusterOutput(toolpath_preview_curves)
cut_entry_preview_lines_2 = ClusterOutput(cut_entry_preview_lines)
merge_13 = Merge(
    Data1=start_code_6,
    Data2=panel_2,
    Data3=filter_9,
    Data4=filter_7,
    Data5=panel_4,
    Data6=join_9,
    Data7=flatten_17,
    Data8=filter_5,
    Data9=end_code_6)
toolpath_shopbot_code = Panel(merge_13)
toolpath_shopbot_code_2 = Panel(toolpath_shopbot_code)

# ---- group: Format milling positions with axis names and feedrates
toolpath_points_6 = Point(gate_15.Target0)
lng_16 = ListLength(List=toolpath_points_6)
plunge_rate_8 = Number(plunge_rate_in_mm_m)
feed_rate_8 = Number(feed_rate_in_mm_m)
panel_17 = Panel(" X")  # disabled
panel_18 = Panel("F")  # disabled
dup_27 = DuplicateData(Data=flatten(panel_17), Number=flatten(lng_16), Order=True)  # disabled
dup_28 = DuplicateData(Data=flatten(panel_18), Number=flatten(lng_16), Order=True)  # disabled
dup_29 = DuplicateData(Data=graft(feed_rate_8), Number=graft(lng_16), Order=True)
number_of_decimal_places_5 = Panel(number_of_decimal_places)
lng_17 = ListLength(List=toolpath_points_6)
replace_2 = ReplaceItems(List=dup_29, Item=plunge_rate_8, Indices="0", Wrap=False)
pdecon_6 = Deconstruct(Point=toolpath_points_6)  # -> XComponent, YComponent, ZComponent
flatten_18 = FlattenTree(Tree=dup_28, Path="{0}")  # disabled
flatten_19 = FlattenTree(Tree=dup_27, Path="{0}")  # disabled
flatten_20 = FlattenTree(Tree=replace_2, Path="{0}")
graft_42 = GraftTree(Tree=flatten_18, IncludeEmptyLists=True, IncludeNullItems=True)  # disabled
graft_43 = GraftTree(Tree=flatten_20, IncludeEmptyLists=True, IncludeNullItems=True)
graft_44 = GraftTree(Tree=flatten_19, IncludeEmptyLists=True, IncludeNullItems=True)  # disabled
num_19 = Number(pdecon_6.XComponent)
num_20 = Number(number_of_decimal_places_5)
num_21 = Number(pdecon_6.YComponent)
num_22 = Number(number_of_decimal_places_5)
num_23 = Number(pdecon_6.ZComponent)
num_24 = Number(number_of_decimal_places_5)
expression_10 = Expression(x=num_19, y=num_20, Expression="Round(x,y)")
expression_11 = Expression(x=num_21, y=num_22, Expression="Round(x,y)")
expression_12 = Expression(x=num_23, y=num_24, Expression="Round(x,y)")
panel_19 = Panel(" Y")  # disabled
panel_20 = Panel(" Z")  # disabled
panel_21 = Panel("G1 ")  # disabled
join_26 = TextJoin(Text=[graft_42, graft_43, graft_44])  # disabled
dup_30 = DuplicateData(Data=panel_20, Number=lng_17, Order=True)  # disabled
dup_31 = DuplicateData(Data=panel_19, Number=lng_17, Order=True)  # disabled
dup_32 = DuplicateData(Data=panel_21, Number=lng_17, Order=True)  # disabled
simplify_35 = SimplifyTree(Tree=flatten(join_26), Front=False)  # disabled
simplify_36 = SimplifyTree(Tree=flatten(dup_32), Front=False)  # disabled
simplify_37 = SimplifyTree(Tree=flatten(expression_10), Front=False)
simplify_38 = SimplifyTree(Tree=flatten(dup_31), Front=False)  # disabled
simplify_39 = SimplifyTree(Tree=flatten(expression_11), Front=False)
simplify_40 = SimplifyTree(Tree=flatten(dup_30), Front=False)  # disabled
simplify_41 = SimplifyTree(Tree=flatten(expression_12), Front=False)
graft_45 = GraftTree(Tree=simplify_36, IncludeEmptyLists=True, IncludeNullItems=True)  # disabled
graft_46 = GraftTree(Tree=simplify_37, IncludeEmptyLists=True, IncludeNullItems=True)
graft_47 = GraftTree(Tree=simplify_38, IncludeEmptyLists=True, IncludeNullItems=True)  # disabled
graft_48 = GraftTree(Tree=simplify_39, IncludeEmptyLists=True, IncludeNullItems=True)
graft_49 = GraftTree(Tree=simplify_40, IncludeEmptyLists=True, IncludeNullItems=True)  # disabled
graft_50 = GraftTree(Tree=simplify_41, IncludeEmptyLists=True, IncludeNullItems=True)
graft_51 = GraftTree(Tree=simplify_35, IncludeEmptyLists=True, IncludeNullItems=True)  # disabled
join_27 = TextJoin(Text=[graft_45, graft_51, graft_46, graft_47, graft_48, graft_49, graft_50])  # disabled
flatten_21 = FlattenTree(Tree=join_27, Path="{0}")  # disabled

# ---- group: Format jog XY postions
jog_rate_x_y_3 = Number(jog_rate_x_y_in_mm_m)
item_10 = ListItem(List=expression_10, Index=0, Wrap=True)
custom_home_x_2 = Number(end_of_job_go_to_x_2)
custom_home_y_2 = Number(end_of_job_go_to_y_2)
item_11 = ListItem(List=expression_11, Index=0, Wrap=True)
int_6 = Integer(jog_rate_x_y_3)
lng_18 = ListLength(List=flatten(item_10))
safe_z_height_8 = Number(safe_z_height_2)
lng_19 = ListLength(List=flatten(item_10))
join_28 = TextJoin(Text=["F", int_6, " X"])
dup_33 = DuplicateData(Data="G1 ", Number=lng_18, Order=True)
dup_34 = DuplicateData(Data=" Y", Number=lng_18, Order=True)
dup_35 = DuplicateData(Data=" Z", Number=lng_18, Order=True)
dup_36 = DuplicateData(Data=safe_z_height_8, Number=lng_18, Order=True)
dup_37 = DuplicateData(Data=join_28, Number=lng_19, Order=True)
simplify_42 = SimplifyTree(Tree=flatten(dup_33), Front=False)
simplify_43 = SimplifyTree(Tree=flatten(item_10), Front=False)
simplify_44 = SimplifyTree(Tree=flatten(dup_34), Front=False)
simplify_45 = SimplifyTree(Tree=flatten(item_11), Front=False)
simplify_46 = SimplifyTree(Tree=flatten(dup_35), Front=False)
simplify_47 = SimplifyTree(Tree=flatten(dup_36), Front=False)
simplify_48 = SimplifyTree(Tree=flatten(dup_37), Front=False)
graft_52 = GraftTree(Tree=simplify_42, IncludeEmptyLists=True, IncludeNullItems=True)
graft_53 = GraftTree(Tree=simplify_48, IncludeEmptyLists=True, IncludeNullItems=True)
graft_54 = GraftTree(Tree=simplify_43, IncludeEmptyLists=True, IncludeNullItems=True)
graft_55 = GraftTree(Tree=simplify_44, IncludeEmptyLists=True, IncludeNullItems=True)
graft_56 = GraftTree(Tree=simplify_45, IncludeEmptyLists=True, IncludeNullItems=True)
graft_57 = GraftTree(Tree=simplify_46, IncludeEmptyLists=True, IncludeNullItems=True)
graft_58 = GraftTree(Tree=simplify_47, IncludeEmptyLists=True, IncludeNullItems=True)
join_29 = TextJoin(Text=[graft_52, graft_53, graft_54, graft_55, graft_56])
jog_rate_x_y_4 = Integer(jog_rate_x_y_3)
flatten_22 = FlattenTree(Tree=join_29, Path="{0}")
join_30 = TextJoin(Text=["F", jog_rate_x_y_4])
home_x_2 = Number(custom_home_x_2)
home_y_2 = Number(custom_home_y_2)
join_31 = TextJoin(Text=["G1 ", join_30, " X", home_x_2, " Y", home_y_2])
merge_14 = Merge(Data1=flatten(flatten_22), Data2=flatten(join_31))
jog_x_y_positions_2 = Panel(merge_14)

# ---- group: Format jog Z postions
# G-Code toolpath processing
jog_rate_z_4 = Number(jog_rate_z_in_mm_m)
int_7 = Integer(jog_rate_z_4)
join_32 = TextJoin(Text=["F", int_7])
safe_z_height_9 = Number(safe_z_height_2)
join_33 = TextJoin(Text=["G1 ", join_32, " Z", safe_z_height_9])
lng_20 = ListLength(List=merge_14)
dup_38 = DuplicateData(Data=join_33, Number=lng_20, Order=True)
flatten_23 = FlattenTree(Tree=dup_38, Path="{0}")
jog_z_positions_2 = Panel(flatten_23)

# ----
format = Format(Format="G1 F{0} X{1} Y{2} Z{3}", Culture=127, Data0=graft_43, Data1=graft_46, Data2=graft_48, Data3=graft_50)
flatten_24 = FlattenTree(Tree=format, Path="{0}")

# ---- group: Format milling positions with axis names and feedrates (continued)
panel_22 = Panel(flatten_24)

# ---- group: Insert jog to safe Z
ma_6 = MassAddition(Input=flatten(lng_17))  # -> Result, PartialResults
merge_15 = Merge(Data1=Slider(0, range=0..100), Data2=ma_6.PartialResults)
ins_9 = InsertItems(List=flatten(panel_22), Item=flatten(jog_z_positions_2), Indices=flatten(merge_15), Wrap=True)

# ----
panel_23 = Panel(join_33)

# ---- group: Insert jog X Y positions
lng_21 = ListLength(List=merge_15)
series_2 = Series(Start=1, Step=1, Count=lng_21)
addition_4 = Addition(A=merge_15, B=series_2)
ins_10 = InsertItems(List=flatten(ins_9), Item=flatten(jog_x_y_positions_2), Indices=flatten(addition_4), Wrap=True)

# ----
merge_16 = Merge(Data1=start_code_3, Data2=panel_23, Data3=g_code_spindle_start_2)
startcode_2 = Panel(merge_16)
merge_17 = Merge(Data1=flatten(startcode_2), Data2=flatten(ins_10), Data3=flatten(endcode))
# Rigth click and choose "Stream destination"
# 
# Give a file name ending with .gcode
# 
# Your toolpath will automatically be updated!
toolpath_g_code = Panel(merge_17)
toolpath_g_code_2 = Panel(toolpath_g_code)
filter_21 = StreamFilter(Gate=make_shopbot_code_not_g_code_2, Stream0=toolpath_g_code_2, Stream1=toolpath_shopbot_code_2)
g_code_stream = ClusterOutput(filter_21)  # Connect a panel to stream the code to a folder on your computer

# ==== cluster CustomStartSBPCode
material_thicness = ClusterInput()
safe_z_height = ClusterInput()
safe_z_height_2 = Number(safe_z_height)
material_thicness_2 = Number(material_thicness)
# Make dialog box for safety material check: MSGBOX (Is your material thickness &Materialthickness mm?, YesNo, SAFETY CHECK)    'create a pop-up dialog asking for confirmation of material thickness
# IF &msganswer = NO THEN GOSUB Canceljob      'if material thickness is wrong, go to the cancel job sub routine with a pop up message of shame
make_dialog_box_for_safety_material_chec = Panel("""MSGBOX (Is your material thickness &Materialthickness mm?, YesNo, SAFETY CHECK)    'create a pop-up dialog asking for confirmation of material thickness
IF &msganswer = NO THEN GOSUB Canceljob      'if material thickness is wrong, go to the cancel job sub routine with a pop up message of shame""")  # "Make dialog box for safety material check"
start_the_authome_x_y_z_subroutine = Panel("FP,C:\\SbParts\\XYandZzero_Zzero_bellow_material.sbp \t\t    'load the file that automatically sets X, Y and Z Zero")
zero_z_part_3 = Panel("       'make a variable for material thickness based on the user input at the start of Bark Beetle main settings")
zero_z_part_1 = Panel("&Materialthickness = ")
zero_z_part_3_2 = Panel(",,,,,0\t      'tell the controller that the current postion is ZH home position (thereby making top of material our new Z Zero)")
zero_z_part_1_2 = Panel("VA,,,")
jog_part_3 = Panel("         'move to Z axis to material top of material + Z home postion")
jog_part_1 = Panel("JZ,")
addition = Addition(A=material_thicness_2, B=safe_z_height_2)
merge = Merge(Data1=zero_z_part_1, Data2=material_thicness_2, Data3=zero_z_part_3)
merge_2 = Merge(Data1=zero_z_part_1_2, Data2=safe_z_height_2, Data3=zero_z_part_3_2)
merge_3 = Merge(Data1=jog_part_1, Data2=addition, Data3=jog_part_3)
join = TextJoin(Text=merge)
join_2 = TextJoin(Text=merge_2)
join_3 = TextJoin(Text=merge_3)
merge_4 = Merge(
    Data1=flatten(join),
    Data2=flatten(make_dialog_box_for_safety_material_chec),
    Data3=flatten(start_the_authome_x_y_z_subroutine),
    Data4=flatten(join_3),
    Data5=flatten(join_2),
    Data6=flatten(join))
panel = Panel(merge_4)
start_code = Text(panel)
start_code_2 = ClusterOutput(start_code)

# ==== cluster CutoutOrProfile: Creates cutout toolpaths from closed flat 2D curves. Compensates for the diameter of your milling bit. It will detect curves inside curves. Inside curves will be cut first and on the inside of the curve. Outside curves last and on the outside of the curve. Note: Two levels of curves inside curves is supported. Use multiple setups to achieve a curve inside a curve inside a curve inside a curve. Supports climb and conventional. Supports inside cutting, but remember to switch of when your are done cutting a inside hole. Cutting your outer geometry on the inside is classic.
use_climb_direction = ClusterInput()
use_inside_cutting = ClusterInput()
curves_for_cutout = ClusterInput()
cutout_tolerance = ClusterInput()
tool_diameter = ClusterInput()
pass_depth = ClusterInput()
cut_depth = ClusterInput()
use_climb_direction_2 = Integer(use_climb_direction)
use_inside_cutting_2 = Integer(use_inside_cutting)
curves_for_cutout_2 = Curve(curves_for_cutout)
cutout_tolerance_2 = Number(cutout_tolerance)
tool_diameter_2 = Number(tool_diameter)
pass_depth_2 = Number(pass_depth)
cut_depth_2 = Number(cut_depth)
tool_diameter_3 = Panel(tool_diameter_2)
use_climb_direction_3 = Panel(use_climb_direction_2)
use_inside_cutting_3 = Panel(use_inside_cutting_2)

# ---- group: Filter out open curves
curves_for_cutout_3 = Curve(curves_for_cutout_2)
cls = Closed(Curve=curves_for_cutout_3)  # -> Closed, Periodic
dispatch = Dispatch(List=curves_for_cutout_3, DispatchPattern=cls.Closed)  # -> ListA, ListB

# ----
xy = XYPlane(Origin=Point(0, 0, 0))
operation_plane = Plane(xy)
multiplication = Multiplication(A=tool_diameter_3, B="0.5")
cutout_tolerance_3 = Panel(cutout_tolerance_2)
tool_radius = Panel(multiplication)

# ---- group: Re-join to assist in offsetting
explode = Explode(Curve=dispatch.ListA, Recursive=True)  # -> Segments, Vertices
join = JoinCurves(Curves=explode.Segments, Preserve=False)
cls_2 = Closed(Curve=join)  # -> Closed, Periodic
crv = Curve(graft(dispatch.ListA))
p_n_c = PickNChoose(Pattern=cls_2.Closed, Stream0=crv, Stream1=join)
flatten = FlattenTree(Tree=p_n_c, Path="{0}")

# ----
addition = Addition(A=tool_radius, B=cutout_tolerance_3)
compensated_tool_radius = Panel(addition)

# ---- group: Merge overlapping curves
curves_for_merging_overlap = Curve(flatten)
mcx = MultipleCurves(Curves=curves_for_merging_overlap)  # -> Points, IndexA, IndexB, ParamA, ParamB
dcon = DeleteConsecutive(Set=[mcx.IndexA, mcx.IndexB], Wrap=False)  # -> Set, Count
item = ListItem(List=curves_for_merging_overlap, Index=dcon.Set, Wrap=True)
cull_i = CullIndex(List=curves_for_merging_overlap, Indices=dcon.Set, Wrap=True)
runion = RegionUnion(Curves=item, Plane=operation_plane)
merged_overlapping_curves = Curve([runion, cull_i])

# ---- group: Align curve direction
curves_for_aligned_direction = Curve(merged_overlapping_curves)
use_inside_cutting_4 = Panel(use_inside_cutting_3)
cir = Circle(Plane=PlaneXY(0, 0, 0), Radius=1)
flip = FlipCurve(Curve=cir)  # -> Curve, Flag
filter = StreamFilter(Gate=use_inside_cutting_4, Stream0=flip.Curve, Stream1=cir)
flip_2 = FlipCurve(Curve=curves_for_aligned_direction, Guide=filter)  # -> Curve, Flag
aligned_curves = Curve(flip_2.Curve)

# ---- group: Flip curves inside curves
crv_2 = Curve(aligned_curves)
boundary = BoundarySurfaces(Edges=crv_2, UseTasks=True)  # -> graft(Surfaces)
edges = BrepEdges(Brep=boundary)  # -> Naked, Interior, NonManifold
suirify = Suirify(edges.Naked)
join_2 = JoinCurves(Curves=suirify, Preserve=False)  # -> simplify(Curves)
crv_3 = Curve(join_2)
lng = ListLength(List=crv_3)
larger = LargerThan(FirstNumber=lng, SecondNumber="1")  # -> LargerThan, OrEqualTo
dispatch_2 = Dispatch(List=crv_3, DispatchPattern=larger.LargerThan)  # -> ListA, ListB
crv_4 = Curve(dispatch_2.ListA)
end = EndPoints(Curve=crv_4)  # -> Start, End
crossref = CrossReference(ListA=end.Start, ListB=crv_4, CrossMode=1)  # -> ListA, ListB
incurve = PointInCurve(Point=simplify(crossref.ListA), Curve=crossref.ListB)  # -> Relationship, Point
lng_2 = ListLength(List=crv_4)
partition = PartitionList(List=incurve.Relationship, Size=lng_2)
partition_2 = PartitionList(List=crv_4, Size=1)
ma = MassAddition(Input=partition)  # -> Result, PartialResults
pshift = ShiftPaths(Data=partition_2, Offset=-1)
pshift_2 = ShiftPaths(Data=ma.Result, Offset=-1)
sort = SortList(Keys=pshift_2, ValuesA=pshift)  # -> reverse(simplify(Keys)), reverse(simplify(ValuesA)), reverse(simplify(ValuesB))
split = SplitList(List=sort.ValuesA, Index="1")  # -> ListA, ListB
inside_curves = Curve(split.ListB)
suirify_2 = Suirify(split.ListA)
suirify_3 = Suirify(dispatch_2.ListB)
flipped_inside_curves = Curve(split.ListB)
merge = Merge(Data1=simplify(suirify_2), Data2=simplify(suirify_3))
outside_curve = Curve(reparameterize(merge))
suirify_4 = Suirify(flipped_inside_curves)
merge_2 = Merge(Data1=outside_curve, Data2=suirify_4)

# ---- group: Fix curve seam
curves_with_original_seam = Curve(reparameterize(flatten(merge_2)))
curves_with_original_seam_2 = Curve(reparameterize(dispatch.ListA))
bbox = BoundingBox(Content=curves_with_original_seam, Plane=PlaneXY(0, 0, 0))  # -> Box, Box_2
bbox_2 = BoundingBox(Content=curves_with_original_seam_2, Plane=PlaneXY(0, 0, 0))  # -> Box, Box_2
debox = DeconstructBox(Box=bbox.Box)  # -> Plane, X, Y, Z
debox_2 = DeconstructBox(Box=bbox_2.Box)  # -> Plane, X, Y, Z
remap = RemapNumbers(Value="0.5", Source=Domain(0, 1), Target=debox.Y)  # -> Mapped, Clipped
remap_2 = RemapNumbers(Value="0.5", Source=Domain(0, 1), Target=debox.X)  # -> Mapped, Clipped
remap_3 = RemapNumbers(Value="0.5", Source=Domain(0, 1), Target=debox_2.Y)  # -> Mapped, Clipped
remap_4 = RemapNumbers(Value="0.5", Source=Domain(0, 1), Target=debox_2.X)  # -> Mapped, Clipped
pt = ConstructPoint(XCoordinate=remap_2.Mapped, YCoordinate=remap.Mapped, ZCoordinate=0)
pt_2 = ConstructPoint(XCoordinate=remap_4.Mapped, YCoordinate=remap_3.Mapped, ZCoordinate=0)
sort_pt = SortPoints(Points=pt)  # -> Points, Indices
sort_pt_2 = SortPoints(Points=pt_2)  # -> Points, Indices
item_2 = ListItem(List=curves_with_original_seam, Index=sort_pt.Indices, Wrap=True)
item_3 = ListItem(List=curves_with_original_seam_2, Index=sort_pt_2.Indices, Wrap=True)
len = Length(Curve=item_2)
len_2 = Length(Curve=item_3)
sort_2 = SortList(Keys=len_2, ValuesA=item_3, ValuesB=sort_pt_2.Indices)  # -> Keys, ValuesA, ValuesB
sort_3 = SortList(Keys=len, ValuesA=item_2, ValuesB=sort_pt.Indices)  # -> Keys, ValuesA, ValuesB
crv_5 = Curve(sort_3.ValuesA)
crv_6 = Curve(sort_2.ValuesA)
end_2 = EndPoints(Curve=crv_6)  # -> Start, End
crv_cp = CurveClosestPoint(Point=end_2.Start, Curve=crv_5)  # -> Point, Parameter, Distance
seam = Seam(Curve=crv_5, Seam=crv_cp.Parameter)
sort_4 = SortList(Keys=sort_3.ValuesB, ValuesA=seam, ValuesC=sort_2.ValuesB)  # -> Keys, ValuesA, ValuesC

# ---- group: Tree fixing for curves inside curves
lng_3 = ListLength(List=merge_2)  # -> flatten(Length)
partition_3 = PartitionList(List=sort_4.ValuesA, Size=lng_3)  # -> simplify(Chunks)
partition_4 = PartitionList(List=sort_4.ValuesC, Size=lng_3)  # -> simplify(Chunks)
split_2 = SplitList(List=partition_3, Index=1)  # -> ListA, ListB
split_3 = SplitList(List=partition_4, Index=1)  # -> flatten(ListA), ListB
flip_3 = FlipCurve(Curve=split_2.ListB)  # -> Curve, Flag
merge_3 = Merge(Data1=flip_3.Curve, Data2=split_2.ListA)  # -> simplify(Result)
group = Group(Objects=merge_3)  # -> flatten(Group)
sort_5 = SortList(Keys=split_3.ListA, ValuesA=group)  # -> Keys, simplify(graft(ValuesA))
ungroup = Ungroup(Group=sort_5.ValuesA)

# ----
curves_for_offset = Curve(ungroup)
operation_plane_2 = Plane(operation_plane)
neg = Negative(Value=compensated_tool_radius)
offset = Offset(Curve=curves_for_offset, Distance=neg, Plane=operation_plane_2, Corners=2)
pshift_3 = ShiftPaths(Data=offset, Offset=-1)

# ---- group: Flip curves for climb direction
sorted_inside_and_outside_curves = Curve(pshift_3)
use_climb_direction_4 = Panel(use_climb_direction_3)
flip_4 = FlipCurve(Curve=sorted_inside_and_outside_curves)  # -> Curve, Flag
filter_2 = StreamFilter(Gate=use_climb_direction_4, Stream0=flip_4.Curve, Stream1=sorted_inside_and_outside_curves)
sorted_inside_and_outside_curves_2 = Curve(filter_2)

# ----
pass_depth_3 = Number(pass_depth_2)
cut_depth_3 = Number(cut_depth_2)

# ---- group: Move cutout toolpaths to cut depths
sorted_inside_and_outside_curves_3 = Curve(sorted_inside_and_outside_curves_2)
pass_depth_4 = Panel(pass_depth_3)
cut_depth_cutout = Panel(cut_depth_3)
division = Division(A=cut_depth_cutout, B=pass_depth_4)
round = Round(Number=division)  # -> Nearest, Floor, Ceiling
division_2 = Division(A=cut_depth_cutout, B=round.Ceiling)
actual_pass_depth = Panel(division_2)
series = Series(Start=actual_pass_depth, Step=actual_pass_depth, Count=round.Ceiling)
neg_2 = Negative(Value=series)
Z = UnitZ(Factor=neg_2)
simplify = SimplifyTree(Tree=sorted_inside_and_outside_curves_3, Front=False)
simplify_2 = SimplifyTree(Tree=Z, Front=False)

# ----
graft = GraftTree(Tree=simplify, IncludeEmptyLists=True, IncludeNullItems=True)
move = Move(Geometry=graft, Motion=simplify_2)  # -> Geometry, Transform

# ---- group: Move cutout toolpaths to cut depths (continued)
flatten_2 = FlattenTree(Tree=move.Geometry, Path="{0}")

# ----
cutout_toolpaths = Curve(flatten_2)
cutout_toolpaths_2 = ClusterOutput(cutout_toolpaths)

# ==== cluster AutosortCurves: Sort curves based upon startpoint
curves = ClusterInput()  # Input curves for sorting
crv = Curve(curves)
clean = CleanTree(RemoveNulls=True, RemoveInvalid=True, RemoveEmpty=False, Tree=crv)
end = EndPoints(Curve=clean)  # -> Start, End
autosorting = GhPythonScript(Strtpoints=end.Start)  # -> out, a; inputs Strtpoints: list of Point3d
# ---------- autosorting: Python ----------
__author__ = "Siemen"

import rhinoscriptsyntax as rs


def shortestpath(pts):
    
    Origin = (0,0,0)
    lastpt = (0,0,0)
    orderedlist = []
    cullist = pts
    
    
    
    distlist =[]
    
    for x in pts:
        distlist = []
        for x in cullist:
            
            dist = rs.Distance(lastpt, x)
            dist = float(dist)
            
            distlist.append(dist)
            
        
        comblist = zip(distlist,cullist)
        
        comblist.sort()
        
        comblist = zip(*comblist)
        
        
        cullist = list(comblist[1])
        
        
        
        lastpt = cullist[0]
        
        orderedlist.append(lastpt)
        cullist.remove(lastpt)
        
        
    return orderedlist
    
    
    
    
if Strtpoints:
    
    a = shortestpath(Strtpoints)
else:
    print "No input curves"
# ---------- end autosorting ----------
cp = ClosestPoint(Point=autosorting.a, Cloud=end.Start)  # -> ClosestPoint, CPIndex, Distance
item = ListItem(List=clean, Index=cp.CPIndex, Wrap=True)
crv_2 = Curve(item)
curves_2 = ClusterOutput(crv_2)  # Autosorted curves

# ==== cluster Pocket: Creates pockets from closed curves. Used to clear all the material inside a curve to a specific depth. Supports curves inside a curve to make islands in a pocket, up til two levels. An island inside an island inside an island inside an island is not supported. Use multiple cutting operations to achieve this.
curves_for_raster_pocket = ClusterInput()
cut_depth_pocket = ClusterInput()
raster_along_y_0_1 = ClusterInput()
stepover_0_1 = ClusterInput()
tool_diameter = ClusterInput()
pass_depth = ClusterInput()
cut_depth_pocket_2 = Number(flatten(cut_depth_pocket))
stepover_0_1_2 = Number(stepover_0_1)
raster_along_y_0_1_2 = Integer(raster_along_y_0_1)
tool_diameter_2 = Number(tool_diameter)
raster_trim_safety_distance = Panel("0.09")
xy = XYPlane(Origin=Point(0, 0, 0))
pass_depth_2 = Number(pass_depth)

# ---- group: Filter out open curves
curves_for_raster_pocket_2 = Curve(flatten(curves_for_raster_pocket))
cls = Closed(Curve=curves_for_raster_pocket_2)  # -> Closed, Periodic
dispatch = Dispatch(List=curves_for_raster_pocket_2, DispatchPattern=cls.Closed)  # -> ListA, ListB
dispatch_2 = Dispatch(List=cut_depth_pocket_2, DispatchPattern=cls.Closed)  # -> ListA, ListB

# ----
operation_plane = Plane(xy)
multiplication = Multiplication(A=tool_diameter_2, B="0.5")
multiplication_2 = Multiplication(A=tool_diameter_2, B=stepover_0_1_2)
tool_radius = Panel(multiplication)
stepover_distance = Panel(multiplication_2)
tool_radius_2 = Panel(tool_radius)

curves_for_raster_pocket_3 = Curve(dispatch.ListA)
raster_trim_safety_distance_2 = Number(raster_trim_safety_distance)
cut_depth_pocket_3 = Number(dispatch_2.ListA)
raster_along_y_0_1_3 = Integer(raster_along_y_0_1_2)
stepover_distance_2 = Number(stepover_distance)
operation_plane_2 = Plane(operation_plane)
pass_depth_3 = Number(pass_depth_2)
tool_radius_3 = Number(tool_radius_2)

# ---- group: Align curve directions
curves_for_aligned_direction = Curve(curves_for_raster_pocket_3)

# ---- group: New align curve direction
cir = Circle(Plane=PlaneXY(0, 0, 0), Radius=1)
flip = FlipCurve(Curve=cir)  # -> Curve, Flag
flip_2 = FlipCurve(Curve=curves_for_aligned_direction, Guide=flip.Curve)  # -> Curve, Flag

# ----
raster_trim_safety_distance_3 = Number(raster_trim_safety_distance_2)
cut_depth_pocket_4 = Number(cut_depth_pocket_3)
raster_along_y_0_1_4 = Integer(raster_along_y_0_1_3)
stepover_distance_3 = Number(stepover_distance_2)
aligned_curves = Curve(flip_2.Curve)
operation_plane_3 = Plane(operation_plane_2)
pass_depth_4 = Number(pass_depth_3)
tool_radius_4 = Number(tool_radius_3)

aligned_curves_2 = Curve(aligned_curves)

# ---- group: Separate curves inside curves
crv = Curve(aligned_curves_2)
boundary = BoundarySurfaces(Edges=crv, UseTasks=True)
edges = BrepEdges(Brep=boundary)  # -> Naked, Interior, NonManifold
join = JoinCurves(Curves=edges.Naked, Preserve=False)  # -> simplify(Curves)
crv_2 = Curve(join)
lng = ListLength(List=crv_2)
larger = LargerThan(FirstNumber=lng, SecondNumber="1")  # -> LargerThan, OrEqualTo
dispatch_3 = Dispatch(List=crv_2, DispatchPattern=larger.LargerThan)  # -> ListA, ListB
crv_3 = Curve(dispatch_3.ListA)
end = EndPoints(Curve=crv_3)  # -> Start, End
crossref = CrossReference(ListA=end.Start, ListB=crv_3, CrossMode=1)  # -> ListA, ListB
incurve = PointInCurve(Point=simplify(crossref.ListA), Curve=crossref.ListB)  # -> Relationship, Point
lng_2 = ListLength(List=crv_3)
partition = PartitionList(List=incurve.Relationship, Size=lng_2)
partition_2 = PartitionList(List=crv_3, Size=1)
ma = MassAddition(Input=partition)  # -> Result, PartialResults
pshift = ShiftPaths(Data=partition_2, Offset=-1)
pshift_2 = ShiftPaths(Data=ma.Result, Offset=-1)
sort = SortList(Keys=pshift_2, ValuesA=pshift)  # -> reverse(simplify(Keys)), reverse(simplify(ValuesA)), reverse(simplify(ValuesB))
split = SplitList(List=sort.ValuesA, Index="1")  # -> ListA, ListB

# ----
suirify = Suirify(dispatch_3.ListB)
suirify_2 = Suirify(split.ListA)
suirify_3 = Suirify(split.ListB)
merge = Merge(Data1=simplify(suirify_2), Data2=simplify(suirify))
outside_curves = Curve(merge)
inside_curves = Curve(suirify_3)
suirify_4 = Suirify(outside_curves)
suirify_5 = Suirify(inside_curves)

raster_trim_safety_distance_4 = Number(raster_trim_safety_distance_3)
raster_along_y_0_1_5 = Integer(raster_along_y_0_1_4)
stepover_distance_4 = Number(stepover_distance_3)
cut_depth_pocket_5 = Number(cut_depth_pocket_4)
operation_plane_4 = Plane(operation_plane_3)
curves_outside = Curve(suirify_4)
curves_inside = Curve(suirify_5)
pass_depth_5 = Number(pass_depth_4)
tool_radius_5 = Number(tool_radius_4)

operation_plane_5 = Plane(operation_plane_4)
tool_radius_6 = Number(tool_radius_5)

# ---- group: Offset inwards
outside_curves_for_offset_inwards = Curve(curves_outside)
offset = Offset(Curve=outside_curves_for_offset_inwards, Distance=tool_radius_6, Plane=operation_plane_5, Corners=2)
suirify_6 = Suirify(offset)

# ---- group: Offset outwards
inside_curves_for_offset_outwards = Curve(curves_inside)
neg = Negative(Value=tool_radius_6)
offset_2 = Offset(Curve=inside_curves_for_offset_outwards, Distance=neg, Plane=operation_plane_5, Corners=2)
pshift_3 = ShiftPaths(Data=offset_2, Offset=-1)

# ----
flip_3 = FlipCurve(Curve=pshift_3)  # -> Curve, Flag
suirify_7 = Suirify(flip_3.Curve)
merge_2 = Merge(Data1=curves_outside, Data2=curves_inside)
crv_4 = Curve(suirify_7)
lng_3 = ListLength(List=merge_2)

# ---- group: A tiny bit faster than solution above
lng_4 = ListLength(List=crv_4)
larger_2 = LargerThan(FirstNumber=lng_4, SecondNumber="1")  # -> LargerThan, OrEqualTo
dispatch_4 = Dispatch(List=crv_4, DispatchPattern=larger_2.LargerThan)  # -> ListA, ListB
runion = RegionUnion(Curves=dispatch_4.ListA, Plane=operation_plane_5)
suirify_8 = Suirify(runion)
suirify_9 = Suirify(dispatch_4.ListB)
merge_3 = Merge(Data1=suirify_8, Data2=suirify_9)

# ----
larger_3 = LargerThan(FirstNumber=lng_3, SecondNumber="1")  # -> LargerThan, OrEqualTo
dispatch_5 = Dispatch(List=suirify_6, DispatchPattern=larger_3.LargerThan)  # -> ListA, ListB
suirify_10 = Suirify(dispatch_5.ListA)
cull_i = CullIndex(List=suirify_10, Indices="0", Wrap=True)
suirify_11 = Suirify(cull_i)
merge_4 = Merge(Data1=suirify_11, Data2=merge_3)
rdiff = RegionDifference(CurvesA=suirify_10, CurvesB=merge_4)
suirify_12 = Suirify(rdiff)
merge_5 = Merge(Data1=dispatch_5.ListB, Data2=suirify_12)

raster_trim_safety_distance_5 = Number(raster_trim_safety_distance_4)
raster_along_y_0_1_6 = Integer(raster_along_y_0_1_5)
stepover_distance_5 = Number(stepover_distance_4)
cut_depth_pocket_6 = Number(cut_depth_pocket_5)
operation_plane_6 = Plane(operation_plane)
curves_outside_2 = Curve(outside_curves_for_offset_inwards)
tool_radius_7 = Number(tool_radius_5)
pass_depth_6 = Number(pass_depth_5)

offset_regions = Curve(merge_5)
offset_regions_2 = Curve(offset_regions)
offset_regions_3 = Curve(offset_regions_2)
xy_2 = XYPlane(Origin=Point(0, 0, 0))
xy_3 = XYPlane(Origin=Point(0, 0, 0))
offset_regions_4 = Curve(offset_regions_2)
xy_4 = XYPlane(Origin=Point(0, 0, 0))
offset_regions_5 = Curve(offset_regions_4)
suirify_13 = Suirify(offset_regions_5)

# ---- group: Generate raster curves outside
outside_curves_for_raster_generation = Curve(offset_regions)
raster_direction_boolean = Integer(raster_along_y_0_1_6)
bbox = BoundingBox(Content=outside_curves_for_raster_generation, Plane=PlaneXY(0, 0, 0), UnionBox=True)  # -> Box, Box_2
Y = UnitY(Factor=1)
rev = Reverse(Vector=Y)
edges_2 = BrepEdges(Brep=bbox.Box)  # -> Naked, Interior, NonManifold
X = UnitX(Factor=1)
filter = StreamFilter(Gate=raster_direction_boolean, Stream0="2", Stream1="3")
filter_2 = StreamFilter(Gate=raster_direction_boolean, Stream0="3", Stream1="2")
filter_3 = StreamFilter(Gate=raster_direction_boolean, Stream0=rev, Stream1=X)
item = ListItem(List=edges_2.Naked, Index=filter, Wrap=True)
item_2 = ListItem(List=edges_2.Naked, Index=filter_2, Wrap=True)
stepover_distance_6 = Panel(stepover_distance_5)
len = Length(Curve=item_2)
division = Division(A=len, B=stepover_distance_6)
round = Round(Number=division)  # -> Nearest, Floor, Ceiling
series = Series(Start=stepover_distance_6, Step=stepover_distance_6, Count=round.Floor)
amp = Amplitude(Vector=filter_3, Amplitude=series)
move = Move(Geometry=item, Motion=amp)  # -> Geometry, Transform

# ----
suirify_14 = Suirify(move.Geometry)

# ---- group: Generate raster curves outside (continued)
raster_curves_outside_curves = Curve(suirify_14)

# ----
raster_curves_outside_curves_2 = Curve(raster_curves_outside_curves)
raster_trim_safety_distance_6 = Number(raster_trim_safety_distance_5)
raster_along_y_0_1_7 = Integer(raster_along_y_0_1_6)
stepover_distance_7 = Number(stepover_distance_5)
cut_depth_pocket_7 = Number(cut_depth_pocket_6)
operation_plane_7 = Plane(operation_plane_6)
curves_outside_3 = Curve(curves_outside_2)
tool_radius_8 = Number(tool_radius_7)
pass_depth_7 = Number(pass_depth_6)

# ----
# Trim raster curves outside
dispatch_6 = Dispatch(List=raster_curves_outside_curves_2, DispatchPattern=[True, False])  # -> ListA, ListB
flip_4 = FlipCurve(Curve=dispatch_6.ListA)  # -> Curve, Flag
weave = Weave(Pattern=[0, 1], Stream0=flip_4.Curve, Stream1=dispatch_6.ListB, NullGaps=False)
raster_trim_safety_distance_7 = Panel(raster_trim_safety_distance_6)
raster_curves_outside = Curve(weave)
operation_plane_8 = Plane(operation_plane_7)
offset_3 = Offset(Curve=offset_regions_3, Distance=raster_trim_safety_distance_7, Plane=operation_plane_8, Corners=1)
pshift_4 = ShiftPaths(Data=offset_3, Offset=-1)
lng_5 = ListLength(List=pshift_4)
larger_4 = LargerThan(FirstNumber=lng_5, SecondNumber="1")  # -> LargerThan, OrEqualTo
dispatch_7 = Dispatch(List=pshift_4, DispatchPattern=larger_4.LargerThan)  # -> ListA, ListB

# ---- group: Separate curves inside curves
crv_5 = Curve(dispatch_7.ListA)
boundary_2 = BoundarySurfaces(Edges=crv_5, UseTasks=True)
edges_3 = BrepEdges(Brep=boundary_2)  # -> Naked, Interior, NonManifold
join_2 = JoinCurves(Curves=edges_3.Naked, Preserve=False)  # -> simplify(Curves)
crv_6 = Curve(join_2)
lng_6 = ListLength(List=crv_6)
larger_5 = LargerThan(FirstNumber=lng_6, SecondNumber="1")  # -> LargerThan, OrEqualTo
dispatch_8 = Dispatch(List=crv_6, DispatchPattern=larger_5.LargerThan)  # -> ListA, ListB
crv_7 = Curve(dispatch_8.ListA)
end_2 = EndPoints(Curve=crv_7)  # -> Start, End
crossref_2 = CrossReference(ListA=end_2.Start, ListB=crv_7, CrossMode=1)  # -> ListA, ListB
incurve_2 = PointInCurve(Point=simplify(crossref_2.ListA), Curve=crossref_2.ListB)  # -> Relationship, Point
lng_7 = ListLength(List=crv_7)
partition_3 = PartitionList(List=incurve_2.Relationship, Size=lng_7)
partition_4 = PartitionList(List=crv_7, Size=1)
ma_2 = MassAddition(Input=partition_3)  # -> Result, PartialResults
pshift_5 = ShiftPaths(Data=partition_4, Offset=-1)
pshift_6 = ShiftPaths(Data=ma_2.Result, Offset=-1)
sort_2 = SortList(Keys=pshift_6, ValuesA=pshift_5)  # -> reverse(simplify(Keys)), reverse(simplify(ValuesA)), reverse(simplify(ValuesB))
split_2 = SplitList(List=sort_2.ValuesA, Index="1")  # -> ListA, ListB

# ----
lng_8 = ListLength(List=crv_5)  # disabled
lng_9 = ListLength(List=boundary_2)  # disabled
equals = Equality(FirstNumber=lng_9, SecondNumber=lng_8)  # -> Equality, Inequality; disabled
dispatch_9 = Dispatch(List=boundary_2, DispatchPattern=equals.Equality)  # -> ListA, ListB; disabled
dispatch_10 = Dispatch(List=dispatch_9.ListA, DispatchPattern=[True, False])  # -> ListA, ListB; disabled
rdiff_2 = RegionDifference(CurvesA=dispatch_10.ListA, CurvesB=dispatch_10.ListB)  # disabled
suirify_15 = Suirify(dispatch_9.ListB)  # disabled
boundary_3 = BoundarySurfaces(Edges=rdiff_2, UseTasks=True)  # disabled
suirify_16 = Suirify(boundary_3)  # disabled
merge_6 = Merge(Data1=suirify_15, Data2=suirify_16)  # disabled

dispatch_11 = Dispatch(List=raster_curves_outside, DispatchPattern=larger_4.LargerThan)  # -> ListA, ListB
trim = TrimWithRegions(Curve=dispatch_11.ListB, Regions=dispatch_7.ListB, Plane=xy_2)  # -> Inside, Outside
cull_i_2 = CullIndex(List=lng_7, Indices=0, Wrap=True)  # -> simplify(List)
pshift_7 = ShiftPaths(Data=trim.Inside, Offset=-1)
crv_8 = Curve(pshift_7)
pshift_8 = ShiftPaths(Data=dispatch_8.ListB, Offset=-1)
suirify_17 = Suirify(split_2.ListA)
suirify_18 = Suirify(pshift_8)
suirify_19 = Suirify(cull_i_2)
suirify_20 = Suirify(split_2.ListB)
inside_curves_2 = Curve(suirify_20)
merge_7 = Merge(Data1=simplify(suirify_17), Data2=simplify(suirify_18), Data3=suirify_19)
outside_curves_2 = Curve(merge_7)
trim_2 = TrimWithRegions(Curve=dispatch_11.ListA, Regions=outside_curves_2, Plane=xy_3)  # -> Inside, Outside
pshift_9 = ShiftPaths(Data=trim_2.Inside, Offset=-1)
crv_9 = Curve(pshift_9)
tstat = TreeStatistics(Tree=merge_7)  # -> Paths, Length, Count
dup = DuplicateData(Data="0", Number=tstat.Count, Order=True)  # -> graft(Data)
suirify_21 = Suirify(dup)
merge_8 = Merge(Data1=dispatch_7.ListB, Data2=outside_curves_2)
cull_i_3 = CullIndex(List=suirify_21, Indices="0", Wrap=True)
suirify_22 = Suirify(cull_i_3)
merge_9 = Merge(Data1=suirify_22, Data2=inside_curves_2)
lng_10 = ListLength(List=merge_9)
larger_6 = LargerThan(FirstNumber=lng_10, SecondNumber="0")  # -> LargerThan, OrEqualTo
dispatch_12 = Dispatch(List=crv_9, DispatchPattern=larger_6.LargerThan)  # -> ListA, ListB
trim_3 = TrimWithRegions(Curve=dispatch_12.ListA, Regions=merge_9, Plane=xy_4)  # -> Inside, Outside
pshift_10 = ShiftPaths(Data=trim_3.Outside, Offset=-1)
crv_10 = Curve(pshift_10)
merge_10 = Merge(Data1=crv_8, Data2=crv_10, Data3=dispatch_12.ListB)
suirify_23 = Suirify(merge_10)

trimmed_and_filtered_raster_curves_outsi = Curve(suirify_23)  # "Trimmed and filtered raster curves (outside)"
raster_trim_safety_distance_8 = Number(raster_trim_safety_distance_6)
stepover_distance_8 = Number(stepover_distance_7)
cut_depth_pocket_8 = Number(cut_depth_pocket_7)
operation_plane_9 = Plane(operation_plane_7)
curves_outside_4 = Curve(curves_outside_3)
tool_radius_9 = Number(tool_radius_8)
pass_depth_8 = Number(pass_depth_7)

# ---- group: Bridges
crv_11 = Curve(trimmed_and_filtered_raster_curves_outsi)
shift = ShiftList(List=crv_11, Shift=-1, Wrap=False)
shift_2 = ShiftList(List=crv_11, Shift=1, Wrap=False)
end_3 = EndPoints(Curve=shift)  # -> Start, End
end_4 = EndPoints(Curve=shift_2)  # -> Start, End
ln = Line(StartPoint=end_4.Start, EndPoint=end_3.End)

# ----
suirify_24 = Suirify(ln)

trimmed_and_filtered_raster_curves_outsi_2 = Curve(trimmed_and_filtered_raster_curves_outsi)  # "Trimmed and filtered raster curves (outside)"
cut_depth_pocket_9 = Number(cut_depth_pocket_8)
connection_lines = Curve(suirify_24)
pass_depth_9 = Number(pass_depth_8)

# ---- group: Trims outisde bridges
tiny_offset_curve_for_infill = Curve(merge_8)
clean = CleanTree(RemoveNulls=True, RemoveInvalid=True, RemoveEmpty=False, Tree=connection_lines)
xy_5 = XYPlane(Origin=Point(0, 0, 0))
trim_4 = TrimWithRegions(Curve=clean, Regions=tiny_offset_curve_for_infill, Plane=xy_5)  # -> Inside, Outside
pshift_11 = ShiftPaths(Data=trim_4.Inside, Offset=-1)

# ---- group: Trims inside bridges
inside = Curve(merge_9)
dispatch_13 = Dispatch(List=pshift_11, DispatchPattern=larger_4.LargerThan)  # -> ListA, ListB
trim_5 = TrimWithRegions(Curve=dispatch_13.ListA, Regions=inside, Plane=xy_5)  # -> Inside, Outside
crv_12 = Curve(trim_5.Outside)
pshift_12 = ShiftPaths(Data=crv_12, Offset=-1)
merge_11 = Merge(Data1=dispatch_13.ListB, Data2=pshift_12)

# ----
join_3 = JoinCurves(Curves=[trimmed_and_filtered_raster_curves_outsi_2, merge_11], Preserve=False)
suirify_25 = Suirify(join_3)
crv_13 = Curve(suirify_25)
trimmed_and_filtered_raster_curves = Curve(crv_13)
dispatch_14 = Dispatch(List=crv_13, DispatchPattern=[True, False])  # -> ListA, ListB; disabled
flip_5 = FlipCurve(Curve=dispatch_14.ListA)  # -> Curve, Flag; disabled
crv_14 = Curve(dispatch_14.ListB)  # disabled
merge_12 = Merge(Data1=flip_5.Curve, Data2=crv_14)  # disabled

cut_depth_pocket_10 = Number(cut_depth_pocket_9)
pass_depth_10 = Number(pass_depth_9)

cut_depths_outer_pocket = Number(flatten(cut_depth_pocket_10))
pass_depth_11 = Number(pass_depth_10)

end_5 = EndPoints(Curve=trimmed_and_filtered_raster_curves)  # -> Start, End
cps = ClosestPoints(Point=end_5.End, Cloud=end_5.Start, Count=2)  # -> ClosestPoint, CPIndex, Distance
dist = Distance(PointA=graft(end_5.Start), PointB=cps.ClosestPoint)
equals_2 = Equality(FirstNumber=dist, SecondNumber="0")  # -> Equality, Inequality
dispatch_15 = Dispatch(List=cps.ClosestPoint, DispatchPattern=equals_2.Equality)  # -> ListA, ListB
item_3 = ListItem(List=dispatch_15.ListB, Index=0, Wrap=True)

pshift_13 = ShiftPaths(Data=item_3, Offset=-1)

ln_2 = Line(StartPoint=pshift_13, EndPoint=end_5.End)
crv_15 = Curve(ln_2)

trimmed_and_filtered_raster_curves_outsi_3 = Curve(trimmed_and_filtered_raster_curves)  # "Trimmed and filtered raster curves (outside)"
offset_outside_curves_inwards = Curve(offset_regions_5)
merge_13 = Merge(Data2=offset_outside_curves_inwards)
crv_16 = Curve(crv_15)
inside_and_outside_outline_curves = Curve(merge_13)
line_connections = Curve(crv_16)
stepover_distance_9 = Panel("6")
colom = CollisionOneMany(Collider=line_connections, Obstacles=inside_and_outside_outline_curves)  # -> Collision, Index
dispatch_16 = Dispatch(List=line_connections, DispatchPattern=colom.Collision)  # -> ListA, ListB
len_2 = Length(Curve=dispatch_16.ListB)
multiplication_3 = Multiplication(A=stepover_distance_9, B="2")
larger_7 = LargerThan(FirstNumber=len_2, SecondNumber=multiplication_3)  # -> LargerThan, OrEqualTo
dispatch_17 = Dispatch(List=dispatch_16.ListB, DispatchPattern=larger_7.LargerThan)  # -> ListA, ListB
good_connection_lines = Curve(dispatch_17.ListB)
to_be_filtered_connection_lines = Curve(dispatch_17.ListA)

stepover_distance_10 = Panel(stepover_distance_9)
curvepoint = PointOnCurve(to_be_filtered_connection_lines, parameter=0.497)
pull = PullPoint(Point=curvepoint, Geometry=inside_and_outside_outline_curves, ClosestOnly=True)  # -> ClosestPoint, Distance
division_2 = Division(A=stepover_distance_10, B=2)
larger_8 = LargerThan(FirstNumber=pull.Distance, SecondNumber=division_2)  # -> LargerThan, OrEqualTo
dispatch_18 = Dispatch(List=to_be_filtered_connection_lines, DispatchPattern=larger_8.LargerThan)  # -> ListA, ListB
crv_17 = Curve(dispatch_18.ListB)

extra_connection_lines = Curve([good_connection_lines, crv_17])
raster_curves = Curve(trimmed_and_filtered_raster_curves_outsi_3)
join_4 = JoinCurves(Curves=[raster_curves, extra_connection_lines], Preserve=False)
raster_curves_outside_2 = Curve(join_4)

crv_18 = Curve(raster_curves_outside_2)

# ---- group: Sort
end_6 = EndPoints(Curve=crv_18)  # -> Start, End
autosorting = GhPythonScript(Strtpoints=end_6.Start)  # -> out, a; inputs Strtpoints: list of Point3d; same code as autosorting
cp = ClosestPoint(Point=autosorting.a, Cloud=end_6.Start)  # -> ClosestPoint, CPIndex, Distance
item_4 = ListItem(List=crv_18, Index=cp.CPIndex, Wrap=True)
crv_19 = Curve(item_4)

# ----
crv_20 = Curve(crv_19)  # disabled
dispatch_19 = Dispatch(List=crv_20, DispatchPattern=[True, False])  # -> ListA, ListB; disabled
trimmed_and_filtered_raster_curves_outsi_4 = Curve(crv_20)  # "Trimmed and filtered raster curves (outside)"; disabled
flip_6 = FlipCurve(Curve=dispatch_19.ListA)  # -> Curve, Flag; disabled
crv_21 = Curve(dispatch_19.ListB)  # disabled
weave_2 = Weave(Pattern=[0, 1], Stream0=flip_6.Curve, Stream1=crv_21, NullGaps=False)  # disabled
crv_22 = Curve(weave_2)  # disabled
shift_3 = ShiftList(List=crv_22, Shift=-1, Wrap=False)  # disabled
shift_4 = ShiftList(List=crv_22, Shift=1, Wrap=False)  # disabled
end_7 = EndPoints(Curve=shift_4)  # -> Start, End; disabled
end_8 = EndPoints(Curve=shift_3)  # -> Start, End; disabled
ln_3 = Line(StartPoint=end_8.Start, EndPoint=end_7.End)  # disabled
connection_lines_2 = Curve(ln_3)  # disabled

# ---- group: Trims outisde bridges
tiny_offset_curve_for_infill_2 = Curve(merge_8)  # disabled
clean_2 = CleanTree(RemoveNulls=True, RemoveInvalid=True, RemoveEmpty=False, Tree=connection_lines_2)  # disabled
xy_6 = XYPlane(Origin=Point(0, 0, 0))  # disabled
trim_6 = TrimWithRegions(Curve=clean_2, Regions=tiny_offset_curve_for_infill_2, Plane=xy_6)  # -> Inside, Outside; disabled
pshift_14 = ShiftPaths(Data=trim_6.Inside, Offset=-1)  # disabled

# ----
suirify_26 = Suirify(pshift_14)  # disabled
suirify_27 = Suirify(trimmed_and_filtered_raster_curves_outsi_4)  # disabled
suirify_28 = Suirify(crv_19)
merge_14 = Merge(Data1=suirify_28, Data2=suirify_13)
in_outside_curves = Curve(merge_14)
iraster_final_pass_curve = Curve(in_outside_curves)
group = Group(Objects=iraster_final_pass_curve)

# ---- group: Trims inside bridges
inside_2 = Curve(merge_9)  # disabled
dispatch_20 = Dispatch(List=suirify_26, DispatchPattern=larger_4.LargerThan)  # -> ListA, ListB; disabled

# ----
dispatch_21 = Dispatch(List=dispatch_20.ListA, DispatchPattern=larger_6.LargerThan)  # -> ListA, ListB; disabled

# ---- group: Trims inside bridges (continued)
trim_7 = TrimWithRegions(Curve=dispatch_21.ListA, Regions=inside_2, Plane=xy_6)  # -> Inside, Outside; disabled
crv_23 = Curve(trim_7.Outside)  # disabled
pshift_15 = ShiftPaths(Data=crv_23, Offset=-1)  # disabled
merge_15 = Merge(Data1=dispatch_20.ListB, Data2=pshift_15, Data3=dispatch_21.ListB)  # disabled

# ----
suirify_29 = Suirify(merge_15)  # disabled
join_5 = JoinCurves(Curves=[suirify_27, suirify_29], Preserve=False)  # disabled
suirify_30 = Suirify(join_5)  # disabled

# ---- group: Move pocket toolpaths to cut depths
pass_depth_12 = Panel(pass_depth_11)
cut_depth_pocket_11 = Panel(cut_depths_outer_pocket)
division_3 = Division(A=cut_depth_pocket_11, B=pass_depth_12)
round_2 = Round(Number=division_3)  # -> Nearest, Floor, Ceiling
division_4 = Division(A=cut_depth_pocket_11, B=round_2.Ceiling)
actual_pass_depth = Panel(division_4)
series_2 = Series(Start=actual_pass_depth, Step=actual_pass_depth, Count=round_2.Ceiling)
neg_2 = Negative(Value=series_2)
item_5 = ListItem(List=neg_2, Index=0, Wrap=True)
null = NullItem(Item=item_5)  # -> NullFlags, InvalidFlags, Description
filter_4 = StreamFilter(Gate=null.NullFlags, Stream0=neg_2, Stream1="0")
Z = UnitZ(Factor=filter_4)
move_2 = Move(Geometry=group, Motion=Z)  # -> Geometry, Transform

# ---- group: Calculate cut load
actual_pass_depth_2 = Panel(actual_pass_depth)
pass_depth_13 = Panel(pass_depth_11)
division_5 = Division(A=pass_depth_13, B=actual_pass_depth_2)
feed_rate_multiplier = Panel(division_5)

# ----
suirify_31 = Suirify(move_2.Geometry)
feed_rate_multiplier_2 = Panel(feed_rate_multiplier)

# ---- group: Move pocket toolpaths to cut depths (continued)
ungroup = Ungroup(Group=suirify_31)
flatten = FlattenTree(Tree=ungroup, Path="{0}")

# ----
feed_rate_multiplier_3 = Number(feed_rate_multiplier_2)

pocket_toolpaths = Curve(flatten)
# fix curve order fail when no raster lines
# fix offset from when 1 line becomes more ? (narrow channels)
pocket_toolpaths_2 = ClusterOutput(pocket_toolpaths)

# ==== cluster MoveStartPoint
crv = ClusterInput()
int = ClusterInput()
crv_2 = Curve(reparameterize(graft(crv)))
int_2 = Integer(int)
larger = LargerThan(FirstNumber=int_2, SecondNumber="0")  # -> LargerThan, OrEqualTo
dispatch = Dispatch(List=crv_2, DispatchPattern=larger.LargerThan)  # -> ListA, ListB
bbox = BoundingBox(Content=dispatch.ListA, Plane=PlaneXY(0, 0, 0))  # -> Box, Box_2
box_corners = BoxCorners(Box=bbox.Box)  # -> CornerA, CornerB, CornerC, CornerD, CornerE, CornerF, CornerG, CornerH
pt = Point(box_corners.CornerA)
pt_2 = Point(box_corners.CornerD)
pt_3 = Point(box_corners.CornerB)
pt_4 = Point(box_corners.CornerC)
filter = StreamFilter(Gate=expr("x-1", int_2), Stream0=pt, Stream1=pt_2, Stream2=pt_3, Stream3=pt_4)
crv_cp = CurveClosestPoint(Point=filter, Curve=crv_2)  # -> Point, Parameter, Distance
seam = Seam(Curve=crv_2, Seam=crv_cp.Parameter)
suirify = Suirify(seam)
suirify_2 = Suirify(dispatch.ListB)
merge = Merge(Data1=suirify, Data2=suirify_2)
crv_3 = Curve(flatten(merge))
crv_4 = ClusterOutput(crv_3)

# ==== cluster AutoSortCutout
crv = ClusterInput()
int = ClusterInput()
crv_2 = Curve(crv)
int_2 = Integer(int)
gate = StreamGate(Stream=crv_2, Gate=int_2)  # -> Target0, Target1, Target2, Target3, Target4, Target5
crv_3 = Curve([gate.Target2, gate.Target3, gate.Target4, gate.Target5])
bbox = BoundingBox(Content=crv_3, Plane=PlaneXY(0, 0, 0))  # -> Box, Box_2
box_corners = BoxCorners(Box=bbox.Box)  # -> CornerA, CornerB, CornerC, CornerD, CornerE, CornerF, CornerG, CornerH
pt = Point(box_corners.CornerA)
pt_2 = Point(box_corners.CornerC)
pdecon = Deconstruct(Point=pt)  # -> XComponent, YComponent, ZComponent
pdecon_2 = Deconstruct(Point=pt_2)  # -> XComponent, YComponent, ZComponent
filter = StreamFilter(
    Gate=expr("x-2", int_2),
    Stream0=pdecon.XComponent,
    Stream1=pdecon_2.XComponent,
    Stream2=pdecon.YComponent,
    Stream3=pdecon_2.YComponent)
sort = SortList(Keys=filter, ValuesA=crv_3)  # -> Keys, reverse(ValuesA)
sort_2 = SortList(Keys=filter, ValuesA=crv_3)  # -> Keys, ValuesA

autosort_curves = AutosortCurves(curves=gate.Target1)
filter_2 = StreamFilter(
    Gate=int_2,
    Stream0=gate.Target0,
    Stream1=autosort_curves,
    Stream2=sort_2.ValuesA,
    Stream3=sort.ValuesA,
    Stream4=sort_2.ValuesA,
    Stream5=sort.ValuesA)

crv_4 = Curve(filter_2)
crv_5 = ClusterOutput(crv_4)

# ==== cluster EstimateTime
C = ClusterInput()
C_2 = ClusterInput()
C_3 = ClusterInput()
feed_rate = ClusterInput()
feed_rate_2 = ClusterInput()

len = Length(Curve=C)
jog_rate = Panel("150")
ma = MassAddition(Input=len)  # -> Result, PartialResults
panel = Panel(ma.Result)
division = Division(A=panel, B=jog_rate)
estimated_time = Panel(division)

len_2 = Length(Curve=C_2)
feed_rate_3 = Panel(feed_rate)
ma_2 = MassAddition(Input=len_2)  # -> Result, PartialResults
panel_2 = Panel(ma_2.Result)
division_2 = Division(A=panel_2, B=feed_rate_3)
estimated_time_2 = Panel(division_2)

len_3 = Length(Curve=C_3)
feed_rate_4 = Panel(feed_rate_2)
ma_3 = MassAddition(Input=len_3)  # -> Result, PartialResults
panel_3 = Panel(ma_3.Result)
division_3 = Division(A=panel_3, B=feed_rate_4)
estimated_time_3 = Panel(division_3)

ma_4 = MassAddition(Input=[estimated_time_2, estimated_time, estimated_time_3])  # -> Result, PartialResults
estimated_time_4 = Number(ma_4.Result)
estimated_time_use_in_seconds = ClusterOutput(estimated_time_4)  # Estimated time use in seconds

# ==== cluster Cutout
use_climb_direction = ClusterInput()
use_inside_cutting = ClusterInput()
curves_for_cutout = ClusterInput()
cutout_tolerance = ClusterInput()
tool_diameter = ClusterInput()
pass_depth = ClusterInput()
cut_depth = ClusterInput()
use_climb_direction_2 = Integer(use_climb_direction)
use_inside_cutting_2 = Integer(use_inside_cutting)
curves_for_cutout_2 = Curve(curves_for_cutout)
cutout_tolerance_2 = Number(cutout_tolerance)
tool_diameter_2 = Number(tool_diameter)
pass_depth_2 = Number(pass_depth)
cut_depth_2 = Number(cut_depth)
tool_diameter_3 = Panel(tool_diameter_2)
use_climb_direction_3 = Panel(use_climb_direction_2)
use_inside_cutting_3 = Panel(use_inside_cutting_2)

# ---- group: Filter out open curves
curves_for_cutout_3 = Curve(curves_for_cutout_2)
cls = Closed(Curve=curves_for_cutout_3)  # -> Closed, Periodic
dispatch = Dispatch(List=curves_for_cutout_3, DispatchPattern=cls.Closed)  # -> ListA, ListB

# ----
xy = XYPlane(Origin=Point(0, 0, 0))
operation_plane = Plane(xy)
multiplication = Multiplication(A=tool_diameter_3, B="0.5")
cutout_tolerance_3 = Panel(cutout_tolerance_2)
tool_radius = Panel(multiplication)

explode = Explode(Curve=dispatch.ListA, Recursive=True)  # -> Segments, Vertices
join = JoinCurves(Curves=explode.Segments, Preserve=False)
flatten = FlattenTree(Tree=join, Path="{0}")

addition = Addition(A=tool_radius, B=cutout_tolerance_3)
compensated_tool_radius = Panel(addition)

# ---- group: Merge overlapping curves
curves_for_merging_overlap = Curve(flatten)
mcx = MultipleCurves(Curves=curves_for_merging_overlap)  # -> Points, IndexA, IndexB, ParamA, ParamB
dcon = DeleteConsecutive(Set=[mcx.IndexA, mcx.IndexB], Wrap=False)  # -> Set, Count
item = ListItem(List=curves_for_merging_overlap, Index=dcon.Set, Wrap=True)
cull_i = CullIndex(List=curves_for_merging_overlap, Indices=dcon.Set, Wrap=True)
runion = RegionUnion(Curves=item, Plane=operation_plane)
merged_overlapping_curves = Curve([runion, cull_i])

# ----
use_inside_cutting_4 = Panel(use_inside_cutting_3)
operation_plane_2 = Plane(operation_plane)
neg = Negative(Value=compensated_tool_radius)
pass_depth_3 = Number(pass_depth_2)
cut_depth_3 = Number(cut_depth_2)

# ---- group: Align curve directions
curves_for_aligned_direction = Curve(merged_overlapping_curves)
graft = GraftTree(Tree=curves_for_aligned_direction, IncludeEmptyLists=True, IncludeNullItems=True)
offset = Offset(Curve=graft, Distance="0.01", Plane=PlaneXY(0, 0, 0), Corners=2)
end = EndPoints(Curve=offset)  # -> Start, End
pshift = ShiftPaths(Data=end.Start, Offset=-1)
incurve = PointInCurve(Point=pshift, Curve=graft)  # -> Relationship, Point
multiplication_2 = Multiplication(A=incurve.Relationship, B="0.5")
round = Round(Number=multiplication_2)  # -> Nearest, Floor, Ceiling
crv = Curve(graft)
int = Integer(round.Nearest)
flip = FlipCurve(Curve=crv)  # -> Curve, Flag
weave = Weave(Pattern=int, Stream0=flip.Curve, Stream1=crv, NullGaps=False)
pshift_2 = ShiftPaths(Data=weave, Offset=-1)

# ----
flip_2 = FlipCurve(Curve=pshift_2)  # -> Curve, Flag
filter = StreamFilter(Gate=use_inside_cutting_4, Stream0=pshift_2, Stream1=flip_2.Curve)

# ---- group: Align curve directions (continued)
aligned_curves = Curve(filter)

# ---- group: Detect curves inside curves
aligned_curves_2 = Curve(aligned_curves)
graft_2 = GraftTree(Tree=aligned_curves_2, IncludeEmptyLists=True, IncludeNullItems=True)
end_2 = EndPoints(Curve=aligned_curves_2)  # -> Start, End
incurve_2 = PointInCurve(Point=end_2.Start, Curve=graft_2)  # -> Relationship, Point
multiplication_3 = Multiplication(A=incurve_2.Relationship, B="0.5")
round_2 = Round(Number=multiplication_3)  # -> Nearest, Floor, Ceiling
int_2 = Integer(round_2.Floor)
flip_3 = FlipMatrix(Data=int_2)
ma = MassAddition(Input=flip_3)  # -> Result, PartialResults
pshift_3 = ShiftPaths(Data=ma.Result, Offset=-1)
dispatch_2 = Dispatch(List=aligned_curves_2, DispatchPattern=pshift_3)  # -> ListA, ListB
curves_outside = Curve(dispatch_2.ListB)
curves_inside = Curve(dispatch_2.ListA)

# ----
curves_for_offset_outwards = Curve(curves_outside)
curves_for_offset_inwards = Curve(curves_inside)
offset_2 = Offset(Curve=curves_for_offset_outwards, Distance=neg, Plane=operation_plane_2, Corners=2)
offset_3 = Offset(Curve=curves_for_offset_inwards, Distance=compensated_tool_radius, Plane=operation_plane_2, Corners=2)
pshift_4 = ShiftPaths(Data=offset_3, Offset=-1)
pshift_5 = ShiftPaths(Data=offset_2, Offset=-1)
flip_4 = FlipCurve(Curve=pshift_4)  # -> Curve, Flag
outside_cutout_curves = Curve(pshift_5)
inside_cutout_curves = Curve(flip_4.Curve)

outside_cutout_curves_2 = Curve(outside_cutout_curves)
inside_cutout_curves_2 = Curve(inside_cutout_curves)
inside_outline_curves = Curve(inside_cutout_curves_2)
flatten_2 = FlattenTree(Tree=outside_cutout_curves_2, Path="{0}")
end_3 = EndPoints(Curve=inside_outline_curves)  # -> Start, End
incurves = PointInCurves(Point=end_3.Start, Curves=flatten_2)  # -> Relationship, Index, Point
addition_2 = Addition(A=incurves.Index, B="1")
ins = InsertItems(List=flatten_2, Item=inside_outline_curves, Indices=incurves.Index, Wrap=True)

# ---- group: Flip curves for climb direction
sorted_inside_and_outside_curves = Curve(ins)
use_climb_direction_4 = Panel(use_climb_direction_3)
flip_5 = FlipCurve(Curve=sorted_inside_and_outside_curves)  # -> Curve, Flag
filter_2 = StreamFilter(Gate=use_climb_direction_4, Stream0=flip_5.Curve, Stream1=sorted_inside_and_outside_curves)
sorted_inside_and_outside_curves_2 = Curve(filter_2)

# ---- group: Move cutout toolpaths to cut depths
sorted_inside_and_outside_curves_3 = Curve(sorted_inside_and_outside_curves_2)
pass_depth_4 = Panel(pass_depth_3)
cut_depth_cutout = Panel(cut_depth_3)
division = Division(A=cut_depth_cutout, B=pass_depth_4)
graft_3 = GraftTree(Tree=sorted_inside_and_outside_curves_3, IncludeEmptyLists=True, IncludeNullItems=True)
round_3 = Round(Number=division)  # -> Nearest, Floor, Ceiling
division_2 = Division(A=cut_depth_cutout, B=round_3.Ceiling)
actual_pass_depth = Panel(division_2)
series = Series(Start=actual_pass_depth, Step=actual_pass_depth, Count=round_3.Ceiling)
neg_2 = Negative(Value=series)
Z = UnitZ(Factor=neg_2)
simplify = SimplifyTree(Tree=graft_3, Front=False)
simplify_2 = SimplifyTree(Tree=Z, Front=False)
move = Move(Geometry=simplify, Motion=simplify_2)  # -> Geometry, Transform
flatten_3 = FlattenTree(Tree=move.Geometry, Path="{0}")

# ----
cutout_toolpaths = Curve(flatten_3)
cutout_toolpaths_2 = ClusterOutput(cutout_toolpaths)

# ==== cluster FeedrateCalculatorForArcs: Compensates for the speed difference between the center of a bit and its outer edge when cutting in circular paths. Calculates a feedrate matching chipload and rpm. This speed difference is similar to how the wheels on a car spin at different speeds during a turn. Can take chip thining into account. Input the maxium stepover the tool will encounter. Normal pockets and profiles will have a full stepover of 1, while the Arc Based High speed milling givve constant low stepovers as speciified.
ramp_feed_reduction_factor = ClusterInput()
ramp_feed_reduction_factor_2 = Number(ramp_feed_reduction_factor)
arc_diameter_factor = ClusterInput()
milling_bit_diameter = ClusterInput()
number_of_flutes = ClusterInput()
max_stepover = ClusterInput()
spindle_rpm = ClusterInput()
chip_load = ClusterInput()
number_of_flutes_2 = Number(number_of_flutes)
milling_bit_diameter_2 = Number(milling_bit_diameter)
spindle_rpm_2 = Number(spindle_rpm)
max_stepover_2 = Number(max_stepover)
chip_load_2 = Number(chip_load)
arc_diameter_factor_2 = Number(arc_diameter_factor)
number_of_flutes_3 = Panel(number_of_flutes_2)
chip_load_3 = Panel(chip_load_2)
max_stepover_3 = Panel(max_stepover_2)
ramp_feedrate_reduction_factor = Panel(ramp_feed_reduction_factor_2)
arc_diameter_factor_3 = Panel(arc_diameter_factor_2)
spindle_rpm_3 = Panel(spindle_rpm_2)
milling_bit_diameter_3 = Panel(milling_bit_diameter_2)

multiplication = Multiplication(A=milling_bit_diameter_3, B=arc_diameter_factor_3)
subtraction = Subtraction(A=multiplication, B=milling_bit_diameter_3)
arc_diameter_at_bit_edge = Panel(multiplication)
arc_diameter_at_bit_center = Panel(subtraction)
division = Division(A=arc_diameter_at_bit_center, B=arc_diameter_at_bit_edge)
arc_feedrate_reduction_factor = Panel(division)

# ---- group: Calulate chip thining
larger = LargerThan(FirstNumber=max_stepover_3, SecondNumber="0.5")  # -> LargerThan, OrEqualTo
filter = StreamFilter(Gate=larger.LargerThan, Stream0=max_stepover_3, Stream1="0.5")
multiplication_2 = Multiplication(A=milling_bit_diameter_3, B=filter)
multiplication_3 = Multiplication(A="0.5", B=milling_bit_diameter_3)
subtraction_2 = Subtraction(A=multiplication_3, B=multiplication_2)
neg = Negative(Value=subtraction_2)
pt = ConstructPoint(XCoordinate=milling_bit_diameter_3, YCoordinate=neg, ZCoordinate=0)
pt_2 = ConstructPoint(XCoordinate=0, YCoordinate=neg, ZCoordinate=0)
xy = XYPlane(Origin=Point(0, 0, 0))
ln = Line(StartPoint=pt_2, EndPoint=pt)
cir = Circle(Plane=xy, Radius=multiplication_3)
ccx = CurveCurve(CurveA=cir, CurveB=ln)  # -> Points, ParamsA, ParamsB
pt_3 = ConstructPoint(XCoordinate=0, YCoordinate=0, ZCoordinate=0)
chip_load_4 = Panel(chip_load_3)
vec2pt = Vector2Pt(PointA=pt_3, PointB=ccx.Points, Unitize=False)  # -> Vector, Length
amp = Amplitude(Vector=vec2pt.Vector, Amplitude=chip_load_4)
move = Move(Geometry=ccx.Points, Motion=amp)  # -> Geometry, Transform
pdecon = Deconstruct(Point=move.Geometry)  # -> XComponent, YComponent, ZComponent
pt_4 = ConstructPoint(XCoordinate=0, YCoordinate=pdecon.YComponent, ZCoordinate=pdecon.ZComponent)
ln_2 = Line(StartPoint=move.Geometry, EndPoint=pt_4)
ccx_2 = CurveCurve(CurveA=cir, CurveB=ln_2)  # -> Points, ParamsA, ParamsB
dist = Distance(PointA=flatten(ccx_2.Points), PointB=flatten(move.Geometry))
move_distance_needed_for_chipload = Panel(dist)
chip_load_5 = Panel(chip_load_3)
division_2 = Division(A=move_distance_needed_for_chipload, B=chip_load_5)

# ---- group: Calculate feedrate
multiplication_4 = Multiplication(A=spindle_rpm_3, B=number_of_flutes_3)
multiplication_5 = Multiplication(A=multiplication_4, B=chip_load_3)
division_3 = Division(A=multiplication_5, B="60")
feedrate = Panel(division_3)

# ----
multiplication_6 = Multiplication(A=feedrate, B=arc_feedrate_reduction_factor)
arc_compensated_feedrate = Panel(multiplication_6)

# ---- group: Safatey in case of too extreme values
backup_feedrate_multiplaication_factor = Panel("2")
feedrate_multiplaication_factor = Panel(division_2)
null = NullItem(Item=ccx_2.Points)  # -> NullFlags, InvalidFlags, Description
filter_2 = StreamFilter(Gate=null.NullFlags, Stream0=feedrate_multiplaication_factor, Stream1=backup_feedrate_multiplaication_factor)

# ---- group: Visualize chip size
X = UnitX(Factor=dist)
ln_3 = Line(StartPoint=ccx.Points, EndPoint=pt)
ln_4 = Line(StartPoint=ccx.Points, EndPoint=move.Geometry)
move_2 = Move(Geometry=cir, Motion=X)  # -> Geometry, Transform
chip_load_cross_section = Curve(ln_4)
new_bit_position = Curve(move_2.Geometry)
old_bit_position = Curve(cir)
material_edge = Curve(ln_3)

# ----
panel = Panel("Stepover to small or chipload to high. Unable to compute optimal feedrate multiplication factor.")
filter_3 = StreamFilter(Gate=null.NullFlags, Stream0="All good", Stream1=panel)
ramp_feedrate_reduction_factor_2 = Panel(ramp_feedrate_reduction_factor)
feedrate_multiplication_factor = Panel(filter_2)
feedrate_2 = Panel(arc_compensated_feedrate)
feedback = Panel(filter_3)
multiplication_7 = Multiplication(A=feedrate_2, B=feedrate_multiplication_factor)
multiplication_8 = Multiplication(A=multiplication_7, B=ramp_feedrate_reduction_factor_2)
feedback_2 = Text(feedback)
int = Integer(multiplication_7)
int_2 = Integer(multiplication_8)
feedback_3 = ClusterOutput(feedback_2)
arc_compensated_feedrate_2 = Number(int)
ramp_feedrate = Number(int_2)
ramp_feedrate_2 = ClusterOutput(ramp_feedrate)
arc_compensated_feedrate_3 = ClusterOutput(arc_compensated_feedrate_2)

# ==== cluster DivideCurveEvenLenght: Calculates approximate curve length for even division
crv = ClusterInput()
crv_2 = Curve(crv)
B = ClusterInput()
len = Length(Curve=crv_2)
division = Division(A=len, B=B)
int = Integer(division)
divide = DivideCurve(Curve=crv_2, Count=int, Kinks=False)  # -> Points, Tangents, Parameters
P = ClusterOutput(divide.Points)

# ==== cluster SafeOffsetCurve: Always makes closed non intersecting curves from offset. Can handle extreme offset values.
curves_to_offset = ClusterInput()
offset_amount = ClusterInput()
curves_to_offset_2 = Curve(curves_to_offset)
offset_amount_2 = Number(offset_amount)
multiplication = Multiplication(A=offset_amount_2, B=Slider(0.05, range=0..1))
multiplication_2 = Multiplication(A=offset_amount_2, B=Slider(0.1, range=0..1))
curve_reduction_tolerance = Number(multiplication)
offset_fix_sample_distance = Number(multiplication_2)
topoly = CurveToPolyline(Curve=curves_to_offset_2, ToleranceDistance=curve_reduction_tolerance, ToleranceAngle=0)  # -> Polyline, Segments
neg = Negative(Value=offset_amount_2)
graft = GraftTree(Tree=topoly.Polyline, IncludeEmptyLists=True, IncludeNullItems=True)
num = Number([offset_amount_2, neg])
offset_l = OffsetLoose(Curve=graft, Distance=num)
crv = Curve(offset_l)
cp = ControlPoints(Curve=crv)  # -> Points, Weights, Knots
hull = ConvexHull(Points=cp.Points, Plane=PlaneXY(0, 0, 0))  # -> Hull, HullZ, Indices
number_slider = Slider(500, range=0..10000)
len = Length(Curve=hull.Hull)
division = Division(A=len, B=offset_fix_sample_distance)
int = Integer(division)
larger = LargerThan(FirstNumber=int, SecondNumber=number_slider)  # -> LargerThan, OrEqualTo
filter = StreamFilter(Gate=larger.LargerThan, Stream0=int, Stream1=number_slider)
pframes = PerpFrames(Curve=hull.Hull, Count=filter, Align=True)  # -> Frames, Parameters
deplane = DeconstructPlane(Plane=pframes.Frames)  # -> Origin, XAxis, YAxis, ZAxis
pcx = CurvePlane(Curve=graft(crv), Plane=pframes.Frames)  # -> Points, ParamsC, ParamsP
dist = Distance(PointA=graft(deplane.Origin), PointB=pcx.Points)
sort = SortList(Keys=dist, ValuesA=pcx.Points)  # -> Keys, ValuesA
item = ListItem(List=sort.ValuesA, Index=0, Wrap=True)
pshift = ShiftPaths(Data=item, Offset=-1)
pline = PolyLine(Vertices=pshift, Closed=True)
pshift_2 = ShiftPaths(Data=pline, Offset=2)
flip = FlipMatrix(Data=pshift_2)
len_2 = Length(Curve=flip)
sort_2 = SortList(Keys=len_2, ValuesA=flip)  # -> Keys, ValuesA
rev = ReverseList(List=sort_2.ValuesA)
curve_reduction_tolerance_2 = Number(curve_reduction_tolerance)
item_2 = ListItem(List=sort_2.ValuesA, Index=0, Wrap=True)
item_3 = ListItem(List=rev, Index=0, Wrap=True)
redpline = Reduce(Polyline=item_3, Tolerance=curve_reduction_tolerance_2)  # -> Polyline, Reduction
redpline_2 = Reduce(Polyline=item_2, Tolerance=curve_reduction_tolerance_2)  # -> Polyline, Reduction
flip_2 = FlipCurve(Curve=redpline_2.Polyline)  # -> Curve, Flag
error_corrected_curves_outside = Curve(redpline.Polyline)
error_corrected_curves_inside = Curve(flip_2.Curve)
error_corrected_curves_outside_2 = ClusterOutput(error_corrected_curves_outside)
error_corrected_curves_inside_2 = ClusterOutput(error_corrected_curves_inside)

# ==== cluster ConnectOverlappingToolpaths
polyline_toolpaths = ClusterInput()
polyline_toolpaths_2 = Curve(polyline_toolpaths)
clean = CleanTree(RemoveNulls=True, RemoveInvalid=True, RemoveEmpty=False, Tree=polyline_toolpaths_2)
crv = Curve(clean)
cp = ControlPoints(Curve=crv)  # -> Points, Weights, Knots
cp_2 = ControlPoints(Curve=crv)  # -> Points, Weights, Knots
end = EndPoints(Curve=crv)  # -> Start, End
lng = ListLength(List=cp.Points)
pshift = ShiftPaths(Data=cp_2.Points, Offset=-1)
shift = ShiftList(List=end.Start, Shift=1, Wrap=False)
shift_2 = ShiftList(List=end.End, Shift=-1, Wrap=False)
pshift_2 = ShiftPaths(Data=lng, Offset=-1)
pline = PolyLine(Vertices=pshift, Closed=False)
pdecon = Deconstruct(Point=shift)  # -> XComponent, YComponent, ZComponent
pdecon_2 = Deconstruct(Point=shift_2)  # -> XComponent, YComponent, ZComponent
panel = Panel("100")
ma = MassAddition(Input=pshift_2)  # -> Result, PartialResults
cp_3 = ControlPoints(Curve=pline)  # -> Points, Weights, Knots
pshift_3 = ShiftPaths(Data=cp_2.Points, Offset=-1)
flatten = FlattenTree(Tree=ma.PartialResults, Path="{0}")

expression = Expression(x=pdecon_2.YComponent, Expression="Round(x,2)")
expression_2 = Expression(x=pdecon_2.XComponent, Expression="Round(x,2)")

expression_3 = Expression(x=pdecon.YComponent, Expression="Round(x,2)")
expression_4 = Expression(x=pdecon.XComponent, Expression="Round(x,2)")

lng_2 = ListLength(List=pshift_3)
lng_3 = ListLength(List=cp_3.Points)
smaller = SmallerThan(FirstNumber=lng_3, SecondNumber=lng_2)  # -> SmallerThan, OrEqualTo
unreialiable_result_boolean = Panel(smaller.SmallerThan)
equals = Equality(FirstNumber=expression_4, SecondNumber=expression_2)  # -> Equality, Inequality
equals_2 = Equality(FirstNumber=expression_3, SecondNumber=expression)  # -> Equality, Inequality
and = GateAnd(A=equals.Equality, B=equals_2.Equality)

# ---- group: Line connection viz for troubleshooting
dispatch = Dispatch(List=shift_2, DispatchPattern=and)  # -> ListA, ListB
dispatch_2 = Dispatch(List=shift, DispatchPattern=and)  # -> ListA, ListB
ln = Line(StartPoint=dispatch_2.ListA, EndPoint=dispatch.ListA)  # disabled

# ----
rev = ReverseList(List=flatten)
rev_2 = ReverseList(List=flatten)
cull_i = CullIndex(List=rev, Indices="0", Wrap=True)
item = ListItem(List=rev, Index="0", Wrap=True)
cull_i_2 = CullIndex(List=rev_2, Indices="0", Wrap=True)
pshift_4 = ShiftPaths(Data=and, Offset=-1)
pshift_5 = ShiftPaths(Data=cull_i, Offset=-1)
pshift_6 = ShiftPaths(Data=cull_i_2, Offset=-1)
rev_3 = ReverseList(List=pshift_5)
lng_4 = ListLength(List=pshift_4)
rev_4 = ReverseList(List=pshift_6)
ins = InsertItems(List=pshift_4, Item=Toggle(False), Indices="0", Wrap=True)
ins_2 = InsertItems(List=pshift_4, Item=Toggle(False), Indices=lng_4, Wrap=True)
subtraction = Subtraction(A=rev_3, B="1")
flatten_2 = FlattenTree(Tree=pshift, Path="{0}")
pshift_7 = ShiftPaths(Data=ins, Offset=-1)
merge = Merge(Data1=subtraction, Data2=item)
merge_2 = Merge(Data1="0", Data2=rev_4)
pshift_8 = ShiftPaths(Data=ins_2, Offset=-1)
dispatch_3 = Dispatch(List=merge_2, DispatchPattern=pshift_7)  # -> ListA, ListB
dispatch_4 = Dispatch(List=merge, DispatchPattern=pshift_8)  # -> ListA, ListB
dom = ConstructDomain(DomainStart=dispatch_3.ListB, DomainEnd=dispatch_4.ListB)
subset = SubList(List=flatten_2, Domain=dom, Wrap=False)  # -> List, Index
pline_2 = PolyLine(Vertices=subset.List, Closed=False)
unreialiable_result_boolean_2 = Panel(unreialiable_result_boolean)  # disabled
flatten_3 = FlattenTree(Tree=pline_2, Path="{0}")
pshift_9 = ShiftPaths(Data=pline_2, Offset=-2)  # disabled
filter = StreamFilter(Gate=unreialiable_result_boolean_2, Stream0=pshift_9)  # disabled
item_2 = ListItem(List=flatten_3, Index=0, Wrap=True)
polyline_toolpaths_3 = Curve(polyline_toolpaths_2)
null = NullItem(Item=item_2)  # -> NullFlags, InvalidFlags, Description
filter_2 = StreamFilter(Gate=null.NullFlags, Stream0=flatten_3, Stream1=polyline_toolpaths_3)
z_connected_polyline_toolpaths = Curve(filter_2)
z_connected_polyline_toolpaths_2 = ClusterOutput(z_connected_polyline_toolpaths)

# ==== cluster TabToolpaths
polyline_toolpaths = ClusterInput()
milling_bit_diamter = ClusterInput()
tab_breps = ClusterInput()
tab_cleanup_overshoot_lenght = Panel("1")
tab_breps_2 = Brep(tab_breps)
polyline_toolpaths_2 = Curve(polyline_toolpaths)
milling_bit_diamter_2 = Number(milling_bit_diamter)
flatten = FlattenTree(Tree=tab_breps_2, Path="{0}")
clean = CleanTree(RemoveNulls=True, RemoveInvalid=True, RemoveEmpty=False, Tree=polyline_toolpaths_2)
clean_2 = CleanTree(RemoveNulls=True, RemoveInvalid=True, RemoveEmpty=False, Tree=flatten)
bbox = BoundingBox(Content=clean, Plane=PlaneXY(0, 0, 0), UnionBox=True)  # -> Box, Box_2

# ---- group: Check if any tab volumes break material surface
bbox_2 = BoundingBox(Content=clean_2, Plane=PlaneXY(0, 0, 0))  # -> Box, Box_2
debrep = DeconstructBrep(Brep=bbox_2.Box)  # -> Faces, Edges, Vertices
item = ListItem(List=debrep.Vertices, Index="4", Wrap=True)
pdecon = Deconstruct(Point=item)  # -> XComponent, YComponent, ZComponent
sort = SortList(Keys=flatten(pdecon.ZComponent))  # -> Keys, ValuesA
rev = ReverseList(List=sort.Keys)
item_2 = ListItem(List=rev, Index=0, Wrap=True)
larger = LargerThan(FirstNumber=item_2, SecondNumber="0")  # -> LargerThan, OrEqualTo
make_severed_toolapths = Panel(larger.LargerThan)

# ---- group: Check for input tab breps
item_3 = ListItem(List=clean_2, Index=0, Wrap=True)
null = NullItem(Item=item_3)  # -> NullFlags, InvalidFlags, Description
no_tab_brep_input_boolean = Panel(null.NullFlags)

# ----
debrep_2 = DeconstructBrep(Brep=bbox.Box)  # -> Faces, Edges, Vertices
item_4 = ListItem(List=debrep_2.Vertices, Index="0", Wrap=True)
pdecon_2 = Deconstruct(Point=flatten(item_4))  # -> XComponent, YComponent, ZComponent
subtraction = Subtraction(A=pdecon_2.ZComponent, B="0.1")
lowes_toolpath_point = Panel(subtraction)
polyline_toolpaths_3 = Curve(clean)
tab_breps_3 = Brep(clean_2)

# ---- group: Bit diameter compensate tab breps (for tab cleanup)
tab_cleanup_overshoot_lenght_2 = Panel(tab_cleanup_overshoot_lenght)
milling_bit_diamter_3 = Number(milling_bit_diamter_2)
tab_breps_4 = Brep(tab_breps_3)
multiplication = Multiplication(A=milling_bit_diamter_3, B="0.5")
debrep_3 = DeconstructBrep(Brep=tab_breps_4)  # -> Faces, Edges, Vertices
bbox_3 = BoundingBox(Content=tab_breps_4, Plane=PlaneXY(0, 0, 0))  # -> Box, Box_2
addition = Addition(A=multiplication, B=tab_cleanup_overshoot_lenght_2)
debrep_4 = DeconstructBrep(Brep=bbox_3.Box)  # -> Faces, Edges, Vertices
planar = IsPlanar(Surface=debrep_3.Faces, Interior=True)  # -> Planar, Plane
deplane = DeconstructPlane(Plane=planar.Plane)  # -> Origin, XAxis, YAxis, ZAxis
lowes_toolpath_point_2 = Panel(lowes_toolpath_point)
pdecon_3 = Deconstruct(Point=deplane.Origin)  # -> XComponent, YComponent, ZComponent
item_5 = ListItem(List=debrep_4.Vertices, Index=4, Wrap=True)
sort_2 = SortList(Keys=pdecon_3.ZComponent, ValuesA=debrep_3.Faces)  # -> Keys, ValuesA
pt = ConstructPoint(XCoordinate=0, YCoordinate=0, ZCoordinate=lowes_toolpath_point_2)
item_6 = ListItem(List=sort_2.ValuesA, Index=0, Wrap=True)
xy = XYPlane(Origin=pt)
edges = BrepEdges(Brep=item_6)  # -> Naked, Interior, NonManifold
cp = PlaneClosestPoint(Point=item_5, Plane=xy)  # -> Point, UVPoint, Distance
pshift = ShiftPaths(Data=edges.Naked, Offset=-1)
join = JoinCurves(Curves=pshift, Preserve=False)
Z = UnitZ(Factor=cp.Distance)
simplify = SimplifyTree(Tree=join, Front=False)
simplify_2 = SimplifyTree(Tree=Z, Front=False)
milling_bit_radius_overshoot = Panel(addition)
project = Project(Geometry=simplify, Plane=xy)  # -> Geometry, Transform
cir = Circle(Plane=PlaneXY(0, 0, 0), Radius=1)
flip = FlipCurve(Curve=project.Geometry, Guide=cir)  # -> Curve, Flag
offset = Offset(Curve=flip.Curve, Distance=milling_bit_radius_overshoot, Plane=PlaneXY(0, 0, 0), Corners=1)
extr = Extrude(Base=offset, Direction=simplify_2)
cap = CapHoles(Brep=extr)
bit_diameter_compensated_tab_breps = Brep(flatten(cap))

# ---- group: Bit diameter compensate tab breps
milling_bit_diamter_4 = Number(milling_bit_diamter_2)
tab_breps_5 = Brep(tab_breps_3)
multiplication_2 = Multiplication(A=milling_bit_diamter_4, B="0.5")
debrep_5 = DeconstructBrep(Brep=tab_breps_5)  # -> Faces, Edges, Vertices
bbox_4 = BoundingBox(Content=tab_breps_5, Plane=PlaneXY(0, 0, 0))  # -> Box, Box_2
milling_bit_radius = Panel(multiplication_2)
debrep_6 = DeconstructBrep(Brep=bbox_4.Box)  # -> Faces, Edges, Vertices
planar_2 = IsPlanar(Surface=debrep_5.Faces, Interior=True)  # -> Planar, Plane
deplane_2 = DeconstructPlane(Plane=planar_2.Plane)  # -> Origin, XAxis, YAxis, ZAxis
lowes_toolpath_point_3 = Panel(lowes_toolpath_point)
item_7 = ListItem(List=debrep_6.Vertices, Index=4, Wrap=True)
pdecon_4 = Deconstruct(Point=deplane_2.Origin)  # -> XComponent, YComponent, ZComponent
sort_3 = SortList(Keys=pdecon_4.ZComponent, ValuesA=debrep_5.Faces)  # -> Keys, ValuesA
pt_2 = ConstructPoint(XCoordinate=0, YCoordinate=0, ZCoordinate=lowes_toolpath_point_3)
item_8 = ListItem(List=sort_3.ValuesA, Index=0, Wrap=True)
xy_2 = XYPlane(Origin=pt_2)
edges_2 = BrepEdges(Brep=item_8)  # -> Naked, Interior, NonManifold
cp_2 = PlaneClosestPoint(Point=item_7, Plane=xy_2)  # -> Point, UVPoint, Distance
pshift_2 = ShiftPaths(Data=edges_2.Naked, Offset=-1)
join_2 = JoinCurves(Curves=pshift_2, Preserve=False)
Z_2 = UnitZ(Factor=cp_2.Distance)
simplify_3 = SimplifyTree(Tree=join_2, Front=False)
# FIX BUG: Tabs equal to bit diamter makes offset and select error
simplify_4 = SimplifyTree(Tree=Z_2, Front=False)
milling_bit_radius_2 = Panel(milling_bit_radius)
project_2 = Project(Geometry=simplify_3, Plane=xy_2)  # -> Geometry, Transform
cir_2 = Circle(Plane=PlaneXY(0, 0, 0), Radius=1)
flip_2 = FlipCurve(Curve=project_2.Geometry, Guide=cir_2)  # -> Curve, Flag
offset_2 = Offset(Curve=flip_2.Curve, Distance=milling_bit_radius_2, Plane=PlaneXY(0, 0, 0), Corners=1)
extr_2 = Extrude(Base=offset_2, Direction=simplify_4)
cap_2 = CapHoles(Brep=extr_2)
bit_diameter_compensated_tab_breps_2 = Brep(flatten(cap_2))

# ---- group: Check for invalid boxes
flatten_2 = FlattenTree(Tree=bit_diameter_compensated_tab_breps_2, Path="{0}")
item_9 = ListItem(List=flatten_2, Index=0, Wrap=True)
null_2 = NullItem(Item=item_9)  # -> NullFlags, InvalidFlags, Description
filter = StreamFilter(Gate=null_2.NullFlags, Stream0=bit_diameter_compensated_tab_breps_2, Stream1=tab_breps_3)

flatten_3 = FlattenTree(Tree=bit_diameter_compensated_tab_breps, Path="{0}")
item_10 = ListItem(List=flatten_3, Index=0, Wrap=True)
null_3 = NullItem(Item=item_10)  # -> NullFlags, InvalidFlags, Description
filter_2 = StreamFilter(Gate=null_3.NullFlags, Stream0=bit_diameter_compensated_tab_breps, Stream1=tab_breps_3)

# ----
mesh = MeshBrep(
    Brep=filter_2,
    Settings={GridMaxCount=0, GridMinCount=16, JaggedSeams=False, MaxEdgeLength=0, MinEdgeLength=0.0001, MinTolerance=0, Refine=True, RefineAngle=0, RelativeTolerance=0.65, SimplePlanes=True, Tolerance=0})
mjoin = MeshJoin(Meshes=mesh)
tab_cleanup_volume_mesh = Mesh(mjoin)

make_severed_toolapths_2 = Panel(make_severed_toolapths)
no_tab_brep_input_boolean_2 = Panel(no_tab_brep_input_boolean)
polyline_toolpaths_4 = Curve(clean)

mesh_2 = MeshBrep(
    Brep=filter,
    Settings={GridMaxCount=0, GridMinCount=16, JaggedSeams=False, MaxEdgeLength=0, MinEdgeLength=0.0001, MinTolerance=0, Refine=True, RefineAngle=0, RelativeTolerance=0.65, SimplePlanes=True, Tolerance=0})
mjoin_2 = MeshJoin(Meshes=mesh_2)
tab_volume_mesh = Mesh(mjoin_2)
colom = CollisionOneMany(Collider=tab_volume_mesh, Obstacles=graft(polyline_toolpaths_3))  # -> Collision, Index
pshift_3 = ShiftPaths(Data=colom.Collision, Offset=-1)

tab_or_no_tab_booleans = Integer(pshift_3)

dispatch = Dispatch(List=polyline_toolpaths_3, DispatchPattern=tab_or_no_tab_booleans)  # -> ListA, ListB
toolpaths_without_tabs = Curve(dispatch.ListB)
toolpaths_for_tabbing = Curve(dispatch.ListA)

bbox_5 = BoundingBox(Content=mesh_2, Plane=PlaneXY(0, 0, 0))  # -> Box, Box_2
volume = Volume(Geometry=bbox_5.Box)  # -> Volume, Centroid
xy_3 = XYPlane(Origin=volume.Centroid)
scale_nu = ScaleNU(Geometry=bbox_5.Box, Plane=xy_3, ScaleX="1.01", ScaleY="1.01", ScaleZ=1)  # -> Geometry, Transform
mjoin_3 = MeshJoin(Meshes=scale_nu.Geometry)
tab_control_point_intersect_mesh = Mesh(mjoin_3)

# ---- group: Filter toolpaths entirely inside tabs
toolpaths_without_tabs_2 = Curve(dispatch.ListB)
tab_breps_6 = Brep(filter)
shapein = ShapeInBrep(Brep=tab_breps_6, Shape=toolpaths_without_tabs_2)
lng = ListLength(List=toolpaths_without_tabs_2)
bool = Boolean(shapein)
series = Series(Start=0, Step=1, Count=lng)
dispatch_2 = Dispatch(List=series, DispatchPattern=bool)  # -> ListA, ListB
replace = ReplaceItems(List=toolpaths_without_tabs_2, Indices=dispatch_2.ListB, Wrap=False)
toolpaths_without_tabs_3 = Curve(replace)

# ---- group: Test closing
cls = Closed(Curve=toolpaths_for_tabbing)  # -> Closed, Periodic
graft = GraftTree(Tree=cls.Closed, IncludeEmptyLists=True, IncludeNullItems=True)

# ----
tab_or_no_tab_booleans_2 = Integer(tab_or_no_tab_booleans)
toolpaths_without_tabs_4 = Curve(replace)

# ---- group: Cut toolpaths with extended tab volumes for tab cleanup
tab_cleanup_volume_mesh_2 = Mesh(tab_cleanup_volume_mesh)
mcx = MeshCurve(Mesh=tab_cleanup_volume_mesh_2, Curve=toolpaths_for_tabbing)  # -> Points, Faces

# ----
cullpt = CullDuplicates(Points=mcx.Points, Tolerance="0.01", CullMode=3)  # -> Points, Indices, Valence
pshift_4 = ShiftPaths(Data=cullpt.Points, Offset=-1)

# ---- group: Cut toolpaths with extended tab volumes for tab cleanup (continued)
crv_cp = CurveClosestPoint(Point=pshift_4, Curve=graft(toolpaths_for_tabbing))  # -> Point, Parameter, Distance
shatter = Shatter(Curve=graft(toolpaths_for_tabbing), Parameters=crv_cp.Parameter)
curvepoint = PointOnCurve(shatter, parameter=0.5)
minc = MeshInclusion(Mesh=tab_cleanup_volume_mesh_2, Point=curvepoint, Strict=False)
dispatch_3 = Dispatch(List=shatter, DispatchPattern=minc)  # -> ListA, ListB
tab_cleanup_toolpaths = Curve(dispatch_3.ListA)
toolpath_outside_tabs = Curve(dispatch_3.ListB)

# ----
tab_cleanup_toolpaths_2 = Curve(tab_cleanup_toolpaths)
flatten_4 = FlattenTree(Tree=tab_cleanup_toolpaths_2, Path="{0}")
tab_cleanup_toolpaths_3 = Curve(flatten_4)
tab_cleanup_toolpaths_4 = ClusterOutput(tab_cleanup_toolpaths_3)

# ---- group: Cut toolpaths with tab volumes
tab_volume_mesh_2 = Mesh(tab_volume_mesh)
mcx_2 = MeshCurve(Mesh=tab_volume_mesh_2, Curve=toolpaths_for_tabbing)  # -> Points, Faces

# ----
cullpt_2 = CullDuplicates(Points=mcx_2.Points, Tolerance="0.01", CullMode=3)  # -> Points, Indices, Valence
pshift_5 = ShiftPaths(Data=cullpt_2.Points, Offset=-1)

# ---- group: Cut toolpaths with tab volumes (continued)
crv_cp_2 = CurveClosestPoint(Point=pshift_5, Curve=graft(toolpaths_for_tabbing))  # -> Point, Parameter, Distance
shatter_2 = Shatter(Curve=graft(toolpaths_for_tabbing), Parameters=crv_cp_2.Parameter)
curvepoint_2 = PointOnCurve(shatter_2, parameter=0.5)
minc_2 = MeshInclusion(Mesh=tab_volume_mesh_2, Point=curvepoint_2, Strict=False)
dispatch_4 = Dispatch(List=shatter_2, DispatchPattern=minc_2)  # -> ListA, ListB
toolpaths_inside_tabs = Curve(dispatch_4.ListA)
toolpath_outside_tabs_2 = Curve(dispatch_4.ListB)

# ----
cp_3 = ControlPoints(Curve=toolpaths_inside_tabs)  # -> Points, Weights, Knots
Z_3 = UnitZ(Factor=1)
meshray = MeshRay(Mesh=tab_control_point_intersect_mesh, Point=cp_3.Points, Direction=Z_3)  # -> Point, Hit
pline = PolyLine(Vertices=meshray.Point, Closed=False)
pshift_6 = ShiftPaths(Data=pline, Offset=-1)

weave = Weave(Pattern=minc_2, Stream0=toolpath_outside_tabs_2, Stream1=pshift_6, NullGaps=False)
cp_4 = ControlPoints(Curve=weave)  # -> Points, Weights, Knots
pshift_7 = ShiftPaths(Data=cp_4.Points, Offset=-1)
pline_2 = PolyLine(Vertices=pshift_7, Closed=graft)
pshift_8 = ShiftPaths(Data=pline_2, Offset="-2")
toolpath_outside_tabs_3 = Curve(toolpath_outside_tabs_2)
group = Group(Objects=toolpath_outside_tabs_3)

# ---- group: Check
flatten_5 = FlattenTree(Tree=pline_2, Path="{0}")
flatten_6 = FlattenTree(Tree=group, Path="{0}")

# ----
toolpaths_with_tabs = Curve(flatten_5)
pshift_9 = ShiftPaths(Data=group, Offset="-2")
filter_3 = StreamFilter(Gate=make_severed_toolapths_2, Stream0=toolpaths_with_tabs, Stream1=flatten_6)
tabbed_toolpaths = Geometry(filter_3)
weave_2 = Weave(Pattern=tab_or_no_tab_booleans_2, Stream0=toolpaths_without_tabs_4, Stream1=tabbed_toolpaths, NullGaps=False)
ungroup = Ungroup(Group=weave_2)
pshift_10 = ShiftPaths(Data=ungroup, Offset=-1)

polyline_toolpaths_5 = Curve(clean)
end = EndPoints(Curve=pshift_10)  # -> Start, End

end_2 = EndPoints(Curve=polyline_toolpaths_5)  # -> Start, End
crv_cp_3 = CurveClosestPoint(Point=end_2.End, Curve=pshift_10)  # -> Point, Parameter, Distance
pt_3 = Point(end_2.End)

dist = Distance(PointA=end.End, PointB=pt_3)
smaller = SmallerThan(FirstNumber=dist, SecondNumber="0.01")  # -> SmallerThan, OrEqualTo
dispatch_5 = Dispatch(List=crv_cp_3.Parameter, DispatchPattern=smaller.SmallerThan)  # -> ListA, ListB
dispatch_6 = Dispatch(List=pshift_10, DispatchPattern=smaller.SmallerThan)  # -> ListA, ListB
seam = Seam(Curve=dispatch_6.ListB, Seam=dispatch_5.ListB)
weave_3 = Weave(Pattern=smaller.SmallerThan, Stream0=seam, Stream1=dispatch_6.ListA, NullGaps=False)

filter_4 = StreamFilter(Gate=no_tab_brep_input_boolean_2, Stream0=weave_3, Stream1=polyline_toolpaths_4)
clean_3 = CleanTree(RemoveNulls=True, RemoveInvalid=False, RemoveEmpty=False, Tree=filter_4)
flatten_7 = FlattenTree(Tree=clean_3, Path="{0}")
tabbed_toolpaths_2 = Curve(flatten_7)
tabbed_toolpaths_3 = ClusterOutput(tabbed_toolpaths_2)

# ==== cluster RampToolpathPlunges
toolpaths_to_ramp = ClusterInput()
ramp_angle = ClusterInput()
toolpaths_to_ramp_2 = Curve(toolpaths_to_ramp)
ramp_angle_2 = Number(ramp_angle)
end = EndPoints(Curve=toolpaths_to_ramp_2)  # -> Start, End
pdecon = Deconstruct(Point=end.Start)  # -> XComponent, YComponent, ZComponent
abs = Absolute(Value=pdecon.ZComponent)
dom = ConstructDomain(DomainStart="1", DomainEnd="89")
rad = Radians(Degrees=ramp_angle_2)
rtrig = RightTrigonometry(Alpha=rad, QLength=abs)  # -> Alpha, Beta, PLength, QLength, RLength
len = Length(Curve=toolpaths_to_ramp_2)
smaller = SmallerThan(FirstNumber=len, SecondNumber=rtrig.PLength)  # -> SmallerThan, OrEqualTo
dispatch = Dispatch(List=len, DispatchPattern=smaller.OrEqualTo)  # -> ListA, ListB
dispatch_2 = Dispatch(List=rtrig.PLength, DispatchPattern=smaller.OrEqualTo)  # -> ListA, ListB
division = Division(A=dispatch_2.ListA, B=dispatch.ListA)
weave = Weave(Pattern=smaller.OrEqualTo, Stream0=dispatch_2.ListB, Stream1=dispatch.ListA, NullGaps=False)

cls = Closed(Curve=toolpaths_to_ramp_2)  # -> Closed, Periodic
dispatch_3 = Dispatch(List=toolpaths_to_ramp_2, DispatchPattern=cls.Closed)  # -> ListA, ListB
flip = FlipCurve(Curve=dispatch_3.ListA)  # -> Curve, Flag
weave_2 = Weave(Pattern=cls.Closed, Stream0=dispatch_3.ListB, Stream1=flip.Curve, NullGaps=False)

round = Round(Number=division)  # -> Nearest, Floor, Ceiling
division_2 = Division(A=weave, B="0.1")
dispatch_4 = Dispatch(List=abs, DispatchPattern=smaller.OrEqualTo)  # -> ListA, ListB
int = Integer(division_2)
division_3 = Division(A=dispatch_4.ListA, B=round.Ceiling)
int_2 = Integer(division_2)
division_4 = Division(A=weave, B=int)
weave_3 = Weave(Pattern=smaller.OrEqualTo, Stream0=dispatch_4.ListB, Stream1=division_3, NullGaps=False)
addition = Addition(A=int, B="1")
division_5 = Division(A=weave_3, B=int_2)
series = Series(Start=0, Step=division_4, Count=addition)
series_2 = Series(Start=0, Step=division_5, Count=addition)
eval = EvaluateLength(Curve=graft(weave_2), Length=series, Normalized=False)  # -> Point, Tangent, Parameter
Z = UnitZ(Factor=series_2)
move = Move(Geometry=eval.Point, Motion=Z)  # -> Geometry, Transform
pline = PolyLine(Vertices=move.Geometry, Closed=False)
pshift = ShiftPaths(Data=pline, Offset=-1)
redpline = Reduce(Polyline=pshift, Tolerance="0.02")  # -> Polyline, Reduction
flip_2 = FlipCurve(Curve=redpline.Polyline)  # -> Curve, Flag

dispatch_5 = Dispatch(List=flip_2.Curve, DispatchPattern=smaller.OrEqualTo)  # -> ListA, ListB
end_2 = EndPoints(Curve=dispatch_5.ListA)  # -> Start, End
pdecon_2 = Deconstruct(Point=end_2.End)  # -> XComponent, YComponent, ZComponent
pdecon_3 = Deconstruct(Point=end_2.Start)  # -> XComponent, YComponent, ZComponent
pt = ConstructPoint(XCoordinate=0, YCoordinate=0, ZCoordinate=pdecon_2.ZComponent)
pt_2 = ConstructPoint(XCoordinate=0, YCoordinate=0, ZCoordinate=pdecon_3.ZComponent)
dist = Distance(PointA=pt_2, PointB=pt)
series_3 = Series(Start=0, Step=dist, Count=round.Ceiling)
Z_2 = UnitZ(Factor=series_3)
move_2 = Move(Geometry=graft(dispatch_5.ListA), Motion=Z_2)  # -> Geometry, Transform

clean = CleanTree(RemoveNulls=True, RemoveInvalid=True, RemoveEmpty=False, Tree=move_2.Geometry)
join = JoinCurves(Curves=move_2.Geometry, Preserve=False)
flip_3 = FlipMatrix(Data=clean)
lng = ListLength(List=join)
dispatch_6 = Dispatch(List=flip_3, DispatchPattern=cls.Closed)  # -> ListA, ListB
larger = LargerThan(FirstNumber=lng, SecondNumber="1")  # -> LargerThan, OrEqualTo
flip_4 = FlipMatrix(Data=dispatch_6.ListB)
dispatch_7 = Dispatch(List=join, DispatchPattern=larger.LargerThan)  # -> ListA, ListB
simplify = SimplifyTree(Tree=dispatch_7.ListA, Front=False)
dispatch_8 = Dispatch(List=flip_4, DispatchPattern=[True, False])  # -> ListA, ListB
flatten = FlattenTree(Tree=dispatch_7.ListB, Path="{0}")
dispatch_9 = Dispatch(List=simplify, DispatchPattern=[True, False])  # -> ListA, ListB
crv = Curve(dispatch_9.ListB)
bbox = BoundingBox(Content=dispatch_9.ListB, Plane=PlaneXY(0, 0, 0))  # -> Box, Box_2
xy = XYPlane(Origin=Point(0, 0, 0))
cp = ControlPoints(Curve=dispatch_8.ListB)  # -> Points, Weights, Knots
x_tremez = Extremes(Curve=crv, Plane=xy)  # -> Highest, Lowest
cp_2 = ControlPoints(Curve=dispatch_9.ListB)  # -> Points, Weights, Knots; disabled
pshift_2 = ShiftPaths(Data=bbox.Box, Offset=-1)
pdecon_4 = Deconstruct(Point=cp.Points)  # -> XComponent, YComponent, ZComponent
ln = Line(StartPoint=x_tremez.Highest, EndPoint=x_tremez.Lowest)
debrep = DeconstructBrep(Brep=pshift_2)  # -> Faces, Edges, Vertices
rev = ReverseList(List=pdecon_4.ZComponent)
pdecon_5 = Deconstruct(Point=cp_2.Points)  # -> XComponent, YComponent, ZComponent
pt_3 = ConstructPoint(XCoordinate=pdecon_4.XComponent, YCoordinate=pdecon_4.YComponent, ZCoordinate=rev)
item = ListItem(List=debrep.Edges, Index="8", Wrap=True)
rev_2 = ReverseList(List=pdecon_5.ZComponent)
eval_2 = EvaluateLength(Curve=ln, Length="0.5", Normalized=True)  # -> Point, Tangent, Parameter
pline_2 = PolyLine(Vertices=pt_3, Closed=False)
pt_4 = ConstructPoint(XCoordinate=pdecon_5.XComponent, YCoordinate=pdecon_5.YComponent, ZCoordinate=rev_2)
pshift_3 = ShiftPaths(Data=eval_2.Point, Offset=-1)  # disabled
pshift_4 = ShiftPaths(Data=pline_2, Offset=-1)
pline_3 = PolyLine(Vertices=pt_4, Closed=False)
xy_2 = XYPlane(Origin=eval_2.Point)
flip_5 = FlipCurve(Curve=pshift_4)  # -> Curve, Flag
pshift_5 = ShiftPaths(Data=pline_3, Offset=-1)
mirror = Mirror(Geometry=crv, Plane=xy_2)  # -> Geometry, Transform
weave_4 = Weave(Pattern=[0, 1], Stream0=dispatch_8.ListA, Stream1=flip_5.Curve, NullGaps=False)
flip_6 = FlipCurve(Curve=pshift_5)  # -> Curve, Flag
flip_7 = FlipMatrix(Data=weave_4)
flip_8 = FlipCurve(Curve=mirror.Geometry)  # -> Curve, Flag
weave_5 = Weave(Pattern=[0, 1], Stream0=dispatch_9.ListA, Stream1=flip_8.Curve, NullGaps=False)
weave_6 = Weave(Pattern=cls.Closed, Stream0=flip_7, Stream1=dispatch_6.ListA, NullGaps=False)
join_2 = JoinCurves(Curves=weave_5, Preserve=False)
flip_9 = FlipMatrix(Data=weave_6)
simplify_2 = SimplifyTree(Tree=join_2, Front=False)
join_3 = JoinCurves(Curves=flip_9, Preserve=False)
number_slider = Slider(4, range=0..10)
weave_7 = Weave(Pattern=flatten(larger.LargerThan), Stream0=flatten(flatten), Stream1=flatten(simplify_2), NullGaps=False)
pshift_6 = ShiftPaths(Data=join_3, Offset=-1)
pshift_7 = ShiftPaths(Data=pshift_6, Offset=-1)
weave_8 = Weave(Pattern=smaller.OrEqualTo, Stream0=dispatch_5.ListB, Stream1=weave_7, NullGaps=False)
item_2 = ListItem(List=toolpaths_to_ramp_2, Index=number_slider, Wrap=True)
item_3 = ListItem(List=weave_8, Index=number_slider, Wrap=True)
weave_9 = Weave(Pattern=[0, 1], Stream0=weave_8, Stream1=toolpaths_to_ramp_2, NullGaps=False)
join_4 = JoinCurves(Curves=weave_9, Preserve=Toggle(True))  # disabled
ramped_toolpaths = Curve(weave_9)
ramped_toolpaths_2 = ClusterOutput(ramped_toolpaths)

# ==== cluster TrochoidalHighSpeedMilling: Makes highspeed toolpaths for deep and fast cutting in metal. Input toolpath curves for the arcs to follow. Be careful about feedrates and stepovers. Prioritize deep passes and small stepovers (0.05 to 0.2). This technique is known as high speed feed machining.

# ---- group: Left this always on to reduce inpput options
make_helical_entry = Boolean(Toggle(True))

# ----
max_peck_depth_factor = ClusterInput()  # How deep each ehlical entry will be. Depth of entry helix = Max peck depth factor * Bit diameter
straight_arc_extensions = ClusterInput()  # Creates a smoother finish but increases the chance of rubbing (and heat buildup)
milling_bit_diameter = ClusterInput()  # The diameter of your milling bit
toolpath_width_factor = ClusterInput()  # How much wider the toolpath will be than the diamter of your milling bit. Width of trochoidal cut = Toolpath width factor * Bit diameter
toolpath_curves = ClusterInput()  # Curve geometry that you want to convert to trochoidal toolpaths. Pro tip: This can be output from toolpath functions like pocket and Cutout
use_climb_milling = ClusterInput()  # Climb milling direction works best in almost all materials
use_peck_entry = ClusterInput()  # Peck entry stops a helical entry at a max epth, before it starts the entry helix again. Allows for hard metals to cool inbetween entries. Use in case of un-optimized feedrates or machine acceleration.
jog_z_lift_factor = ClusterInput()  # How high up the bit moves during its return pass. Helps avoiding that the bit rubs on the floor during a return pass
ramp_angle = ClusterInput()  # The angle of the entry helix. Low angles and high speeds works well for metals
stepover = ClusterInput()  # How far into the material the bit moves each pass. Stepover distance = Bit diameter * Stepover

# ---- group: Separate feedrate and jog rates is not yet impleneted, it is rarely needed
ramp_entry_feedrate = Number(25)
feedrate = Number(50)
jograte = Number(60)

# ----
straight_arc_extensions_2 = Boolean(straight_arc_extensions)
max_peck_depth_factor_2 = Number(max_peck_depth_factor)
use_peck_entry_2 = Boolean(use_peck_entry)
toolpath_width_factor_2 = Number(toolpath_width_factor)
milling_bit_diameter_2 = Number(milling_bit_diameter)
use_climb_milling_2 = Boolean(use_climb_milling)
toolpath_curves_2 = Curve(toolpath_curves)
jog_z_lift_factor_2 = Number(jog_z_lift_factor)
ramp_angle_2 = Number(ramp_angle)
stepover_2 = Number(stepover)
max_diameter_factor_of_ramp_helix = Panel("2.2")
helix_entry_diameter_to_bit_diameter_rat = Panel("0.8")  # "Helix entry diameter to bit diameter ratio"
ramp_angle_3 = Panel(ramp_angle_2)
jog_z_lift_factor_3 = Panel(jog_z_lift_factor_2)
use_climb_milling_3 = Panel(use_climb_milling_2)
milling_bit_diameter_3 = Panel(milling_bit_diameter_2)
arc_diameter_factor = Panel(toolpath_width_factor_2)
stepover_3 = Panel(stepover_2)
make_straight_arc_extensions = Panel(straight_arc_extensions_2)
feedrate_2 = Panel(feedrate)
jograte_2 = Panel(jograte)
ramp_feedrate = Panel(ramp_entry_feedrate)
make_helical_entry_ramp = Panel(make_helical_entry)
max_peck_depth_factor_3 = Panel(max_peck_depth_factor_2)
use_peck_entry_3 = Panel(use_peck_entry_2)

# ---- group: Shetter curves at corners and shatter closed curves
disc = Discontinuity(Curve=toolpath_curves_2, Level=1)  # -> Points, Parameters
lng = ListLength(List=disc.Parameters)
smaller = SmallerThan(FirstNumber=lng, SecondNumber="1")  # -> SmallerThan, OrEqualTo
weave = Weave(Pattern=smaller.SmallerThan, Stream0=disc.Parameters, Stream1="0", NullGaps=False)
shatter = Shatter(Curve=graft(toolpath_curves_2), Parameters=weave)

# ----
straight = Panel("0")
smooth = Panel("2")
multiplication = Multiplication(A=milling_bit_diameter_3, B=arc_diameter_factor)
multiplication_2 = Multiplication(A=milling_bit_diameter_3, B=jog_z_lift_factor_3)
multiplication_3 = Multiplication(A=milling_bit_diameter_3, B=stepover_3)
subtraction = Subtraction(A=multiplication, B=milling_bit_diameter_3)
filter = StreamFilter(Gate=make_straight_arc_extensions, Stream0=smooth, Stream1=straight)
stepover_distance = Panel(multiplication_3)
z_lift_distance = Panel(multiplication_2)
arc_extension_type = Panel(filter)
arc_diameter = Panel(subtraction)
shattered_toolpath_curves = Curve(shatter)

# ---- group: Check if all curves consist of singel line, can give errors in data weaving
lng_2 = ListLength(List=shattered_toolpath_curves)
sort = SortList(Keys=flatten(lng_2))  # -> Keys, ValuesA
rev = ReverseList(List=sort.Keys)
item = ListItem(List=rev, Index=0, Wrap=True)
smaller_2 = SmallerThan(FirstNumber=item, SecondNumber="2")  # -> SmallerThan, OrEqualTo
all_toolpaths_are_single_curve = Panel(smaller_2.SmallerThan)

# ---- group: Make oriented planes for toolpah arcs
len = Length(Curve=shattered_toolpath_curves)
division = Division(A=len, B=stepover_distance)
int = Integer(division)
divide = DivideCurve(Curve=shattered_toolpath_curves, Count=int, Kinks=False)  # -> Points, Tangents, Parameters
cull_i = CullIndex(List=divide.Tangents, Indices="0", Wrap=True)
cull_i_2 = CullIndex(List=divide.Points, Indices="0", Wrap=True)
xy = XYPlane(Origin=cull_i_2)
align = AlignPlane(Plane=xy, Direction=cull_i)  # -> Plane, Angle
simplify = SimplifyTree(Tree=align.Plane, Front=False)
toolpath_planes = Plane(simplify)

# ----
all_toolpaths_are_single_curve_2 = Panel(all_toolpaths_are_single_curve)
max_diameter_factor_of_ramp_helix_2 = Panel(max_diameter_factor_of_ramp_helix)

# ---- group: Make toolpath arcs
arc_diameter_2 = Panel(arc_diameter)
use_climb_milling_4 = Panel(use_climb_milling_3)
arc_extension_type_2 = Panel(arc_extension_type)
stepover_distance_2 = Panel(stepover_distance)
pi = Pi(Factor=1)
pi_2 = Pi(Factor=1)
multiplication_4 = Multiplication(A=arc_diameter_2, B="0.5")
multiplication_5 = Multiplication(A=pi, B="0.5")
multiplication_6 = Multiplication(A=pi_2, B="-0.5")
xy_2 = XYPlane(Origin=Point(0, 0, 0))
dom = ConstructDomain(DomainStart=multiplication_6, DomainEnd=multiplication_5)
arc = Arc(Plane=xy_2, Radius=multiplication_4, Angle=dom)  # -> Arc, Length
ext = ExtendCurve(Curve=arc.Arc, Type=arc_extension_type_2, Start=stepover_distance_2, End=stepover_distance_2)
gate = StreamGate(Stream=ext, Gate=use_climb_milling_4)  # -> Target0, Target1
flip = FlipCurve(Curve=gate.Target0)  # -> Curve, Flag
filter_2 = StreamFilter(Gate=use_climb_milling_4, Stream0=flip.Curve, Stream1=gate.Target1)
orient = Orient(Geometry=filter_2, Source=xy_2, Target=toolpath_planes)  # -> Geometry, Transform
toolpath_arcs = Curve(orient.Geometry)

# ---- group: Abandoned work on making a better entry helix (without variable diameter) / Add curves here
curve_holes_to_thread_mill = Curve()  # disabled

# ---- group: Abandoned work on making a better entry helix (without variable diameter) / Create planes at center of curves
area = Area(Geometry=curve_holes_to_thread_mill)  # -> Area, Centroid; disabled
xy_3 = XYPlane(Origin=flatten(area.Centroid))  # disabled

# ---- group: Abandoned work on making a better entry helix (without variable diameter) / Select one plane to generate helix on
item_2 = ListItem(List=xy_3, Index=0, Wrap=True)  # disabled
helix_working_plane = Plane(item_2)  # disabled

# ----
all_toolpaths_are_single_curve_3 = Panel(all_toolpaths_are_single_curve)

# ---- group: Make transition jog arcs for corner transitions
z_lift_distance_2 = Panel(z_lift_distance)
toolpath_arcs_2 = Curve(toolpath_arcs)
rev_2 = ReverseList(List=toolpath_arcs_2)
number_slider = Slider(0.5, range=0..1)
item_3 = ListItem(List=rev_2, Index=0, Wrap=True)
item_4 = ListItem(List=toolpath_arcs_2, Index=0, Wrap=True)
flatten = FlattenTree(Tree=item_4, Path="{0}")
pshift = ShiftPaths(Data=item_3, Offset=-1)
flatten_2 = FlattenTree(Tree=item_3, Path="{0}")
pshift_2 = ShiftPaths(Data=item_4, Offset=-1)
flatten_3 = FlattenTree(Tree=pshift, Path="{0}")
clean = CleanTree(RemoveNulls=True, RemoveInvalid=True, RemoveEmpty=False, Tree=flatten_3)
item_5 = ListItem(List=clean, Index=0, Wrap=True)
null = NullItem(Item=item_5)  # -> NullFlags, InvalidFlags, Description
filter_3 = StreamFilter(Gate=null.NullFlags, Stream0=pshift, Stream1=flatten_2)
filter_4 = StreamFilter(Gate=null.NullFlags, Stream0=pshift_2, Stream1=flatten)
shift = ShiftList(List=filter_4, Shift=1, Wrap=False)
shift_2 = ShiftList(List=filter_3, Shift=-1, Wrap=False)
blendc = BlendCurve(CurveA=shift_2, CurveB=shift, BulgeA=number_slider, BulgeB=number_slider, Continuity=1)
reb = RebuildCurve(Curve=blendc, Count="5", Tangents=False)
multiplication_7 = Multiplication(A="5", B="0.5")
cp = ControlPoints(Curve=reb)  # -> Points, Weights, Knots
int_2 = Integer(multiplication_7)
Z = UnitZ(Factor=z_lift_distance_2)
item_6 = ListItem(List=cp.Points, Index=int_2, Wrap=True)
move = Move(Geometry=item_6, Motion=Z)  # -> Geometry, Transform
replace = ReplaceItems(List=cp.Points, Item=move.Geometry, Indices=int_2, Wrap=False)
nurbs = NurbsCurve(Vertices=replace, Degree=3, Periodic=False)  # -> Curve, Length, Domain
all_toolpaths_are_single_curve_4 = Panel(all_toolpaths_are_single_curve_3)
simplify_2 = SimplifyTree(Tree=nurbs.Curve, Front=False)
gate_2 = StreamGate(Stream=simplify_2, Gate=all_toolpaths_are_single_curve_4)  # -> Target0, Target1

# ---- group: Abandoned work on making a better entry helix (without variable diameter)
start_arcs = Curve(filter_4)  # disabled
make_helical_entry_ramp_2 = Panel(make_helical_entry_ramp)  # disabled
stepover_distance_3 = Panel(stepover_distance)  # disabled
helix_entry_diameter_to_bit_diameter_rat_2 = Panel(helix_entry_diameter_to_bit_diameter_rat)  # "Helix entry diameter to bit diameter ratio"; disabled
inner_diameter_overlap = Panel("0.05")  # disabled
ramp_angle_4 = Panel(ramp_angle_3)  # disabled
ramp_extra_start_height = Panel("1")  # disabled
all_toolpaths_are_single_curve_5 = Panel(all_toolpaths_are_single_curve)  # disabled
milling_bit_diameter_4 = Panel(milling_bit_diameter_3)  # disabled
multiplication_8 = Multiplication(A=milling_bit_diameter_4, B=helix_entry_diameter_to_bit_diameter_rat_2)  # disabled
item_7 = ListItem(List=flatten(start_arcs), Index=0, Wrap=True)  # disabled
helical_entry_diamter = Panel(multiplication_8)  # disabled
graft = GraftTree(Tree=start_arcs, IncludeEmptyLists=True, IncludeNullItems=True)  # disabled
end = EndPoints(Curve=item_7)  # -> Start, End; disabled
pitch = Panel("0.8")  # disabled
thread_depth = Panel("12")  # disabled
tool_diameter = Panel("3.9")  # disabled
thread_top_margin = Panel("0.6")  # disabled
thread_diameter = Panel("5.1")  # disabled
thread_bottom_margin = Panel("0.4")  # disabled
filter_5 = StreamFilter(Gate=all_toolpaths_are_single_curve_5, Stream0=start_arcs, Stream1=graft)  # disabled
dist = Distance(PointA=end.Start, PointB=end.End)  # disabled
arc_diameter_3 = Panel(dist)  # disabled
item_8 = ListItem(List=filter_5, Index=0, Wrap=True)  # disabled
end_2 = EndPoints(Curve=item_8)  # -> Start, End; disabled
pdecon = Deconstruct(Point=end_2.Start)  # -> XComponent, YComponent, ZComponent; disabled
ln = Line(StartPoint=end_2.Start, EndPoint=end_2.End)  # disabled
panel = Panel("0.5")  # disabled
abs = Absolute(Value=pdecon.ZComponent)  # disabled
eval = EvaluateLength(Curve=ln, Length=panel, Normalized=True)  # -> Point, Tangent, Parameter; disabled
addition = Addition(A=abs, B=ramp_extra_start_height)  # disabled
start_point = Point(eval.Point)  # disabled
cut_depths = Panel(addition)  # disabled

# ---- group: Make fancy jog to surface ending
all_toolpaths_are_single_curve_6 = Panel(all_toolpaths_are_single_curve)
last_arcs_in_list = Curve(filter_3)
graft_2 = GraftTree(Tree=last_arcs_in_list, IncludeEmptyLists=True, IncludeNullItems=True)
filter_6 = StreamFilter(Gate=all_toolpaths_are_single_curve_6, Stream0=last_arcs_in_list, Stream1=graft_2)
rev_3 = ReverseList(List=filter_6)
item_9 = ListItem(List=rev_3, Index=0, Wrap=True)
end_3 = EndPoints(Curve=item_9)  # -> Start, End
crv_cp = CurveClosestPoint(Point=end_3.End, Curve=item_9)  # -> Point, Parameter, Distance
ln_2 = Line(StartPoint=end_3.Start, EndPoint=end_3.End)
dist_2 = Distance(PointA=end_3.Start, PointB=end_3.End)
eval_2 = EvaluateLength(Curve=ln_2, Length="0.3", Normalized=True)  # -> Point, Tangent, Parameter
eval_3 = EvaluateCurve(Curve=item_9, Parameter=crv_cp.Parameter)  # -> Point, Tangent, Angle
multiplication_9 = Multiplication(A=dist_2, B="0.5")
end_point_tangent = Vector(eval_3.Tangent)
arc_center_point = Point(eval_2.Point)
arc_end_point = Point(end_3.End)
arc_radius = Panel(multiplication_9)
arc_2 = ArcSED(Start=arc_end_point, End=arc_center_point, Direction=end_point_tangent)  # -> Arc, Plane, Radius
reb_2 = RebuildCurve(Curve=arc_2.Arc, Count="5", Tangents=False)
multiplication_10 = Multiplication(A="5", B="0.5")
cp_2 = ControlPoints(Curve=reb_2)  # -> Points, Weights, Knots
multiplication_11 = Multiplication(A=arc_radius, B="0.1")
multiplication_12 = Multiplication(A=arc_radius, B="0.7")
multiplication_13 = Multiplication(A=arc_radius, B="0.3")
int_3 = Integer(multiplication_10)
addition_2 = Addition(A=int_3, B="1")
Z_2 = UnitZ(Factor=multiplication_13)
Z_3 = UnitZ(Factor=multiplication_11)
item_10 = ListItem(List=cp_2.Points, Index=int_3, Wrap=True)
Z_4 = UnitZ(Factor=arc_radius)
Z_5 = UnitZ(Factor=multiplication_12)
move_2 = Move(Geometry=item_10, Motion=Z_3)  # -> Geometry, Transform
replace_2 = ReplaceItems(List=cp_2.Points, Item=move_2.Geometry, Indices=int_3, Wrap=False)
item_11 = ListItem(List=replace_2, Index=addition_2, Wrap=True)
move_3 = Move(Geometry=item_11, Motion=Z_2)  # -> Geometry, Transform
subtraction_2 = Subtraction(A="5", B="1")
replace_3 = ReplaceItems(List=replace_2, Item=move_3.Geometry, Indices=addition_2, Wrap=False)
item_12 = ListItem(List=replace_3, Index=subtraction_2, Wrap=True)
move_4 = Move(Geometry=item_12, Motion=Z_5)  # -> Geometry, Transform
move_5 = Move(Geometry=item_12, Motion=Z_4)  # -> Geometry, Transform
replace_4 = ReplaceItems(List=replace_3, Item=move_4.Geometry, Indices=subtraction_2, Wrap=False)
ins = InsertItems(List=replace_4, Item=move_5.Geometry, Indices="5", Wrap=True)
nurbs_2 = NurbsCurve(Vertices=ins, Degree=3, Periodic=False)  # -> Curve, Length, Domain
simplify_3 = SimplifyTree(Tree=nurbs_2.Curve, Front=False)
end_jog_arcs = Curve(simplify_3)

# ---- group: Abandoned work on making a better entry helix (without variable diameter) / Find helix radius
subtraction_3 = Subtraction(A=thread_diameter, B=tool_diameter)  # disabled
panel_2 = Panel("2")  # disabled
division_2 = Division(A=subtraction_3, B=panel_2)  # disabled

# ---- group: Abandoned work on making a better entry helix (without variable diameter) / Create base circle for helix
cir = Circle(Plane=helix_working_plane, Radius=division_2)  # disabled
flip_2 = FlipCurve(Curve=cir)  # -> Curve, Flag; disabled
divide_2 = DivideCurve(Curve=flip_2.Curve, Count=10, Kinks=False)  # -> Points, Tangents, Parameters; disabled

# ---- group: Abandoned work on making a better entry helix (without variable diameter) / Find helix lenght and max turns
addition_3 = Addition(A=thread_depth, B=thread_top_margin, C=thread_bottom_margin)  # disabled
division_3 = Division(A=addition_3, B=pitch)  # disabled
round = Round(Number=division_3)  # -> Nearest, Floor, Ceiling; disabled

# ---- group: Abandoned work on making a better entry helix (without variable diameter) / Add start point to end
item_13 = ListItem(List=flatten(divide_2.Points), Index=0, Wrap=True)  # disabled
merge = Merge(Data1=flatten(divide_2.Points), Data2=flatten(item_13))  # disabled

# ---- group: Abandoned work on making a better entry helix (without variable diameter) / Create move vectors for helix points
lng_3 = ListLength(List=merge)  # disabled
panel_3 = Panel("1")  # disabled
subtraction_4 = Subtraction(A=lng_3, B=panel_3)  # disabled
division_4 = Division(A=pitch, B=subtraction_4)  # disabled
series = Series(Start=0, Step=division_4, Count=lng_3)  # disabled
neg = Negative(Value=series)  # disabled
Z_6 = UnitZ(Factor=neg)  # disabled

# ---- group: Make jog arcs, transtion between each semicircular cut
z_lift_distance_3 = Panel(z_lift_distance)
toolpath_arcs_3 = Curve(toolpath_arcs)
number_slider_2 = Slider(0.5, range=0..1)
shift_3 = ShiftList(List=toolpath_arcs_3, Shift=1, Wrap=False)
shift_4 = ShiftList(List=toolpath_arcs_3, Shift=-1, Wrap=False)
blendc_2 = BlendCurve(CurveA=shift_4, CurveB=shift_3, BulgeA=number_slider_2, BulgeB=number_slider_2, Continuity=1)
blended_transitions = Curve(blendc_2)
reb_3 = RebuildCurve(Curve=blended_transitions, Count="5", Tangents=False)
multiplication_14 = Multiplication(A="5", B="0.5")
cp_3 = ControlPoints(Curve=reb_3)  # -> Points, Weights, Knots
int_4 = Integer(multiplication_14)
Z_7 = UnitZ(Factor=z_lift_distance_3)
item_14 = ListItem(List=cp_3.Points, Index=int_4, Wrap=True)
move_6 = Move(Geometry=item_14, Motion=Z_7)  # -> Geometry, Transform
replace_5 = ReplaceItems(List=cp_3.Points, Item=move_6.Geometry, Indices=int_4, Wrap=False)
nurbs_3 = NurbsCurve(Vertices=replace_5, Degree=3, Periodic=False)  # -> Curve, Length, Domain
jog_arcs = Curve(nurbs_3.Curve)

# ---- group: Abandoned work on making a better entry helix (without variable diameter) / Create helix trim plane
addition_4 = Addition(A=thread_depth, B=thread_bottom_margin)  # disabled
neg_2 = Negative(Value=addition_4)  # disabled
Z_8 = UnitZ(Factor=neg_2)  # disabled
move_7 = Move(Geometry=helix_working_plane, Motion=Z_8)  # -> Geometry, Transform; disabled

# ---- group: Abandoned work on making a better entry helix (without variable diameter) / Create vectors for copying helixes downwards
series_2 = Series(Start=0, Step=pitch, Count=round.Ceiling)  # disabled
neg_3 = Negative(Value=series_2)  # disabled
Z_9 = UnitZ(Factor=neg_3)  # disabled

# ---- group: Abandoned work on making a better entry helix (without variable diameter) / Make helix
move_8 = Move(Geometry=merge, Motion=Z_6)  # -> Geometry, Transform; disabled
intcrv = Interpolate(Vertices=move_8.Geometry, Degree=3, Periodic=False, KnotStyle=1)  # -> Curve, Length, Domain; disabled

# ---- group: Abandoned work on making a better entry helix (without variable diameter) / Move to start height and
Z_10 = UnitZ(Factor=thread_top_margin)  # disabled
move_9 = Move(Geometry=intcrv.Curve, Motion=Z_10)  # -> Geometry, Transform; disabled
move_10 = Move(Geometry=move_9.Geometry, Motion=Z_9)  # -> Geometry, Transform; disabled

# ---- group: Abandoned work on making a better entry helix (without variable diameter) / Trim helix to correct length inc. margin
join = JoinCurves(Curves=move_10.Geometry, Preserve=False)  # disabled
pcx = CurvePlane(Curve=join, Plane=move_7.Geometry)  # -> Points, ParamsC, ParamsP; disabled
shatter_2 = Shatter(Curve=join, Parameters=pcx.ParamsC)  # disabled
item_15 = ListItem(List=shatter_2, Index=0, Wrap=True)  # disabled

# ---- group: Abandoned work on making a better entry helix (without variable diameter) / Create top exit point
deplane = DeconstructPlane(Plane=helix_working_plane)  # -> Origin, XAxis, YAxis, ZAxis; disabled
pdecon_2 = Deconstruct(Point=deplane.Origin)  # -> XComponent, YComponent, ZComponent; disabled
addition_5 = Addition(A=pdecon_2.ZComponent, B=thread_top_margin)  # disabled
pt = ConstructPoint(XCoordinate=pdecon_2.XComponent, YCoordinate=pdecon_2.YComponent, ZCoordinate=addition_5)  # disabled

# ---- group: Abandoned work on making a better entry helix (without variable diameter) / Create bottom exit point
end_4 = EndPoints(Curve=item_15)  # -> Start, End; disabled
pdecon_3 = Deconstruct(Point=end_4.End)  # -> XComponent, YComponent, ZComponent; disabled
pt_2 = ConstructPoint(XCoordinate=pdecon_2.XComponent, YCoordinate=pdecon_2.YComponent, ZCoordinate=pdecon_3.ZComponent)  # disabled

# ----
neg_4 = Negative(Value="1")
Z_11 = UnitZ(Factor=neg_4)
multiplication_15 = Multiplication(A="1", B="2")

# ---- group: Abandoned work on making a better entry helix (without variable diameter) / Create exit path and join
ln_3 = Line(StartPoint=end_4.End, EndPoint=pt_2)  # disabled
ln_4 = Line(StartPoint=pt_2, EndPoint=pt)  # disabled
merge_2 = Merge(Data1=item_15, Data2=ln_3, Data3=ln_4)  # disabled
join_2 = JoinCurves(Curves=merge_2, Preserve=False)  # disabled

# ---- group: Abandoned work on making a better entry helix (without variable diameter) / Finsihed path
thread_milling_path = Curve(join_2)  # disabled

# ---- group: Abandoned work on making a better entry helix (without variable diameter) / Copy helix path tp all holes and group for concenient selecting
orient_2 = Orient(Geometry=thread_milling_path, Source=helix_working_plane, Target=xy_3)  # -> Geometry, Transform; disabled
group = Group(Objects=flatten(orient_2.Geometry))  # disabled
thread_milling_paths = Geometry(group)  # disabled

# ---- group: Abandoned work on making a better entry helix (without variable diameter) / Bake these
thread_milling_paths_2 = Geometry(thread_milling_paths)  # disabled

# ---- group: Inser fancy end jog to surface
corner_jog_arcs = Curve(gate_2.Target0)
end_jog_arcs_2 = Curve(end_jog_arcs)
pshift_3 = ShiftPaths(Data=corner_jog_arcs, Offset=-1)
flatten_4 = FlattenTree(Tree=corner_jog_arcs, Path="{0}")
flatten_5 = FlattenTree(Tree=pshift_3, Path="{0}")
flatten_6 = FlattenTree(Tree=end_jog_arcs_2, Path="{0}")
clean_2 = CleanTree(RemoveNulls=True, RemoveInvalid=True, RemoveEmpty=False, Tree=flatten_5)
item_16 = ListItem(List=clean_2, Index=0, Wrap=True)
null_2 = NullItem(Item=item_16)  # -> NullFlags, InvalidFlags, Description
filter_7 = StreamFilter(Gate=null_2.NullFlags, Stream0=pshift_3, Stream1=flatten_4)
filter_8 = StreamFilter(Gate=null_2.NullFlags, Stream0=end_jog_arcs_2, Stream1=flatten_6)
merge_3 = Merge(Data1=filter_7, Data2=filter_8)
graft_3 = GraftTree(Tree=merge_3, IncludeEmptyLists=True, IncludeNullItems=True)
clean_3 = CleanTree(RemoveNulls=True, RemoveInvalid=True, RemoveEmpty=True, Tree=graft_3)
transition_jog_arcs = Curve(clean_3)

# ---- group: Insert jog corner transitions
jog_arcs_2 = Curve(jog_arcs)
corner_jog_arcs_2 = Curve(transition_jog_arcs)
simplify_4 = SimplifyTree(Tree=jog_arcs_2, Front=False)
pshift_4 = ShiftPaths(Data=simplify_4, Offset=-1)
flatten_7 = FlattenTree(Tree=simplify_4, Path="{0}")
flatten_8 = FlattenTree(Tree=pshift_4, Path="{0}")
clean_4 = CleanTree(RemoveNulls=True, RemoveInvalid=True, RemoveEmpty=False, Tree=flatten_8)
item_17 = ListItem(List=clean_4, Index=0, Wrap=True)
null_3 = NullItem(Item=item_17)  # -> NullFlags, InvalidFlags, Description
filter_9 = StreamFilter(Gate=null_3.NullFlags, Stream0=pshift_4, Stream1=flatten_7)
lng_4 = ListLength(List=filter_9)
ins_2 = InsertItems(List=filter_9, Item=corner_jog_arcs_2, Indices=lng_4, Wrap=False)
jog_arcs_3 = Curve(ins_2)

# ---- group: Weave cuts and jogs
toolpath_arcs_4 = Curve(toolpath_arcs)
jog_arcs_4 = Curve(jog_arcs_3)
jograte_3 = Panel(jograte_2)
feedrate_3 = Panel(feedrate_2)
lng_5 = ListLength(List=toolpath_arcs_4)
lng_6 = ListLength(List=jog_arcs_4)
dup = DuplicateData(Data=feedrate_3, Number=lng_5, Order=True)
dup_2 = DuplicateData(Data=jograte_3, Number=lng_6, Order=True)
simplify_5 = SimplifyTree(Tree=dup_2, Front=False)
simplify_6 = SimplifyTree(Tree=dup, Front=False)
simplify_7 = SimplifyTree(Tree=jog_arcs_4, Front=False)
simplify_8 = SimplifyTree(Tree=toolpath_arcs_4, Front=False)
match = MatchTree(Tree=simplify_5, Guide=simplify_6)
match_2 = MatchTree(Tree=simplify_7, Guide=simplify_8)
weave_2 = Weave(Pattern=[0, 1], Stream0=simplify_6, Stream1=match, NullGaps=False)
weave_3 = Weave(Pattern=[0, 1], Stream0=simplify_8, Stream1=match_2, NullGaps=False)
shift_paths_if_possible = ShiftPathsIfPossible(data_paths_to_shifts=weave_2)
shift_paths_if_possible_2 = ShiftPathsIfPossible(data_paths_to_shifts=weave_3)

# ----
feedback = Panel("All good")

# ---- group: Feedback is not yet implemented
feedback_2 = Text(feedback)

# ---- group: Make helical entry plunge
stepover_distance_4 = Panel(stepover_distance)
make_helical_entry_ramp_3 = Panel(make_helical_entry_ramp)
inner_diameter_overlap_2 = Panel("0.05")
milling_bit_diameter_5 = Panel(milling_bit_diameter_3)
ramp_angle_5 = Panel(ramp_angle_3)
ramp_extra_start_height_2 = Panel("1")
start_arcs_2 = Curve(filter_4)
filter_10 = StreamFilter(Gate=make_helical_entry_ramp_3, Stream1=start_arcs_2)
rad = Radians(Degrees=ramp_angle_5)
subtraction_5 = Subtraction(A="1", B=inner_diameter_overlap_2)
rtrig = RightTrigonometry(Alpha=rad, PLength=stepover_distance_4)  # -> Alpha, Beta, PLength, QLength, RLength
multiplication_16 = Multiplication(A=milling_bit_diameter_5, B=subtraction_5)
multiplication_17 = Multiplication(A=multiplication_16, B="0.5")
eleveation_per_stepover_distance = Panel(rtrig.QLength)
inner_circle_radius = Panel(multiplication_17)
stepover_distance_5 = Panel(stepover_distance_4)
division_5 = Division(A="1", B="12")
Z_12 = UnitZ(Factor=1)
eleveation_per_stepover_distance_2 = Panel(eleveation_per_stepover_distance)
stepover_distance_6 = Panel(stepover_distance_4)
Z_13 = UnitZ(Factor=1)
xy_4 = XYPlane(Origin=Point(0, 0, 0))
rad_2 = Radians(Degrees="5")
rad_3 = Radians(Degrees="360")
dom_2 = ConstructDomain(DomainStart=rad_2, DomainEnd=rad_3)

# ----
multiplication_18 = Multiplication(A=milling_bit_diameter_5, B=max_diameter_factor_of_ramp_helix_2)
item_18 = ListItem(List=flatten(start_arcs_2), Index=0, Wrap=True)
graft_4 = GraftTree(Tree=filter_10, IncludeEmptyLists=True, IncludeNullItems=True)
subtraction_6 = Subtraction(A=multiplication_18, B=milling_bit_diameter_5)
filter_11 = StreamFilter(Gate=all_toolpaths_are_single_curve_2, Stream0=filter_10, Stream1=graft_4)
end_5 = EndPoints(Curve=item_18)  # -> Start, End
max_helix_diameter = Panel(subtraction_6)
dist_3 = Distance(PointA=end_5.Start, PointB=end_5.End)
larger = LargerThan(FirstNumber=dist_3, SecondNumber=0)  # -> LargerThan, OrEqualTo
make_narrow_entry_helix = Panel(larger.LargerThan)
max_helix_diameter_2 = Panel(max_helix_diameter)
make_narrow_entry_helix_2 = Panel(make_narrow_entry_helix)
multiplication_19 = Multiplication(A=max_helix_diameter_2, B="0.5")
make_narrow_entry_helix_3 = Panel(make_narrow_entry_helix)

# ---- group: Make helical entry plunge (continued)
item_19 = ListItem(List=filter_11, Index=0, Wrap=True)
end_6 = EndPoints(Curve=item_19)  # -> Start, End
dist_4 = Distance(PointA=end_6.Start, PointB=end_6.End)
ln_5 = Line(StartPoint=end_6.Start, EndPoint=end_6.End)
pdecon_4 = Deconstruct(Point=end_6.Start)  # -> XComponent, YComponent, ZComponent
vec2pt = Vector2Pt(PointA=end_6.Start, PointB=end_6.End, Unitize=False)  # -> Vector, Length
multiplication_20 = Multiplication(A=dist_4, B="0.5")
eval_4 = EvaluateLength(Curve=ln_5, Length="0.5", Normalized=True)  # -> Point, Tangent, Parameter
abs_2 = Absolute(Value=pdecon_4.ZComponent)
start_point_2 = Point(eval_4.Point)
addition_6 = Addition(A=abs_2, B=ramp_extra_start_height_2)
rev_4 = Reverse(Vector=vec2pt.Vector)
xy_5 = XYPlane(Origin=start_point_2)
arc_radius_2 = Panel(multiplication_20)
cut_depths_2 = Panel(addition_6)
align_2 = AlignPlane(Plane=xy_5, Direction=rev_4)  # -> Plane, Angle
cir_2 = Circle(Plane=align_2.Plane, Radius=multiplication_20)
arc_radius_3 = Panel(arc_radius_2)
flip_3 = FlipCurve(Curve=cir_2)  # -> Curve, Flag
subtraction_7 = Subtraction(A=arc_radius_3, B=inner_circle_radius)
horizontal_spiral_distance = Panel(subtraction_7)
divide_3 = DivideCurve(Curve=flip_3.Curve, Count="12", Kinks=False)  # -> Points, Tangents, Parameters
division_6 = Division(A=horizontal_spiral_distance, B=stepover_distance_5)
multiplication_21 = Multiplication(A="12", B=division_6)
number_of_spiral_points = Panel(multiplication_21)
series_3 = Series(Start=0, Step=1, Count=number_of_spiral_points)
series_4 = Series(Start=0, Step=division_5, Count=number_of_spiral_points)
item_20 = ListItem(List=divide_3.Points, Index=series_3, Wrap=True)
multiplication_22 = Multiplication(A=series_4, B=stepover_distance_5)
vec2pt_2 = Vector2Pt(PointA=item_20, PointB=start_point_2, Unitize=False)  # -> Vector, Length
amp = Amplitude(Vector=vec2pt_2.Vector, Amplitude=multiplication_22)
move_11 = Move(Geometry=item_20, Motion=amp)  # -> Geometry, Transform
intcrv_2 = Interpolate(Vertices=move_11.Geometry, Degree=3, Periodic=False, KnotStyle=1)  # -> Curve, Length, Domain
flip_4 = FlipCurve(Curve=intcrv_2.Curve)  # -> Curve, Flag
start_point_3 = Point(start_point_2)
start_point_4 = Point(start_point_2)
cut_depths_3 = Panel(cut_depths_2)
start_point_5 = Point(start_point_2)
project = Project(Geometry=start_point_5, Plane=xy_4)  # -> Geometry, Transform
xy_6 = XYPlane(Origin=start_point_5)
cut_depths_4 = Panel(cut_depths_2)
Z_14 = UnitZ(Factor=cut_depths_4)
move_12 = Move(Geometry=xy_6, Motion=Z_14)  # -> Geometry, Transform
arc_radius_4 = Panel(arc_radius_2)
start_point_plane = Plane(align_2.Plane)
arc_3 = Arc(Plane=start_point_plane, Radius=arc_radius_4, Angle=dom_2)  # -> Arc, Length
simplify_9 = SimplifyTree(Tree=arc_3.Arc, Front=False)

# ----
pln = Plane(align_2.Plane)
gate_3 = StreamGate(Stream=pln, Gate=make_narrow_entry_helix_2)  # -> Target0, Target1
move_13 = Move(Geometry=gate_3.Target1, Motion=Z_11)  # -> Geometry, Transform
cyl = Cylinder(Base=move_13.Geometry, Radius=multiplication_19, Length=multiplication_15)
cap = CapHoles(Brep=cyl)
trim = TrimWithBrep(Curve=flip_4.Curve, Brep=cap)  # -> Inside, Outside
narrow_bottom_flat_spiral = Curve(trim.Inside)
bottom_flat_spiral = Curve(flip_4.Curve)
filter_12 = StreamFilter(Gate=make_narrow_entry_helix_3, Stream0=bottom_flat_spiral, Stream1=narrow_bottom_flat_spiral)

# ---- group: Make helical entry plunge (continued)
bottom_flat_spiral_for_buidling_helix = Curve(filter_12)
end_7 = EndPoints(Curve=bottom_flat_spiral_for_buidling_helix)  # -> Start, End
vec2pt_3 = Vector2Pt(PointA=start_point_3, PointB=end_7.Start, Unitize=False)  # -> Vector, Length
pl = ConstructPlane(Origin=start_point_3, XAxis=vec2pt_3.Vector, YAxis=Z_12)
mirror = Mirror(Geometry=bottom_flat_spiral_for_buidling_helix, Plane=pl)  # -> Geometry, Transform
divide_curve_even_lenght = DivideCurveEvenLenght(crv=mirror.Geometry, B=stepover_distance_6)
lng_7 = ListLength(List=divide_curve_even_lenght)
series_5 = Series(Start=0, Step=eleveation_per_stepover_distance_2, Count=lng_7)
Z_15 = UnitZ(Factor=series_5)
move_14 = Move(Geometry=divide_curve_even_lenght, Motion=Z_15)  # -> Geometry, Transform
intcrv_3 = Interpolate(Vertices=move_14.Geometry, Degree=3, Periodic=False, KnotStyle=1)  # -> Curve, Length, Domain
flip_5 = FlipCurve(Curve=intcrv_3.Curve)  # -> Curve, Flag
lower_plunge_helix = Curve(flip_5.Curve)
end_8 = EndPoints(Curve=lower_plunge_helix)  # -> Start, End
vec2pt_4 = Vector2Pt(PointA=start_point_4, PointB=end_8.Start, Unitize=False)  # -> Vector, Length
pl_2 = ConstructPlane(Origin=end_8.Start, XAxis=vec2pt_4.Vector, YAxis=Z_13)
mirror_2 = Mirror(Geometry=lower_plunge_helix, Plane=pl_2)  # -> Geometry, Transform
flip_6 = FlipCurve(Curve=mirror_2.Geometry)  # -> Curve, Flag
xy_7 = XYPlane(Origin=end_8.Start)
mirror_3 = Mirror(Geometry=flip_6.Curve, Plane=xy_7)  # -> Geometry, Transform
upper_plunge_helix = Curve(mirror_3.Geometry)
lower_plunge_helix_2 = Curve(lower_plunge_helix)
merge_4 = Merge(Data1=upper_plunge_helix, Data2=lower_plunge_helix_2)
join_3 = JoinCurves(Curves=merge_4, Preserve=False)
simplify_10 = SimplifyTree(Tree=join_3, Front=False)
plunge_helix = Curve(simplify_10)
end_9 = EndPoints(Curve=plunge_helix)  # -> Start, End
pdecon_5 = Deconstruct(Point=end_9.Start)  # -> XComponent, YComponent, ZComponent
pdecon_6 = Deconstruct(Point=end_9.End)  # -> XComponent, YComponent, ZComponent
pt_3 = ConstructPoint(XCoordinate=0, YCoordinate=0, ZCoordinate=pdecon_5.ZComponent)
pt_4 = ConstructPoint(XCoordinate=0, YCoordinate=0, ZCoordinate=pdecon_6.ZComponent)
dist_5 = Distance(PointA=pt_3, PointB=pt_4)
plunge_helix_height = Panel(dist_5)
division_7 = Division(A=cut_depths_3, B=plunge_helix_height)
round_2 = Round(Number=division_7)  # -> Nearest, Floor, Ceiling
end_10 = EndPoints(Curve=plunge_helix)  # -> Start, End
project_2 = Project(Geometry=end_10.Start, Plane=xy_4)  # -> Geometry, Transform
project_3 = Project(Geometry=end_10.End, Plane=xy_4)  # -> Geometry, Transform
vec2pt_5 = Vector2Pt(PointA=project.Geometry, PointB=project_3.Geometry, Unitize=False)  # -> Vector, Length
vec2pt_6 = Vector2Pt(PointA=project.Geometry, PointB=project_2.Geometry, Unitize=False)  # -> Vector, Length
angle = Angle(VectorA=vec2pt_6.Vector, VectorB=vec2pt_5.Vector, Plane=xy_4)  # -> Angle, Reflex
series_6 = Series(Start=0, Step=plunge_helix_height, Count=round_2.Ceiling)
series_7 = Series(Start=0, Step=angle.Reflex, Count=round_2.Ceiling)
Z_16 = UnitZ(Factor=series_6)
move_15 = Move(Geometry=plunge_helix, Motion=Z_16)  # -> Geometry, Transform
rotate = Rotate(Geometry=move_15.Geometry, Angle=series_7, Plane=xy_6)  # -> Geometry, Transform
join_4 = JoinCurves(Curves=rotate.Geometry, Preserve=False)
bottom_flat_spiral_2 = Curve(bottom_flat_spiral)
simplify_11 = SimplifyTree(Tree=join_4, Front=False)
plunge_helix_tower = Curve(simplify_11)
flatten_9 = FlattenTree(Tree=bottom_flat_spiral_2, Path="{0}")
lng_8 = ListLength(List=flatten_9)
pcx_2 = CurvePlane(Curve=plunge_helix_tower, Plane=move_12.Geometry)  # -> Points, ParamsC, ParamsP
smaller_3 = SmallerThan(FirstNumber=lng_8, SecondNumber="2")  # -> SmallerThan, OrEqualTo
shatter_3 = Shatter(Curve=plunge_helix_tower, Parameters=pcx_2.ParamsC)
rev_5 = ReverseList(List=shatter_3)
filter_13 = StreamFilter(Gate=smaller_3.SmallerThan, Stream0=bottom_flat_spiral_2, Stream1=flatten_9)
item_21 = ListItem(List=rev_5, Index=0, Wrap=True)
rotate_2 = Rotate(Geometry=filter_13, Angle=rad_2, Plane=start_point_plane)  # -> Geometry, Transform
rev_6 = ReverseList(List=item_21)
simplify_12 = SimplifyTree(Tree=rotate_2.Geometry, Front=False)
rotate_3 = Rotate(Geometry=rev_6, Angle=rad_2, Plane=start_point_plane)  # -> Geometry, Transform
join_5 = JoinCurves(Curves=[simplify_12, simplify_9], Preserve=False)
simplify_13 = SimplifyTree(Tree=rotate_3.Geometry, Front=False)
simplify_14 = SimplifyTree(Tree=join_5, Front=False)
flatten_10 = FlattenTree(Tree=simplify_14, Path="{0}")
flatten_11 = FlattenTree(Tree=simplify_13, Path="{0}")
filter_14 = StreamFilter(Gate=smaller_3.SmallerThan, Stream0=simplify_14, Stream1=flatten_10)
filter_15 = StreamFilter(Gate=smaller_3.SmallerThan, Stream0=simplify_13, Stream1=flatten_11)
join_6 = JoinCurves(Curves=[filter_15, filter_14], Preserve=False)
cut_entry_plunges = Curve(join_6)

# ---- group: Make peck helix entry
max_peck_depth_factor_4 = Panel(max_peck_depth_factor_3)
milling_bit_diameter_6 = Panel(milling_bit_diameter_3)
use_peck_entry_4 = Panel(use_peck_entry_3)
cut_entry_plunges_2 = Curve(cut_entry_plunges)
multiplication_23 = Multiplication(A=max_peck_depth_factor_4, B=milling_bit_diameter_6)
gate_4 = StreamGate(Stream=cut_entry_plunges_2, Gate=use_peck_entry_4)  # -> Target0, Target1
bbox = BoundingBox(Content=gate_4.Target1, Plane=PlaneXY(0, 0, 0))  # -> Box, Box_2
debrep = DeconstructBrep(Brep=bbox.Box)  # -> Faces, Edges, Vertices
item_22 = ListItem(List=debrep.Edges, Index="8", Wrap=True)
item_23 = ListItem(List=debrep.Faces, Index="5", Wrap=True)
len_2 = Length(Curve=item_22)
edges = BrepEdges(Brep=item_23)  # -> Naked, Interior, NonManifold
max_peck_depth = Panel(multiplication_23)
helix_depths = Panel(len_2)
join_7 = JoinCurves(Curves=edges.Naked, Preserve=False)
offset = Offset(Curve=join_7, Distance="0.1", Plane=PlaneXY(0, 0, 0), Corners=1)
division_8 = Division(A=helix_depths, B=max_peck_depth)
round_3 = Round(Number=division_8)  # -> Nearest, Floor, Ceiling
series_8 = Series(Start=max_peck_depth, Step=max_peck_depth, Count=round_3.Floor)
neg_5 = Negative(Value=series_8)
Z_17 = UnitZ(Factor=neg_5)
extr = Extrude(Base=offset, Direction=Z_17)
cut_entry_plunges_3 = Curve(gate_4.Target1)
cap_2 = CapHoles(Brep=extr)
simplify_15 = SimplifyTree(Tree=cap_2, Front=False)
simplify_16 = SimplifyTree(Tree=cut_entry_plunges_3, Front=False)
lng_9 = ListLength(List=simplify_15)
dup_3 = DuplicateData(Data=simplify_16, Number=lng_9, Order=True)
simplify_17 = SimplifyTree(Tree=dup_3, Front=False)
trim_2 = TrimWithBreps(Curve=graft(simplify_17), Brep=graft(simplify_15))  # -> Inside, Outside
pshift_5 = ShiftPaths(Data=trim_2.Inside, Offset=-1)
pshift_6 = ShiftPaths(Data=pshift_5, Offset=-1)
end_11 = EndPoints(Curve=pshift_6)  # -> Start, End
item_24 = ListItem(List=end_11.Start, Index=0, Wrap=True)
max_peck_depth_2 = Panel(max_peck_depth)
vec2pt_7 = Vector2Pt(PointA=end_11.End, PointB=item_24, Unitize=False)  # -> Vector, Length
amp_2 = Amplitude(Vector=vec2pt_7.Vector, Amplitude=max_peck_depth_2)
multiplication_24 = Multiplication(A=max_peck_depth_2, B="0.9")
amp_3 = Amplitude(Vector=vec2pt_7.Vector, Amplitude=multiplication_24)
move_16 = Move(Geometry=end_11.End, Motion=amp_2)  # -> Geometry, Transform
move_17 = Move(Geometry=end_11.End, Motion=amp_3)  # -> Geometry, Transform
ln_6 = Line(StartPoint=move_17.Geometry, EndPoint=move_16.Geometry)
flip_7 = FlipCurve(Curve=pshift_6)  # -> Curve, Flag
eval_5 = EvaluateLength(Curve=flip_7.Curve, Length=multiplication_24, Normalized=False)  # -> Point, Tangent, Parameter
shatter_4 = Shatter(Curve=graft(flip_7.Curve), Parameters=graft(eval_5.Parameter))
item_25 = ListItem(List=shatter_4, Index="1", Wrap=False)
flip_8 = FlipCurve(Curve=item_25)  # -> Curve, Flag
number_slider_3 = Slider(0.5, range=0..1)
pshift_7 = ShiftPaths(Data=flip_8.Curve, Offset=-1)
pshift_8 = ShiftPaths(Data=pshift_7, Offset=-1)
blendc_3 = BlendCurve(CurveA=pshift_8, CurveB=ln_6, BulgeA=number_slider_3, BulgeB=number_slider_3, Continuity=2)
merge_5 = Merge(Data1=graft(pshift_8), Data2=graft(blendc_3))
join_8 = JoinCurves(Curves=merge_5, Preserve=False)
pshift_9 = ShiftPaths(Data=join_8, Offset=-1)
cut_entry_plunges_4 = Curve(gate_4.Target1)
pshift_10 = ShiftPaths(Data=pshift_9, Offset=-1)
distance_to_extend_top_of_helix_curve_fo = Panel("0.1")  # "Distance to extend top of helix curve (for joining)"
simplify_18 = SimplifyTree(Tree=pshift_10, Front=False)
simplify_19 = SimplifyTree(Tree=cut_entry_plunges_4, Front=False)
lng_10 = ListLength(List=flatten(simplify_19))
merge_6 = Merge(Data1=flatten(simplify_18), Data2=flatten(simplify_19))
merge_7 = Merge(Data1=simplify_18, Data2=simplify_19)
addition_7 = Addition(A=round_3.Floor, B="1")
smaller_4 = SmallerThan(FirstNumber=lng_10, SecondNumber="2")  # -> SmallerThan, OrEqualTo
series_9 = Series(Start=0, Step=distance_to_extend_top_of_helix_curve_fo, Count=simplify(addition_7))
filter_16 = StreamFilter(Gate=smaller_4.SmallerThan, Stream0=merge_7, Stream1=flatten(merge_6))
ext_2 = ExtendCurve(Curve=filter_16, Type=2, Start=series_9, End="0")
end_12 = EndPoints(Curve=ext_2)  # -> Start, End
shift_5 = ShiftList(List=end_12.End, Shift="-1", Wrap=False)
shift_6 = ShiftList(List=end_12.Start, Shift="1", Wrap=False)
ln_7 = Line(StartPoint=shift_5, EndPoint=shift_6)
simplify_20 = SimplifyTree(Tree=ext_2, Front=False)
simplify_21 = SimplifyTree(Tree=ln_7, Front=False)
merge_8 = Merge(Data1=simplify_20, Data2=simplify_21)
merge_9 = Merge(Data1=graft(simplify_20), Data2=graft(simplify_21))
filter_17 = StreamFilter(Gate=smaller_4.SmallerThan, Stream0=merge_8, Stream1=flatten(merge_9))
join_9 = JoinCurves(Curves=filter_17, Preserve=False)
pshift_11 = ShiftPaths(Data=join_9, Offset=-1)
simplify_22 = SimplifyTree(Tree=pshift_11, Front=False)
match_3 = MatchTree(Tree=simplify_22, Guide=cut_entry_plunges_2)
peck_helix = Curve(match_3)

# ---- group: Prepare ramp for insert
cut_entry_plunges_with_peck_helix = Curve(peck_helix)
ramp_feedrate_2 = Panel(ramp_feedrate)
use_peck_entry_5 = Panel(use_peck_entry_3)
make_helical_entry_ramp_4 = Panel(make_helical_entry_ramp)
all_toolpaths_are_single_curve_7 = Panel(all_toolpaths_are_single_curve)
cut_entry_plunges_5 = Curve(cut_entry_plunges)

# ----
filter_18 = StreamFilter(Gate=use_peck_entry_5, Stream0=cut_entry_plunges_5, Stream1=cut_entry_plunges_with_peck_helix)

# ---- group: Prepare ramp for insert (continued)
cut_entry_plunges_6 = Curve(filter_18)
lng_11 = ListLength(List=cut_entry_plunges_6)
dup_4 = DuplicateData(Data=ramp_feedrate_2, Number=lng_11, Order=True)
simplify_23 = SimplifyTree(Tree=cut_entry_plunges_6, Front=False)
simplify_24 = SimplifyTree(Tree=dup_4, Front=False)
flatten_12 = FlattenTree(Tree=simplify_24, Path="{0}")
flatten_13 = FlattenTree(Tree=simplify_23, Path="{0}")
filter_19 = StreamFilter(Gate=all_toolpaths_are_single_curve_7, Stream0=simplify_24, Stream1=flatten_12)
filter_20 = StreamFilter(Gate=all_toolpaths_are_single_curve_7, Stream0=simplify_23, Stream1=flatten_13)

# ---- group: Insert ramp feedrates
ins_3 = InsertItems(List=shift_paths_if_possible, Item=filter_19, Indices="0", Wrap=True)
simplify_25 = SimplifyTree(Tree=ins_3, Front=False)
filter_21 = StreamFilter(Gate=make_helical_entry_ramp_4, Stream0=shift_paths_if_possible, Stream1=simplify_25)

# ---- group: Insert ramp geometry
ins_4 = InsertItems(List=shift_paths_if_possible_2, Item=filter_20, Indices="0", Wrap=True)
simplify_26 = SimplifyTree(Tree=ins_4, Front=False)
filter_22 = StreamFilter(Gate=make_helical_entry_ramp_4, Stream0=shift_paths_if_possible_2, Stream1=simplify_26)

# ----
toolpaths = Curve(filter_22)
feedrates = Panel(filter_21)

# ---- group: Preview toolpaths
preview_toolpath = Slider(0, range=0..1)
shift_paths_if_possible_3 = ShiftPathsIfPossible(data_paths_to_shifts=toolpaths)  # disabled
join_10 = JoinCurves(Curves=shift_paths_if_possible_3, Preserve=False)
milling_bit_diameter_7 = Panel(milling_bit_diameter_3)
eval_6 = EvaluateLength(Curve=graft(join_10), Length=preview_toolpath, Normalized=True)  # -> Point, Tangent, Parameter
shatter_5 = Shatter(Curve=graft(join_10), Parameters=eval_6.Parameter)
multiplication_25 = Multiplication(A=milling_bit_diameter_7, B="0.5")
pt_5 = Point(eval_6.Point)
xy_8 = XYPlane(Origin=eval_6.Point)
xy_9 = XYPlane(Origin=Point(0, 0, 0))
item_26 = ListItem(List=shatter_5, Index=0, Wrap=True)
cyl_2 = Cylinder(Base=xy_9, Radius=multiplication_25, Length=Slider(40, range=0..100))
orient_3 = Orient(Geometry=cyl_2, Source=xy_9, Target=xy_8)  # -> Geometry, Transform
preview = CustomPreview(Geometry=orient_3.Geometry, Shader=ColourSwatch(SwatchColor=RGB(79, 79, 79)))

# ---- group: Separate feedrate and jog rates is not yet impleneted, it is rarely needed
feedrates_2 = Number(feedrates)

# ----
toolpaths_2 = Curve(toolpaths)
trochoidal_toolpaths = ClusterOutput(toolpaths_2)  # Input into post processor

# ==== cluster PlungeRoughing
milling_bit_diameter = ClusterInput()
toolpath_curves = ClusterInput()
stepover = ClusterInput()
milling_bit_diameter_2 = Number(milling_bit_diameter)
toolpath_curves_2 = Curve(toolpath_curves)
stepover_2 = Number(stepover)
milling_bit_diameter_3 = Panel(milling_bit_diameter_2)
safe_z = Panel("1")
stepover_3 = Panel(stepover_2)

# ---- group: Shetter curves at corners and shatter closed curves
disc = Discontinuity(Curve=toolpath_curves_2, Level=1)  # -> Points, Parameters
lng = ListLength(List=disc.Parameters)
smaller = SmallerThan(FirstNumber=lng, SecondNumber="1")  # -> SmallerThan, OrEqualTo
weave = Weave(Pattern=smaller.SmallerThan, Stream0=disc.Parameters, Stream1="0", NullGaps=False)
shatter = Shatter(Curve=graft(toolpath_curves_2), Parameters=weave)

# ----
multiplication = Multiplication(A=milling_bit_diameter_3, B=stepover_3)
stepover_distance = Panel(multiplication)
shattered_toolpath_curves = Curve(shatter)
len = Length(Curve=shattered_toolpath_curves)
division = Division(A=len, B=stepover_distance)
int = Integer(division)
divide = DivideCurve(Curve=shattered_toolpath_curves, Count=int, Kinks=False)  # -> Points, Tangents, Parameters

# ---- group: Create drill lines
pdecon = Deconstruct(Point=divide.Points)  # -> XComponent, YComponent, ZComponent; disabled
pt = ConstructPoint(XCoordinate=pdecon.XComponent, YCoordinate=pdecon.YComponent, ZCoordinate=0)
Z = UnitZ(Factor=pdecon.ZComponent)
move = Move(Geometry=pt, Motion=Z)  # -> Geometry, Transform
ln = Line(StartPoint=pt, EndPoint=move.Geometry)

# ---- group: Create plunges with custom safe Z
safe_z_2 = Panel(safe_z)
pdecon_2 = Deconstruct(Point=divide.Points)  # -> XComponent, YComponent, ZComponent
pt_2 = Point(divide.Points)
pt_3 = ConstructPoint(XCoordinate=pdecon_2.XComponent, YCoordinate=pdecon_2.YComponent, ZCoordinate=safe_z_2)
simplify = SimplifyTree(Tree=pt_2, Front=False)
simplify_2 = SimplifyTree(Tree=pt_3, Front=False)
weave_2 = Weave(Pattern=[0, 1, 2], Stream0=simplify_2, Stream1=simplify, Stream2=simplify_2, NullGaps=False)
pline = PolyLine(Vertices=weave_2, Closed=False)

# ----
plunge_rough_lines = Curve(flatten(pline))
plunge_rough_lines_2 = ClusterOutput(plunge_rough_lines)

# ==== cluster ShiftPathsIfPossible
data_paths_to_shifts = ClusterInput()
pshift = ShiftPaths(Data=data_paths_to_shifts, Offset=-1)
flatten = FlattenTree(Tree=data_paths_to_shifts, Path="{0}")
flatten_2 = FlattenTree(Tree=pshift, Path="{0}")
clean = CleanTree(RemoveNulls=True, RemoveInvalid=True, RemoveEmpty=False, Tree=flatten_2)
item = ListItem(List=clean, Index=0, Wrap=True)
null = NullItem(Item=item)  # -> NullFlags, InvalidFlags, Description
filter = StreamFilter(Gate=null.NullFlags, Stream0=pshift, Stream1=flatten)
safely_shifted_paths = ClusterOutput(filter)  # Safely shifted paths
